# Grasshopper definition ur_setup_kd.ghx (Grasshopper 1.0.7)

reload = Button()
py = PythonScript(reload=reload)
# ---------- py: Python ----------
from compas_rhino.utilities.misc import get_tolerance
from compas_rhino.utilities.misc import unload_modules

from compas_ghpython import unload_modules
unload_modules("compas")
unload_modules("compas_fab")
unload_modules("roslibpy")
# ---------- end py ----------

number_slider = Slider(25, range=0..1000)  # disabled
py_2 = PythonScript()  # -> ghfile_path
# ---------- py_2: Python ----------
import os

filepath = ghenv.Component.OnPingDocument().FilePath
ghfile_path = os.path.dirname(filepath)
# ---------- end py_2 ----------
list = ValueList({"ur3.urdf", "ur5.urdf", "ur10.urdf", "ur3_with_measurement_tool.urdf", "ur5_with_measurement_tool.urdf", "ur10_with_measurement_tool.urdf"}, selected="ur10.urdf")
list_2 = ValueList({"ur3.srdf", "ur5.srdf", "ur10.srdf", "ur3_with_measurement_tool.srdf", "ur5_with_measurement_tool.srdf", "ur10_with_measurement_tool.srdf"}, selected="ur10.srdf")

# ---- group: ROS client
disconnect = Button()
connect = Button()
restart = Button()
ros = PythonScript(restart=restart)  # -> out, ros_client
# ---------- ros: Python ----------
import sys
import time
import logging
import scriptcontext as sc

from compas_fab.backends import RosClient

from System import TimeSpan
from System.Threading import ManualResetEventSlim

LOGGER = logging.getLogger('roslibpy')

key = 'rosclient_%s' % str(ghenv.Component.InstanceGuid)
previous_client = sc.sticky.get(key, None)
if previous_client:
    previous_client.terminate()

ros_client = RosClient('127.0.0.1', 9090)
sc.sticky[key] = ros_client

waitLock = ManualResetEventSlim(False)

ros_client.on_ready(lambda: waitLock.Set())

if not waitLock.Wait(TimeSpan.FromSeconds(5)):
    raise Exception('Unable to connect to ROS')

LOGGER.info('ROS connection opened')
# ---------- end ros ----------
connect_2 = PythonScript(ros_client=ros.ros_client, connect=connect, disconnect=disconnect)  # -> out, ros_client
# ---------- connect_2: Python ----------
import logging
from System import TimeSpan
from System.Threading import ManualResetEventSlim

LOGGER = logging.getLogger('roslibpy')

if connect:
    if not ros_client.is_connected:
        LOGGER.debug('Connecting...')
        waitLock = ManualResetEventSlim(False)
        ros_client.on_ready(lambda: waitLock.Set())
        ros_client.connect()

        if not waitLock.Wait(TimeSpan.FromSeconds(5)):
            raise Exception('Unable to connect to ROS')
        LOGGER.debug('Reconnected')

if disconnect:
    if ros_client.is_connected:
        ros_client.terminate()
        LOGGER.debug('Terminated')
# ---------- end connect_2 ----------

# ----
list_3 = ValueList({"ur_description", "ur_end_effectors"}, selected="ur_description")
list_4 = ValueList({"ur_description", "ur_end_effectors"}, selected="ur_end_effectors")
list_5 = ValueList({"ur_description", "ur_setups"}, selected="ur_description")

# ----
# Robot
py_3 = PythonScript(ghfile_path=py_2)  # -> robot_description
# ---------- py_3: Python ----------
import os

robot_description = os.path.join(ghfile_path, "..", "data", "robot_description")
robot_description = os.path.abspath(robot_description)

print robot_description
# ---------- end py_3 ----------
py_4 = PythonScript(path=py_3, package=list_5, urdf_name=list, srdf_name=list_2)  # -> package_path, urdf_filename, srdf_filename
# ---------- py_4: Python ----------
import os

package_path = os.path.join(path, package)

urdf_filename = os.path.join(package_path, "urdf", urdf_name)
srdf_filename = os.path.join(package_path, srdf_name)

assert os.path.isfile(urdf_filename)
assert os.path.isfile(srdf_filename)
# ---------- end py_4 ----------
py_5 = PythonScript(path=py_3, packages=[list_3, list_4])  # -> loaders; inputs packages: list
# ---------- py_5: Python ----------
from compas.robots import LocalPackageMeshLoader

loaders = []
print packages
for package in packages:
    loaders.append(LocalPackageMeshLoader(path, package))
# ---------- end py_5 ----------
load = Button()
units = ValueList({"m": 1, "cm": 100, "mm": 1000}, selected="m")
create = PythonScript(loaders=py_5, urdf_filename=py_4.urdf_filename, srdf_filename=py_4.srdf_filename, scale_factor=units, load=load)  # -> robot; inputs loaders: list
# ---------- create: Python ----------
import os
from scriptcontext import sticky as st

import compas

from compas.robots import RobotModel
from compas.robots import LocalPackageMeshLoader

from compas_fab.robots import Robot
from compas_fab.robots import RobotSemantics

from compas_fab.ghpython import RobotArtist

compas.PRECISION = '12f'

# store robot in component
guid = str(ghenv.Component.InstanceGuid)
robot_key = "robot_" + guid

if robot_key not in st:
    st[robot_key] = None

print loaders
if load:
    model = RobotModel.from_urdf_file(urdf_filename)
    
    model.load_geometry(*loaders)
    artist = RobotArtist(model)
    semantics = RobotSemantics.from_srdf_file(srdf_filename, model)
    robot = Robot(model, artist, semantics, client=None)
    
    st[robot_key] = robot

robot = st[robot_key]


if robot:
    robot.scale(scale_factor)
# ---------- end create ----------
robot = Data(create)
set = PythonScript(robot=robot, client=connect_2.ros_client)
# ---------- set: Python ----------
if robot and client:
    robot.client = client
# ---------- end set ----------

# ----
# Create attached collision object
number_slider_2 = Slider(75, range=0..1000)  # disabled
number_slider_3 = Slider(120, range=0..1000)  # disabled
brick = PythonScript(w=number_slider_2, d=number_slider_3, h=number_slider)  # -> brick; disabled
# ---------- brick: Python ----------
import Rhino.Geometry as rg


brick = rg.Box(rg.Plane.WorldXY, rg.Interval(-w/2,w/2), rg.Interval(-d/2,d/2), rg.Interval(0,h))
# ---------- end brick ----------
mesh = Mesh(brick)  # disabled
mesh_2 = PythonScript(mesh=mesh, scale_factor=units, ghfile_path=py_2)  # -> compas_mesh; disabled
# ---------- mesh_2: Python ----------
import os
import compas
from compas.datastructures import Mesh
from compas.datastructures import mesh_quads_to_triangles
from compas_rhino.helpers import mesh_from_guid

import Rhino.Geometry as rg

S = rg.Transform.Scale(rg.Plane.WorldXY, 1./scale_factor, 1./scale_factor, 1./scale_factor)
mesh.Transform(S)

compas_mesh = mesh_from_guid(Mesh, mesh)
mesh_quads_to_triangles(compas_mesh)

compas_mesh.to_obj(os.path.abspath(os.path.join(ghfile_path, '..', 'data', 'attached_objects', 'brick.obj')))
# ---------- end mesh_2 ----------
groups = ValueList({"axis_abb", "abb"}, selected="axis_abb")  # disabled
panel = Panel("brick")  # disabled
attached_co = PythonScript(robot=robot, compas_mesh=mesh_2, id_name=panel)  # -> attached_collision_object; disabled
# ---------- attached_co: Python ----------
if robot:
    group = robot.main_group_name
    base_link_name = robot.get_base_link_name(group)
    ee_name = robot.get_end_effector_link_name(group)
    print base_link_name
    print ee_name
    last_link_with_geometry = None
    for link in reversed(list(robot.model.iter_link_chain(base_link_name, ee_name))):
        if len(link.collision) or len(link.visual):
            last_link_with_geometry = link.name
            break
    print(last_link_with_geometry)
    touch_links = [last_link_with_geometry]
    
    aco = robot.create_collision_mesh_attached_to_end_effector(id_name, compas_mesh, group)
    #aco = robot.build_attached_collision_mesh(id_name,  compas_mesh, group=None, touch_links=touch_links, scale=False)
# ---------- end attached_co ----------

python = GhPythonScript(robot=robot)  # -> out, scene
# ---------- python: Python ----------
from compas_fab.robots import PlanningScene

if robot and robot.client:
    scene = PlanningScene(robot)
else:
    print("Robot is not connected")
# ---------- end python ----------

# ----
# Scene geometry
mesh_3 = PythonScript(package_path=py_2)  # -> compas_mesh, M
# ---------- mesh_3: Python ----------
import os
from compas.datastructures import Mesh
from compas_ghpython import mesh_draw

compas_mesh = Mesh.from_stl(os.path.join(package_path, '..', 'data', 'scene_geometry', 'ur3_test_scene', 'platform_kd.stl'))

M = mesh_draw(compas_mesh)
# ---------- end mesh_3 ----------
preview = CustomPreview(Geometry=mesh_3.M, Shader=ColourSwatch(SwatchColor=RGB(255, 255, 255)))
remove = Button()
add = Button()
# Pass collision object to planning scene
collision = PythonScript(robot=robot, scene=python.scene, compas_mesh=mesh_3.compas_mesh, id_name="platform", add=add, remove=remove)  # -> out
# ---------- collision: Python ----------
from compas_fab.robots import AttachedCollisionMesh, CollisionMesh

if robot and robot.client:
    if add:
        col_mesh = CollisionMesh(compas_mesh, id_name)
        att_col_mesh = AttachedCollisionMesh(col_mesh, id_name)
        scene.add_attached_collision_mesh(att_col_mesh)
    if remove:
        scene.remove_attached_collision_mesh(id_name)
else:
    print("Robot is not connected")
# ---------- end collision ----------
panel_2 = Panel(collision)

panel_3 = Panel("Define an obstacle")
brep = Brep(<brep referenced from the Rhino model>)
preview_2 = CustomPreview(Geometry=brep, Shader=ColourSwatch(SwatchColor=RGB(255, 255, 255)))
mesh_4 = Mesh(brep)
mesh_5 = PythonScript(mesh=mesh_4, scale_factor=units)  # -> compas_mesh
# ---------- mesh_5: Python ----------
import compas
from compas.datastructures import Mesh
from compas.datastructures import mesh_quads_to_triangles
from compas_rhino.helpers import mesh_from_guid

import Rhino.Geometry as rg

S = rg.Transform.Scale(rg.Plane.WorldXY, 1./scale_factor, 1./scale_factor, 1./scale_factor)
mesh.Transform(S)

compas_mesh = mesh_from_guid(Mesh, mesh)
mesh_quads_to_triangles(compas_mesh)
# ---------- end mesh_5 ----------
remove_2 = Button()
add_2 = Button()
collision_2 = PythonScript(robot=robot, scene=python.scene, compas_mesh=mesh_5, id_name="floor", add=add_2, remove=remove_2)  # -> out
# ---------- collision_2: Python ----------
from compas_fab.robots import CollisionMesh

if robot and robot.client:
    if add:
        col_mesh = CollisionMesh(compas_mesh, id_name)
        scene.add_collision_mesh(col_mesh)
    if remove:
        scene.remove_collision_mesh(id_name)
else:
    print("Robot is not connected")
# ---------- end collision_2 ----------
panel_4 = Panel(collision_2)

draw = Button()

# ----
# Info
info = PythonScript(robot=robot)  # -> out, planning_groups, main_group, base_frame, all_joint_names, main_joint_names
# ---------- info: Python ----------
from compas.robots import Joint

if robot:
    robot.info()
# ---------- end info ----------
panel_5 = Panel(info.out)

collision_3 = PythonScript(robot=robot, draw=draw)  # -> out, scene
# ---------- collision_3: Python ----------
from compas_fab.artists import BaseRobotArtist

if robot and robot.client:
    if draw:
        artist_col = BaseRobotArtist(robot)
        artist_col.draw_collision()
        
#        robot.remove_collision_mesh_from_planning_scene(id_name)
else:
    print("Robot is not connected")
# ---------- end collision_3 ----------
panel_6 = Panel(collision_3.out)

# ----
# Configuration
a1 = Slider(0, range=-180..180)
a3 = Slider(90, range=-360..360)
a6 = Slider(90, range=-360..360)
a2 = Slider(-90, range=-360..360)
a4 = Slider(-90, range=-360..360)
a5 = Slider(-90, range=-360..360)
set_joint_positions = BooleanToggle(True)
jp = GhPythonScript()  # -> joint_positions
# ---------- jp: Python ----------
import math


joint_positions = [0,-90,90,-90,-90,90]
joint_positions = [math.radians(a) for a in joint_positions]
print joint_positions
# ---------- end jp ----------
forward_kinematics = PythonScript(robot=robot, set_joint_positions=set_joint_positions, joint_positions=jp, a1=a1, a2=a2, a3=a3, a4=a4, a5=a5, a6=a6)  # -> out, configuration; inputs joint_positions: list
# ---------- forward_kinematics: Python ----------
import math
import Grasshopper
from compas_fab.robots import Configuration

if set_joint_positions:
    
    j = 0
    for i in range(ghenv.Component.Params.Input.Count):
        nslider = ghenv.Component.Params.Input[i].Sources[0]
        if nslider.GetType() == Grasshopper.Kernel.Special.GH_NumberSlider:
            #nslider.Slider.Minimum = (decimal) I.T0;
            #nslider.Slider.Maximum = (decimal) I.T1;
            #nslider.Slider.FixDomain();
            nslider.TrySetSliderValue(math.degrees(joint_positions[j]))
            j += 1

if robot:
    configuration = robot.init_configuration() #robot.get_configuration 
    print(configuration)
    configuration.values = [math.radians(a) for a in [a1, a2, a3, a4, a5, a6]]
    print configuration
# ---------- end forward_kinematics ----------

# ---- group: inverse kinematic
x_axis = Curve(<curve referenced from the Rhino model>)
y_axis = Curve(<curve referenced from the Rhino model>)
python_2 = PythonScript(plane_axes=[x_axis, y_axis])  # -> out, plane; inputs plane_axes: list of Curve
# ---------- python_2: Python ----------
import Rhino.Geometry as rg

x_axis, y_axis = plane_axes

x_axis = rg.Line(x_axis.PointAtStart, x_axis.PointAtEnd)
y_axis = rg.Line(y_axis.PointAtStart, y_axis.PointAtEnd)

if x_axis.From.DistanceTo(y_axis.From) < 0.01:
    origin = x_axis.From
    xvec = x_axis.Direction
    yvec = y_axis.Direction
elif x_axis.To.DistanceTo(y_axis.To) < 0.01:
    origin = x_axis.To
    xvec = -x_axis.Direction
    yvec = -y_axis.Direction
elif x_axis.From.DistanceTo(y_axis.To) < 0.01:
    origin = x_axis.From
    xvec = x_axis.Direction
    yvec = -y_axis.Direction
elif x_axis.To.DistanceTo(y_axis.From) < 0.01:
    origin = x_axis.To
    xvec = -x_axis.Direction
    yvec = y_axis.Direction

plane = rg.Plane(origin, xvec, yvec)
# ---------- end python_2 ----------

# Kinematics
take_current_configuration = BooleanToggle(True)
groups_2 = ValueList({"ur_manipulator": "manipulator"}, selected="ur_manipulator")
py_6 = PythonScript(robot=robot)  # -> configuration
# ---------- py_6: Python ----------
from compas_fab.robots import Configuration

configuration = robot.init_configuration()
print configuration

configuration.values = [-1.8, -1.752, 0.607, 0.883, 2.761, 0.000]

print configuration
# ---------- end py_6 ----------
ik = PythonScript(
    calc=Button(),
    robot=robot,
    group=groups_2,
    start_configuration=py_6,
    take_current_configuration=take_current_configuration,
    plane=python_2.plane)  # -> out, configuration, error
# ---------- ik: Python ----------
from scriptcontext import sticky as st
import logging
import Rhino
import math

from compas.robots import Joint
from compas.geometry import Frame
from compas.geometry import Transformation
from compas_fab.robots import Configuration
from compas_fab.backends.ros import RosError


LOGGER = logging.getLogger('roslibpy')

guid = str(ghenv.Component.InstanceGuid)
response_key = "response_" + guid

if response_key not in st:
    st[response_key] = None


frame = Frame(plane.Origin, plane.XAxis, plane.YAxis)

if robot and robot.client and calc:
    if robot.client.is_connected:
        if take_current_configuration:
            start_configuration = robot.get_configuration(group=group)
        st[response_key] = robot.inverse_kinematics(frame_WCF=frame, 
                                                    start_configuration=start_configuration, 
                                                    group=group,
                                                    constraints=None,
                                                    attempts=20)
    else:
        print("Robot is not connected")

configuration = st[response_key]
if configuration: 
    configuration = robot.get_group_configuration(group, configuration)

print configuration
# ---------- end ik ----------
panel_7 = Panel(ik.out)
error = Panel(ik.error)

# ----
attached_collision_object = Data()

# ----
# Linear Motion Path
start_configuration = Data(ik.configuration)
take_current_configuration_2 = BooleanToggle(True)
pln = Plane(python_2.plane)
avoid_collisions = BooleanToggle(True)
compute = Button()
cartesian_path = PythonScript(
    robot=robot,
    start_configuration=start_configuration,
    take_current_configuration=take_current_configuration_2,
    planes=pln,
    max_step=Slider(0.01, range=0..0.01),
    avoid_collisions=avoid_collisions,
    attached_collision_object=attached_collision_object,
    compute=compute)  # -> out, response; inputs planes: list, avoid_collisions: Boolean
# ---------- cartesian_path: Python ----------
import logging
from scriptcontext import sticky as st

from compas.geometry import Frame

# store data in component
guid = str(ghenv.Component.InstanceGuid)
response_key = "response_" + guid

if response_key not in st:
    st[response_key] = None

# conversion necessary because GHPython component converts None into something like <type 'NoneType'>
if not attached_collision_object:
    attached_collision_object = None 
    
if robot and robot.client:
    if robot.client.is_connected:
        if start_configuration and compute:
#        if compute:
            if take_current_configuration:
                start_configuration = robot.get_configuration()
            frames = [Frame(plane.Origin, plane.XAxis, plane.YAxis) for plane in planes]
            st[response_key] = robot.plan_cartesian_motion(frames, 
                                                            start_configuration, 
                                                            float(max_step),
                                                            bool(avoid_collisions))
    else:
        print("Robot is not connected")
        st[response_key] = None
 
response = st[response_key]
# ---------- end cartesian_path ----------
vis = PythonScript(response=cartesian_path.response)  # -> P, V, A, time
# ---------- vis: Python ----------
from compas_ghpython import list_to_ghtree

if response:

    positions = []
    velocities = []
    accelerations = []
    time_from_start = []
    
    for p in response.points:
        positions.append(p.positions)
        velocities.append(p.velocities)
        accelerations.append(p.accelerations)
        time_from_start.append(p.time_from_start.seconds)
    
    P = list_to_ghtree(list(zip(*positions)))
    V = list_to_ghtree(list(zip(*velocities)))
    A = list_to_ghtree(list(zip(*accelerations)))
    
    time = time_from_start[-1]
    print time
# ---------- end vis ----------
time_s = Panel(vis.time)
py_7 = PythonScript(response=cartesian_path.response)  # -> start_configuration, configurations, fraction
# ---------- py_7: Python ----------
from compas_fab.backends.ros import MoveItErrorCodes

joint_positions = []

if response:
#    if response.error_code == MoveItErrorCodes.SUCCESS:
    if True:
#        configurations = response.configurations
        configurations = response.points
        start_configuration = response.start_configuration
#    error = response.error_code.human_readable
    fraction = response.fraction
# ---------- end py_7 ----------
fraction = Panel(py_7.fraction)
prismatic = QuickGraph(vis.P, SortOrder=0)
panel_8 = Panel("positions")
animate = PythonScript(
    robot=robot,
    start_configuration=py_7.start_configuration,
    configurations=py_7.configurations,
    value=Slider(0, range=0..1))  # -> configuration; inputs configurations: list
# ---------- animate: Python ----------
from compas_fab.utilities import map_range
from compas_fab.robots import Configuration

count = len(configurations)
print robot
if count and robot and configurations != [None]:
    idx = int(map_range(value, 0, 1, 0, count - 1))
    current_configuration = configurations[idx]
    #make full configuration
    group = robot.main_group_name
    configuration = robot.merge_group_with_full_configuration(current_configuration, start_configuration, group)
else:
    configuration = robot.init_configuration()

print configuration
# ---------- end animate ----------
graph = QuickGraph(vis.V, SortOrder=0)
graph_2 = QuickGraph(vis.A, SortOrder=0)
panel_9 = Panel("velocities")
panel_10 = Panel("accelerations")

# ---- group: kinematic path
# Kinematic Motion Path
take_current_configuration_3 = BooleanToggle(True)
compute_2 = Button()
start_configuration_2 = Data(ik.configuration)
goal_plane = Plane(python_2.plane)
kinematic_path = PythonScript(
    robot=robot,
    start_configuration=start_configuration_2,
    take_current_configuration=take_current_configuration_3,
    goal_plane=goal_plane,
    tolerance_position=Slider(0.001, range=0..0.01),
    tolerance_angle_deg=Slider(5, range=0..180),
    compute=compute_2)  # -> out, response
# ---------- kinematic_path: Python ----------
from scriptcontext import sticky as st
import math
from compas.geometry import Frame
from compas_fab.robots import Configuration

# store data in component
guid = str(ghenv.Component.InstanceGuid)
response_key = "response_" + guid

if response_key not in st:
    st[response_key] = None

data = dict(requesting_solution=False)
frame = Frame(goal_plane.Origin, goal_plane.XAxis, goal_plane.YAxis)

# conversion necessary because GHPython component converts None into something like <type 'NoneType'>
#if not attached_collision_object:
#    attached_collision_object = None 

#print(robot.group_names)

if take_current_configuration:
    start_configuration = robot.get_group_configuration('manipulator',)
    print start_configuration

if robot and robot.client and robot.client.is_connected and start_configuration and compute:
    tolerance_angle = math.radians(tolerance_angle_deg)
    constraints = robot.constraints_from_frame(frame, float(tolerance_position), [tolerance_angle]*3)
    st[response_key] = robot.plan_motion(constraints, 
                                        start_configuration, 
                                        path_constraints=None, 
                                        planner_id='RRT',
                                        num_planning_attempts=10,
                                        allowed_planning_time=5.)

response = st[response_key]
# ---------- end kinematic_path ----------
vis_2 = PythonScript(response=kinematic_path.response)  # -> P, V, A, time; same code as vis
py_8 = PythonScript(response=kinematic_path.response)  # -> start_configuration, configurations, fraction; same code as py_7
time_s_2 = Panel(vis_2.time)
prismatic_2 = QuickGraph(vis_2.P, SortOrder=0)
animate_2 = PythonScript(
    robot=robot,
    start_configuration=py_8.start_configuration,
    configurations=py_8.configurations,
    value=Slider(1, range=0..1))  # -> configuration; inputs configurations: list
# ---------- animate_2: Python ----------
from compas_fab.utilities import map_range
from compas_fab.robots import Configuration

count = len(configurations)
if count and robot and configurations != [None]:
    idx = int(map_range(value, 0, 1, 0, count - 1))
    current_configuration = configurations[idx]
    #make full configuration
    group = robot.main_group_name
    configuration = robot.merge_group_with_full_configuration(current_configuration, start_configuration, group)
else:
    configuration = robot.init_configuration()

print configuration
# ---------- end animate_2 ----------
graph_3 = QuickGraph(vis_2.V, SortOrder=0)
graph_4 = QuickGraph(vis_2.A, SortOrder=0)

# ----
panel_14 = Panel(cartesian_path.out)
panel_15 = Panel(kinematic_path.out)

# ---- group: inverse kinematic / forward kinematics
fk = PythonScript(robot=robot, group=groups_2, configuration=ik.configuration)  # -> out, frame_WCF, plane_WCF, error
# ---------- fk: Python ----------
import scriptcontext as sc
import Rhino

from compas_fab.robots import Configuration
from compas.geometry import Frame
from compas_ghpython.utilities import draw_frame

if robot and robot.client and configuration:
    if robot.client.is_connected:
        response = robot.forward_kinematics(configuration, group)
        frame_WCF = response.frame_WCF
        error = response.error_code.human_readable
    else:
        print("Robot is not connected")
        error = "Robot is not connected"
        frame_WCF = None

if frame_WCF: 
    print frame_WCF 
    plane_WCF = draw_frame(frame_WCF)

else:
    plane_WCF = None
# ---------- end fk ----------
panel_16 = Panel(fk.out)
panel_17 = Panel(fk.error)

# ----
start_timer_update = Button()
stop_timer_update = Button()

unsubscribe = Button()
# Execution
subscribe = Button()
joint_states = PythonScript(robot=robot, sub=subscribe, unsub=unsubscribe)
# ---------- joint_states: Python ----------
import roslibpy
import scriptcontext as sc

key = 'topic_%s' % str(ghenv.Component.InstanceGuid)
previous_topic = sc.sticky.get(key, None)

# Interval in ms between messages
THROTTLE_RATE = 50

if sub:
    if robot.client.is_connected:
        if previous_topic:
            previous_topic.unsubscribe()

        def received_joint_states(message):
            sc.sticky['joint_states'] = message
    
        topic = roslibpy.Topic(robot.client, '/joint_states', 'sensor_msgs/JointState', throttle_rate=THROTTLE_RATE)
        topic.subscribe(received_joint_states)
    
        sc.sticky[key] = topic
        print('Subscribed')
    else:
        print('ROS client not connected')

if unsub:
    if 'joint_states' in sc.sticky:
        del sc.sticky['joint_states']
    if previous_topic:
        previous_topic.unsubscribe()
# ---------- end joint_states ----------
value_list = ValueList({"0 cartesian path": 0, "1 kinematic path": 1}, selected="1 kinematic path")
refresh_hz = Slider(2, range=0..30)
filter = StreamFilter(Gate=value_list, Stream1=kinematic_path.response)
execute = Button()
check = Button()
cancel = Button()
current = PythonScript(
    robot=robot,
    rate=refresh_hz,
    subscribe=subscribe,
    unsubscribe=unsubscribe,
    start_update=start_timer_update,
    stop_update=stop_timer_update)  # -> out, configuration; inputs subscribe: Boolean, unsubscribe: Boolean, start_update: Boolean, stop_update: Boolean
# ---------- current: Python ----------
import scriptcontext as sc
from compas_fab.robots import Configuration
from compas_ghpython import update_component
from datetime import datetime


guid = str(ghenv.Component.InstanceGuid)
timer_running_key = "timer_running_" + guid

if stop_update or timer_running_key not in sc.sticky or unsubscribe:
    sc.sticky[timer_running_key] = False

if start_update or subscribe:
    sc.sticky[timer_running_key] = True



values = []
types = []

now = datetime.now()
timestamp = datetime.time(now)


print('receiving joint states at: ' + str(timestamp))


if 'joint_states' in sc.sticky:
    
    joint_states = sc.sticky['joint_states']
    joint_states = dict(zip(joint_states['name'], joint_states['position']))

    for joint in robot.get_configurable_joints():
        values.append(joint_states[joint.name])
        types.append(joint.type)
    
    configuration = Configuration(values, types)
    print(configuration)

else:
    configuration = robot.get_configuration()
    configuration.values = [0,0,0,0,0,0]
    
    

data_coming_in = robot.client.is_connected and 'joint_states' in sc.sticky

slow_interval = 2000
if rate != 0:
    refresh_interval = (1. / rate) * 1000
else:
    refresh_interval = slow_interval
interval = refresh_interval if data_coming_in else slow_interval

if sc.sticky[timer_running_key]==True:
    print sc.sticky[timer_running_key]
    update_component(ghenv, interval)

#update_component(ghenv, interval)
print('Interval: %dms' % interval)
# ---------- end current ----------
trajectory = PythonScript(robot=robot, response=filter, execute=execute, check=check, cancel=cancel)  # -> out, status
# ---------- trajectory: Python ----------
import time
import datetime

import roslibpy

import scriptcontext as sc

key = 'trajectory_%s' % str(ghenv.Component.InstanceGuid)
sent_trajectory = sc.sticky.get(key, None)

#joint_trajectory = response.trajectory.joint_trajectory if response else None
joint_trajectory = response if response else None
points = response.points if response else []

print response

if robot and robot.client.is_connected:
    if execute:
        sc.sticky[key] = dict(started_at=time.time(), trajectory=joint_trajectory, state='EXECUTING')

        def completion(result):
            if key in sc.sticky:
                if sc.sticky[key]['state'] == 'EXECUTING':
                    sc.sticky[key]['state'] = 'SUCCESSFUL'
                sc.sticky[key]['completed_at'] = time.time()
                del sc.sticky[key]['cancellable']

        def failure(e):
            if key in sc.sticky:
                sc.sticky[key]['state'] = 'ERROR'
                sc.sticky[key]['completed_at'] = time.time()
                sc.sticky[key]['exception'] = e

        print('Executing trajectory of %d points' % len(points))
        cancellable = robot.client.follow_joint_trajectory(joint_trajectory, completion, failure)
        sc.sticky[key]['cancellable'] = cancellable

    if cancel and 'cancellable' in sc.sticky[key]:
        sc.sticky[key]['state'] = 'CANCELLED'
        sc.sticky[key]['cancellable'].cancel()
        
else:
    status = 'NOT CONNECTED'

try:
    started_at = sc.sticky[key].get('started_at', 'n/a')
    completed_at = sc.sticky[key].get('completed_at', 'n/a')
    exception = sc.sticky[key].get('exception', '')
    execution_state = sc.sticky[key].get('state', '')
    
    if started_at != 'n/a':
        started_at = datetime.datetime.fromtimestamp(started_at).strftime('%H:%M:%S')
    if completed_at != 'n/a':
        completed_at = datetime.datetime.fromtimestamp(completed_at).strftime('%H:%M:%S')
    if exception:
        exception = 'Found an exception during execution: ' + str(exception)
    
    if not joint_trajectory:
        status = 'No trajectory available'
    else:
        status = """execution state: {}
    started at: {}
    completed at: {}
    trajectory of {} points\n{}""".format(execution_state,
                                          started_at,
                                          completed_at,
                                          len(points),
                                          exception)
    
    print(status)
except KeyError:
    pass
# ---------- end trajectory ----------
status = Panel(trajectory.status)

# ----
# Visualisation
# Select configuration input: from fk, ik, cartesian, or kinematic path
list_6 = ValueList({"0 forward_kinematics": 0, "1 inverse_kinematics": 1, "2 cartesian path": 2, "3 kinematic path": 3, "4 connected robot": 4, "5 planned path topic": 5}, selected="0 forward_kinematics")
filter_2 = StreamFilter(
    Gate=list_6,
    Stream0=forward_kinematics.configuration,
    Stream1=ik.configuration,
    Stream2=animate,
    Stream3=animate_2,
    Stream4=current.configuration)
show_end_effector_frame = BooleanToggle(True)
show_base_frame = BooleanToggle(False)
show_collision = BooleanToggle(False)
show_visual = BooleanToggle(True)
show_axes = BooleanToggle(False)
visualize = PythonScript(
    robot=robot,
    configuration=filter_2,
    show_visual=show_visual,
    show_collision=show_collision,
    show_axes=show_axes,
    show_base_frame=show_base_frame,
    show_end_effector_frame=show_end_effector_frame)  # -> out, visual, collision, axes, axes_color, ee_plane, ee_frame, ee_frame_geo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
# ---------- visualize: Python ----------
from System.Drawing import Color

from compas.geometry import Vector
from compas.geometry import Point
from compas_ghpython.utilities import draw_frame
from compas_ghpython.utilities import draw_pipes

from compas_fab.robots import Configuration

red = Color.FromArgb(255, 0, 0)
green = Color.FromArgb(0, 255, 0)
blue = Color.FromArgb(0, 0, 255)

frame_colors = [red, green, blue]

# TODO: move to frame artist?
def pipes_from_frame(frame, size, radius): 
    pipes = []
    for axis in [frame.xaxis, frame.yaxis, frame.zaxis]:
        pipe = {}
        pipe['points'] = [list(frame.point), list(Point(*frame.point) + Vector(*axis) * size)]
        pipe['radius'] = radius
        pipes.append(pipe)
    return pipes

if robot and configuration:
    
    pipe_size = 0.1 * robot.scale_factor
    pipe_radius = 0.001 * robot.scale_factor
    
    robot.update(configuration, collision=show_collision)
    
    print("Configuration:")
    print(configuration.values)
    
    if show_visual:
        visual = robot.draw_visual()
        print(visual)
        
    if show_collision:
        collision = robot.draw_collision()
    
    if show_axes:
        pipes = []
        axes_color = []
        for frame in robot.frames:
            pipes += pipes_from_frame(frame, pipe_size, pipe_radius)
            axes_color += frame_colors
        axes = xdraw_pipes(pipes, cap=1)
    
    ee_frame = robot.get_end_effector_frame()
    ee_plane = draw_frame(ee_frame)
    
    print("End-effector frame:")
    print(ee_frame)
    
    if show_end_effector_frame:
        ee_pipes = pipes_from_frame(ee_frame, pipe_size, pipe_radius)
        ee_frame_geo = draw_pipes(ee_pipes, cap=1)
        ee_frame_color = frame_colors
        
    base_frame = robot.get_base_frame()
    base_plane = draw_frame(base_frame)
    
    if show_base_frame:
        base_pipes = pipes_from_frame(base_frame, pipe_size, pipe_radius)
        base_frame_geo = xdraw_pipes(base_pipes, cap=1)
        base_frame_color = frame_colors
        

#print robot.frames
# ---------- end visualize ----------
preview_3 = CustomPreview(Geometry=visualize.axes, Shader=visualize.axes_color)
geo = Geometry(visualize.collision)
geo_2 = Geometry(visualize.visual)
preview_4 = CustomPreview(Geometry=visualize.ee_frame_geo, Shader=visualize.ee_frame_color)
preview_5 = CustomPreview(Geometry=visualize.base_frame_geo, Shader=visualize.base_frame_color)
preview_6 = CustomPreview(Geometry=geo_2, Shader=ColourSwatch(SwatchColor=RGB(125, 125, 125)))
panel_18 = Panel(visualize.out)

plane = Plane(fk.plane_WCF)
data_recorder = DataRecorder(trajectory.out, DataLimit=-10, RecordData=False)
panel_19 = Panel(data_recorder)
panel_20 = Panel(current.out)
