# Grasshopper definition r8_01_ur_robot_model.ghx (Grasshopper 1.0.8)
# plug-ins: RhinoCodePluginGH

# ----
# IP Settings
# --> Set your IP address
# --> Set robot IP address
server_ip = ValueList({"192.168.10.44", "192.168.10.12", "192.168.10.11", "192.168.10.10", "192.168.10.2", "127.0.0.1", "192.168.10.111", "192.168.0.250", "192.168.0.30", "10.42.0.212", "10.42.0.133"}, selected="192.168.0.250")
server_port = ValueList({"50002", "50003", "50005", "50006", "50007", "50008", "50009", "50010", "50011", "50012", "50013", "50014", "50015", "50016", "50017", "50018", "50019", "50020", "50021", "50022", "50023", "50024", "50025", "50026", "50027", "50028"}, selected="50012")
ur_ip = ValueList({"192.168.10.10", "192.168.10.20", "192.168.10.11", "192.168.10.12", "127.0.0.1", "192.168.10.111", "192.168.0.210", "192.168.0.211", "192.168.0.30"}, selected="192.168.0.210")
ur_port = ValueList({"30002"}, selected="30002")
globals = Python3Script(server_ip=server_ip, server_port=server_port, ur_ip=ur_ip, ur_port=ur_port, clear=Button())  # inputs server_ip: String, server_port: Int32, ur_ip: String, ur_port: Int32
# ---------- globals: Python ----------
from scriptcontext import sticky as st

st["server_ip"] = server_ip
st["server_port"] = server_port

st["ur_ip"] = ur_ip
st["ur_port"] = ur_port

if clear:
    st.clear()
# ---------- end globals ----------

# ----
# Check if UR robot
#  is available
ping = Button()
ping_2 = Python3Script(ip=ur_ip, ping=ping)  # -> out; inputs ip: String
# ---------- ping_2: Python ----------
from scriptcontext import sticky as st
from ur_fabrication_control.direct_control.utilities import is_available

guid = str(ghenv.Component.InstanceGuid)
txt_key = "txt_" + guid
if txt_key not in st:
    st[txt_key] = ""

if ping:
    
    available = is_available(ip)
    
    if available:
        st[txt_key] = "%s is up!" % ip
        trigger = True
    else:
        st[txt_key] = "%s is down!" % ip
        trigger = False

print(st[txt_key])
# ---------- end ping_2 ----------
panel = Panel(ping_2)

reload = Button()
# ROBOT
py3 = Python3Script()  # -> HERE, DATA, ROBOT_DESCRIPTION
# ---------- py3: Python ----------
import os

HERE = os.path.dirname(ghdoc.Path)
DATA = os.path.abspath(os.path.join(HERE, "..", "data"))
ROBOT_DESCRIPTION = os.path.abspath(os.path.join(DATA, "robot_description"))

print(HERE)
print(DATA)
print(ROBOT_DESCRIPTION)
# ---------- end py3 ----------
reload_2 = Python3Script(reload=reload)  # -> out
# ---------- reload_2: Python ----------
if reload:
    from compas_rhino import unload_modules
    unload_modules("assembly_information_model")
    unload_modules('ur_fabrication_control')
# ---------- end reload_2 ----------

# ----
# ROS client
list = ValueList({"local": "127.0.0.1", "linux computer": "192.168.0.42", "linux eduroam": "10.181.95.254", "linux ccnet": "192.168.0.102", "linux vmware": "192.168.199.36", "robot": "192.168.0.200", "robotAA_wifi": "192.168.0.111", "robotAB_wifi": "192.168.0.112", "robotAB_eduroam": "10.181.67.95"}, selected="local")
connect = BooleanToggle(True)
ros = Python3Script(ip=list, port="9090", connect=connect)  # -> out, ros_client, is_connected; inputs ip: String, port: Int32, connect: Boolean
# ---------- ros: Python ----------
"""
Connect or disconnect to ROS.

COMPAS FAB v0.27.0
"""
from scriptcontext import sticky as st

from compas_fab.backends import RosClient

ros_client = None

ip = ip or '127.0.0.1'
port = port or 9090
key = "ros_client_001"
ros_client = st.get(key, None)

if ros_client:
    st[key].close()
if connect:
    st[key] = RosClient(ip, port)
    st[key].run(5)

ros_client = st.get(key, None)
is_connected = ros_client.is_connected if ros_client else False
# ---------- end ros ----------
panel_2 = Panel(ros.is_connected)

# ----
# Load robot from ROS
load = Button()
robot = Python3Script(ros_client=ros.ros_client, load=load)  # -> out, robot; inputs prefix: String
# ---------- robot: Python ----------
"""
Load robot directly from ROS.

COMPAS FAB v0.27.0
"""
import Rhino
import scriptcontext
from scriptcontext import sticky as st

scriptcontext.doc = Rhino.RhinoDoc.ActiveDoc

from compas_robots import RobotModel
from compas_robots.ghpython.scene import RobotModelObject
import compas_robots.ghpython

scriptcontext.doc = ghdoc

key = 'robot_AA'
print(key)
if ros_client and ros_client.is_connected and load:
    # Load URDF from ROS
    robot = ros_client.load_robot(
            load_geometry=True, 
            urdf_param_name= '{}/robot_description'.format(prefix),
            srdf_param_name= '{}/robot_description_semantic'.format(prefix))
    robot.scene_object = RobotModelObject(robot.model)
    # mobile_robot = MobileRobot(robot.model, robot.scene_object, robot.semantics, client=None)
    st[key] = robot


robot = st.get(key, None)
if robot:  # client sometimes need to be restarted, without needing to reload geometry
    robot.client = ros_client
# ---------- end robot ----------

robot_2 = Data(robot.robot)
info = Python3Script(robot=robot_2)  # -> out, main_group_name
# ---------- info: Python ----------
if robot:
    robot.info()
    main_group_name = robot.main_group_name
# ---------- end info ----------
panel_3 = Panel(info.out)

# ----
# Attach tool
list_2 = ValueList({"measurement tool": 0, "area gripper": 1, "parallel gripper": 2}, selected="measurement tool")
show = BooleanToggle(True)
path = Python3Script()  # -> DATA
# ---------- path: Python ----------
import os

package_path = ghdoc.Path
DATA = os.path.abspath(os.path.join(package_path,"../../data"))

print(package_path)
print(DATA)
# ---------- end path ----------
tool = Python3Script(data_path=path, tool=list_2, show=show)  # -> tool, M, ee_plane; inputs data_path: String
# ---------- tool: Python ----------
import os, math
from compas.geometry import Frame, Rotation, Vector
from compas.datastructures import Mesh
from compas_rhino.conversions import mesh_to_rhino, frame_to_rhino_plane
from compas_fab.robots import Tool

tolerance = 0

if tool == 0:
    filename = 'measurement_tool_zaxis.stl'
    ee_frame = Frame([0, 0, 0.109], [1, 0, 0], [0, 1, 0])

elif tool == 1:
    filename = 'area_gripper_zaxis.stl'
    ee_frame = Frame([0, 0, 0.10219 + tolerance], [1, 0, 0], [0, 1, 0])

elif tool == 2:
    filename = 'parallel_gripper_zaxis.stl'
    ee_frame = Frame([0, 0, 0.176 + tolerance], [1, 0, 0], [0, 1, 0])

data_path = os.path.join(data_path, "tool_geometry")
fullfilename = os.path.join(data_path, filename)

ee_mesh = Mesh.from_stl(fullfilename)

if show:
    M = mesh_to_rhino(ee_mesh)

tool = Tool(ee_mesh, ee_frame)
ee_plane = frame_to_rhino_plane(ee_frame)
print(ee_frame.quaternion.xyzw)
ee_framek = Frame([0.0110607,0.00809854,0.41498], [0,1,0], [1,0,0])
print(ee_framek.quaternion.xyzw)
# ---------- end tool ----------
remove = Button()
attach = Button()
mesh = Mesh(tool.M)
attach_tool = Python3Script(robot=robot_2, tool=tool.tool, attach=attach, remove=remove)  # -> tool, M, ee_plane, bang
# ---------- attach_tool: Python ----------
if attach:
    robot.attach_tool(tool)
if remove:
    robot.detach_tool()
# ---------- end attach_tool ----------

# ----
# forward kinematics
number_slider = Slider(44.2, range=-180..180)
forward_kinematics = Python3Script(
    robot=robot_2,
    j1=number_slider,
    j2=Slider(-66, range=-90..150),
    j3=Slider(46.9, range=-180..180),
    j4=Slider(-94.2, range=-400..400),
    j5=Slider(36, range=-125..120),
    j6=Slider(-400, range=-400..400))  # -> configuration
# ---------- forward_kinematics: Python ----------
import math

from compas_robots.model import Joint
from compas_robots import Configuration


if robot:
    joint_positions = [j1, j2, j3, j4, j5, j6]
    print (joint_positions)
    joint_types = robot.model.get_joint_types()
    print(joint_types)
    joint_names = robot.model.get_configurable_joint_names()
    print(joint_names)

    for i, joint_type in enumerate(joint_types):
        if joint_type == Joint.REVOLUTE:
            joint_positions[i] = math.radians(joint_positions[i])
        if joint_type == Joint.PRISMATIC:
            joint_positions[i] = joint_positions[i]
    
    configuration = Configuration(joint_positions, joint_types, joint_names)
    print (configuration)
# ---------- end forward_kinematics ----------

# ----
# Configuration
# zero configuration
zero = Python3Script(robot=robot_2, group=info.main_group_name)  # -> out, configuration; inputs group: String
# ---------- zero: Python ----------
configuration = robot.zero_configuration(group)
# ---------- end zero ----------

# ----
# analytical inverse kinematics
select_configuration = Slider(4, range=0..7)
plane = Plane(Plane(origin=(0, -1, 0), x=(-1, 0, 0), y=(0, 1, 0)))
analytic_inverse = Python3Script(robot=robot_2, plane_WCS=plane, idx=select_configuration)  # -> out, configuration, plane_RCS, plane_tool0_RCS; inputs plane_WCS: Plane, idx: Int32
# ---------- analytic_inverse: Python ----------
import Rhino.Geometry as rg
import math
from compas.geometry import Frame, Transformation, Rotation
from compas_robots import Configuration
from ur_fabrication_control.kinematics.ur_kinematics import inverse_kinematics
from ur_fabrication_control.kinematics.ur_params import ur_params
from compas_rhino.conversions import plane_to_compas_frame
from compas_ghpython import draw_frame

frame_WCS = plane_to_compas_frame(plane_WCS)

from roslibpy import tf

# transform frame to robot coordinate system
frame_WCS = plane_to_compas_frame(plane_WCS)

if robot.attached_tool:
    tool0_RCS = robot.from_tcf_to_t0cf([frame_WCS])[0]
else:
    tool0_RCS = frame_WCS

plane_tool0_RCS = draw_frame(tool0_RCS)
plane_RCS = draw_frame(frame_WCS)

# calculate solutions to frame
ur_params = ur_params["ur10e"] # get the parameters according to the robot model
# print ur_params
solutions = inverse_kinematics(tool0_RCS, ur_params)
# print solutions

if not len(solutions):
    joint_values = [0, 0, 0, 0, 0, 0]
    configuration = Configuration.from_revolute_values(joint_values)
else:
    joint_values = solutions[idx]
    configuration = [Configuration.from_revolute_values(joint_values)]

print(configuration)
# ---------- end analytic_inverse ----------

# ----
# Visualisation
list_3 = ValueList({"0 zero_configuration": 0, "1 forward_kinematics": 1, "2 inverse_kinematics": 2, "3 motion_planning": 3}, selected="2 inverse_kinematics")
filter = StreamFilter(Gate=list_3, Stream0=zero.configuration, Stream1=forward_kinematics, Stream2=analytic_inverse.configuration)
show_frames = BooleanToggle(True)
show_visual = BooleanToggle(True)
show_collision = BooleanToggle(True)
show_base_frame = BooleanToggle(True)
show_end_effector_frame = BooleanToggle(True)
show_acm = BooleanToggle(True)
visualise = Python3Script(
    robot=robot_2,
    configuration=filter,
    show_frames=show_frames,
    show_visual_meshes=show_visual,
    show_collision_meshes=show_collision,
    show_base_frame=show_base_frame,
    show_end_effector_frame=show_end_effector_frame,
    show_attached_collision_meshes=show_acm,
    bang=attach_tool.bang)  # -> out, joint_planes, visual_meshes, collision_meshes, base_plane, end_effector_plane, attched_collision_meshes; inputs bang: list
# ---------- visualise: Python ----------
from compas.geometry import Frame
from compas.geometry import Transformation
from compas_rhino.conversions import frame_to_rhino

robot.update(configuration)

if show_frames == True: 
    #print(configuration)
    joint_frames = robot.model.transformed_frames(configuration)
    joint_planes = [frame_to_rhino(a) for a in joint_frames]

if show_base_frame == True:
    show_base_frame = robot.model.forward_kinematics(configuration, robot.model.get_base_link_name())
    #print(show_base_frame)
    base_plane = frame_to_rhino(show_base_frame) 

if show_end_effector_frame == True:
    end_effector_frame = robot.model.forward_kinematics(configuration, robot.model.get_end_effector_link_name())
    #print(end_effector_frame)
    end_effector_plane = frame_to_rhino(end_effector_frame) 

if show_visual_meshes == True:
    visual_meshes = robot.draw_visual()

if show_collision_meshes == True:
    collision_meshes = robot.draw_collision()

if show_attached_collision_meshes == True:
    pass
# ---------- end visualise ----------
py3_2 = Python3Script(planes=visualise.joint_planes, scale=Slider(0.2, range=0..1))  # -> P, V, C, W; inputs planes: list of Plane, scale: Double
# ---------- py3_2: Python ----------
from Rhino.Display import ColorRGBA
from ghpythonlib.components import ColourRGBf


red = ColourRGBf(255, 255, 0, 0)
green = ColourRGBf(255, 0, 255, 0)
blue = ColourRGBf(255, 0, 0, 255)

P = []
V = []
C = []

# scale = float(scale)

for plane in planes:
    if not plane:
        continue
    P += [plane.Origin] * 3
    V.append(plane.XAxis * scale)
    V.append(plane.YAxis * scale)
    V.append(plane.ZAxis * scale)
    C += [red, green, blue]

W = 3
# ---------- end py3_2 ----------
pln = Plane(visualise.joint_planes)
mesh_2 = Mesh(visualise.collision_meshes)
mesh_3 = Mesh(visualise.visual_meshes)
pln_2 = Plane(visualise.base_plane)
pln_3 = Plane(visualise.end_effector_plane)
vdisex = VectorDisplayEx(Point=py3_2.P, Vector=py3_2.V, Colour=py3_2.C, Width=py3_2.W)
preview = CustomPreview(Geometry=mesh_3, Material=ColourSwatch(SwatchColor=RGB(74, 74, 74)))
