# Grasshopper definition r8_03_ur_moveit_simulation_direct_control_EK.gh (Grasshopper 1.0.8)
# plug-ins: RhinoCodePluginGH, Pufferfish

# ----
# IP Settings
# --> Set your IP address
# --> Set robot IP address
server_ip = ValueList({"192.168.10.74", "192.168.10.12", "192.168.10.11", "192.168.10.10", "192.168.10.2", "127.0.0.1", "192.168.10.111", "192.168.0.250", "192.168.0.30", "10.42.0.212", "10.42.0.133"}, selected="192.168.10.74")
ur_ip = ValueList({"192.168.10.10", "192.168.10.20", "192.168.10.11", "192.168.10.12", "127.0.0.1", "192.168.10.111", "192.168.0.210", "192.168.0.211", "192.168.0.30"}, selected="192.168.0.210")
server_port = ValueList({"50002", "50003", "50005", "50006", "50007", "50008", "50009", "50010", "50011", "50012", "50013", "50014", "50015", "50016", "50017", "50018", "50019", "50020", "50021", "50022", "50023", "50024", "50025", "50026", "50027", "50028"}, selected="50012")
ur_port = ValueList({"30002"}, selected="30002")
globals = Python3Script(server_ip=server_ip, server_port=server_port, ur_ip=ur_ip, ur_port=ur_port, clear=Button())  # inputs server_ip: String, server_port: Int32, ur_ip: String, ur_port: Int32
# ---------- globals: Python ----------
from scriptcontext import sticky as st

st["server_ip"] = server_ip
st["server_port"] = server_port

st["ur_ip"] = ur_ip
st["ur_port"] = ur_port

if clear:
    st.clear()
# ---------- end globals ----------

# ----
# Check if UR robot
#  is available
ping = Button()
ping_2 = Python3Script(ip=ur_ip, ping=ping)  # -> out; inputs ip: String
# ---------- ping_2: Python ----------
from scriptcontext import sticky as st
from ur_fabrication_control.direct_control.utilities import is_available

guid = str(ghenv.Component.InstanceGuid)
txt_key = "txt_" + guid
if txt_key not in st:
    st[txt_key] = ""

if ping:
    
    available = is_available(ip)
    
    if available:
        st[txt_key] = "%s is up!" % ip
        trigger = True
    else:
        st[txt_key] = "%s is down!" % ip
        trigger = False

print(st[txt_key])
# ---------- end ping_2 ----------
panel = Panel(ping_2)

reload = Button()
# ROBOT
py3 = Python3Script()  # -> HERE, DATA, ROBOT_DESCRIPTION
# ---------- py3: Python ----------
import os

HERE = os.path.dirname(ghdoc.Path)
DATA = os.path.abspath(os.path.join(HERE, "..", "data"))
ROBOT_DESCRIPTION = os.path.abspath(os.path.join(DATA, "robot_description"))

print(HERE)
print(DATA)
print(ROBOT_DESCRIPTION)
# ---------- end py3 ----------
reload_2 = Python3Script(reload=reload)  # -> out
# ---------- reload_2: Python ----------
if reload:
    from compas_rhino import unload_modules
    unload_modules("assembly_information_model")
    unload_modules('ur_fabrication_control')
# ---------- end reload_2 ----------

# ----
# ROS client
list = ValueList({"local": "127.0.0.1", "linux computer": "192.168.0.42", "linux eduroam": "10.181.95.254", "linux ccnet": "192.168.0.102", "linux vmware": "192.168.199.36", "robot": "192.168.0.200", "robotAA_wifi": "192.168.0.111", "robotAB_wifi": "192.168.0.112", "robotAB_eduroam": "10.181.67.95"}, selected="local")
connect = BooleanToggle(True)
ros = Python3Script(ip=list, port="9090", connect=connect)  # -> out, ros_client, is_connected; inputs ip: String, port: Int32, connect: Boolean
# ---------- ros: Python ----------
"""
Connect or disconnect to ROS.

COMPAS FAB v0.27.0
"""
from scriptcontext import sticky as st

from compas_fab.backends import RosClient

ros_client = None

ip = ip or '127.0.0.1'
port = port or 9090
key = "ros_client_001"
ros_client = st.get(key, None)

if ros_client:
    st[key].close()
if connect:
    st[key] = RosClient(ip, port)
    st[key].run(5)

ros_client = st.get(key, None)
is_connected = ros_client.is_connected if ros_client else False
# ---------- end ros ----------
panel_2 = Panel(ros.is_connected)

# ----
# Load robot from ROS
load = Button()
robot = Python3Script(ros_client=ros.ros_client, load=load)  # -> out, robot; inputs prefix: String
# ---------- robot: Python ----------
"""
Load robot directly from ROS.

COMPAS FAB v0.27.0
"""
import Rhino
import scriptcontext
from scriptcontext import sticky as st

scriptcontext.doc = Rhino.RhinoDoc.ActiveDoc

from compas_robots import RobotModel
from compas_robots.ghpython.scene import RobotModelObject
import compas_robots.ghpython

scriptcontext.doc = ghdoc

key = 'robot_AA'
print(key)
if ros_client and ros_client.is_connected and load:
    # Load URDF from ROS
    robot = ros_client.load_robot(
            load_geometry=True, 
            urdf_param_name= '{}/robot_description'.format(prefix),
            srdf_param_name= '{}/robot_description_semantic'.format(prefix))
    robot.scene_object = RobotModelObject(robot.model)
    st[key] = robot


robot = st.get(key, None)
if robot:  # client sometimes need to be restarted, without needing to reload geometry
    robot.client = ros_client
# ---------- end robot ----------

robot_2 = Data(robot.robot)
info = Python3Script(robot=robot_2)  # -> out, main_group_name
# ---------- info: Python ----------
if robot:
    robot.info()
    main_group_name = robot.main_group_name
# ---------- end info ----------
panel_3 = Panel(info.out)

# ----
# Attach tool
list_2 = ValueList({"measurement tool": 0, "area gripper": 1, "parallel gripper": 2, "earth extruder": 3, "earth extruder angled": 4}, selected="earth extruder angled")
show = BooleanToggle(False)
path = Python3Script()  # -> DATA
# ---------- path: Python ----------
import os

package_path = ghdoc.Path
DATA = os.path.abspath(os.path.join(package_path,"../../data"))

print(package_path)
print(DATA)
# ---------- end path ----------
tool = Python3Script(data_path=path, tool=list_2, show=show)  # -> tool, M, ee_plane; inputs data_path: String
# ---------- tool: Python ----------
import os, math
from compas.geometry import Frame, Rotation, Vector
from compas.datastructures import Mesh
from compas_rhino.conversions import mesh_to_rhino, frame_to_rhino_plane
from compas_fab.robots import Tool

tolerance = 0

if tool == 0:
    filename = 'measurement_tool_zaxis.stl'
    ee_frame = Frame([0, 0, 0.109], [1, 0, 0], [0, 1, 0])

elif tool == 1:
    filename = 'area_gripper_zaxis.stl'
    ee_frame = Frame([0, 0, 0.10219 + tolerance], [1, 0, 0], [0, 1, 0])

elif tool == 2:
    filename = 'parallel_gripper_zaxis.stl'
    ee_frame = Frame([0, 0, 0.176 + tolerance], [1, 0, 0], [0, 1, 0])

elif tool == 3:
    filename = 'earth_extruder_10mm_EK.stl'
    ee_frame = Frame([0, -0.381699, 0.1330299,], [1, 0, 0], [0, 0, 1])

elif tool == 4:
    filename = 'earth_extruder_16mm_15deg_EK.stl'
    ee_frame = Frame([0.000957, -0.367331, 0.122301,], [1, 0, 0], [0, -0.003365, 0.012557])

data_path = os.path.join(data_path, "tool_geometry")
fullfilename = os.path.join(data_path, filename)

ee_mesh = Mesh.from_stl(fullfilename)

if show:
    M = mesh_to_rhino(ee_mesh)

tool = Tool(ee_mesh, ee_frame)
ee_plane = frame_to_rhino_plane(ee_frame)
print(ee_frame.quaternion.xyzw)
ee_framek = Frame([0.0110607,0.00809854,0.41498], [0,1,0], [1,0,0])
print(ee_framek.quaternion.xyzw)
# ---------- end tool ----------
remove = Button()
attach = Button()
mesh = Mesh(tool.M)
attach_tool = Python3Script(robot=robot_2, tool=tool.tool, attach=attach, remove=remove)  # -> tool, M, ee_plane, bang
# ---------- attach_tool: Python ----------
if attach:
    robot.attach_tool(tool)
if remove:
    robot.detach_tool()
# ---------- end attach_tool ----------

# ----
# Planning scene
scene = Python3Script(robot=robot_2)  # -> scene
# ---------- scene: Python ----------
"""
Create a planning scene.

COMPAS FAB v0.28.0
"""

from ghpythonlib.componentbase import executingcomponent as component
from scriptcontext import sticky as st

from compas_fab.ghpython.components import create_id
from compas_fab.robots import PlanningScene


class PlanningSceneComponent(component):
    def RunScript(self, robot):
        key = "planning_scene"
        if robot:
            st[key] = PlanningScene(robot)
        return st.get(key, None)
# ---------- end scene ----------

# ----
# Attach collision mesh to scene
append = Button()
remove_2 = Button()
add = Button()
mesh_table = Mesh(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)
collision_mesh = Python3Script(scene=scene, mesh=mesh_table, identifier="table", add=add, append=append, remove=remove_2)  # -> ok, bang; inputs mesh: Mesh, identifier: String
# ---------- collision_mesh: Python ----------
"""
Add or remove a collision mesh from the planning scene.
"""

from compas_rhino.conversions import mesh_to_compas
from compas_fab.robots import CollisionMesh

ok = False
Message = ""

if (add and append) or (append and remove) or (add and remove):
    Message = "Use only one operation at a time\n(add, append or remove)"
    raise Exception(Message)

if scene and mesh and identifier:
    compas_mesh = mesh_to_compas(mesh)
    collision_mesh = CollisionMesh(compas_mesh, identifier)
    if add:
        scene.add_collision_mesh(collision_mesh)
        Message = "Added"
        ok = True
    if append:
        scene.append_collision_mesh(collision_mesh)
        Message = "Appended"
        ok = True
    if remove:
        scene.remove_collision_mesh(identifier)
        Message = "Removed"
        ok = True
# ---------- end collision_mesh ----------
panel_4 = Panel(collision_mesh.ok)

# ----
# Attach collision mesh to robot
panel_5 = Panel("attached_brick")
remove_3 = Button()
add_2 = Button()
mesh_2 = Mesh(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)
attached_collision_mesh = Python3Script(scene=scene, mesh=mesh_2, identifier=panel_5, link_name="ee_link", touch_links="ee_link", add=add_2, remove=remove_3)  # -> out, attached_collision_mesh, bang; inputs mesh: Mesh
# ---------- attached_collision_mesh: Python ----------
"""
Add an attached collision mesh to the robot.

COMPAS FAB v0.28.0
"""

from compas_rhino.conversions import mesh_to_compas
from ghpythonlib.componentbase import executingcomponent as component

from compas_fab.robots import AttachedCollisionMesh
from compas_fab.robots import CollisionMesh

from compas_ghpython import create_id


class AttachedCollisionMeshComponent(component):
    def RunScript(self,
            scene,
            mesh: Rhino.Geometry.Mesh,
            identifier,
            link_name,
            touch_links,
            add,
            remove):
        attached_collision_mesh = None
        if scene and mesh and identifier and link_name:
            compas_mesh = mesh_to_compas(mesh)
            collision_mesh = CollisionMesh(compas_mesh, identifier)
            attached_collision_mesh = AttachedCollisionMesh(collision_mesh, link_name, touch_links)
            if add:
                scene.add_attached_collision_mesh(attached_collision_mesh)
            if remove:
                scene.remove_attached_collision_mesh(identifier)
                scene.remove_collision_mesh(identifier)
        return attached_collision_mesh
# ---------- end attached_collision_mesh ----------
panel_6 = Panel(attached_collision_mesh.attached_collision_mesh)

geo = Geometry(tool.ee_plane)

# ----
# forward kinematics
number_slider = Slider(173, range=-180..180)
forward_kinematics = Python3Script(
    robot=robot_2,
    j1=number_slider,
    j2=Slider(-54, range=-90..150),
    j3=Slider(89, range=-180..180),
    j4=Slider(-36, range=-400..400),
    j5=Slider(91, range=-360..360),
    j6=Slider(0, range=-400..400))  # -> configuration
# ---------- forward_kinematics: Python ----------
import math

from compas_robots.model import Joint
from compas_robots import Configuration


if robot:
    joint_positions = [j1, j2, j3, j4, j5, j6]
    print (joint_positions)
    joint_types = robot.model.get_joint_types()
    print(joint_types)
    joint_names = robot.model.get_configurable_joint_names()
    print(joint_names)

    for i, joint_type in enumerate(joint_types):
        if joint_type == Joint.REVOLUTE:
            joint_positions[i] = math.radians(joint_positions[i])
        if joint_type == Joint.PRISMATIC:
            joint_positions[i] = joint_positions[i]
    
    configuration = Configuration(joint_positions, joint_types, joint_names)
    print (configuration)
# ---------- end forward_kinematics ----------

# ----
# Configuration
# zero configuration
zero = Python3Script(robot=robot_2, group=info.main_group_name)  # -> out, configuration; inputs group: String
# ---------- zero: Python ----------
configuration = robot.zero_configuration(group)
# ---------- end zero ----------

# ----
# analytical inverse kinematics
select_configuration = Slider(0, range=0..7)
plane = Plane(Plane(origin=(1, 0, 0), x=(-1, 0, 0), y=(0, 1, 0)))
analytic_inverse = Python3Script(robot=robot_2, plane_WCS=plane, idx=select_configuration)  # -> out, configuration, plane_RCS, plane_tool0_RCS; inputs plane_WCS: Plane, idx: Int32
# ---------- analytic_inverse: Python ----------
import Rhino.Geometry as rg
import math
from compas.geometry import Frame, Transformation, Rotation
from compas_robots import Configuration
from ur_fabrication_control.kinematics.ur_kinematics import inverse_kinematics
from ur_fabrication_control.kinematics.ur_params import ur_params
from compas_rhino.conversions import plane_to_compas_frame
from compas_ghpython import draw_frame

frame_WCS = plane_to_compas_frame(plane_WCS)

from roslibpy import tf

# transform frame to robot coordinate system
frame_WCS = plane_to_compas_frame(plane_WCS)

if robot.attached_tool:
    tool0_RCS = robot.from_tcf_to_t0cf([frame_WCS])[0]
else:
    tool0_RCS = frame_WCS

plane_tool0_RCS = draw_frame(tool0_RCS)
plane_RCS = draw_frame(frame_WCS)

# calculate solutions to frame
ur_params = ur_params["ur10e"] # get the parameters according to the robot model
# print ur_params
solutions = inverse_kinematics(tool0_RCS, ur_params)
# print solutions

if not len(solutions):
    joint_values = [0, 0, 0, 0, 0, 0]
    configuration = Configuration.from_revolute_values(joint_values)
else:
    joint_values = solutions[idx]
    configuration = [Configuration.from_revolute_values(joint_values)]

print(configuration)
# ---------- end analytic_inverse ----------

# ----
# Plan motion
plane_2 = Plane(Plane(origin=(0.9373701784, -0.2091342998, 0.4795403412), x=(-0.7236318944, -0.6901861209, 0), y=(-0.5107925263, 0.5355450541, -0.672519509)))
constraints_from_plane = Python3Script(robot=robot_2, plane=plane_2, group=info.main_group_name)  # -> constraints
# ---------- constraints_from_plane: Python ----------
"""
Create a position and an orientation constraint from a plane calculated for the group's end-effector link.

COMPAS FAB v1.0.2
"""

import math

from compas_rhino.conversions import plane_to_compas_frame
from ghpythonlib.componentbase import executingcomponent as component


class ConstraintsFromPlane(component):
    def RunScript(self,
            robot,
            plane,
            group,
            tolerance_position,
            tolerance_xaxis,
            tolerance_yaxis,
            tolerance_zaxis):
        goal_constraints = None
        if robot and plane:
            tolerance_position = tolerance_position or 0.001
            tolerance_xaxis = tolerance_xaxis or 1.0
            tolerance_yaxis = tolerance_yaxis or 1.0
            tolerance_zaxis = tolerance_zaxis or 1.0

            frame = plane_to_compas_frame(plane)
            tolerances_axes = [
                math.radians(tolerance_xaxis),
                math.radians(tolerance_yaxis),
                math.radians(tolerance_zaxis),
            ]
            goal_constraints = robot.constraints_from_frame(frame, tolerance_position, tolerances_axes, group)

        return goal_constraints
# ---------- end constraints_from_plane ----------
compute = Button()
plan_motion = Python3Script(
    robot=robot_2,
    goal_constraints=constraints_from_plane,
    start_configuration=analytic_inverse.configuration,
    group=info.main_group_name,
    compute=compute)  # -> trajectory
# ---------- plan_motion: Python ----------
"""
Calculate a motion path.

COMPAS FAB v1.0.2
"""

from ghpythonlib.componentbase import executingcomponent as component
from scriptcontext import sticky as st

from compas_fab.ghpython.components import create_id


class PlanMotion(component):
    def RunScript(self,
            robot,
            goal_constraints,
            start_configuration,
            group,
            attached_collision_meshes,
            path_constraints,
            planner_id,
            compute):
        key = "trajectory"

        path_constraints = list(path_constraints) if path_constraints else None
        attached_collision_meshes = list(attached_collision_meshes) if attached_collision_meshes else None
        planner_id = str(planner_id) if planner_id else "RRTConnect"

        if (
            robot
            and robot.client
            and robot.client.is_connected
            and start_configuration
            and goal_constraints
            and compute
        ):
            st[key] = robot.plan_motion(
                goal_constraints,
                start_configuration=start_configuration,
                group=group,
                options=dict(
                    attached_collision_meshes=attached_collision_meshes,
                    path_constraints=path_constraints,
                    planner_id=planner_id,
                ),
            )

        trajectory = st.get(key, None)
        return trajectory
# ---------- end plan_motion ----------
trajectory_visualize = Python3Script(robot=robot_2, group=info.main_group_name, trajectory=plan_motion)  # -> out, start_configuration, configurations, fraction, time, planes, P, V, A
# ---------- trajectory_visualize: Python ----------
"""
Visualizes a trajectory.

COMPAS FAB v1.0.2
"""

from compas_ghpython import draw_frame
from compas_ghpython.sets import list_to_ghtree
from ghpythonlib.componentbase import executingcomponent as component


class TrajectoryVisualize(component):
    def RunScript(self, robot, group, trajectory):
        start_configuration = None
        configurations = []
        fraction = 0.0
        time = 0.0

        planes = []
        positions = []
        velocities = []
        accelerations = []

        if robot and trajectory:
            group = group or robot.main_group_name

            for c in trajectory.points:
                configurations.append(
                    robot.merge_group_with_full_configuration(c, trajectory.start_configuration, group)
                )
                frame = robot.forward_kinematics(c, group, options=dict(solver="model"))
                planes.append(draw_frame(frame))
                positions.append(c.positions)
                velocities.append(c.velocities)
                accelerations.append(c.accelerations)

            start_configuration = trajectory.start_configuration
            fraction = trajectory.fraction
            time = trajectory.time_from_start

        P = list_to_ghtree(list(zip(*positions)))
        V = list_to_ghtree(list(zip(*velocities)))
        A = list_to_ghtree(list(zip(*accelerations)))

        # return outputs if you have them; here I try it for you:
        return (start_configuration, configurations, fraction, time, planes, P, V, A)
# ---------- end trajectory_visualize ----------
pln = Python3Script(P=trajectory_visualize.planes)  # -> P
# ---------- pln: Python ----------
print("hi")
# ---------- end pln ----------
pline = PolyLine(Vertices=pln, Closed=False)
select = Python3Script(L=trajectory_visualize.configurations, i=Slider(0, range=0..100))  # -> a; inputs i: Int32
# ---------- select: Python ----------
print(len(L))

if i < len(L):
    a = L[i]
else:
    a = L[-1]
# ---------- end select ----------
preview = CustomPreview(Geometry=pline, Material=ColourSwatch(SwatchColor=RGB(59, 137, 161)))

# ----
# inverse kinematics
inverse = Python3Script(robot=robot_2, plane=plane)  # -> configuration
# ---------- inverse: Python ----------
"""
Calculate the robot's inverse kinematic for a given plane.

COMPAS FAB v1.0.2
"""

from compas_rhino.conversions import plane_to_compas_frame
from ghpythonlib.componentbase import executingcomponent as component


class InverseKinematics(component):
    def RunScript(self, robot, plane, start_configuration, group):
        configuration = None
        if robot and robot.client and robot.client.is_connected and plane:
            frame = plane_to_compas_frame(plane)
            configuration = robot.inverse_kinematics(frame, start_configuration, group)
        return configuration
# ---------- end inverse ----------

show_robot_collision = BooleanToggle(False)

# ----
# Visualisation
list_3 = ValueList({"0 zero_configuration": 0, "1 forward_kinematics": 1, "2 analytic_inverse_kinematics": 2, "3 inverse_kinematics": 3, "4 motion_planning": 4}, selected="1 forward_kinematics")
filter = StreamFilter(
    Gate=list_3,
    Stream0=zero.configuration,
    Stream1=forward_kinematics,
    Stream2=analytic_inverse.configuration,
    Stream3=inverse,
    Stream4=select)
show_frames = BooleanToggle(True)
show_visual = BooleanToggle(True)
show_collision = BooleanToggle(True)
show_attached_collision = BooleanToggle(True)
show_base_frame = BooleanToggle(True)
show_end_effector_frame = BooleanToggle(True)
visualise = Python3Script(
    robot=robot_2,
    configuration=filter,
    show_frames=show_frames,
    show_visual_meshes=show_visual,
    show_robot_collision_meshes=show_robot_collision,
    show_collision_meshes=show_collision,
    show_attached_collision_meshes=show_attached_collision,
    show_base_frame=show_base_frame,
    show_end_effector_frame=show_end_effector_frame,
    bang=[attach_tool.bang, collision_mesh.bang, attached_collision_mesh.bang])  # -> out, joint_planes, visual_meshes, robot_collision_meshes, collision_meshes, base_plane, end_effector_plane, attached_meshes; inputs bang: list
# ---------- visualise: Python ----------
from scriptcontext import sticky as st
import time
from compas_ghpython import create_id
from compas.geometry import Frame
from compas.geometry import Transformation
from compas_rhino.conversions import frame_to_rhino
from compas.scene import SceneObject
from compas_fab.robots import PlanningScene

robot.update(configuration)

if show_frames == True: 
    #print(configuration)
    joint_frames = robot.model.transformed_frames(configuration)
    joint_planes = [frame_to_rhino(a) for a in joint_frames]

if show_base_frame == True:
    show_base_frame = robot.model.forward_kinematics(configuration, robot.model.get_base_link_name())
    #print(show_base_frame)
    base_plane = frame_to_rhino(show_base_frame) 

if show_end_effector_frame == True:
    end_effector_frame = robot.forward_kinematics(configuration)
    #print(end_effector_frame)
    end_effector_plane = frame_to_rhino(end_effector_frame) 

if show_visual_meshes == True:
    visual_meshes = robot.draw_visual()

if show_robot_collision_meshes == True:
    robot_collision_meshes = robot.draw_collision()

cached_scene_key = "cached_scene"

if show_collision_meshes or show_attached_collision_meshes:
    cached_scene = st.get(cached_scene_key)
    if not cached_scene:
        cached_scene = {"time": 0}

    # # expire cache if the component has not been executed in the last 2 seconds
    # # this allows to slide through a list of configurations
    # # without triggering refreshes of the scene in the middle of it

    # if time.time() - cached_scene["time"] > 2:
    #     update_scene = True
    # else:
    #     update_scene = False

    update_scene = True

    if update_scene:
        scene = PlanningScene(robot)
        scene = robot.client.get_planning_scene()

    if update_scene and show_collision_meshes:
        collision_meshes = []

        for co in scene.world.collision_objects:
            print(co)
            header = co.header
            frame_id = header.frame_id
            cms = co.to_collision_meshes()

            for cm in cms:
                if cm.frame != Frame.worldXY():
                    t = Transformation.from_frame(cm.frame)
                    mesh = cm.mesh.transformed(t)
                else:
                    mesh = cm.mesh
                collision_meshes.extend(SceneObject(item=mesh).draw())

        cached_scene["cm"] = collision_meshes

        collision_meshes = cached_scene.get("cm", [])

    if update_scene and show_attached_collision_meshes:
        attached_meshes = []

        for aco in scene.robot_state.attached_collision_objects:
            for acm in aco.to_attached_collision_meshes():
                frame_id = aco.object["header"]["frame_id"]
                frame = robot.forward_kinematics(configuration, options=dict(link=frame_id))
                t = Transformation.from_frame(frame)

                # Local CM frame
                if acm.collision_mesh.frame and acm.collision_mesh.frame != Frame.worldXY():
                    t = t * Transformation.from_frame(acm.collision_mesh.frame)

                mesh = acm.collision_mesh.mesh.transformed(t)

                attached_meshes.extend(SceneObject(item=mesh).draw())

        cached_scene["acm"] = attached_meshes

        attached_meshes = cached_scene.get("acm", [])
    
    cached_scene["time"] = time.time()
    st[cached_scene_key] = cached_scene
# ---------- end visualise ----------
py3_2 = Python3Script(planes=visualise.joint_planes, scale=Slider(0.2, range=0..1))  # -> P, V, C, W; inputs planes: list of Plane, scale: Double
# ---------- py3_2: Python ----------
from Rhino.Display import ColorRGBA
from ghpythonlib.components import ColourRGBf


red = ColourRGBf(255, 255, 0, 0)
green = ColourRGBf(255, 0, 255, 0)
blue = ColourRGBf(255, 0, 0, 255)

P = []
V = []
C = []

# scale = float(scale)

for plane in planes:
    if not plane:
        continue
    P += [plane.Origin] * 3
    V.append(plane.XAxis * scale)
    V.append(plane.YAxis * scale)
    V.append(plane.ZAxis * scale)
    C += [red, green, blue]

W = 3
# ---------- end py3_2 ----------
pln_2 = Plane(visualise.joint_planes)
mesh_3 = Mesh(visualise.visual_meshes)
mesh_4 = Mesh(visualise.collision_meshes)
pln_3 = Plane(visualise.base_plane)
pln_4 = Plane(visualise.end_effector_plane)
preview_2 = CustomPreview(Geometry=mesh_3, Material=ColourSwatch(SwatchColor=RGB(74, 74, 74)))
vdisex = VectorDisplayEx(Point=py3_2.P, Vector=py3_2.V, Colour=py3_2.C, Width=py3_2.W)

mesh_5 = Mesh(visualise.robot_collision_meshes)
mesh_6 = Mesh(visualise.attached_meshes)
amr_4 = Geometry([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])
amr_1 = Geometry([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])
amr_2 = Geometry([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])
amr_3 = Geometry([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])
amr_5 = Geometry([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])
scale = Scale(Geometry=amr_4, Center=Point(0, 0, 0), Factor=Slider(0.001, range=0..0.001))  # -> Geometry, Transform

# ----
# Move Joints
list_4 = ValueList({"send ik configuration": 0, "send one motion configuration": 1, "send all motion configurations": 2}, selected="send one motion configuration")
filter_2 = StreamFilter(Gate=list_4, Stream0=forward_kinematics, Stream1=select, Stream2=trajectory_visualize.configurations)
movej = Python3Script(configurations=filter_2, velocity=Slider(0.057, range=0..0.5))  # -> urscript, lift, values; inputs configurations: list
# ---------- movej: Python ----------
from ur_fabrication_control.direct_control import URScript
from compas_robots import Configuration
import math

urscript = URScript()
urscript.start()
for configuration in configurations:
    joint_configuration = Configuration.from_revolute_values(configuration.revolute_values)
    print(joint_configuration)
    lift = configuration
    urscript.move_joint(joint_configuration, velocity)
urscript.end()

urscript = urscript.generate()

print(urscript)
# ---------- end movej ----------
send = Button()
ur_send = Python3Script(urscript=movej.urscript, send=send)  # -> out
# ---------- ur_send: Python ----------
from scriptcontext import sticky as st
from ur_fabrication_control.direct_control import send_script

ur_ip = st["ur_ip"]
ur_port = st["ur_port"]

print(urscript)

if send:
    send_script(urscript, ur_ip, ur_port)
# ---------- end ur_send ----------

# ----
# For testing the alignment of the workpiece
number_slider_2 = Slider(0.1, range=0..0.1)
Y = UnitY(Factor=1)
X = UnitX(Factor=1)
geo_2 = Geometry([<point referenced from the Rhino model> x4])
pl = ConstructPlane(Origin=geo_2, XAxis=Y, YAxis=X)
Z = UnitZ(Factor=number_slider_2)
move = Move(Geometry=pl, Motion=Z)  # -> Geometry, Transform
item = ListItem(List=move.Geometry, Index=1, Wrap=True)

# ----
# Stop
stop = Button()
stop_2 = Python3Script(stop=stop)
# ---------- stop_2: Python ----------
from scriptcontext import sticky as st
from ur_fabrication_control.direct_control.common import send_stop

ur_ip = st["ur_ip"]
ur_port = st["ur_port"]

if stop:
    send_stop(ur_ip, ur_port)
# ---------- end stop_2 ----------

# ----
# Move Cartesian
list_5 = ValueList({"send one cartesian position": 0, "send all cartesian positions": 1}, selected="send one cartesian position")
filter_3 = StreamFilter(Gate=list_5, Stream0=item)
radius = Slider(0, range=0..0.5)
movel = Python3Script(robot=robot.robot, planes_WCS=filter_3, velocity=Slider(0.036, range=0..0.5), radius=radius)  # -> urscript; inputs planes_WCS: list of Plane
# ---------- movel: Python ----------
import Rhino.Geometry as rg
from compas.geometry import Frame
from compas.geometry import Transformation, Rotation
from compas_rhino.conversions import plane_to_compas_frame
from compas_ghpython import draw_frame
from ur_fabrication_control import direct_control 
import math

from scriptcontext import sticky as st
from ur_fabrication_control.direct_control import URScript

# retrieve the current tool frame in axis angle format
if robot.attached_tool:
    tool_angle_axis = list(robot.attached_tool.frame.point) + list(robot.attached_tool.frame.axis_angle_vector)
else:
    tool0_frame = Frame([0, 0, 0], [1, 0, 0], [0, 1, 0])
    tool_angle_axis = list(tool0_frame.point) + list(tool0_frame.axis_angle_vector)

frames_RCS = []
for plane_WCS in planes_WCS:
    frame_WCS = plane_to_compas_frame(plane_WCS)
    pose = frame_WCS.point.__data__ + frame_WCS.axis_angle_vector.__data__
    x = "p[{}, {}, {}, {}, {}, {}]".format(*pose)
    print(x)
    frame_RCS = frame_WCS # Transform the frame if the robot is not at WCF. In this case, it is not necessary.
    frames_RCS.append(frame_RCS)

urscript = URScript()
urscript.start()
urscript.set_tcp(tool_angle_axis)
for frame_RCS in frames_RCS:
    urscript.move_linear(frame=frame_RCS, velocity=velocity, radius=radius)
urscript.end()

urscript = urscript.generate()

print(urscript)
# ---------- end movel ----------
send_2 = Button()
ur_send_2 = Python3Script(urscript=movel, send=send_2)  # -> out
# ---------- ur_send_2: Python ----------
from scriptcontext import sticky as st
from ur_fabrication_control.direct_control import send_script

ur_ip = st["ur_ip"]
ur_port = st["ur_port"]

if send:
    send_script(urscript, ur_ip, ur_port)
# ---------- end ur_send_2 ----------

amr_1_2 = Geometry([<curve referenced from the Rhino model> x31])
amr_2_2 = Geometry([<curve referenced from the Rhino model> x33])
amr_3_2 = Geometry([<curve referenced from the Rhino model> x50])
amr_4_2 = Geometry([<curve referenced from the Rhino model> x32])
amr_5_2 = Geometry([<curve referenced from the Rhino model> x30])

data = Data([amr_4_2, amr_2_2])
end_points = EndPoints(Curve=data)  # -> Start, End
deconstruct = Deconstruct(Point=end_points.End)  # -> XComponent, YComponent, ZComponent
worldxy = Plane(PlaneXY(0, 0, 0))

# ---- group: Sorted in Z Cordinate
sort_list = SortList(Keys=deconstruct.ZComponent, ValuesValuesA=data)  # -> Keys, ValuesValuesA

# ----
# Orient geometry
number_slider_3 = Slider(0.03, range=0..0.1)
trnf_origin = Plane(Plane(origin=(0.6247863273, -0.34, -0.495), x=(0.9999218842, 0, 0.01249902355), y=(0, 1, 0)))
deplane = DeconstructPlane(Plane=trnf_origin)  # -> Origin, XAxis, YAxis, ZAxis
multiplication = Multiplication(A=deplane.ZAxis, B=number_slider_3)
geo_3 = Geometry([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])
origin = Plane(PlaneXY(0.6247863273, -0.34, -0.495))
box = Orient(Geometry=geo_3, Source=origin, Target=trnf_origin)  # -> Geometry, Transform
move_2 = Move(Geometry=trnf_origin, Motion=multiplication)  # -> Geometry, Transform
curves = Orient(Geometry=sort_list.ValuesValuesA, Source=worldxy, Target=move_2.Geometry)  # -> Geometry, Transform
preview_3 = CustomPreview(Geometry=box.Geometry, Material=ColourSwatch(SwatchColor=RGBA(255, 255, 255, 26)))

# ----
# Slicer
frames = Python3Script(offset_curves=curves.Geometry)  # -> out, all_frame_layers, offset_curves; inputs offset_curves: list of Curve
# ---------- frames: Python ----------
from compas_rhino.conversions import plane_to_rhino
from compas.geometry import Frame
import Rhino
from Rhino.Geometry.Intersect import Intersection
from Rhino.Geometry import Plane, Point3d, Vector3d, Curve, Brep, CurveOffsetCornerStyle, Polyline, Mesh, CurveOrientation

all_frame_layers = []

for curve in offset_curves:
    if curve.GetLength() < 0.015:
        offset_curves.remove(curve)
        #points.append(curve.PointAtStart)
        #points.append(curve.PointAtEnd)

for curve in offset_curves:
    points = []
    point_parameters = curve.DivideByLength(0.015, True)
    if point_parameters:
        for i in point_parameters:
            points.append(curve.PointAt(i))

    # Create a list of frames for each layer
    frames = [Frame([pt.X, pt.Y, pt.Z], [0, 1, 0], [1, 0, 0]) for pt in points] #normal orientation
    #frames = [Frame([pt.X, pt.Y, pt.Z], [1, 1, 0], [1, -1, 0]) for pt in points]  #Rotated 45 degrees
    all_frame_layers.append(frames)
# ---------- end frames ----------

# ----
# Get Pose Joint
get = Button()
pose = Python3Script(robot=robot.robot, get=get)  # -> out, configuration, pose_joints
# ---------- pose: Python ----------
from scriptcontext import sticky as st
from ur_fabrication_control.direct_control.common import get_current_pose_joints
from compas.geometry import Frame
from compas_robots import Configuration


server_ip = st["server_ip"]
server_port = st["server_port"]
ur_port = st["ur_port"]
ur_ip = st["ur_ip"]
print(ur_ip)

guid = str(ghenv.Component.InstanceGuid)
pose_joints_key = "pose_joints" + guid

if pose_joints_key not in st:
    st[pose_joints_key] = None

# retrieve the current tool frame in axis angle format
if robot.attached_tool:
    tool_angle_axis = list(robot.attached_tool.frame.point) + list(robot.attached_tool.frame.axis_angle_vector)
else:
    tool0_frame = Frame([0, 0, 0], [1, 0, 0], [0, 1, 0])
    tool_angle_axis = list(tool0_frame.point) + list(tool0_frame.axis_angle_vector)

print(tool_angle_axis)

# send script to the robot to receive the current joint configuration
if get:
    st[pose_joints_key] = get_current_pose_joints(server_ip, server_port, ur_ip, ur_port, tool_angle_axis)

if st[pose_joints_key] is not None:
    print(st[pose_joints_key])
    configuration = Configuration.from_revolute_values(st[pose_joints_key])
    pose_joints = configuration.joint_values
"""
if pose_joints_key not in st:
    configuration = Configuration.from_revolute_values([0,0,0,0,0,0])
else:
    configuration = Configuration.from_revolute_values(st[pose_joints_key])

pose_joints = configuration.values
"""
# ---------- end pose ----------
panel_7 = Panel(pose.pose_joints)

valve_on_off = Python3Script(turn_on=Toggle(True))  # -> urscript; inputs turn_on: Boolean
# ---------- valve_on_off: Python ----------
import Rhino.Geometry as rg
from compas.geometry import Frame
from compas.geometry import Transformation, Rotation
from compas_rhino.conversions import plane_to_compas_frame
from compas_ghpython import draw_frame
from ur_fabrication_control import direct_control 
import math

from scriptcontext import sticky as st
from ur_fabrication_control.direct_control import URScript


urscript = URScript()
urscript.start()
if turn_on:
    urscript.add_digital_out(6, False)
else:
    urscript.add_digital_out(6, True)
urscript.end()

urscript = urscript.generate()

print(urscript)
# ---------- end valve_on_off ----------
send_3 = Button()
ur_send_3 = Python3Script(urscript=valve_on_off, send=send_3)  # -> out; same code as ur_send_2

end = EndPoints(Curve=frames.offset_curves)  # -> Start, End
button = Button()
button_2 = Button()
pt = Point(end.Start)
item_2 = ListItem(List=curves.Geometry, Index=Slider(44, range=0..100), Wrap=True)
segment_counter = Python3Script(increase=button, decrease=button_2)  # -> out
# ---------- segment_counter: Python ----------
from scriptcontext import sticky as st

#st["layer_number"] = 0

if increase:
    st["layer_number"] += 1
if decrease:
    st["layer_number"] -= 1

print("Current segment {}".format(st["layer_number"]))
# ---------- end segment_counter ----------
listdexs = ListIndices(List=pt)
print_layer = Python3Script(
    robot=robot_2,
    all_frame_layers=frames.all_frame_layers,
    velocity=Slider(0.058, range=0..1),
    radius=Slider(0.005, range=0..0.01),
    trigger=[button, button_2])  # -> out, urscript, planes, layer_number; inputs all_frame_layers: list, velocity: Double, radius: Double
# ---------- print_layer: Python ----------
from ur_fabrication_control.direct_control import URScript
from compas.geometry import Frame, Translation, Vector
from am_information_model.model import Element
from compas_rhino.conversions import frame_to_rhino_plane
from scriptcontext import sticky as st

if not st.get("layer_number"):
    st["layer_number"] = 0

layer_number = st["layer_number"]
print("Current layer is {}.".format(layer_number))

urscript = URScript()

# retrieve the current tool frame in axis angle format
if robot.attached_tool:
    tool_angle_axis = list(robot.attached_tool.frame.point) + list(robot.attached_tool.frame.axis_angle_vector)
else:
    tool0_frame = Frame([0, 0, 0], [1, 0, 0], [0, 1, 0])
    tool_angle_axis = list(tool0_frame.point) + list(tool0_frame.axis_angle_vector)

def print_layer(frames, velocity, radius):
    for i, frame in enumerate(frames[1:]):
        if i == len(frames)-3:
            urscript.add_digital_out(6, True)
        if frame == frames[0]:
            urscript.move_linear(frame=frame, velocity=velocity, radius=radius)
        elif frame != frames[0]:
            urscript.move_process(frame=frame, velocity=velocity, radius=radius)
    urscript.add_digital_out(6, True)

def approach(frames, velocity, radius):
    approach_frame = frames[0]
    urscript.move_linear(approach_frame, velocity, radius)
    urscript.add_digital_out(6, False)

def retract(frames, velocity, radius):
    T = Translation.from_vector(Vector(0,0,0.3)) 
    retract_frame = frames[0].transformed(T)
    urscript.move_linear(retract_frame, velocity, radius)

frames = all_frame_layers[layer_number]

urscript.start()
urscript.set_tcp(tool_angle_axis)

urscript.set_payload(6.0)
approach(frames, velocity, radius)
urscript.add_line("\tsleep(0.5)") 
print_layer(frames, velocity, radius)
retract(frames, velocity, radius)

urscript.end()
urscript = urscript.generate()

planes = [frame_to_rhino_plane(frame) for frame in frames]

print(urscript)
# ---------- end print_layer ----------
tag = TextTag(Location=end.Start, Text=listdexs)
panel_8 = Panel(segment_counter)
pt_2 = Point(print_layer.planes)
pln_5 = Plane(print_layer.planes)
item_3 = ListItem(List=frames.offset_curves, Index=print_layer.layer_number, Wrap=True)

# ----
# Send
send_4 = Button()
ur_send_4 = Python3Script(urscript=print_layer.urscript, send=send_4)  # -> out
# ---------- ur_send_4: Python ----------
from scriptcontext import sticky as st
from ur_fabrication_control.direct_control import send_script
from scriptcontext import sticky as st

ur_ip = st["ur_ip"]
ur_port = st["ur_port"]

layer_number = st["layer_number"]
print("Printing layer {}".format(st["layer_number"]))

if send:
    
    send_script(urscript, ur_ip, ur_port)
# ---------- end ur_send_4 ----------

# ----
# Stop
stop_3 = Button()
stop_4 = Python3Script(stop=stop_3)  # same code as stop_2

jny_1 = Geometry([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])  # disabled
jny_2 = Geometry([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])  # disabled
jny_1_2 = Geometry([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])  # disabled

pipe = Pipe(Curve=item_3, Radius=0.009, Caps=2)
preview_4 = CustomPreview(Geometry=pipe, Material=ColourSwatch(SwatchColor=RGB(25, 125, 255)))
rec = DataRecorder(ur_send_4, DataLimit=-10, RecordData=True)
panel_9 = Panel(rec)

# ----
# Get Pose Cartesian
get_2 = Button()
pose_2 = Python3Script(robot=robot.robot, get=get_2)  # -> out, pose_cartesian
# ---------- pose_2: Python ----------
from scriptcontext import sticky as st
#from ur_fabrication_control.online_control.ur_direct import get_current_pose_cartesian

from ur_fabrication_control.direct_control.common import get_current_pose_cartesian
from compas.geometry import Frame
from compas_ghpython import draw_frame


server_ip = st["server_ip"]
server_port = st["server_port"]
ur_port = st["ur_port"]
ur_ip = st["ur_ip"]
pose_cartesian_meter = []

# retrieve the current tool frame in axis angle format
if robot.attached_tool:
    print("attached")
    tool_angle_axis = list(robot.attached_tool.frame.point) + list(robot.attached_tool.frame.axis_angle_vector)

    
else:
    tool0_frame = Frame([0, 0, 0], [1, 0, 0], [0, 1, 0])
    tool_angle_axis = list(tool0_frame.point) + list(tool0_frame.axis_angle_vector)

guid = str(ghenv.Component.InstanceGuid)
pose_cartesian_key = "pose_cartesian" + guid

if pose_cartesian_key not in st:
    st[pose_cartesian_key] = None
if get:
    print("getting pose")
    st[pose_cartesian_key] = get_current_pose_cartesian(tool_angle_axis, server_ip, server_port, ur_ip, ur_port, send=True)
    
pose_cartesian = st[pose_cartesian_key]
# ---------- end pose_2 ----------
python = Python3Script(robot=robot.robot, pose=pose_2.pose_cartesian)  # -> out, plane
# ---------- python: Python ----------
__author__ = "Gido"
__version__ = "2023.07.05"

import rhinoscriptsyntax as rs
from compas.geometry import Frame
from compas_ghpython import draw_frame

if pose is not None:
    frame_RCS = Frame.from_axis_angle_vector(pose[3:6], pose[0:3])
    T = Transformation.from_change_of_basis(robot.RCF, Frame.worldXY())
    frame_WCS = frame_RCS.transformed(T)
    plane = draw_frame(frame_WCS)
# ---------- end python ----------

# ----
# Direct UR control
rec_2 = DataRecorder(pose_2.out, DataLimit=-10, RecordData=True)

panel_10 = Panel(rec_2)
