# Grasshopper definition ur_direct_control_playground_fabrication_two_robots.ghx (Grasshopper 1.0.7)

# ----
# 1.
# Settings
bang = Button()
panel = Panel("Unload libraries")
unload = PythonScript(bang=bang)
# ---------- unload: Python ----------
from compas_rhino.utilities.misc import get_tolerance
from compas_rhino.utilities.misc import unload_modules

unload_modules("compas")
unload_modules("compas_fab")
unload_modules("ur_fabrication_control")
unload_modules("mobile_additive_manufacturing")
unload_modules("am_information_model")
unload_modules("src")
# ---------- end unload ----------

ext_ip = ValueList({"192.168.10.10", "192.168.10.20", "192.168.10.11", "192.168.10.12", "127.0.0.1", "192.168.10.111", "192.168.0.30", "192.168.10.50"}, selected="192.168.10.50")
ur_ip = ValueList({"192.168.10.10", "192.168.10.20", "192.168.10.11", "192.168.10.12", "127.0.0.1", "192.168.10.111", "192.168.0.30"}, selected="192.168.10.10")

# ----
# Check if UR robot
#  is available
ping = Button()
py = PythonScript(ip=ur_ip, ping=ping)  # -> out, trigger
# ---------- py: Python ----------
from scriptcontext import sticky as st
from ur_fabrication_control.direct_control.utilities import is_available

guid = str(ghenv.Component.InstanceGuid)
txt_key = "txt_" + guid
if txt_key not in st:
    st[txt_key] = ""

if ping:
    
    available = is_available(ip)
    
    if available:
        st[txt_key] = "%s is up!" % ip
        trigger = True
    else:
        st[txt_key] = "%s is down!" % ip
        trigger = False

print(st[txt_key])
# ---------- end py ----------
panel_2 = Panel(py.out)

ur_port = ValueList({"30002"}, selected="30002")
ext_port = ValueList({"50003", "50004"}, selected="50004")

# ----
# --> Set your IP address
# --> Set robot IP address
server_ip = ValueList({"192.168.10.44", "192.168.10.12", "192.168.10.11", "192.168.10.10", "192.168.10.2", "127.0.0.1", "192.168.10.111", "192.168.0.30"}, selected="192.168.10.11")
ur_ip_2 = ValueList({"192.168.10.10", "192.168.10.20", "192.168.10.11", "192.168.10.12", "127.0.0.1", "192.168.10.111", "192.168.0.30"}, selected="192.168.10.20")
server_port = ValueList({"50002", "50003", "50004", "50005"}, selected="50002")
ur_port_2 = ValueList({"30002"}, selected="30002")
# 2.
globals = PythonScript(
    server_address=server_ip,
    server_port=server_port,
    ur_ip_1=ur_ip_2,
    ur_ip_2=ur_ip,
    ur_port_1=ur_port_2,
    ur_port_2=ur_port,
    ext_ip=ext_ip,
    ext_port=ext_port,
    clear=Button())  # inputs server_port: Int32
# ---------- globals: Python ----------
from scriptcontext import sticky as st

st["server_address"] = server_address
st["server_port"] = server_port

st["ur_ip_1"] = ur_ip_1
st["ur_port_1"] = ur_port_1

st["ur_ip_2"] = ur_ip_2
st["ur_port_2"] = ur_port_2

st["ext_ip"] = ext_ip
st["ext_port"] = ext_port


if clear:
    st.clear()
# ---------- end globals ----------

# ----
# Check if UR robot
#  is available
ping_2 = Button()
py_2 = PythonScript(ip=ur_ip_2, ping=ping_2)  # -> out, trigger; same code as py
panel_3 = Panel(py_2.out)

py_3 = PythonScript()  # -> DATA
# ---------- py_3: Python ----------
import os

#package_path = os.path.dirname(mobile_additive_manufacturing.__file__)
#DATA = os.path.abspath(os.path.join(package_path,"../../data"))

package_path = ghdoc.Path
# package_path = os.path.dirname(ur_fabrication_control.__file__)
DATA = os.path.abspath(os.path.join(package_path,"../../data"))

print(package_path)
print(DATA)
# ---------- end py_3 ----------
py_4 = PythonScript()  # -> DATA
# ---------- py_4: Python ----------
import os

#package_path = os.path.dirname(mobile_additive_manufacturing.__file__)
#DATA = os.path.abspath(os.path.join(package_path,"../../data"))

package_path = ghdoc.Path
# package_path = os.path.dirname(ur_fabrication_control.__file__)
DATA = os.path.abspath(os.path.join(package_path,"../../../ur_fabrication_control/data"))

print(package_path)
print(DATA)
# ---------- end py_4 ----------
list = ValueList({"ur3.urdf", "ur3_rot.urdf", "ur5.urdf", "ur10.urdf", "ur3e.urdf", "ur5e.urdf", "ur10e.urdf", "ur10e_rot.urdf"}, selected="ur10e_rot.urdf")
list_2 = ValueList({"ur3.urdf", "ur3_rot.urdf", "ur5.urdf", "ur10.urdf", "ur3e.urdf", "ur5e.urdf", "ur10e.urdf", "ur10e_rot.urdf"}, selected="ur10e_rot.urdf")
list_3 = ValueList({"ur3.srdf", "ur5.srdf", "ur10.srdf", "ur3e.srdf", "ur5e.srdf", "ur10e.srdf"}, selected="ur10e.srdf")
list_4 = ValueList({"ur3.srdf", "ur5.srdf", "ur10.srdf", "ur3e.srdf", "ur5e.srdf", "ur10e.srdf"}, selected="ur10e.srdf")
py_5 = PythonScript()  # -> DATA
# ---------- py_5: Python ----------
import os
import ur_fabrication_control

package_path = ghdoc.Path
# package_path = os.path.dirname(ur_fabrication_control.__file__)
DATA = os.path.abspath(os.path.join(package_path,"../../../ur_fabrication_control/data"))
print(package_path)
print(DATA)
# ---------- end py_5 ----------

# ----
# Robot Model
# Load Model
list_5 = ValueList({"ur_description", "ur_e_description", "ur_setups"}, selected="ur_e_description")
py_6 = PythonScript(data_path=py_5, package=list_5, urdf_name=list, srdf_name=list_3)  # -> loaders, urdf_filename, srdf_filename
# ---------- py_6: Python ----------
import os
from compas.robots import LocalPackageMeshLoader

path = os.path.join(data_path, "robot_description")

#loaders
packages = ["ur_description", "ur_e_description", "ur_end_effectors", "ur_setups"]
loaders = [LocalPackageMeshLoader(path, pck) for pck in packages]

#files
package_path = os.path.join(path, package)
print package_path

urdf_filename = os.path.join(package_path, "urdf", urdf_name)
srdf_filename = os.path.join(package_path, srdf_name)

assert os.path.isfile(urdf_filename)
assert os.path.isfile(srdf_filename)
# ---------- end py_6 ----------
load = Button()
units = ValueList({"m": 1, "cm": 100, "mm": 1000}, selected="m")
create = PythonScript(load=load, loaders=py_6.loaders, urdf_filename=py_6.urdf_filename, srdf_filename=py_6.srdf_filename, scale_factor=units)  # -> out, robot; inputs load: Boolean, loaders: list
# ---------- create: Python ----------
import os
from scriptcontext import sticky as st

import compas

from compas.robots import RobotModel
from compas.robots import LocalPackageMeshLoader

from compas_fab.robots import Robot
from compas_fab.robots import RobotSemantics
from compas_fab.ghpython import RobotArtist

compas.PRECISION = '12f'

# store robot in component
guid = str(ghenv.Component.InstanceGuid)
robot_key = "robot_1"

if robot_key not in st:
    st[robot_key] = None

print loaders
if load:
    model = RobotModel.from_urdf_file(urdf_filename)
    
    model.load_geometry(*loaders)
    artist = RobotArtist(model)
    semantics = RobotSemantics.from_srdf_file(srdf_filename, model)
    robot = Robot(model, artist, semantics, client=None)
    
    st[robot_key] = robot

robot = st[robot_key]


if robot:
    robot.scale(scale_factor)
# ---------- end create ----------
robot = Data(create.robot)

# ----
# Tool
# 2.
list_6 = ValueList({"measurement_tool": 0, "clay_extruder_7mm": 1, "clay_extruder_7mm_unit_x": 2}, selected="clay_extruder_7mm")
panel_4 = Panel("Attach a custom tool")
show = BooleanToggle(False)
python = PythonScript(data_path=py_3, tool=list_6, show=show)  # -> tool, M
# ---------- python: Python ----------
import os, math
from compas.geometry import Frame, Rotation
from compas.datastructures import Mesh
from compas_ghpython.artists import MeshArtist
from compas_fab.robots import Tool

tolerance = 0

if tool == 0:
    filename = 'measurement_tool_zaxis.stl'
    ee_frame = Frame([0, 0, 0.109], [1, 0, 0], [0, 1, 0])

elif tool == 1:
    filename = 'clay_extruder_7mm.stl'
    # real frame:
    ee_frame = Frame([-0.000502, -0.105348, 0.0662,], [1, 0, 0], [0, 0, 1])
    
    # test frame:
    # ee_frame = Frame([0.0, 0.0, 0.1,], [1, 0, 0], [0, 1, 0])
elif tool == 2:
    filename = 'clay_extruder_7mm_unit_x.stl'
    # non-rotated frame:
    ee_frame = Frame([0.0662, 0.000502, 0.105348], [1, 0, 0], [0, 1, 0])


data_path = os.path.join(data_path, "tool_geometry")
fullfilename = os.path.join(data_path, filename)
print fullfilename

ee_mesh = Mesh.from_stl(fullfilename)

#R = Rotation.from_axis_and_angle(ee_frame.zaxis, math.radians(180), point=ee_frame.point)
#ee_frame.transform(R)

if show:
    artist = MeshArtist(ee_mesh)
    M = artist.draw()

tool = Tool(ee_mesh, ee_frame)
# ---------- end python ----------
py_7 = PythonScript(robot=robot, tool=python.tool, attach=Toggle(True))  # -> a
# ---------- py_7: Python ----------
if attach:
    robot.attach_tool(tool)
else:
    robot.detach_tool()
# ---------- end py_7 ----------

py_8 = PythonScript()  # -> DATA; same code as py_5

# ----
# Robot Model
# Load Model
list_7 = ValueList({"ur_description", "ur_e_description", "ur_setups"}, selected="ur_e_description")
py_9 = PythonScript(data_path=py_8, package=list_7, urdf_name=list_2, srdf_name=list_4)  # -> loaders, urdf_filename, srdf_filename; same code as py_6
load_2 = Button()
units_2 = ValueList({"m": 1, "cm": 100, "mm": 1000}, selected="m")
create_2 = PythonScript(
    load=load_2,
    loaders=py_9.loaders,
    urdf_filename=py_9.urdf_filename,
    srdf_filename=py_9.srdf_filename,
    scale_factor=units_2)  # -> out, robot; inputs load: Boolean, loaders: list
# ---------- create_2: Python ----------
import os
from scriptcontext import sticky as st

import compas

from compas.robots import RobotModel
from compas.robots import LocalPackageMeshLoader

from compas_fab.robots import Robot
from compas_fab.robots import RobotSemantics
from compas_fab.ghpython import RobotArtist

compas.PRECISION = '12f'

# store robot in component
guid = str(ghenv.Component.InstanceGuid)
robot_key = "robot_2"

if robot_key not in st:
    st[robot_key] = None

print loaders
if load:
    model = RobotModel.from_urdf_file(urdf_filename)
    
    model.load_geometry(*loaders)
    artist = RobotArtist(model)
    semantics = RobotSemantics.from_srdf_file(srdf_filename, model)
    robot = Robot(model, artist, semantics, client=None)
    
    st[robot_key] = robot

robot = st[robot_key]


if robot:
    robot.scale(scale_factor)
# ---------- end create_2 ----------
robot_2 = Data(create_2.robot)

# ----
# Tool
list_8 = ValueList({"measurement_tool": 0, "clay_extruder_7mm": 1, "clay_extruder_7mm_unit_x": 2, "airpick": 3}, selected="airpick")
show_2 = BooleanToggle(False)
python_2 = PythonScript(data_path=py_4, tool=list_8, show=show_2)  # -> tool, M
# ---------- python_2: Python ----------
import os, math
from compas.geometry import Frame, Rotation
from compas.datastructures import Mesh
from compas_ghpython.artists import MeshArtist
from compas_fab.robots import Tool

tolerance = 0

if tool == 0:
    filename = 'measurement_tool_zaxis.stl'
    ee_frame = Frame([0, 0, 0.109], [1, 0, 0], [0, 1, 0])

elif tool == 1:
    filename = 'clay_extruder_7mm.stl'
    # real frame:
    ee_frame = Frame([-0.000502, -0.105348, 0.0662,], [1, 0, 0], [0, 0, 1])
    
    # test frame:
    # ee_frame = Frame([0.0, 0.0, 0.1,], [1, 0, 0], [0, 1, 0])
elif tool == 2:
    filename = 'clay_extruder_7mm_unit_x.stl'
    # non-rotated frame:
    ee_frame = Frame([0.0662, 0.000502, 0.105348], [1, 0, 0], [0, 1, 0])

elif tool == 3:
    filename = 'measurement_tool_zaxis.stl'
    ee_frame = Frame([0, 0, 0.0915], [1, 0, 0], [0, 1, 0])
    
data_path = os.path.join(data_path, "tool_geometry")
fullfilename = os.path.join(data_path, filename)
print fullfilename

ee_mesh = Mesh.from_stl(fullfilename)

#R = Rotation.from_axis_and_angle(ee_frame.zaxis, math.radians(180), point=ee_frame.point)
#ee_frame.transform(R)

if show:
    artist = MeshArtist(ee_mesh)
    M = artist.draw()

tool = Tool(ee_mesh, ee_frame)
# ---------- end python_2 ----------
py_10 = PythonScript(robot=robot_2, tool=python_2.tool, attach=Toggle(True))  # -> a; same code as py_7

# ----
# Info
info = PythonScript(robot=robot)  # -> out, main_group_name
# ---------- info: Python ----------
if robot:
    robot.info()
    main_group_name = robot.main_group_name
# ---------- end info ----------
panel_6 = Panel(info.out)

# ----
# Info
info_2 = PythonScript(robot=robot_2)  # -> out, main_group_name; same code as info
panel_7 = Panel(info_2.out)

data = Data()

# ---- group: forward kinematics
a3 = Slider(90, range=-360..360)
a4 = Slider(0, range=-360..360)
a6 = Slider(0, range=-360..360)
# Configuration
a1 = Slider(0, range=-360..360)
a2 = Slider(-90, range=-360..360)
a5 = Slider(90, range=-360..360)
jp = GhPythonScript()  # -> joint_positions
# ---------- jp: Python ----------
import math

joint_positions = [0,-90,90,0,90,0]
joint_positions = [math.radians(a) for a in joint_positions]
#joint_positions = [-3.136, -0.328, -1.218, 3.129, 0.852, 0.008]
#joint_positions = [0] * 6



#joint_positions = [1.6239667567485938, 0.25439606475392273, 4.409424838594969-2*3.14, 3.1901607306255908, 1.5707963267948954, 0.053170429953696939]
#joint_positions = [1.598543436748912, 0.23021224965157744, 4.712232135219824-2*3.14, 6.0531299026928744, 4.7123889803846915, 0.027747109954015234]
#joint_positions = [-1.1373533430447322, 4.0117247163121572, 5.4083762087596021-2*3.14, 1.5754733624925168, 4.7123889803846879, 3.5750356373399574]
print joint_positions
# ---------- end jp ----------
forward_kinematics = PythonScript(robot=robot, set_joint_positions=Button(), joint_positions=jp, a1=a1, a2=a2, a3=a3, a4=a4, a5=a5, a6=a6)  # -> full_configuration; inputs joint_positions: list
# ---------- forward_kinematics: Python ----------
import math
import Grasshopper
from compas.robots import Joint
from compas_fab.robots import Configuration

if set_joint_positions:

    j = 0
    for i in range(ghenv.Component.Params.Input.Count):
        nslider = ghenv.Component.Params.Input[i].Sources[0]
        if nslider.GetType() == Grasshopper.Kernel.Special.GH_NumberSlider:
            nslider.TrySetSliderValue(math.degrees(joint_positions[j]))
            j += 1

if robot:
    joint_positions = [a1, a2, a3, a4, a5, a6]
    joint_types = robot.get_configurable_joint_types()
    for i, joint_type in enumerate(joint_types):
        if joint_type == Joint.REVOLUTE:
            joint_positions[i] = math.radians(joint_positions[i])
    full_configuration = Configuration(joint_positions, joint_types)
    
print(full_configuration)
# ---------- end forward_kinematics ----------

a3_2 = Slider(90, range=-360..360)
a4_2 = Slider(0, range=-360..360)
a6_2 = Slider(0, range=-360..360)
# Configuration
a1_2 = Slider(0, range=-360..360)
a2_2 = Slider(-90, range=-360..360)
a5_2 = Slider(90, range=-360..360)
jp_2 = GhPythonScript()  # -> joint_positions; same code as jp
forward_kinematics_2 = PythonScript(robot=robot_2, set_joint_positions=Button(), joint_positions=jp_2, a1=a1_2, a2=a2_2, a3=a3_2, a4=a4_2, a5=a5_2, a6=a6_2)  # -> full_configuration; inputs joint_positions: list; same code as forward_kinematics

# ----
plane_nr = Slider(3, range=0..20)
plane_nr_2 = Slider(3, range=0..20)
pln = Plane(Plane(origin=(-0.7542, -0.173498, 0.568652), x=(0, -1, 0), y=(-1, 0, 0)))

# ---- group: inverse kinematics
select_configuration = Slider(0, range=0..7)
inverse = PythonScript(robot=robot_2, group=info_2.main_group_name, plane_WCS=pln, idx=select_configuration)  # -> out, plane_tool0_RCS, plane_tcp_RCS, configuration; inputs plane_WCS: Plane, idx: Int32
# ---------- inverse: Python ----------
import Rhino.Geometry as rg
import math
from compas.geometry import Frame, Transformation, Rotation
from compas_fab.robots import Configuration
from ur_fabrication_control.kinematics.ur_kinematics import inverse_kinematics
from ur_fabrication_control.kinematics.ur_params import ur_params
from compas_ghpython import draw_frame

tcp_WCS = Frame(plane_WCS.Origin, plane_WCS.XAxis, plane_WCS.YAxis)

# transform frame to robot coordinate system
print tcp_WCS
print plane_WCS
tcp_RCS = robot.to_local_coordinates(tcp_WCS)
tool0_RCS = robot.from_tcf_to_t0cf([tcp_RCS])[0]
tool0_RCS_rot = Frame(tool0_RCS.point, tool0_RCS.zaxis, tool0_RCS.yaxis)
print tcp_RCS
print tool0_RCS
plane_tool0_RCS = draw_frame(tool0_RCS)
plane_tcp_RCS = draw_frame(tcp_RCS)
# calculate solutions to frame
ur_params = ur_params[robot.name] # get the parameters according to the robot model
print ur_params
solutions = inverse_kinematics(tool0_RCS, ur_params)
print solutions

if not len(solutions):
    joint_values = [0,0,0,0,0,0]
    configuration = Configuration.from_revolute_values(joint_values)
else:
    joint_values = solutions[idx]
    #print joint_values
    
    ### ***** HACK ***** ##### TODO: CHECK!!!
    for i, v in enumerate(joint_values):
        if v > math.pi:
            v -= 2*math.pi
        if v < -math.pi:
            v += 2*math.pi
        joint_values[i] = v
    ### ***** HACK ***** ##### TODO: CHECK!!!
    configuration = [Configuration.from_revolute_values(joint_values)]

print(configuration)
# ---------- end inverse ----------

# ---- group: Visualise
list_9 = ValueList({"20", "50", "100", "500", "1000", "5000"}, selected="20")
back = Button()
reset = Button()
start = Button()
stop = Button()
step = Button()
full = Button()

list_10 = ValueList({"20", "50", "100", "500", "1000", "5000"}, selected="20")
back_2 = Button()
reset_2 = Button()
start_2 = Button()
stop_2 = Button()
step_2 = Button()
full_2 = Button()

# 1. Visualise the entire assembly.
# 2. Visualise the assembly process by setting a counter and a speed.
counter = CountThroughList(am_model=data, start=start, stop=stop, step=step, step_back=back, reset=reset, full=full, interval=list_9)  # -> item, counter; inputs start: Boolean, stop: Boolean, step_back: Boolean
# ---------- counter: Python ----------
from scriptcontext import sticky as st
from compas_ghpython import update_component


L = list(am_model.layers())
# store data in component
guid = str(ghenv.Component.InstanceGuid)
counter_key = "counter_" + guid
running_key = "running_" + guid

if counter_key not in st:
    st[counter_key] = 0

if running_key not in st:
    st[running_key] = False
    

if st[running_key]:
    if st[counter_key] < len(L) - 1:
        st[counter_key] += 1
        update_component(ghenv, interval)
    else:
        st[counter_key] = 0
        st[running_key] = False
    
    
if start:
    st[running_key] = True

if stop:
    st[running_key] = False

if step:
    if st[counter_key] < len(L) - 1:
        st[counter_key] += 1

if step_back:
    if st[counter_key] < len(L) - 1:
        st[counter_key] -= 1

if reset:
    st[counter_key] = 0

if full:
    st[counter_key] = len(L)-1

if len(L):
    item = L[st[counter_key]]



#st["visualisation_counter"] = st[counter_key]
counter = st[counter_key]
# ---------- end counter ----------
show_3 = BooleanToggle(True)
show_4 = BooleanToggle(False)
idx = Panel(counter.counter)
draw = PythonScript(am_model=data, show_all=show_3, show_counter=show_4, counter=idx)  # -> G, tool_planes_WCS, current_tool_plane, current_layer_planes; inputs counter: Int32
# ---------- draw: Python ----------
import os
import sys

import math

from compas_ghpython.artists import MeshArtist
from compas_ghpython import draw_frame

#from assembly_information_model.artist import AssemblyArtist


G = []

key_index = am_model.network.key_index()
keys = [key_index[key] for key in am_model.network.nodes()]
layers = [am_model.layer(key) for key in keys] 

tool_planes_WCS = [draw_frame(layer.node(0).frame) for layer in layers]

current_tool_plane = tool_planes_WCS[counter]
current_layer_planes = [draw_frame(frame) for frame in layers[counter].path]

if show_all and not show_counter:
    for layer in layers:
        for key, node in layer.nodes():
            plane = draw_frame(node.frame)
            G.append(plane)

if show_counter:
    for layer in layers[0:counter+1]:
        for key, node in layer.nodes():
            plane = draw_frame(node.frame)
            G.append(plane)
# ---------- end draw ----------
geo = Geometry(draw.G)
pln_2 = Plane(draw.current_tool_plane)
pln_3 = Plane(draw.tool_planes_WCS)
pln_4 = Plane(draw.current_layer_planes)
preview = CustomPreview(Geometry=geo, Shader=ColourSwatch(SwatchColor=RGBA(255, 186, 220, 146)))

# ---- group: inverse kinematics
select_configuration_2 = Slider(0, range=0..7)
inverse_2 = PythonScript(robot=robot, planes_WCS=pln_4, plane_nr=plane_nr, idx=select_configuration_2)  # -> out, plane_tool0_RCS, plane_tcp_RCS, configuration; inputs planes_WCS: list of Plane, plane_nr: Int32, idx: Int32
# ---------- inverse_2: Python ----------
import Rhino.Geometry as rg
import math
from compas.geometry import Frame, Transformation, Rotation
from compas_fab.robots import Configuration
from ur_fabrication_control.kinematics.ur_kinematics import inverse_kinematics
from ur_fabrication_control.kinematics.ur_params import ur_params
from compas_ghpython import draw_frame

plane_WCS = planes_WCS[plane_nr]

tcp_WCS = Frame(plane_WCS.Origin, plane_WCS.XAxis, plane_WCS.YAxis)

# transform frame to robot coordinate system
tcp_RCS = robot.to_local_coordinates(tcp_WCS)
tool0_RCS = robot.from_tcf_to_t0cf([tcp_RCS])[0]

print tcp_RCS
print tool0_RCS
plane_tool0_RCS = draw_frame(tool0_RCS)
plane_tcp_RCS = draw_frame(tcp_RCS)
# calculate solutions to frame
ur_params = ur_params[robot.name] # get the parameters according to the robot model
solutions = inverse_kinematics(tool0_RCS, ur_params)

if not len(solutions):
    joint_values = [0,0,0,0,0,0]
    configuration = Configuration.from_revolute_values(joint_values)
else:
    joint_values = solutions[idx]
    #print joint_values
    
    ### ***** HACK ***** ##### TODO: CHECK!!!
    for i, v in enumerate(joint_values):
        if v > math.pi:
            v -= 2*math.pi
        if v < -math.pi:
            v += 2*math.pi
        joint_values[i] = v
    ### ***** HACK ***** ##### TODO: CHECK!!!
    
    configuration = [Configuration.from_revolute_values(joint_values)]

print(configuration)
# ---------- end inverse_2 ----------

# ----
pln_5 = Plane(pln_2)

# ---- group: inverse kinematics
select_configuration_3 = Slider(0, range=0..7)
inverse_3 = PythonScript(robot=robot, group=info.main_group_name, plane_WCS=pln_5, idx=select_configuration_3)  # -> out, plane_tool0_RCS, plane_tcp_RCS, configuration; inputs plane_WCS: Plane, idx: Int32; same code as inverse

# ----
# Fabrication
ur_speed = Slider(0.004, range=0..1)
ext_accel = Slider(200, range=0..1000)
ext_speed = Slider(800, range=0..1600)
# 5.
safe_level = Slider(0, range=0..1)
send = Button()
single_layer = GhPythonScript(
    am_model=data,
    robot=robot,
    counter=idx,
    safe_level=safe_level,
    ur_speed=ur_speed,
    ext_speed=ext_speed,
    ext_accel=ext_accel,
    include_extruder=Toggle(True))  # -> out, ur_script, script; inputs counter: Int32
# ---------- single_layer: Python ----------
from scriptcontext import sticky as st

import sys, os
am_hackathon_path = os.path.abspath(os.path.join(ghdoc.Path,"../../src"))
if am_hackathon_path not in sys.path:
    sys.path.append(am_hackathon_path)
    
from compas.geometry import Translation
from compas.geometry import Vector
from compas_ghpython import update_component
from am_hackathon.control import URScript_Extrusion

ur_ip = st["ur_ip"]
ur_port = st["ur_port"]
ext_ip = st["ext_ip"]
ext_port = st["ext_port"]

layers = [layer for key, layer in am_model.layers()]
ur_script = URScript_Extrusion(ur_ip=ur_ip, ur_port=ur_port, ext_ip=ext_ip, ext_port=ext_port)

def get_frames_in_RCS(frames):
    return [robot.to_local_coordinates(frame) for frame in frames]

def get_ur_script(layer):
    tool_angle_axis = list(robot.attached_tool.frame.point) + list(robot.attached_tool.frame.axis_angle_vector)
    ur_script.start()
    ur_script.set_tcp(tool_angle_axis)
    if include_extruder:
        ur_script.open_socket_extruder()
        ur_script.set_extruder_data(speed=ext_speed, acceleration=ext_accel)
        #ur_script.toggle_fan(state=1)
        ur_script.toggle_air(state=1)
    RCS_frames = get_frames_in_RCS([node.frame for key, node in layer.nodes()])
    T = Translation.from_vector(Vector(0,0,safe_level))
    safeframe_start = RCS_frames[0].transformed(T)
    safeframe_end = RCS_frames[-1].transformed(T)
    ur_script.move_linear(safeframe_start, velocity=ur_speed*25, radius=0)
    first = False
    for key, node in layer.nodes():
        if not first:
            ur_script.move_linear(robot.to_local_coordinates(node.frame), velocity=ur_speed*10, radius=node.radius)
            first = True
            if include_extruder:
                ur_script.toggle_drv8825(state=1)
                ur_script.add_line('\tsleep(1)')
                ur_script.toggle_extruder(state=1)
                ur_script.add_line('\tsleep(1)')
        else:
            ur_script.move_process(robot.to_local_coordinates(node.frame), ur_speed, node.radius)
    if include_extruder:
        ur_script.toggle_extruder(state=0)
        ur_script.add_line('\tsleep(1)')
        ur_script.toggle_drv8825(state=0)
    ur_script.move_linear(safeframe_end, velocity=ur_speed*25, radius=0)
    if include_extruder:
        ur_script.toggle_air(state=0)
        #ur_script.toggle_fan(state=0)
        ur_script.add_line('\tsleep(1)')
        ur_script.close_socket_extruder()
    ur_script.end()
    ur_script.generate()
    return ur_script


ur_script = get_ur_script(layers[counter])

script = ur_script.script
# ---------- end single_layer ----------
send_script = GhPythonScript(ur_script=single_layer.ur_script, send=send)  # -> out, a
# ---------- send_script: Python ----------
__author__ = "Gido"
__version__ = "2020.01.14"

if send:
    ur_script.send_script()
# ---------- end send_script ----------
panel_8 = Panel(single_layer.script)

# ----
# 4.
list_11 = ValueList({"0 forward_kinematics": 0, "1 inverse_kinematics": 1, "2 inverse_kinematics": 2}, selected="2 inverse_kinematics")
filter = StreamFilter(Gate=list_11, Stream0=forward_kinematics, Stream1=inverse_3.configuration, Stream2=inverse_2.configuration)

# ----
# Visualisation
show_end_effector_frame = BooleanToggle(True)
show_base_frame = BooleanToggle(True)
show_collision = BooleanToggle(False)
show_frames = BooleanToggle(True)
show_visual = BooleanToggle(True)
show_acm = BooleanToggle(False)
visualize = PythonScript(
    robot=robot,
    tool=python.tool,
    group=info.main_group_name,
    configuration=filter,
    redraw=py_7,
    show_visual=show_visual,
    show_collision=show_collision,
    show_end_effector_frame=show_end_effector_frame,
    show_frames=show_frames,
    show_base_frame=show_base_frame,
    show_acm=show_acm)  # -> out, robot, visual, collision, attached_meshes, frames, ee_frame, tool0_frame, base_frame; inputs redraw: list, attached_collision_meshes: list
# ---------- visualize: Python ----------
from compas.geometry import Vector
from compas.geometry import Point
from compas.geometry import Transformation
from compas.geometry import Frame
from compas_ghpython.artists import MeshArtist
from compas_fab.robots import Configuration
from ur_fabrication_control.kinematics.ur_kinematics import forward_kinematics
from ur_fabrication_control.kinematics.ur_params import ur_params

print(configuration)

if robot and configuration:
    
    robot.update(configuration, visual=show_visual, collision=show_collision)
    ur_params = ur_params[robot.name]
    
    if show_visual:
        visual = robot.artist.draw_visual()

    if show_collision:
        collision = robot.artist.draw_collision()
    
    frames = robot.transformed_frames(configuration, group)

    if show_base_frame:
        base_frame = frames[0]

    if show_end_effector_frame:
        tool0_frame = forward_kinematics(configuration.revolute_values, ur_params)
#        tool0_frame = robot.forward_kinematics(configuration, group)
        print tool0_frame
        ee_frame = robot.from_t0cf_to_tcf([tool0_frame])
        print("End-effector", ee_frame)
    
    if not show_frames:
        frames = None

    frame = forward_kinematics(configuration.revolute_values, ur_params)
#    frame = robot.forward_kinematics(configuration, options=dict(solver='model', link_name=robot.attached_tool.link_name))
    robot.artist.update_tool(visual=visual, collision=collision, transformation=Transformation.from_frame_to_frame(Frame.worldXY(), tool0_frame))
    
    if show_acm:
        M = []
        for acm in attached_collision_meshes:
            frame = robot.forward_kinematics(configuration, options=dict(solver='model', link_name=acm.link_name))
            T = Transformation.from_frame_to_frame(Frame.worldXY(), frame)
            mesh = acm.collision_mesh.mesh.transformed(T)
            M.append(MeshArtist(mesh).draw())
        attached_meshes = M
# ---------- end visualize ----------
geo_2 = Geometry(visualize.visual)
geo_3 = Geometry(visualize.collision)
draw_2 = GhPythonScript(
    frames=[visualize.frames, visualize.ee_frame, visualize.base_frame, visualize.tool0_frame],
    scale=Slider(0.1, range=0..1))  # -> P, V, C, W; inputs frames: list
# ---------- draw_2: Python ----------
from System.Drawing import Color
from compas_ghpython.utilities import draw_frame

red = Color.FromArgb(255, 0, 0)
green = Color.FromArgb(0, 255, 0)
blue = Color.FromArgb(0, 0, 255)

P = []
V = []
C = []

scale = float(scale)

for frame in frames:
    if not frame:
        continue
    plane = draw_frame(frame)
    P += [plane.Origin] * 3
    V.append(plane.XAxis * scale)
    V.append(plane.YAxis * scale)
    V.append(plane.ZAxis * scale)
    C += [red, green, blue]

W = 3
# ---------- end draw_2 ----------
vdisex = VectorDisplayEx(Point=draw_2.P, Vector=draw_2.V, Colour=draw_2.C, Width=draw_2.W)
preview_2 = CustomPreview(Geometry=geo_2, Shader=ColourSwatch(SwatchColor=RGB(105, 105, 105)))
preview_3 = CustomPreview(Geometry=visualize.attached_meshes, Shader=ColourSwatch(SwatchColor=RGB(255, 255, 255)))

# ---- group: Visualise
# 1. Visualise the entire assembly.
# 2. Visualise the assembly process by setting a counter and a speed.
counter_2 = CountThroughList(am_model=data, start=start_2, stop=stop_2, step=step_2, step_back=back_2, reset=reset_2, full=full_2, interval=list_10)  # -> item, counter; inputs start: Boolean, stop: Boolean, step_back: Boolean; same code as counter
show_5 = BooleanToggle(True)
show_6 = BooleanToggle(False)
idx_2 = Panel(counter_2.counter)
draw_3 = PythonScript(show_all=show_5, show_counter=show_6, counter=idx_2)  # -> G, tool_planes_WCS, current_tool_plane, current_layer_planes; inputs counter: Int32; same code as draw
geo_4 = Geometry(draw_3.G)
pln_6 = Plane(draw_3.current_tool_plane)
pln_7 = Plane(draw_3.tool_planes_WCS)
pln_8 = Plane(draw_3.current_layer_planes)
preview_4 = CustomPreview(Geometry=geo_4, Shader=ColourSwatch(SwatchColor=RGBA(255, 186, 220, 146)))

# ---- group: inverse kinematics
select_configuration_4 = Slider(0, range=0..7)
inverse_4 = PythonScript(robot=robot_2, planes_WCS=pln_8, plane_nr=plane_nr_2, idx=select_configuration_4)  # -> out, plane_tool0_RCS, plane_tcp_RCS, configuration; inputs planes_WCS: list of Plane, plane_nr: Int32, idx: Int32; same code as inverse_2

# ----
# 4.
list_12 = ValueList({"0 forward_kinematics": 0, "1 inverse_kinematics": 1, "2 inverse_kinematics": 2}, selected="0 forward_kinematics")
filter_2 = StreamFilter(Gate=list_12, Stream0=forward_kinematics_2, Stream1=inverse.configuration, Stream2=inverse_4.configuration)

pln_9 = Plane(Plane(origin=(-1.051779291, -0.9873534711, -0.1400827257), x=(-0.01959243385, -0.999801926, -0.003499332918), y=(0.9997873805, -0.01956940342, -0.006498635332)))

# ----
# Visualisation
show_end_effector_frame_2 = BooleanToggle(True)
show_base_frame_2 = BooleanToggle(True)
show_collision_2 = BooleanToggle(False)
show_frames_2 = BooleanToggle(True)
show_visual_2 = BooleanToggle(True)
show_acm_2 = BooleanToggle(False)
visualize_2 = PythonScript(
    rb_cp=pln_9,
    robot=robot_2,
    tool=python_2.tool,
    group=info_2.main_group_name,
    configuration=filter_2,
    redraw=py_10,
    show_visual=show_visual_2,
    show_collision=show_collision_2,
    show_end_effector_frame=show_end_effector_frame_2,
    show_frames=show_frames_2,
    show_base_frame=show_base_frame_2,
    show_acm=show_acm_2)  # -> out, robot, visual, collision, attached_meshes, frames, ee_frame, tool0_frame, base_frame; inputs redraw: list, attached_collision_meshes: list
# ---------- visualize_2: Python ----------
from compas.geometry import Vector
from compas.geometry import Point
from compas.geometry import Transformation
from compas.geometry import Frame
from compas_rhino.geometry import RhinoMesh
from compas_ghpython.artists import MeshArtist
from compas_fab.robots import Configuration
from ur_fabrication_control.kinematics.ur_kinematics import forward_kinematics
from ur_fabrication_control.kinematics.ur_params import ur_params

print(configuration)

if robot and configuration:
    
    robot.update(configuration, visual=show_visual, collision=show_collision)
    ur_params = ur_params[robot.name]
    
    if show_visual:
        rmesh = robot.artist.draw_visual()
        cmesh = [RhinoMesh.from_geometry(v).to_compas() for v in rmesh]
        rb_cf = Frame(rb_cp.Origin, rb_cp.XAxis, rb_cp.YAxis)
        T_rcs = Transformation.from_frame(rb_cf)
        cmesh_tf = [m.transformed(T_rcs) for m in cmesh]
        artists = [MeshArtist(m) for m in cmesh_tf]
        visual = [a.draw() for a in artists]

    if show_collision:
        collision = robot.artist.draw_collision()
    
    frames = robot.transformed_frames(configuration, group)

    if show_base_frame:
        base_frame = frames[0]

    if show_end_effector_frame:
        tool0_frame = forward_kinematics(configuration.revolute_values, ur_params)
#        tool0_frame = robot.forward_kinematics(configuration, group)
        print tool0_frame
        ee_frame = robot.from_t0cf_to_tcf([tool0_frame])
        print("End-effector", ee_frame)
    
    if not show_frames:
        frames = None

    frame = forward_kinematics(configuration.revolute_values, ur_params)
#    frame = robot.forward_kinematics(configuration, options=dict(solver='model', link_name=robot.attached_tool.link_name))
    robot.artist.update_tool(visual=visual, collision=collision, transformation=Transformation.from_frame_to_frame(Frame.worldXY(), tool0_frame))
    
    if show_acm:
        M = []
        for acm in attached_collision_meshes:
            frame = robot.forward_kinematics(configuration, options=dict(solver='model', link_name=acm.link_name))
            T = Transformation.from_frame_to_frame(Frame.worldXY(), frame)
            mesh = acm.collision_mesh.mesh.transformed(T)
            M.append(MeshArtist(mesh).draw())
        attached_meshes = M
# ---------- end visualize_2 ----------
geo_5 = Geometry(visualize_2.visual)
geo_6 = Geometry(visualize_2.collision)
draw_4 = GhPythonScript(
    frames=[visualize_2.frames, visualize_2.ee_frame, visualize_2.base_frame, visualize_2.tool0_frame],
    scale=Slider(0.1, range=0..1))  # -> P, V, C, W; inputs frames: list; same code as draw_2
vdisex_2 = VectorDisplayEx(Point=draw_4.P, Vector=draw_4.V, Colour=draw_4.C, Width=draw_4.W)
preview_5 = CustomPreview(Geometry=geo_5, Shader=ColourSwatch(SwatchColor=RGB(105, 105, 105)))
preview_6 = CustomPreview(Geometry=visualize_2.attached_meshes, Shader=ColourSwatch(SwatchColor=RGB(255, 255, 255)))

bang_2 = Button()
unload_2 = PythonScript(bang=bang_2)
# ---------- unload_2: Python ----------
from compas_rhino.utilities.misc import get_tolerance
from compas_rhino.utilities.misc import unload_modules

unload_modules("compas")
unload_modules("compas_fab")
unload_modules("ur_fabrication_control")
unload_modules("mobile_additive_manufacturing")
unload_modules("am_information_model")
# ---------- end unload_2 ----------

Z = UnitZ(Factor=Slider(-0.007, range=-1..1))
pln_10 = Plane(PlaneXY(-0.3711756465, -0.9413201081, -0.1263573783))

# ---- group: Only needs to be created once
overwrite = Button()
create_3 = Button()
fabrication = GhPythonScript(create=create_3, overwrite=overwrite)  # -> out, fabrication
# ---------- fabrication: Python ----------
__author__ = "Gido"
__version__ = "2020.01.14"

from scriptcontext import sticky as st
from ur_fabrication_control.direct_control.fabrication_process import Fabrication

server_ip = st["server_address"]
server_port = st["server_port"]

fabrication_key = "fabrication"

if fabrication_key not in st:
    st[fabrication_key] = None

if overwrite and st[fabrication_key] != None:
    fabrication = st[fabrication_key]
    if hasattr(fabrication, 'task_thread') and hasattr(fabrication, 'listen_thread'):
        fabrication._join_threads()

if (create and st[fabrication_key] == None) or overwrite:
    fabrication = Fabrication()
    fabrication.set_feedback_server(server_ip, server_port)
    
    st[fabrication_key] = fabrication

fabrication = st[fabrication_key]
# ---------- end fabrication ----------

# ----
undo_task = Button()
skip_task = Button()
move = Move(Geometry=pln_10, Motion=Z)  # -> Geometry, Transform

# ----
# Continuous fabrication
ur_speed_2 = Slider(0.012, range=0..1)
ext_speed_2 = Slider(1600, range=0..4000)
ext_accel_2 = Slider(4000, range=0..4000)
include_extruder = BooleanToggle(True)
Z_2 = UnitZ(Factor=Slider(0.6, range=0..1))
pln_11 = Plane(Plane(origin=(-0.5724708092, 0.4611080103, -0.4485086044), x=(-0.02249180773, -0.999742404, 0.003040432089), y=(-0.9996669393, 0.02252839569, 0.01258895932)))
create_tasks = Button()
send_data = Button()
start_3 = Button()
stop_3 = Button()
move_2 = Move(Geometry=pln_11, Motion=Z_2)  # -> Geometry, Transform
timer = Timer(Interval=1000, TimerInterval=1000, Target=continuous_operation_multiple_layers)
continuous_operation_multiple_layers = GhPythonScript(
    fabrication=fabrication.fabrication,
    am_model=data,
    am_safety_plane=move_2.Geometry,
    robot_2_cp=pln_9,
    assembly_pickup=move.Geometry,
    robot_1=robot,
    robot_2=robot_2,
    ur_speed=ur_speed_2,
    ext_speed=ext_speed_2,
    ext_maxspeed=ext_accel_2,
    create_tasks=create_tasks,
    send_extruder_data=send_data,
    include_extruder=include_extruder,
    start=start_3,
    stop=stop_3,
    skip_task=skip_task,
    undo_task=undo_task)  # -> out, msgs, states, tasks, exit_msgs, current_task, fabrication; inputs arch_radii: list, arch_layer: list
# ---------- continuous_operation_multiple_layers: Python ----------
from scriptcontext import sticky as st

import sys, os
am_hackathon_path = os.path.abspath(os.path.join(ghdoc.Path,"../../src"))
if am_hackathon_path not in sys.path:
    sys.path.append(am_hackathon_path)

from compas.geometry import Frame
from compas.geometry import Translation
from compas.geometry import Transformation
from compas.geometry import Vector
from compas_ghpython import update_component
from mobile_additive_manufacturing.control import URScript_Extrusion
from mobile_additive_manufacturing.control import set_extruder_data
from ur_fabrication_control.direct_control import URScript
from ur_fabrication_control.direct_control.mixins.airpick_mixins import AirpickMixins
from ur_fabrication_control.direct_control.fabrication_process import Fabrication

ur_ip_1 = st["ur_ip_1"]
ur_port_1 = st["ur_port_1"]
ur_ip_2 = st["ur_ip_2"]
ur_port_2 = st["ur_port_2"]
server_ip = st["server_address"]
server_port = st["server_port"]
ext_ip = st["ext_ip"]
ext_port = st["ext_port"]

safe_level = 0.200
element_num = 1
robot_2_cf = Frame(robot_2_cp.Origin, robot_2_cp.XAxis, robot_2_cp.YAxis)
T_rcf2 = Transformation.from_frame_to_frame(robot_2_cf, Frame.worldXY())

pick_frame = Frame(assembly_pickup.Origin, assembly_pickup.YAxis, assembly_pickup.XAxis)

class URScript_Airpick(URScript, AirpickMixins):
    pass

def create_tasks_from_am_model(am_model):
    for key, layer in am_model.layers():
        if key == 0 or key in arch_layer:
            toggle_extruder = True
        elif key == am_model.number_of_layers()-1:
            toggle_extruder = False
        else:
            toggle_extruder = None
        if key in arch_layer:
            stop_script = get_stop_ur_script(am_safety_plane)
            exit_message = "Element{}_placed".format(arch_layer.index(key))
            assembly_script = get_pick_and_place_ur_script(assembly.element(arch_layer.index(key)), exit_message)
            fabrication.add_task(assembly_script, exit_message)
        exit_message = "Layer{}_completed".format(key)
        layer_urscript = get_layer_ur_script(layer, toggle_extruder, exit_message)
        fabrication.add_task(layer_urscript, exit_message)

def get_frames_in_RCS(frames):
    return [robot_1.to_local_coordinates(frame) for frame in frames]

def get_layer_ur_script(layer, toggle_extruder, exit_message):
    ur_script = URScript_Extrusion(ur_ip=ur_ip_1, ur_port=ur_port_1, ext_ip=ext_ip, ext_port=ext_port)
    tool_angle_axis = list(robot_1.attached_tool.frame.point) + list(robot_1.attached_tool.frame.axis_angle_vector)
    
    ur_script.start()
    ur_script.set_tcp(tool_angle_axis)
    RCS_frames = get_frames_in_RCS([node.frame for key, node in layer.nodes()])
    first = False
    for key, node in layer.nodes():
        if not first:
            ur_script.move_linear(robot_1.to_local_coordinates(node.frame), velocity=ur_speed, radius=node.radius)
            first = True
            if (toggle_extruder == True) and (toggle_extruder != None) and include_extruder:
                toggle_extrusion(ur_script, int(toggle_extruder))
        else:
            ur_script.move_process(robot_1.to_local_coordinates(node.frame), ur_speed, node.radius)
    else:
        if (toggle_extruder == False) and (toggle_extruder != None) and include_extruder:
            toggle_extrusion(ur_script, int(toggle_extruder))
    # Signify ready
    ur_script.socket_open(server_ip, server_port, "Feedbackserver")
    ur_script.socket_send_line_string(exit_message, socket_name="Feedbackserver")
    ur_script.socket_close(name="Feedbackserver")
    #Finalize script
    ur_script.end()
    ur_script.generate()
    return ur_script

def get_pick_and_place_ur_script(element, exit_message):
    tool_angle_axis = list(robot_2.attached_tool.frame.point) + list(robot_2.attached_tool.frame.axis_angle_vector)
    ur_script = URScript_Airpick(ur_ip=ur_ip_2, ur_port=ur_port_2)
    ur_script.start()
    ur_script.add_airpick_commands()
    ur_script.set_tcp(tool_angle_axis)
    vec = [sum(x) for x in zip(assembly_pickup.XAxis*arch_radii[int(exit_message[7])], assembly_pickup.ZAxis*arch_radii[element_num])]
    T1 = Translation.from_vector(vec)
    T2 = Translation.from_vector([0,0,safe_level])
    T3 = Translation.from_vector([0,0,safe_level*2])
    pick_frame_RCS = pick_frame.transformed(T_rcf2)
    pick_frame_elem = pick_frame_RCS.transformed(T1)
    pick_safe_level = pick_frame_elem.transformed(T2)
    tool_frame_RCS = element.tool_frame.transformed(T_rcf2)
    target_safe_level = tool_frame_RCS.transformed(T3)
    
    ur_script.move_linear(pick_safe_level, ur_speed*5, radius=0.1)
    ur_script.move_linear(pick_frame_elem, ur_speed*2)
    ur_script.airpick_on(max_vac=75, min_vac=25)
    ur_script.move_linear(pick_safe_level, ur_speed*5, radius=0.1)
    ur_script.move_linear(target_safe_level, ur_speed*5, radius=0.1)
    ur_script.move_linear(tool_frame_RCS, ur_speed*2)
    ur_script.airpick_off(pressure=80, timeout=5)
    ur_script.move_linear(target_safe_level, ur_speed*5, radius=0.1)
    ur_script.move_linear(pick_safe_level, ur_speed*5, radius=0.1)
    # Signify ready
    ur_script.socket_open(server_ip, server_port, "Feedbackserver")
    ur_script.socket_send_line_string(exit_message, socket_name="Feedbackserver")
    ur_script.socket_close(name="Feedbackserver")
    ur_script.end()
    ur_script.generate()
    return ur_script

def get_stop_ur_script(safety_plane):
    safety_frame_WCS = Frame(safety_plane.Origin, safety_plane.XAxis, safety_plane.YAxis)
    safety_frame_RCS = robot_1.to_local_coordinates(safety_frame_WCS)
    
    ur_script = URScript_Extrusion(ur_ip=ur_ip_1, ur_port=ur_port_1, ext_ip=ext_ip, ext_port=ext_port)
    tool_angle_axis = list(robot_1.attached_tool.frame.point) + list(robot_1.attached_tool.frame.axis_angle_vector)
    
    ur_script.start()
    ur_script.set_tcp(tool_angle_axis)
    if include_extruder:
        toggle_extrusion(ur_script, 0)
    ur_script.move_linear(safety_frame_RCS, velocity=ur_speed, radius=0)
    ur_script.end()
    ur_script.generate()
    return ur_script

def toggle_extrusion(ur_script, state):
    ur_script.open_socket_extruder()
    if state==1:
        ur_script.toggle_fan(state=state)
    ur_script.toggle_air(state=state)
    ur_script.set_extruder_data(state=state, max_speed=ext_maxspeed, speed=ext_speed)
    ur_script.close_socket_extruder()

if create_tasks:
    fabrication.clear_tasks()
    fabrication.stop_task = get_stop_ur_script(am_safety_plane)
    create_tasks_from_am_model(am_model)

if send_extruder_data:
    set_extruder_data(ur_ip, ur_port, ext_ip, ext_port, 0, ext_maxspeed, ext_speed)

if stop:
    fabrication.stop()

if start:
    fabrication.start()

if skip_task:
    skip_key = fabrication.get_next_task()
    fabrication.tasks[skip_key]["state"] = "completed"

if undo_task:
    undo_key = fabrication.get_next_task()-1
    fabrication.tasks[undo_key]["state"] = "waiting"

try:
    fab = fabrication
except NameError:
    fabrication = None
else:
    task_dict = fabrication.tasks.values()
    if fabrication.tasks_available():
        if fabrication.current_task == None:
            task_key_current = fabrication.get_next_task()
        else:
            task_key_current = fabrication.current_task
        current_task = task_dict[task_key_current]["task"].script
    tasks = []
    states = []
    exit_msgs = []
    for task in task_dict:
        tasks.append(task["task"])
        states.append(task["state"])
        exit_msgs.append(task["exit_message"])
    msgs = fabrication.server.msgs.values()
# ---------- end continuous_operation_multiple_layers ----------
server_messages = Panel(continuous_operation_multiple_layers.msgs)
states = Panel(continuous_operation_multiple_layers.states)
current_task = Panel(continuous_operation_multiple_layers.current_task)
tasks = Panel(continuous_operation_multiple_layers.tasks)
exit_message = Panel(continuous_operation_multiple_layers.exit_msgs)

# ----
# Stop
stop_4 = Button()
stop_5 = PythonScript(stop=stop_4)
# ---------- stop_5: Python ----------
from scriptcontext import sticky as st
from ur_fabrication_control.direct_control.common import send_stop

ur_ip = st["ur_ip"]
ur_port = st["ur_port"]

if stop:
    send_stop(ur_ip, ur_port)
# ---------- end stop_5 ----------

# ----
# Stop
stop_6 = Button()
stop_7 = PythonScript(stop=stop_6)  # same code as stop_5

# ----
# Set Digital Out
number = Slider(7, range=0..10)
value = BooleanToggle(True)
digital_out = PythonScript(number=number, value=value)  # -> urscript; inputs number: Int32, value: Boolean
# ---------- digital_out: Python ----------
from ur_fabrication_control.direct_control import URScript

urscript = URScript()
urscript.start()
urscript.add_line("\tset_digital_out({}, {})".format(number, value))
urscript.end()
urscript = urscript.generate()

print(urscript)
# ---------- end digital_out ----------
send_2 = Button()
send_3 = GhPythonScript(urscript=digital_out, send=send_2)  # -> out; inputs send: Boolean
# ---------- send_3: Python ----------
from scriptcontext import sticky as st
from ur_fabrication_control.direct_control import send_script

ur_ip = st["ur_ip"]
ur_port = st["ur_port"]

if send:
    send_script(urscript, ur_ip, ur_port)
# ---------- end send_3 ----------

# ----
# Set Digital Out
number_2 = Slider(7, range=0..10)
value_2 = BooleanToggle(True)
digital_out_2 = PythonScript(number=number_2, value=value_2)  # -> urscript; inputs number: Int32, value: Boolean; same code as digital_out
send_4 = Button()
send_5 = GhPythonScript(urscript=digital_out_2, send=send_4)  # -> out; inputs send: Boolean; same code as send_3

# ----
# Set Extruder data
speed = Slider(1600, range=0..51200)
max_speed = Slider(4000, range=0..51200)
number_3 = Slider(0, range=0..10)
value_3 = BooleanToggle(False)
send_6 = Button()
extruder_data = PythonScript(motor_id=number_3, motor_state=value_3, max_speed=max_speed, speed=speed, send=send_6)  # -> urscript; inputs motor_id: Int32, motor_state: Boolean
# ---------- extruder_data: Python ----------
import time
from scriptcontext import sticky as st
from mobile_additive_manufacturing.control.clay_extruder_control import ExtruderClient

ext_ip = st["ext_ip"]
ext_port = st["ext_port"]

ec = ExtruderClient(ext_ip, ext_port)
wait_for_response = False

if send:
    ec.connect()
    time.sleep(0.2)
    ec.send_motordata(motor_state, max_speed, speed, wait_for_response)
    time.sleep(0.2)
    ec.close()
# ---------- end extruder_data ----------
acceleration = Slider(600, range=0..1000)

# ----
# Get Extruder Info
send_7 = Button()
get_info = PythonScript(send=send_7)  # -> info
# ---------- get_info: Python ----------
import time
from scriptcontext import sticky as st
from mobile_additive_manufacturing.control.clay_extruder_control import ExtruderClient

ext_ip = st["ext_ip"]
ext_port = st["ext_port"]

ec = ExtruderClient(ext_ip, ext_port)
wait_for_response = True

if send:
    ec.connect()
    time.sleep(0.2)
    info = ec.send_get_arduino_info(wait_for_response)
    time.sleep(0.2)
    ec.close()
# ---------- end get_info ----------

# ----
# Direct extruder control
panel_10 = Panel(get_info)

# ----
# Toggle Extruder
value_4 = BooleanToggle(True)
send_8 = Button()
extruder_state = PythonScript(state=value_4, send=send_8)  # -> urscript; inputs state: Boolean
# ---------- extruder_state: Python ----------
import time
from scriptcontext import sticky as st
from mobile_additive_manufacturing.control.clay_extruder_control import ExtruderClient

ext_ip = st["ext_ip"]
ext_port = st["ext_port"]

ec = ExtruderClient(ext_ip, ext_port)
wait_for_response = False

if send:
    ec.connect()
    time.sleep(0.2)
    ec.send_motorstate(0, int(state), wait_for_response)
    time.sleep(0.2)
    ec.close()
# ---------- end extruder_state ----------

# ----
# Get Pose Cartesian
get = Button()
pose = PythonScript(get=get)  # -> pose_cartesian, frame_WCS, plane_WCS
# ---------- pose: Python ----------
from scriptcontext import sticky as st
from ur_fabrication_control.direct_control.common import get_current_pose_cartesian
from compas.geometry import Frame
from compas_ghpython import draw_frame

robot = st["robot_1"]

server_address = st["server_address"]
server_port = st["server_port"]
ur_port = st["ur_port_1"]
ur_ip = st["ur_ip_1"]

# retrieve the current tool frame in axis angle format
if robot.attached_tool:
    tool_angle_axis = list(robot.attached_tool.frame.point) + list(robot.attached_tool.frame.axis_angle_vector)
else:
    tool0_frame = Frame([0, 0, 0], [1, 0, 0], [0, 1, 0])
    tool_angle_axis = list(tool0_frame.point) + list(tool0_frame.axis_angle_vector)

print(tool_angle_axis)

guid = str(ghenv.Component.InstanceGuid)
pose_cartesian_key = "pose_cartesian" + guid


if get:
    st[pose_cartesian_key] = get_current_pose_cartesian(tool_angle_axis, server_address, server_port, ur_ip, ur_port, send=True)

if pose_cartesian_key not in st:
    pose_cartesian = []
else:
    pose_cartesian = st[pose_cartesian_key]

print(pose_cartesian)

# get frame and plane of the current pose cartesian in world coordinates for visualization
if pose_cartesian:
    frame_RCS = Frame.from_axis_angle_vector(axis_angle_vector=pose_cartesian[3:], point=pose_cartesian[:3])
    frame_WCS = robot.to_world_coordinates(frame_RCS)
    plane_WCS  = draw_frame(frame_WCS)
    print frame_RCS
    print frame_WCS
# ---------- end pose ----------
draw_5 = GhPythonScript(frames=pose.frame_WCS, scale=Slider(0.1, range=0..1))  # -> P, V, W; inputs frames: list; same code as draw_2
vdisex_3 = VectorDisplayEx(Point=draw_5.P, Vector=draw_5.V, Colour=RGB(0, 0, 0), Width=draw_5.W)
panel_11 = Panel(pose.pose_cartesian)

# ----
# Move Cartesian
add = Button()
list_13 = ValueList({"send all positions": 0, "send only one position": 1, "from inverse": 2}, selected="from inverse")
clear = Button()
idx_3 = Slider(0, range=0..100)
crv = Curve(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)
hframes = HorizontalFrames(Curve=crv, Count=10)  # -> Frames, Parameters
rec_car = PythonScript(msg=pose.plane_WCS, rec=add, clear=clear)  # -> rec
# ---------- rec_car: Python ----------
from scriptcontext import sticky as st

guid = str(ghenv.Component.InstanceGuid)
recorded_key =  "recorded_" + guid
just_cleared_key = "just_cleared_" + guid


if recorded_key not in st:
    st[recorded_key] = []

if just_cleared_key not in st:
    st[just_cleared_key] = False

if clear:
    st[recorded_key] = []
    st[just_cleared_key] = True
else:
    if len(msg):
        if msg != [None] and not st[just_cleared_key] and rec:
            st[recorded_key].append(msg)
    st[just_cleared_key] = False
        


rec = st[recorded_key]

print rec
# ---------- end rec_car ----------
item = ListItem(List=hframes.Frames, Index=idx_3, Wrap=True)
filter_3 = StreamFilter(Gate=list_13, Stream0=hframes.Frames, Stream1=item, Stream2=rec_car)
radius = Slider(0.5, range=0..0.5)
movel = PythonScript(planes_WCS=pln_5, velocity=Slider(0.075, range=0..0.5), radius=radius)  # -> urscript; inputs planes_WCS: list
# ---------- movel: Python ----------
import Rhino.Geometry as rg
from compas.geometry import Frame
from compas.geometry import Transformation, Rotation
from compas_ghpython import draw_frame
from compas_fab.robots import robot
from ur_fabrication_control import direct_control 
import math

from scriptcontext import sticky as st
from ur_fabrication_control.direct_control import URScript

robot = st["robot"]

# retrieve the current tool frame in axis angle format
if robot.attached_tool:
    tool_angle_axis = list(robot.attached_tool.frame.point) + list(robot.attached_tool.frame.axis_angle_vector)
else:
    tool0_frame = Frame([0, 0, 0], [1, 0, 0], [0, 1, 0])
    tool_angle_axis = list(tool0_frame.point) + list(tool0_frame.axis_angle_vector)

frames_RCS = []
for plane_WCS in planes_WCS:
    frame_WCS = Frame(plane_WCS.Origin, plane_WCS.XAxis, plane_WCS.YAxis)
    frame_RCS = robot.to_local_coordinates(frame_WCS)
    frames_RCS.append(frame_RCS)

urscript = URScript()
urscript.start()
urscript.moves_linear(frames_RCS, velocity, radius)
urscript.end()

urscript = urscript.generate()

print(urscript)
# ---------- end movel ----------
send_9 = Button()
send_10 = GhPythonScript(urscript=movel, send=send_9)  # -> out; inputs send: Boolean; same code as send_3

# ----
# Move Circular
clear_2 = Button()
list_14 = ValueList({"send all positions": 0, "send only one position": 1, "from inverse": 2}, selected="from inverse")
add_2 = Button()
idx_4 = Slider(0, range=0..100)
crv_2 = Curve(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)
hframes_2 = HorizontalFrames(Curve=crv_2, Count=10)  # -> Frames, Parameters
rec_viacar = PythonScript(msg=pose.plane_WCS, rec=add_2, clear=clear_2)  # -> rec; same code as rec_car
item_2 = ListItem(List=hframes_2.Frames, Index=idx_4, Wrap=True)
filter_4 = StreamFilter(Gate=list_14, Stream0=hframes_2.Frames, Stream1=item_2, Stream2=rec_car)
filter_5 = StreamFilter(Gate=list_14, Stream0=hframes_2.Frames, Stream1=item_2, Stream2=rec_viacar)
radius_2 = Slider(0.5, range=0..0.5)
movec = PythonScript(planes_WCS=filter_4, planes_via_WCS=filter_5, velocity=Slider(0.075, range=0..0.5), radius=radius_2)  # -> urscript; inputs planes_WCS: list, planes_via_WCS: list
# ---------- movec: Python ----------
import Rhino.Geometry as rg
from compas.geometry import Frame
from compas.geometry import Transformation, Rotation
from compas_ghpython import draw_frame
from compas_fab.robots import robot
from ur_fabrication_control import direct_control 
import math

from scriptcontext import sticky as st
from ur_fabrication_control.direct_control import URScript

robot = st["robot"]

# retrieve the current tool frame in axis angle format
if robot.attached_tool:
    tool_angle_axis = list(robot.attached_tool.frame.point) + list(robot.attached_tool.frame.axis_angle_vector)
else:
    tool0_frame = Frame([0, 0, 0], [1, 0, 0], [0, 1, 0])
    tool_angle_axis = list(tool0_frame.point) + list(tool0_frame.axis_angle_vector)

frames_RCS = []
for plane_WCS in planes_WCS:
    frame_WCS = Frame(plane_WCS.Origin, plane_WCS.XAxis, plane_WCS.YAxis)
    frame_RCS = robot.to_local_coordinates(frame_WCS)
    frames_RCS.append(frame_RCS)

frames_via_RCS = []
for plane_WCS in planes_via_WCS:
    frame_WCS = Frame(plane_WCS.Origin, plane_WCS.XAxis, plane_WCS.YAxis)
    frame_RCS = robot.to_local_coordinates(frame_WCS)
    frames_via_RCS.append(frame_RCS)

urscript = URScript()
urscript.start()
urscript.moves_circular(frames_via_RCS, frames_RCS, velocity, radius)
urscript.end()

urscript = urscript.generate()

print(urscript)
# ---------- end movec ----------
send_11 = Button()
send_12 = GhPythonScript(urscript=movec, send=send_11)  # -> out; inputs send: Boolean; same code as send_3

# ----
# Move Process
list_15 = ValueList({"send all positions": 0, "send only one position": 1, "from inverse": 2}, selected="from inverse")
idx_5 = Slider(0, range=0..100)
crv_3 = Curve(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)
hframes_3 = HorizontalFrames(Curve=crv_3, Count=10)  # -> Frames, Parameters
item_3 = ListItem(List=hframes_3.Frames, Index=idx_5, Wrap=True)
filter_6 = StreamFilter(Gate=list_15, Stream0=hframes_3.Frames, Stream1=item_3, Stream2=rec_car)
radius_3 = Slider(0.5, range=0..0.5)
movep = PythonScript(planes_WCS=filter_6, velocity=Slider(0.075, range=0..0.5), radius=radius_3)  # -> urscript; inputs planes_WCS: list
# ---------- movep: Python ----------
import Rhino.Geometry as rg
from compas.geometry import Frame
from compas.geometry import Transformation, Rotation
from compas_ghpython import draw_frame
from compas_fab.robots import robot
from ur_fabrication_control import direct_control 
import math

from scriptcontext import sticky as st
from ur_fabrication_control.direct_control import URScript

robot = st["robot"]

# retrieve the current tool frame in axis angle format
if robot.attached_tool:
    tool_angle_axis = list(robot.attached_tool.frame.point) + list(robot.attached_tool.frame.axis_angle_vector)
else:
    tool0_frame = Frame([0, 0, 0], [1, 0, 0], [0, 1, 0])
    tool_angle_axis = list(tool0_frame.point) + list(tool0_frame.axis_angle_vector)

frames_RCS = []
for plane_WCS in planes_WCS:
    frame_WCS = Frame(plane_WCS.Origin, plane_WCS.XAxis, plane_WCS.YAxis)
    frame_RCS = robot.to_local_coordinates(frame_WCS)
    frames_RCS.append(frame_RCS)

urscript = URScript()
urscript.start()
urscript.moves_process(frames_RCS, velocity, radius)
urscript.end()

urscript = urscript.generate()

print(urscript)
# ---------- end movep ----------
send_13 = Button()
send_14 = GhPythonScript(urscript=movep, send=send_13)  # -> out; inputs send: Boolean; same code as send_3

# ----
# Get Pose Cartesian
get_2 = Button()
pose_2 = PythonScript(get=get_2)  # -> pose_cartesian, frame_WCS, plane_WCS
# ---------- pose_2: Python ----------
from scriptcontext import sticky as st
from ur_fabrication_control.direct_control.common import get_current_pose_cartesian
from compas.geometry import Frame
from compas_ghpython import draw_frame

robot = st["robot_2"]

server_address = st["server_address"]
server_port = st["server_port"]
ur_port = st["ur_port_2"]
ur_ip = st["ur_ip_2"]

# retrieve the current tool frame in axis angle format
if robot.attached_tool:
    tool_angle_axis = list(robot.attached_tool.frame.point) + list(robot.attached_tool.frame.axis_angle_vector)
else:
    tool0_frame = Frame([0, 0, 0], [1, 0, 0], [0, 1, 0])
    tool_angle_axis = list(tool0_frame.point) + list(tool0_frame.axis_angle_vector)

print(tool_angle_axis)

guid = str(ghenv.Component.InstanceGuid)
pose_cartesian_key = "pose_cartesian" + guid


if get:
    st[pose_cartesian_key] = get_current_pose_cartesian(tool_angle_axis, server_address, server_port, ur_ip, ur_port, send=True)

if pose_cartesian_key not in st:
    pose_cartesian = []
else:
    pose_cartesian = st[pose_cartesian_key]

print(pose_cartesian)

# get frame and plane of the current pose cartesian in world coordinates for visualization
if pose_cartesian:
    frame_RCS = Frame.from_axis_angle_vector(axis_angle_vector=pose_cartesian[3:], point=pose_cartesian[:3])
    frame_WCS = robot.to_world_coordinates(frame_RCS)
    plane_WCS  = draw_frame(frame_WCS)
    print frame_RCS
    print frame_WCS
# ---------- end pose_2 ----------
draw_6 = GhPythonScript(frames=pose_2.frame_WCS, scale=Slider(0.1, range=0..1))  # -> P, V, W; inputs frames: list; same code as draw_2
vdisex_4 = VectorDisplayEx(Point=draw_6.P, Vector=draw_6.V, Colour=RGB(0, 0, 0), Width=draw_6.W)
panel_12 = Panel(pose_2.pose_cartesian)

# ----
# Move Cartesian
add_3 = Button()
list_16 = ValueList({"send all positions": 0, "send only one position": 1, "from inverse": 2}, selected="from inverse")
clear_3 = Button()
idx_6 = Slider(0, range=0..100)
crv_4 = Curve(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)
hframes_4 = HorizontalFrames(Curve=crv_4, Count=10)  # -> Frames, Parameters
rec_car_2 = PythonScript(msg=pose_2.plane_WCS, rec=add_3, clear=clear_3)  # -> rec; same code as rec_car
item_4 = ListItem(List=hframes_4.Frames, Index=idx_6, Wrap=True)
filter_7 = StreamFilter(Gate=list_16, Stream0=hframes_4.Frames, Stream1=item_4, Stream2=rec_car_2)
radius_4 = Slider(0.5, range=0..0.5)
movel_2 = PythonScript(planes_WCS=pln, velocity=Slider(0.075, range=0..0.5), radius=radius_4)  # -> urscript; inputs planes_WCS: list; same code as movel
send_15 = Button()
send_16 = GhPythonScript(urscript=movel_2, send=send_15)  # -> out; inputs send: Boolean; same code as send_3

# ----
# Move Circular
clear_4 = Button()
list_17 = ValueList({"send all positions": 0, "send only one position": 1, "from inverse": 2}, selected="from inverse")
add_4 = Button()
idx_7 = Slider(0, range=0..100)
crv_5 = Curve(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)
hframes_5 = HorizontalFrames(Curve=crv_5, Count=10)  # -> Frames, Parameters
rec_viacar_2 = PythonScript(msg=pose_2.plane_WCS, rec=add_4, clear=clear_4)  # -> rec; same code as rec_car
item_5 = ListItem(List=hframes_5.Frames, Index=idx_7, Wrap=True)
filter_8 = StreamFilter(Gate=list_17, Stream0=hframes_5.Frames, Stream1=item_5, Stream2=rec_car_2)
filter_9 = StreamFilter(Gate=list_17, Stream0=hframes_5.Frames, Stream1=item_5, Stream2=rec_viacar_2)
radius_5 = Slider(0.5, range=0..0.5)
movec_2 = PythonScript(planes_WCS=filter_8, planes_via_WCS=filter_9, velocity=Slider(0.075, range=0..0.5), radius=radius_5)  # -> urscript; inputs planes_WCS: list, planes_via_WCS: list; same code as movec
send_17 = Button()
send_18 = GhPythonScript(urscript=movec_2, send=send_17)  # -> out; inputs send: Boolean; same code as send_3

# ----
# Move Process
list_18 = ValueList({"send all positions": 0, "send only one position": 1, "from inverse": 2}, selected="from inverse")
idx_8 = Slider(0, range=0..100)
crv_6 = Curve(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)
hframes_6 = HorizontalFrames(Curve=crv_6, Count=10)  # -> Frames, Parameters
item_6 = ListItem(List=hframes_6.Frames, Index=idx_8, Wrap=True)
filter_10 = StreamFilter(Gate=list_18, Stream0=hframes_6.Frames, Stream1=item_6, Stream2=rec_car_2)
radius_6 = Slider(0.5, range=0..0.5)
movep_2 = PythonScript(planes_WCS=filter_10, velocity=Slider(0.075, range=0..0.5), radius=radius_6)  # -> urscript; inputs planes_WCS: list; same code as movep
send_19 = Button()
send_20 = GhPythonScript(urscript=movep_2, send=send_19)  # -> out; inputs send: Boolean; same code as send_3

# ----
# Get Pose Joint
get_3 = Button()
pose_3 = PythonScript(get=get_3)  # -> configuration, pose_joints
# ---------- pose_3: Python ----------
from scriptcontext import sticky as st
from ur_fabrication_control.direct_control.common import get_current_pose_joints
from compas_fab.robots import Configuration


robot = st["robot"]

server_address = st["server_address"]
server_port = st["server_port"]
ur_port = st["ur_port"]
ur_ip = st["ur_ip"]


guid = str(ghenv.Component.InstanceGuid)
pose_joints_key = "pose_joints" + guid


# send script to the robot to receive the current joint configuration
if get:
    st[pose_joints_key] = get_current_pose_joints(server_address, server_port, ur_ip, ur_port, send=True)

if pose_joints_key not in st:
    configuration = Configuration.from_revolute_values([0,0,0,0,0,0])
else:
    configuration = Configuration.from_revolute_values(st[pose_joints_key])

pose_joints = configuration.values
# ---------- end pose_3 ----------
panel_13 = Panel(pose_3.pose_joints)

# ----
# Get Pose Joint
get_4 = Button()
pose_4 = PythonScript(get=get_4)  # -> configuration, pose_joints; same code as pose_3
panel_14 = Panel(pose_4.pose_joints)

# ----
# Set Extruder data
max_speed_2 = Slider(450, range=0..1000)
speed_2 = Slider(300, range=0..1000)
value_5 = BooleanToggle(True)
send_21 = Button()
extruder_data_2 = PythonScript(motor_state=value_5, max_speed=max_speed_2, speed=speed_2, send=send_21)  # -> urscript; inputs motor_state: Int32
# ---------- extruder_data_2: Python ----------
from scriptcontext import sticky as st
from mobile_additive_manufacturing.control.urscript_extrusion import set_extruder_data

ur_ip = st["ur_ip"]
ur_port = st["ur_port"]
ext_ip = st["ext_ip"]
ext_port = st["ext_port"]

if send:
    set_extruder_data(ur_ip, ur_port, ext_ip, ext_port, motor_state, max_speed, speed)
# ---------- end extruder_data_2 ----------

# ----
# Extruder control through UR
# Get Extruder Info
send_22 = Button()
get_info_2 = PythonScript(send=send_22)  # -> info
# ---------- get_info_2: Python ----------
from scriptcontext import sticky as st
from mobile_additive_manufacturing.control.urscript_extrusion import get_extruder_info

ur_ip = st["ur_ip"]
ur_port = st["ur_port"]
ext_ip = st["ext_ip"]
ext_port = st["ext_port"]

if send:
    get_extruder_info(ur_ip, ur_port, ext_ip, ext_port)
# ---------- end get_info_2 ----------

# ----
# Stop Extruder
stop_8 = Button()
stop_9 = PythonScript(stop=stop_8)
# ---------- stop_9: Python ----------
import time
from scriptcontext import sticky as st
from mobile_additive_manufacturing.control.clay_extruder_control import ExtruderClient

ext_ip = st["ext_ip"]
ext_port = st["ext_port"]

ec = ExtruderClient(ext_ip, ext_port)
wait_for_response = False

if stop:
    ec.connect()
    time.sleep(0.2)
    ec.send_stop(wait_for_response)
    time.sleep(0.2)
    ec.close()
# ---------- end stop_9 ----------

# ----
# Toggle Extruder
value_6 = BooleanToggle(True)
send_23 = Button()
extruder_state_2 = PythonScript(state=value_6, send=send_23)  # -> urscript; inputs state: Int32
# ---------- extruder_state_2: Python ----------
from scriptcontext import sticky as st
from mobile_additive_manufacturing.control.urscript_extrusion import toggle_extruder

ur_ip = st["ur_ip"]
ur_port = st["ur_port"]
ext_ip = st["ext_ip"]
ext_port = st["ext_port"]

if send:
    toggle_extruder(ur_ip, ur_port, ext_ip, ext_port, state)
# ---------- end extruder_state_2 ----------

list_19 = ValueList({"30", "32", "34"}, selected="30")

# ----
# Set Extruder Digital Out
value_7 = BooleanToggle(False)
send_24 = Button()
digital_out_3 = PythonScript(pin=list_19, state=value_7, send=send_24)  # -> urscript; inputs pin: Int32, state: Boolean
# ---------- digital_out_3: Python ----------
import time
from scriptcontext import sticky as st
from mobile_additive_manufacturing.control.clay_extruder_control import ExtruderClient

ext_ip = st["ext_ip"]
ext_port = st["ext_port"]

ec = ExtruderClient(ext_ip, ext_port)
wait_for_response = False

if send:
    ec.connect()
    time.sleep(0.2)
    ec.send_set_do(pin, int(state), wait_for_response)
    time.sleep(0.2)
    ec.close()
# ---------- end digital_out_3 ----------

list_20 = ValueList({"30", "32", "34"}, selected="34")

# ----
# Toggle fan
value_8 = BooleanToggle(True)
send_25 = Button()
digital_out_4 = PythonScript(pin=list_20, state=value_8, send=send_25)  # -> urscript; inputs pin: Int32, state: Boolean; same code as digital_out_3

list_21 = ValueList({"30", "32", "34"}, selected="32")

# ----
# Toggle air
value_9 = BooleanToggle(True)
send_26 = Button()
digital_out_5 = PythonScript(pin=list_21, state=value_9, send=send_26)  # -> urscript; inputs pin: Int32, state: Boolean; same code as digital_out_3

# ----
# Calculate Basis - 3-Point Method
# Measure basis:
# 1. Clear the recorded poses
# 2. Move robot to origin and press "get pose"
# 3. Move robot to point in positive x-axis and press "get pose"
# 4. Move robot to an other point in your basis and press "get pose"
# (The further away these positions are, the better)
# 
# 5. Alternatively change the order in the component calc base
# 6. Copy output into base component (TODO: check if it has to be inverted)
list_22 = ValueList({"o, pos.x-axis, xy pl": 0, "o, pos.y-axis, xy pl": 1}, selected="o, pos.x-axis, xy pl")
clear_5 = Button()
rec = PythonScript(msg=pose.pose_cartesian, rec=get, clear=clear_5)  # -> rec; inputs msg: list; same code as rec_car
calc_base = PythonScript(poses=rec, input_type=list_22)  # -> out, base_plane; inputs poses: list
# ---------- calc_base: Python ----------
import Rhino.Geometry as rg
import math


if len(poses) > 2:
    
    O = poses[0]
    P1 = poses[1]
    P2 = poses[2]
    
    if input_type == 0:
        # origin, pt on positive x-axis, pt in xy plane
        origin = rg.Point3d(O[0], O[1], O[2])
        pt_on_xaxis = rg.Point3d(P1[0], P1[1], P1[2])
        pt_in_xyplane = rg.Point3d(P2[0], P2[1], P2[2])
        
        xaxis = pt_on_xaxis - origin
        xaxis.Unitize()
        
        v = pt_in_xyplane - origin
        zaxis = rg.Vector3d.CrossProduct(v, xaxis)
        zaxis.Unitize()
        
        # zaxis must look up!
        if math.acos(rg.Vector3d.ZAxis * zaxis) > math.acos(rg.Vector3d.ZAxis * -zaxis):
            zaxis = -zaxis
        
        yaxis = rg.Vector3d.CrossProduct(zaxis, xaxis)
    
    elif input_type == 1:
        # origin, pt on positive y-axis, pt in xy plane
        origin = rg.Point3d(O[0], O[1], O[2])
        pt_on_yaxis = rg.Point3d(P1[0], P1[1], P1[2])
        pt_in_xyplane = rg.Point3d(P2[0], P2[1], P2[2])
        
        yaxis = pt_on_yaxis - origin
        yaxis.Unitize()
        
        v = pt_in_xyplane - origin
        zaxis = rg.Vector3d.CrossProduct(v, yaxis)
        zaxis.Unitize()
        
        # zaxis must look up!
        if math.acos(rg.Vector3d.ZAxis * zaxis) > math.acos(rg.Vector3d.ZAxis * -zaxis):
            zaxis = -zaxis
        
        xaxis = rg.Vector3d.CrossProduct(yaxis, zaxis)
        
        
    print "Copy the following into base component:"
    print " "
    print "origin = [%.2f, %.2f, %.2f]" % tuple(list(origin))
    print "xaxis = [%.5f, %.5f, %.5f]" % tuple(list(xaxis))
    print "yaxis = [%.5f, %.5f, %.5f]" % tuple(list(yaxis))
    

#print rg.Vector3d.CrossProduct(rg.Vector3d.YAxis, rg.Vector3d.ZAxis)
#print rg.Vector3d.CrossProduct(rg.Vector3d.ZAxis, rg.Vector3d.XAxis)

    base_plane = rg.Plane(origin, xaxis, xaxis)
# ---------- end calc_base ----------
panel_15 = Panel(rec)
panel_16 = Panel(calc_base.out)

# ----
# Direct UR Control
config = GhPythonScript()  # -> out, joint_configs
# ---------- config: Python ----------
from compas_fab.robots import Configuration

values=[-0.737876, -1.64531, 1.740348, -0.367801, -0.37385, -0.110741]
joint_configs = [Configuration.from_revolute_values(values)]
# ---------- end config ----------
pln_12 = Plane(calc_base.base_plane)
list_23 = ValueList({"30", "32", "34"}, selected="30")
list_24 = ValueList({"30", "32", "34"}, selected="34")
list_25 = ValueList({"30", "32", "34"}, selected="32")

# ----
# Move Joints
clear_6 = Button()
add_5 = Button()
idx_9 = Slider(0, range=0..100)
list_26 = ValueList({"send all positions": 0, "send only one position": 1, "from inverse": 2}, selected="from inverse")
rec_joints = PythonScript(msg=pose_3.configuration, rec=add_5, clear=clear_6)  # -> rec
# ---------- rec_joints: Python ----------
from scriptcontext import sticky as st

guid = str(ghenv.Component.InstanceGuid)
recorded_key =  "recorded_" + guid
just_cleared_key = "just_cleared_" + guid


if recorded_key not in st:
    st[recorded_key] = []

if just_cleared_key not in st:
    st[just_cleared_key] = False

if clear:
    st[recorded_key] = []
    st[just_cleared_key] = True
else:
    if msg != [None] and not st[just_cleared_key] and rec:
        st[recorded_key].append(msg)
    st[just_cleared_key] = False
        


rec = st[recorded_key]

print rec
# ---------- end rec_joints ----------
item_7 = ListItem(List=config.joint_configs, Index=idx_9, Wrap=True)
filter_11 = StreamFilter(Gate=list_26, Stream0=config.joint_configs, Stream1=item_7, Stream2=rec_joints)
movej = PythonScript(joint_configurations=forward_kinematics, velocity=Slider(0.3, range=0..0.5))  # -> urscript, values; inputs joint_configurations: list
# ---------- movej: Python ----------
from ur_fabrication_control.direct_control import URScript
import math


"""
for c in joint_configurations:
    for i,v in enumerate(c.values):
        #print v
        if v>math.pi:
            v-=2*math.pi
        if v<-math.pi:
            v+=2*math.pi
        c.values[i]=v
print joint_configurations
values = joint_configurations[0].values
print([math.degrees(v) for v in values])
"""

#joint_config = ["movej({}, v={})".format(c.values, velocity/10) for c in joint_configurations]

urscript = URScript()
urscript.start()
for jc in joint_configurations:
    urscript.move_joint(jc, velocity)
urscript.end()

urscript = urscript.generate()

print(urscript)
# ---------- end movej ----------
send_27 = Button()
send_28 = GhPythonScript(urscript=movej.urscript, send=send_27)  # -> out; inputs send: Boolean; same code as send_3

# ----
# Calculate Basis - Point fitting method via RPC
toggle = BooleanToggle(False)
plane_init_guess = Plane(Plane(origin=(0, 0, 0), x=(0, -1, 0), y=(1, 0, 0)))
pt = Point([<point referenced from the Rhino model> x3])
calc_base_2 = PythonScript(poses=rec, pts_cad=pt, base_plane_init_guess=plane_init_guess, calc=toggle)  # -> out, pts_mtip_init_guess, pts_mtip_fit, base_plane_fit; inputs poses: list, pts_cad: list of Point3d, base_plane_init_guess: Plane
# ---------- calc_base_2: Python ----------
import ghpythonlib.components as ghcomp
import Rhino.Geometry as rg
from scriptcontext import sticky as st
from compas.geometry import Frame
import math as m
import sys
from compas.rpc import Proxy # for calling the numpy function in CPython


if len(poses):
    
    # get points from poses
    pts_mtip = [rg.Point3d(p[0], p[1], p[2]) for p in poses]
    
    T_W_R_init_guess = rg.Transform.PlaneToPlane(rg.Plane.WorldXY, base_plane_init_guess)
    pts_mtip_init_guess = [ghcomp.Transform(pt, T_W_R_init_guess) for pt in pts_mtip]
    
    # format Rhino transformation
    T_W_R_init_guess_flattened = [float(f) for f in T_W_R_init_guess.ToFloatArray(True)]
    T_W_R_init_guess_list = [T_W_R_init_guess_flattened[i:(i + 4)] for i in range(0, len(T_W_R_init_guess_flattened), 4)]  

    # format ptsA and ptsB
    dataB = [list(pt) for pt in pts_cad]
    dataA = [list(pt) for pt in pts_mtip]
    
    # call the function
    max_iterations = 100
    
    if calc:
        icp_func = Proxy('ur_fabrication_control.optimisation.icp', python = 'C://Users//kathrind//anaconda3//envs//ur_fab//python.exe')
        
        print icp_func._python

        transformation, distances = icp_func.icp(dataA, dataB, init_guess=T_W_R_init_guess_list, max_iterations=max_iterations, tolerance=0.000001)
        
        print "distances", distances
        
        # format result
        T = rg.Transform.Identity
        for i in range(4):
            for j in range(4):
                code = "T.M%i%i = %f" % (i, j, transformation[i][j])
                print code
                exec(code)
        #print T
        
        # now transform the points with the transformation calculated
        pts_mtip_fit = [ghcomp.Transform(pt, T) for pt in pts_mtip]
        base_plane_fit = ghcomp.Transform(rg.Plane.WorldXY, T)
        
        
        #f = Frame(base_plane_fit)
        #print f.get_pose_quaternion()
        
        # correct the zvalue
        #base_plane_fit = ghcomp.Transform(base_plane_fit, rg.Transform.Translation(0,0,-3))
# ---------- end calc_base_2 ----------
pt_2 = Point(calc_base_2.pts_mtip_init_guess)
pt_3 = Point(calc_base_2.pts_mtip_fit)
pln_13 = Plane(calc_base_2.base_plane_fit)

# ----
# Calculate Basis - 3-Point Method
list_27 = ValueList({"o, pos.x-axis, xy pl": 0, "o, pos.y-axis, xy pl": 1}, selected="o, pos.x-axis, xy pl")
clear_7 = Button()
rec_2 = PythonScript(msg=pose_2.pose_cartesian, rec=get_2, clear=clear_7)  # -> rec; inputs msg: list; same code as rec_car
calc_base_3 = PythonScript(poses=rec_2, input_type=list_27)  # -> out, base_plane; inputs poses: list; same code as calc_base
panel_17 = Panel(rec_2)
panel_18 = Panel(calc_base_3.out)

# ----
# Direct UR Control
config_2 = GhPythonScript()  # -> out, joint_configs; same code as config
pln_14 = Plane(calc_base_3.base_plane)

# ----
# Move Joints
clear_8 = Button()
add_6 = Button()
idx_10 = Slider(0, range=0..100)
list_28 = ValueList({"send all positions": 0, "send only one position": 1, "from inverse": 2}, selected="from inverse")
rec_joints_2 = PythonScript(msg=pose_4.configuration, rec=add_6, clear=clear_8)  # -> rec; same code as rec_joints
item_8 = ListItem(List=config_2.joint_configs, Index=idx_10, Wrap=True)
filter_12 = StreamFilter(Gate=list_28, Stream0=config_2.joint_configs, Stream1=item_8, Stream2=rec_joints_2)
movej_2 = PythonScript(joint_configurations=inverse.configuration, velocity=Slider(0.3, range=0..0.5))  # -> urscript, values; inputs joint_configurations: list
# ---------- movej_2: Python ----------
from ur_fabrication_control.direct_control import URScript
import math


"""
for c in joint_configurations:
    for i,v in enumerate(c.values):
        #print v
        if v>math.pi:
            v-=2*math.pi
        if v<-math.pi:
            v+=2*math.pi
        c.values[i]=v
print joint_configurations
values = joint_configurations[0].values
print([math.degrees(v) for v in values])
"""

#joint_config = ["movej({}, v={})".format(c.values, velocity/10) for c in joint_configurations]

urscript = URScript()
urscript.start()
for jc in joint_configurations:
    urscript.move_joint(jc.joint_values, velocity)
urscript.end()

urscript = urscript.generate()

print(urscript)
# ---------- end movej_2 ----------
send_29 = Button()
send_30 = GhPythonScript(urscript=movej_2.urscript, send=send_29)  # -> out; inputs send: Boolean
# ---------- send_30: Python ----------
from scriptcontext import sticky as st
from ur_fabrication_control.direct_control import send_script

ur_ip = st["ur_ip_2"]
ur_port = st["ur_port_2"]

if send:
    send_script(urscript, ur_ip, ur_port)
# ---------- end send_30 ----------

# ----
# Calculate Basis - Point fitting method via RPC
toggle_2 = BooleanToggle(False)
plane_init_guess_2 = Plane(Plane(origin=(0, 0, 0), x=(0, -1, 0), y=(1, 0, 0)))
pt_4 = Point([<point referenced from the Rhino model> x3])
calc_base_4 = PythonScript(poses=rec_2, pts_cad=pt_4, base_plane_init_guess=plane_init_guess_2, calc=toggle_2)  # -> out, pts_mtip_init_guess, pts_mtip_fit, base_plane_fit; inputs poses: list, pts_cad: list of Point3d, base_plane_init_guess: Plane; same code as calc_base_2
pt_5 = Point(calc_base_4.pts_mtip_init_guess)
pt_6 = Point(calc_base_4.pts_mtip_fit)
pln_15 = Plane(calc_base_4.base_plane_fit)

# ----
# Stop Extruder
stop_10 = Button()
stop_11 = PythonScript(stop=stop_10)
# ---------- stop_11: Python ----------
from scriptcontext import sticky as st
from mobile_additive_manufacturing.control.urscript_extrusion import stop_extruder

ur_ip = st["ur_ip"]
ur_port = st["ur_port"]
ext_ip = st["ext_ip"]
ext_port = st["ext_port"]

if stop:
    stop_extruder(ur_ip, ur_port, ext_ip, ext_port)
# ---------- end stop_11 ----------

# ----
# Set Extruder Digital Out
value_10 = BooleanToggle(True)
send_31 = Button()
digital_out_6 = PythonScript(pin=list_23, state=value_10, send=send_31)  # -> urscript; inputs pin: Int32, state: Int32
# ---------- digital_out_6: Python ----------
from scriptcontext import sticky as st
from mobile_additive_manufacturing.control.urscript_extrusion import set_extruder_digital_out

ur_ip = st["ur_ip"]
ur_port = st["ur_port"]
ext_ip = st["ext_ip"]
ext_port = st["ext_port"]

if send:
    set_extruder_digital_out(ur_ip, ur_port, ext_ip, ext_port, pin, state)
# ---------- end digital_out_6 ----------

# ----
# Toggle fan
value_11 = BooleanToggle(True)
send_32 = Button()
digital_out_7 = PythonScript(pin=list_24, state=value_11, send=send_32)  # -> urscript; inputs pin: Int32, state: Int32
# ---------- digital_out_7: Python ----------
from scriptcontext import sticky as st
from mobile_additive_manufacturing.control.urscript_extrusion import toggle_fan

ur_ip = st["ur_ip"]
ur_port = st["ur_port"]
ext_ip = st["ext_ip"]
ext_port = st["ext_port"]

if send:
    toggle_fan(ur_ip, ur_port, ext_ip, ext_port, pin, state)
# ---------- end digital_out_7 ----------

# ----
# Toggle air
value_12 = BooleanToggle(True)
send_33 = Button()
digital_out_8 = PythonScript(pin=list_25, state=value_12, send=send_33)  # -> urscript; inputs pin: Int32, state: Int32
# ---------- digital_out_8: Python ----------
from scriptcontext import sticky as st
from mobile_additive_manufacturing.control.urscript_extrusion import toggle_air

ur_ip = st["ur_ip"]
ur_port = st["ur_port"]
ext_ip = st["ext_ip"]
ext_port = st["ext_port"]

if send:
    toggle_air(ur_ip, ur_port, ext_ip, ext_port, pin, state)
# ---------- end digital_out_8 ----------
