# Grasshopper definition ur_robot_model.ghx (Grasshopper 1.0.7)

reload = Button()
py = PythonScript(reload=reload)
# ---------- py: Python ----------
from compas_rhino.utilities.misc import get_tolerance
from compas_rhino.utilities.misc import unload_modules

from compas_ghpython import unload_modules
unload_modules("compas")
unload_modules("compas_fab")
unload_modules("roslibpy")
# ---------- end py ----------

list = ValueList({"ur3.urdf", "ur5.urdf", "ur10.urdf", "ur3e.urdf", "ur5e.urdf", "ur10e.urdf", "ur10e_rot.urdf", "ur3_with_measurement_tool.urdf", "ur5_with_measurement_tool.urdf", "ur10_with_measurement_tool.urdf", "ur10e_vacuumgripper.urdf"}, selected="ur10e_rot.urdf")
list_2 = ValueList({"ur3.srdf", "ur5.srdf", "ur10.srdf", "ur3e.srdf", "ur5e.srdf", "ur10e.srdf", "ur3_with_measurement_tool.srdf", "ur5_with_measurement_tool.srdf", "ur10_with_measurement_tool.srdf", "ur10e_vacuumgripper.srdf"}, selected="ur10e.srdf")
py_2 = PythonScript()  # -> HERE, DATA
# ---------- py_2: Python ----------
import os

HERE = os.path.dirname(ghdoc.Path)
DATA = os.path.abspath(os.path.join(HERE, "..", "data"))
print(HERE)
print(DATA)
# ---------- end py_2 ----------
panel = Panel(py_2.DATA)
list_3 = ValueList({"ur_description", "ur_e_description", "ur_setups"}, selected="ur_e_description")

# ----
# Load robot from local package
py_3 = PythonScript()  # -> ghfile_path
# ---------- py_3: Python ----------
import os

filepath = ghenv.Component.OnPingDocument().FilePath
ghfile_path = os.path.dirname(filepath)
# ---------- end py_3 ----------
py_4 = PythonScript(ghfile_path=py_3)  # -> robot_description
# ---------- py_4: Python ----------
import os

robot_description = os.path.join(ghfile_path, "..", "data", "robot_description")
robot_description = os.path.abspath(robot_description)

print robot_description
# ---------- end py_4 ----------
py_5 = PythonScript()  # -> packages
# ---------- py_5: Python ----------
packages = ["ur_description", "ur_e_description", "ur_end_effectors", "ur_setups"]
# ---------- end py_5 ----------
py_6 = PythonScript(path=py_4, package=list_3, urdf_name=list, srdf_name=list_2)  # -> package_path, urdf_filename, srdf_filename
# ---------- py_6: Python ----------
import os

package_path = os.path.join(path, package)

urdf_filename = os.path.join(package_path, "urdf", urdf_name)
srdf_filename = os.path.join(package_path, srdf_name)

assert os.path.isfile(urdf_filename)
assert os.path.isfile(srdf_filename)
# ---------- end py_6 ----------
py_7 = PythonScript(path=py_4, packages=py_5)  # -> loaders; inputs packages: list
# ---------- py_7: Python ----------
from compas.robots import LocalPackageMeshLoader

loaders = []
print packages


for package in packages:
    loaders.append(LocalPackageMeshLoader(path, package))
# ---------- end py_7 ----------
load = Button()
units = ValueList({"m": 1, "cm": 100, "mm": 1000}, selected="m")
create = PythonScript(loaders=py_7, urdf_filename=py_6.urdf_filename, srdf_filename=py_6.srdf_filename, scale_factor=units, load=load)  # -> out, robot; inputs loaders: list
# ---------- create: Python ----------
import os
from scriptcontext import sticky as st

import compas

from compas.robots import RobotModel
from compas.robots import LocalPackageMeshLoader

from compas_fab.robots import Robot
from compas_fab.robots import RobotSemantics

from compas_fab.ghpython import RobotArtist

compas.PRECISION = '12f'

# store robot in component
guid = str(ghenv.Component.InstanceGuid)
robot_key = "robot_" + guid

if robot_key not in st:
    st[robot_key] = None

print loaders
if load:
    model = RobotModel.from_urdf_file(urdf_filename)
    
    model.load_geometry(*loaders)
    artist = RobotArtist(model)
    semantics = RobotSemantics.from_srdf_file(srdf_filename, model)
    robot = Robot(model, artist, semantics, client=None)

    
    st[robot_key] = robot

robot = st[robot_key]


if robot:
    robot.scale(scale_factor)
# ---------- end create ----------

data_path = Data(py_2.DATA)

# ----
# Robot
robot = Data(create.robot)

# ----
# Tool
list_4 = ValueList({"measurement_tool": 0, "air_pick_15mm": 1}, selected="measurement_tool")
panel_2 = Panel("Attach a custom tool")
show = BooleanToggle(False)
python = PythonScript(data_path=data_path, tool=list_4, show=show)  # -> tool, M
# ---------- python: Python ----------
import os, math
from compas.geometry import Frame, Rotation
from compas.datastructures import Mesh
from compas_ghpython.artists import MeshArtist
from compas_fab.robots import Tool

tolerance = 0

if tool == 0:
    filename = 'measurement_tool_zaxis.stl'
    ee_frame = Frame([0, 0, 0.109], [1, 0, 0], [0, 1, 0])

elif tool == 1:
    filename = 'hrca_airpick_zaxis.stl'
    ee_frame = Frame([0, 0, 0.158 + tolerance], [1, 0, 0], [0, 1, 0])


data_path = os.path.join(data_path, "tool_geometry")
fullfilename = os.path.join(data_path, filename)
print fullfilename

ee_mesh = Mesh.from_stl(fullfilename)

#R = Rotation.from_axis_and_angle(ee_frame.zaxis, math.radians(180), point=ee_frame.point)
#ee_frame.transform(R)

if show:
    artist = MeshArtist(ee_mesh)
    M = artist.draw()

tool = Tool(ee_mesh, ee_frame)
# ---------- end python ----------
py_8 = PythonScript(robot=robot, tool=python.tool, attach=Toggle(True))  # -> a
# ---------- py_8: Python ----------
if attach:
    robot.attach_tool(tool)
else:
    robot.detach_tool()
# ---------- end py_8 ----------

# ----
# Info
info = PythonScript(robot=robot)  # -> out, main_group_name
# ---------- info: Python ----------
if robot:
    robot.info()
    main_group_name = robot.main_group_name
# ---------- end info ----------
panel_3 = Panel(info.out)

# ---- group: forward kinematics
a1 = Slider(0, range=-360..360)
a3 = Slider(90, range=-360..360)
a4 = Slider(-90, range=-360..360)
a6 = Slider(90, range=-360..360)
a2 = Slider(-90, range=-360..360)
a5 = Slider(-90, range=-360..360)
jp = GhPythonScript()  # -> joint_positions
# ---------- jp: Python ----------
import math

joint_positions = [0,-90,90,-90,-90,90]
joint_positions = [math.radians(a) for a in joint_positions]
#joint_positions = [-3.136, -0.328, -1.218, 3.129, 0.852, 0.008]
#joint_positions = [0] * 6

print joint_positions
# ---------- end jp ----------
forward_kinematics = PythonScript(robot=robot, set_joint_positions=Button(), joint_positions=jp, a1=a1, a2=a2, a3=a3, a4=a4, a5=a5, a6=a6)  # -> full_configuration; inputs joint_positions: list
# ---------- forward_kinematics: Python ----------
import math
import Grasshopper
from compas.robots import Joint
from compas_fab.robots import Configuration

if set_joint_positions:

    j = 0
    for i in range(ghenv.Component.Params.Input.Count):
        nslider = ghenv.Component.Params.Input[i].Sources[0]
        if nslider.GetType() == Grasshopper.Kernel.Special.GH_NumberSlider:
            nslider.TrySetSliderValue(math.degrees(joint_positions[j]))
            j += 1

if robot:
    joint_positions = [a1, a2, a3, a4, a5, a6]
    joint_types = robot.get_configurable_joint_types()
    for i, joint_type in enumerate(joint_types):
        if joint_type == Joint.REVOLUTE:
            joint_positions[i] = math.radians(joint_positions[i])
    full_configuration = Configuration(joint_positions, joint_types)
    
print(full_configuration)
# ---------- end forward_kinematics ----------

# ----
# Configuration
main_planning_group = Text(info.main_group_name)
select_configuration = Slider(2, range=0..7)
X = UnitX(Factor=1)
Y = UnitY(Factor=Slider(-1, range=-2..-1))
pt = Point(Point(0.1975739037, -0.8652839445, 0.569893879))
pl = ConstructPlane(Origin=pt, XAxis=X, YAxis=Y)
forward = PythonScript(robot=robot, group=main_planning_group, full_configuration=forward_kinematics)  # -> out, frame_WCF
# ---------- forward: Python ----------
"""Calculate the robot's forward kinematic.
    Inputs:
        robot: :class:`compas_fab.robots.Robot`
            The robot.
        group: str, optional
            The planning group used for calculation. Defaults to the robot's
            main planning group.
        full_configuration : :class:`compas_fab.robots.Configuration`
            The full configuration to calculate the forward kinematic for. If no
            full configuration is passed, the zero-joint state for the other
            configurable joints is assumed.
    Output:
        :class:`Frame`
            The frame in the world coordinate frame (WCF).
"""
from __future__ import print_function
import logging

import compas_fab
print(compas_fab.__version__)

LOGGER = logging.getLogger('roslibpy')

if robot and robot.client and full_configuration:
    if robot.client.is_connected:
        #frame_WCF = robot.forward_kinematics(full_configuration, group, options={'backend':'model'})
        frame_WCF = robot.forward_kinematics(full_configuration, group)
        print(frame_WCF)
    else:
        print("Robot is not connected")
# ---------- end forward ----------
inverse = PythonScript(robot=robot, plane_WCS=pl, idx=select_configuration)  # -> out, configuration, plane_WCS; inputs plane_WCS: Plane, idx: Int32
# ---------- inverse: Python ----------
import Rhino.Geometry as rg
from compas.geometry import Frame, Transformation
from compas_fab.robots import Configuration
from ur_fabrication_control.kinematics.ur_kinematics import inverse_kinematics
from ur_fabrication_control.kinematics.ur_params import ur_params
import math

ur_params = ur_params["ur10e"]

tcp_WCS = Frame(plane_WCS.Origin, plane_WCS.XAxis, plane_WCS.YAxis)

# transform frame to robot coordinate system
tcp_RCS = robot.to_local_coordinates(tcp_WCS)
tool0_RCS = robot.from_tcf_to_t0cf([tcp_RCS])

# calculate solutions to frame
solutions = inverse_kinematics(tool0_RCS[0], ur_params)

if not len(solutions):
    configuration = [0,0,0,0,0,0]
else:
    idx = min(len(solutions) - 1, idx)
    #configuration = solutions[idx]
    joint_values = solutions[idx]
    configuration = Configuration.from_revolute_values(joint_values)

print(configuration)
# ---------- end inverse ----------
panel_4 = Panel(forward.out)

# ----
# Visualisation
list_5 = ValueList({"0 forward_kinematics": 0, "1 inverse_kinematics": 1}, selected="1 inverse_kinematics")
show_end_effector_frame = BooleanToggle(True)
show_base_frame = BooleanToggle(False)
show_collision = BooleanToggle(False)
show_frames = BooleanToggle(False)
show_visual = BooleanToggle(True)
show_acm = BooleanToggle(True)
filter = StreamFilter(Gate=list_5, Stream0=forward_kinematics, Stream1=inverse.configuration)
visualize = PythonScript(
    robot=robot,
    group=main_planning_group,
    configuration=filter,
    redraw=py_8,
    show_visual=show_visual,
    show_collision=show_collision,
    show_end_effector_frame=show_end_effector_frame,
    show_frames=show_frames,
    show_base_frame=show_base_frame,
    show_acm=show_acm)  # -> out, robot, visual, collision, attached_meshes, frames, ee_frame, base_frame; inputs redraw: list, attached_collision_meshes: list
# ---------- visualize: Python ----------
from compas.geometry import Vector
from compas.geometry import Point
from compas.geometry import Transformation
from compas.geometry import Frame
from compas_ghpython.artists import MeshArtist
from compas_fab.robots import Configuration

print(configuration)

if robot and configuration:
    
    robot.update(configuration, visual=show_visual, collision=show_collision)

    if show_visual:
        visual = robot.artist.draw_visual()

    if show_collision:
        collision = robot.artist.draw_collision()
    
    frames = robot.transformed_frames(configuration, group)

    if show_base_frame:
        base_frame = frames[0]

    if show_end_effector_frame:
        ee_frame = robot.forward_kinematics(configuration, group)
        print("End-effector", ee_frame)
    
    if not show_frames:
        frames = None

    frame = robot.forward_kinematics(configuration, options=dict(solver='model', link_name=robot.attached_tool.link_name))
    robot.artist.update_tool(visual=visual, collision=collision, transformation=Transformation.from_frame_to_frame(Frame.worldXY(), frame))
    
    if show_acm:
        M = []
        for acm in attached_collision_meshes:
            frame = robot.forward_kinematics(configuration, options=dict(solver='model', link_name=acm.link_name))
            T = Transformation.from_frame_to_frame(Frame.worldXY(), frame)
            mesh = acm.collision_mesh.mesh.transformed(T)
            M.append(MeshArtist(mesh).draw())
        attached_meshes = M
# ---------- end visualize ----------
geo = Geometry(visualize.visual)
geo_2 = Geometry(visualize.collision)
draw = GhPythonScript(frames=[visualize.frames, visualize.ee_frame, visualize.base_frame], scale=Slider(0.1, range=0..1))  # -> P, V, C, W; inputs frames: list
# ---------- draw: Python ----------
from System.Drawing import Color
from compas_ghpython.utilities import draw_frame

red = Color.FromArgb(255, 0, 0)
green = Color.FromArgb(0, 255, 0)
blue = Color.FromArgb(0, 0, 255)

P = []
V = []
C = []

scale = float(scale)

for frame in frames:
    if not frame:
        continue
    plane = draw_frame(frame)
    P += [plane.Origin] * 3
    V.append(plane.XAxis * scale)
    V.append(plane.YAxis * scale)
    V.append(plane.ZAxis * scale)
    C += [red, green, blue]

W = 3
# ---------- end draw ----------
vdisex = VectorDisplayEx(Point=draw.P, Vector=draw.V, Colour=draw.C, Width=draw.W)
preview = CustomPreview(Geometry=geo, Shader=ColourSwatch(SwatchColor=RGB(105, 105, 105)))
preview_2 = CustomPreview(Geometry=visualize.attached_meshes, Shader=ColourSwatch(SwatchColor=RGB(255, 255, 255)))
