# Grasshopper definition ur_robots_setup_mobile_hrca.ghx (Grasshopper 1.0.7)
# plug-ins: Weaverbird

# ----
# ROS - Settings
list = ValueList({"local": 0, "backpack computer": 1}, selected="backpack computer")  # disabled

# ---- group: ROS client
restart = Button()  # disabled
disconnect = Button()  # disabled
connect = Button()  # disabled
ros = PythonScript(restart=restart, connection=list)  # -> ros_client; disabled
# ---------- ros: Python ----------
import time
import logging
import scriptcontext as sc

from roslibpy import Ros
from System import TimeSpan
from System.Threading import ManualResetEventSlim

LOGGER = logging.getLogger('roslibpy')

guid = str(ghenv.Component.InstanceGuid)
ros_client_key = "rosclient_" + guid

previous_client = sc.sticky.get(ros_client_key, None)
if previous_client:
    previous_client.terminate()

if connection == 0: #local
    ros_client = Ros('127.0.0.1', 9090) #local, own laptop
elif connection == 1: # backpack computer
    ros_client = Ros('10.181.163.92', 9090) #mabi computer - lan
sc.sticky[ros_client_key] = ros_client

waitLock = ManualResetEventSlim(False) 
ros_client.on_ready(lambda: waitLock.Set()) 

if not waitLock.Wait(TimeSpan.FromSeconds(5)):
    raise Exception('Unable to connect to ROS')

LOGGER.info('ROS connection opened')
# ---------- end ros ----------
connect_2 = PythonScript(ros_client=ros, connect=connect, disconnect=disconnect)  # -> out, ros_client; disabled
# ---------- connect_2: Python ----------
import logging
from System import TimeSpan
from System.Threading import ManualResetEventSlim

LOGGER = logging.getLogger('roslibpy')

if connect:
    if not ros_client.is_connected:
        LOGGER.debug('Connecting...')
        waitLock = ManualResetEventSlim(False)
        ros_client.on_ready(lambda: waitLock.Set())
        ros_client.connect()

        if not waitLock.Wait(TimeSpan.FromSeconds(5)):
            raise Exception('Unable to connect to ROS')
        LOGGER.debug('Reconnected')

if disconnect:
    if ros_client.is_connected:
        ros_client.terminate()
        LOGGER.debug('Terminated')
        
       
if (ros_client.is_connected):
    print('connected')
else:
    print('disconnected')
# ---------- end connect_2 ----------
panel = Panel(connect_2.out)  # disabled

# ----
panel_2 = Panel("Unload libraries")
bang = Button()
unload = PythonScript(bang=bang)
# ---------- unload: Python ----------
from compas_rhino.utilities.misc import get_tolerance
from compas_rhino.utilities.misc import unload_modules

unload_modules("compas")
unload_modules("compas_fab")
unload_modules("ur_online_control")
unload_modules("roslibpy")
unload_modules("human_robot_collaborative_assembly")
# ---------- end unload ----------

import = Button(ExpressionNormal="True", ExpressionPressed="False")
py = PythonScript()  # -> HERE, DATA
# ---------- py: Python ----------
import os

HERE = os.path.dirname(ghdoc.Path)
DATA = os.path.abspath(os.path.join(HERE, "..", "data"))
print(HERE)
print(DATA)
# ---------- end py ----------
panel_3 = Panel("Import current assembly")
current_assembly = GhPythonScript(DATA=py.DATA, import_from_json=import)  # -> out, assembly; inputs import_from_json: Boolean
# ---------- current_assembly: Python ----------
import os
import json

from human_robot_collaborative_assembly.assembly import HRCAssembly as Assembly
from human_robot_collaborative_assembly.assembly import HRCElement as Element

#assembly = Assembly()

if import_from_json:
    filename = "hrca/hrca_current_assembly_2020_09_18_18_43_02.json"
    PATH = os.path.join(DATA, filename)
    assembly = Assembly.from_json(PATH)
# ---------- end current_assembly ----------

# ----
# 1.
# Load initial assembly
import_2 = Button(ExpressionNormal="True", ExpressionPressed="False")
# Import initial assembly (first module)
py_2 = PythonScript(import_from_json=import_2)  # -> HERE, DATA, import_from_json
# ---------- py_2: Python ----------
import os
from scriptcontext import sticky as st

HERE = os.path.dirname(ghdoc.Path)
DATA = os.path.abspath(os.path.join(HERE, "..", "data"))
print(HERE)
print(DATA)

st.clear()
st['DATA_PATH'] = DATA
# ---------- end py_2 ----------
initial_assembly = GhPythonScript(DATA=py_2.DATA, import_from_json=py_2.import_from_json)  # -> out, assembly; inputs import_from_json: Boolean
# ---------- initial_assembly: Python ----------
import os
import json
from scriptcontext import sticky

from human_robot_collaborative_assembly.assembly import HRCAssembly as Assembly
from human_robot_collaborative_assembly.assembly import HRCElement as Element

#assembly = Assembly()

if import_from_json:
    filename = "hrca/hrca_current_assembly_2020_09_18_18_43_02.json"
    PATH = os.path.join(DATA, filename)
    assembly = Assembly.from_json(PATH)


#assembly.network.delete_node(6)

if assembly:
    counter = 1
    """
    for key, elem, data in assembly.elements(data=True):
        data['frame_id'] = counter
        counter +=1
    """
    sticky['assembly'] = assembly
# ---------- end initial_assembly ----------

py_3 = PythonScript()  # -> HERE, DATA; same code as py
show = BooleanToggle(False)
panel_4 = Panel(py_3.DATA)
data_path = Data(py_3.DATA)

# ---- group: Assembly Visualization
reset = Button()
back = Button()
start = Button()
step = Button()
stop = Button()
full = Button()
list_2 = ValueList({"20", "50", "100", "500", "1000", "5000"}, selected="50")

# Count
counter = CountThroughList(
    assembly=current_assembly.assembly,
    start=start,
    stop=stop,
    step=step,
    step_back=back,
    reset=reset,
    full=full,
    interval=list_2)  # -> item, counter, assembly; inputs start: Boolean, stop: Boolean, step_back: Boolean
# ---------- counter: Python ----------
from scriptcontext import sticky as st
from compas_ghpython import update_component


L = list(assembly.elements())

# store data in component
guid = str(ghenv.Component.InstanceGuid)
counter_key = "counter_" + guid
running_key = "running_" + guid

if counter_key not in st:
    st[counter_key] = 0

if running_key not in st:
    st[running_key] = False


if st[running_key]:
    if st[counter_key] < len(L) - 1:
        st[counter_key] += 1
        update_component(ghenv, interval)
    else:
        st[counter_key] = 0
        st[running_key] = False


if start:
    st[running_key] = True

if stop:
    st[running_key] = False

if step:
    if st[counter_key] < len(L) - 1:
        st[counter_key] += 1

if step_back:
    if st[counter_key] <= len(L) - 1:
        st[counter_key] -= 1

if reset:
    st[counter_key] = 0

if full:
    st[counter_key] = len(L)-1

if len(L):
    item = L[st[counter_key]]


counter = st[counter_key]
# ---------- end counter ----------
idx = Panel(counter.counter)

# ----
colour_swatch = ColourSwatch(SwatchColor=RGB(255, 0, 0))
x_axis = Curve(<curve referenced from the Rhino model>)
y_axis = Curve(<curve referenced from the Rhino model>)
pln = Plane(Plane(origin=(1.19655, 2.161514, 0.605786), x=(-0.001236999481, 0.9999475801, 0.01016399573), y=(-0.9999970623, -0.001215745702, -0.002096997544)))
_9cm_off = PythonScript(plane_axes=[x_axis, y_axis])  # -> plane; inputs plane_axes: list of Curve
# ---------- _9cm_off: Python ----------
import Rhino.Geometry as rg

x_axis, y_axis = plane_axes

x_axis = rg.Line(x_axis.PointAtStart, x_axis.PointAtEnd)
y_axis = rg.Line(y_axis.PointAtStart, y_axis.PointAtEnd)

if x_axis.From.DistanceTo(y_axis.From) < 0.01:
    origin = x_axis.From
    xvec = x_axis.Direction
    yvec = y_axis.Direction
elif x_axis.To.DistanceTo(y_axis.To) < 0.01:
    origin = x_axis.To
    xvec = -x_axis.Direction
    yvec = -y_axis.Direction
elif x_axis.From.DistanceTo(y_axis.To) < 0.01:
    origin = x_axis.From
    xvec = x_axis.Direction
    yvec = -y_axis.Direction
elif x_axis.To.DistanceTo(y_axis.From) < 0.01:
    origin = x_axis.To
    xvec = -x_axis.Direction
    yvec = y_axis.Direction

plane = rg.Plane(origin, xvec, yvec)
# ---------- end _9cm_off ----------

# ---- group: ROS client
panel_5 = Panel("127.0.0.1")
disconnect_2 = Button()
connect_3 = Button()
restart_2 = Button()
ros_2 = PythonScript(ip="10.181.163.92", restart=restart_2)  # -> out, ros_client
# ---------- ros_2: Python ----------
import sys
import time
import logging
import scriptcontext as sc

from compas_fab.backends import RosClient

from System import TimeSpan
from System.Threading import ManualResetEventSlim

LOGGER = logging.getLogger('roslibpy')

key = 'rosclient_%s' % str(ghenv.Component.InstanceGuid)
previous_client = sc.sticky.get(key, None)
if previous_client:
    previous_client.terminate()

ros_client = RosClient(ip, 9090)
sc.sticky[key] = ros_client

waitLock = ManualResetEventSlim(False)

ros_client.on_ready(lambda: waitLock.Set())

if not waitLock.Wait(TimeSpan.FromSeconds(5)):
    raise Exception('Unable to connect to ROS')

LOGGER.info('ROS connection opened')
# ---------- end ros_2 ----------
connect_4 = PythonScript(ros_client=ros_2.ros_client, connect=connect_3, disconnect=disconnect_2)  # -> out, ros_client
# ---------- connect_4: Python ----------
import logging
from System import TimeSpan
from System.Threading import ManualResetEventSlim

LOGGER = logging.getLogger('roslibpy')

if connect:
    if not ros_client.is_connected:
        LOGGER.debug('Connecting...')
        waitLock = ManualResetEventSlim(False)
        ros_client.on_ready(lambda: waitLock.Set())
        ros_client.connect()

        if not waitLock.Wait(TimeSpan.FromSeconds(5)):
            raise Exception('Unable to connect to ROS')
        LOGGER.debug('Reconnected')

if disconnect:
    if ros_client.is_connected:
        ros_client.terminate()
        LOGGER.debug('Terminated')

print ros_client.is_connected
# ---------- end connect_4 ----------
is_connected = Panel(connect_4.out)

# ----
list_3 = ValueList({"measurement_tool": 0, "air_pick_15mm": 1}, selected="air_pick_15mm")

# ----
# Robot
load = Button()

ros_client = Data(connect_4.ros_client)

# ----
# Service: REMOVE OBJECTS
list_4 = ValueList({"by keys": 0, "by frame id": 1}, selected="by keys")
frame_ids = Integer([2, 3, 4])
keys = Integer([0, 1, 2])
filter = StreamFilter(Gate=list_4, Stream0=keys, Stream1=frame_ids)
ros_service_request = PythonScript(ros_client=ros_client, assembly=initial_assembly.assembly, keys=filter, key_type=list_4, send=Button())  # -> out, assembly, bang; inputs keys: list of Int32, key_type: Int32, send: Boolean
# ---------- ros_service_request: Python ----------
import logging
import roslibpy
from roslibpy import Topic
from roslibpy import ServiceRequest
from roslibpy import Service
from roslibpy import Message
from scriptcontext import sticky


LOGGER = logging.getLogger('roslibpy') 

def ros_msg_remove_objects(keys):
    ros_msg = {}
    if key_type == 0: #by keys
        frame_ids = []
        for key in keys:
            id = assembly.network.node_attribute(key, 'frame_id')
            #print id
            if id:
                frame_ids.append(id)
    else:
        frame_ids = keys
    ros_msg = {'object_ids':frame_ids}
    #print ros_msg
    return ros_msg

if send:
    print("send")
    if ros_client:
            message = ros_msg_remove_objects(keys) 
            #print (message)  
            if len(msg['object_ids']):
                service_name = '/incon/remove_objects'
                service_type = '/incon_msgs/remove_objects'
                service = roslibpy.Service(ros_client, service_name, service_type)
                request = ServiceRequest(message)
                result = service.call(request, timeout=1) #sending of message
                sticky['result_remove_objects'] = result
                if result:
                    success, num_objects_processed = (result['success'], result['num_objects_processed'])                    
                    bang = True if result['success'] == True else False
            
if 'result_remove_objects' in sticky:
    print sticky['result_remove_objects']

msg = ros_msg_remove_objects(keys)
#print len(msg['object_ids'])
print msg
# ---------- end ros_service_request ----------
panel_6 = Panel(ros_service_request.out)

# ----
# Rhino to App:
# Service: ADD OBJECTS
# 2b.
button = Button()
# 2.
ros_service_request_2 = PythonScript(ros_client=ros_client, assembly=initial_assembly.assembly, send=button)  # -> out, assembly, bang; inputs send: Boolean
# ---------- ros_service_request_2: Python ----------
import logging
import roslibpy
from roslibpy import Topic
from roslibpy import ServiceRequest
from roslibpy import Service
from roslibpy import Message
from scriptcontext import sticky


LOGGER = logging.getLogger('roslibpy') 


len_elems = len(list(assembly.elements()))
print len_elems
if "key_threshold" not in sticky:
    sticky["key_threshold"] = len_elems-7

sticky["key_threshold"] = len_elems-7
print sticky["key_threshold"]

def ros_msg_add_objects():
    ros_msg = {}
    pose_stamped_array = []
    for key, element in assembly.elements():
        if key > sticky["key_threshold"]:
            x,y,z,qw,qx,qy,qz = element.get_pose_quaternion()
            pose_stamped_array.append({'header':{'seq': 0, 'stamp':{'secs': 0, 'nsecs': 0}, 'frame_id': str(key)}, 'pose': {'position': {'x': x, 'y': y, 'z': z}, 'orientation': {'x': qx, 'y': qy, 'z': qz, 'w': qw}}})
    ros_msg['poses'] = pose_stamped_array
    return ros_msg


if send:
    print("send")
    if ros_client:
            message = ros_msg_add_objects() #geometry_msgs/PoseStamped[] 
            #message = handle_add_two_bricks()[0] #geometry_msgs/PoseStamped[] 
            #print (message)                
            service_name = '/incon/add_objects'
            service_type = '/incon_msgs/add_objects'
            service = roslibpy.Service(ros_client, service_name, service_type)
            request = ServiceRequest(message)
            result = service.call(request, timeout=1) #sending of message
            #print(result)
            sticky['result_add_objects'] = result
            
            
            if result:
                # set the frame_id as received from the app
                added_keys, added_ids = (result['added_keys'], result['added_ids'])
                for key, id in zip(added_keys, added_ids):
                    assembly.network.node_attribute(key, 'frame_id', id)
                    
                bang = True if result['success'] == True else False
            
if 'result_add_objects' in sticky:
    print sticky['result_add_objects']



"""
for key in sticky['result_add_objects']['added_keys']:
    print assembly.element(key, data=True)
"""

for key, element, data in assembly.elements(data=True):
    print data['frame_id']
# ---------- end ros_service_request_2 ----------
panel_7 = Panel(ros_service_request_2.out)

# ----
# Load robot from local package
list_5 = ValueList({"ur3.urdf", "ur5.urdf", "ur10.urdf", "ur3e.urdf", "ur5e.urdf", "ur10e.urdf", "ur10e_rot.urdf", "ur3_with_measurement_tool.urdf", "ur5_with_measurement_tool.urdf", "ur10_with_measurement_tool.urdf", "ur10e_vacuumgripper.urdf"}, selected="ur10e_rot.urdf")
list_6 = ValueList({"ur3.srdf", "ur5.srdf", "ur10.srdf", "ur3e.srdf", "ur5e.srdf", "ur10e.srdf", "ur3_with_measurement_tool.srdf", "ur5_with_measurement_tool.srdf", "ur10_with_measurement_tool.srdf", "ur10e_vacuumgripper.srdf"}, selected="ur10e.srdf")
py_4 = PythonScript()  # -> ghfile_path
# ---------- py_4: Python ----------
import os

filepath = ghenv.Component.OnPingDocument().FilePath
ghfile_path = os.path.dirname(filepath)
# ---------- end py_4 ----------
list_7 = ValueList({"ur_description", "ur_e_description", "ur_setups"}, selected="ur_e_description")
py_5 = PythonScript(ghfile_path=py_4)  # -> robot_description
# ---------- py_5: Python ----------
import os

robot_description = os.path.join(ghfile_path, "..", "data", "robot_description")
robot_description = os.path.abspath(robot_description)

print robot_description
# ---------- end py_5 ----------
py_6 = PythonScript()  # -> packages
# ---------- py_6: Python ----------
packages = ["ur_description", "ur_e_description", "ur_end_effectors", "ur_setups"]
# ---------- end py_6 ----------
py_7 = PythonScript(path=py_5, package=list_7, urdf_name=list_5, srdf_name=list_6)  # -> package_path, urdf_filename, srdf_filename
# ---------- py_7: Python ----------
import os

package_path = os.path.join(path, package)

urdf_filename = os.path.join(package_path, "urdf", urdf_name)
srdf_filename = os.path.join(package_path, srdf_name)

assert os.path.isfile(urdf_filename)
assert os.path.isfile(srdf_filename)
# ---------- end py_7 ----------
py_8 = PythonScript(path=py_5, packages=py_6)  # -> loaders; inputs packages: list
# ---------- py_8: Python ----------
from compas.robots import LocalPackageMeshLoader

loaders = []
print packages


for package in packages:
    loaders.append(LocalPackageMeshLoader(path, package))
# ---------- end py_8 ----------
load_2 = Button()
units = ValueList({"m": 1, "cm": 100, "mm": 1000}, selected="m")
create = PythonScript(loaders=py_8, urdf_filename=py_7.urdf_filename, srdf_filename=py_7.srdf_filename, scale_factor=units, load=load_2)  # -> out, robot; inputs loaders: list
# ---------- create: Python ----------
import os
from scriptcontext import sticky as st

import compas

from compas.robots import RobotModel
from compas.robots import LocalPackageMeshLoader

from compas_fab.robots import Robot
from compas_fab.robots import RobotSemantics

from compas_fab.ghpython import RobotArtist

compas.PRECISION = '12f'

# store robot in component
guid = str(ghenv.Component.InstanceGuid)
robot_key = "robot_" + guid
print guid

if robot_key not in st:
    st[robot_key] = None

print loaders
if load:
    model = RobotModel.from_urdf_file(urdf_filename)
    
    model.load_geometry(*loaders)
    artist = RobotArtist(model)
    semantics = RobotSemantics.from_srdf_file(srdf_filename, model)
    robot = Robot(model, artist, semantics, client=None)
    
    st[robot_key] = robot

robot = st[robot_key]

"""
if robot:
    robot.scale(scale_factor)
"""
# ---------- end create ----------
set = PythonScript(robot=create.robot, client=ros_client)  # -> robot
# ---------- set: Python ----------
if robot and client:
    robot.client = client
# ---------- end set ----------

# ----
# Load robot directly from ROS
# (only working if connected and file_server launched)
units_2 = ValueList({"m": 1, "cm": 100, "mm": 1000}, selected="m")
python = PythonScript(client=ros_client, scale_factor=units_2, load=load)  # -> robot; inputs load: Boolean
# ---------- python: Python ----------
import os
from scriptcontext import sticky as st
import compas
from compas.robots import RobotModel
from compas_fab.backends import RosClient
from compas_fab.backends import RosFileServerLoader
from compas_fab.robots import Robot
from compas_fab.robots import RobotSemantics
from compas_fab.ghpython import RobotArtist

# Set high precision to import meshes defined in meters
compas.PRECISION = '24f'

# store robot in component
guid = str(ghenv.Component.InstanceGuid)
robot_key = "robot_" + guid

if robot_key not in st:
    st[robot_key] = None

if client and client.is_connected and load:
    # Load URDF from ROS
    loader = RosFileServerLoader(client)
    urdf = loader.load_urdf()
    srdf = loader.load_srdf()

    # Create robot model from URDF and load geometry
    model = RobotModel.from_urdf_string(urdf)
    model.load_geometry(loader)
    
    semantics = RobotSemantics.from_srdf_string(srdf, model)
    
    robot = Robot(model, semantics=semantics)
    robot.artist = RobotArtist(robot.model)
    robot.scale(scale_factor)
    st[robot_key] = robot

robot = st[robot_key]
if robot:
    robot.client = client
# ---------- end python ----------

# ----
# TOPIC LISTENER AND PUBLISHER
start_timer = Button()
# 3.
stop_timer = Button()
bang_2 = Button()
listening_and_publishing = GhPythonScript(bang=bang_2, start_timer=start_timer, stop_timer=stop_timer)  # -> out, added_elem_frame, frame_id, bang_sound
# ---------- listening_and_publishing: Python ----------
from scriptcontext import sticky
from compas_ghpython.utilities import update_component
from compas.geometry import Frame

assembly = sticky['assembly']


guid = str(ghenv.Component.InstanceGuid)
timer_running_key = "timer_running_" + guid
counter_key = "counter_" + guid

if stop_timer or timer_running_key not in sticky:
    sticky[timer_running_key] = False
    sticky[counter_key] = 0

if start_timer:
    sticky[timer_running_key] = True
    sticky[counter_key] = 0
    

if sticky[timer_running_key]:
    update_component(ghenv, 1000)
    
    sticky[counter_key] += 1
    print(sticky[counter_key])

def handle_object_options():
    options = assembly.current_options
    float_array = []
    for option in options:
        float_array += option
    size_array = len(float_array) / len(options)
    return float_array, len(options), size_array

def receive_message_object_poses(message):
    #sticky['message'] = str(datetime.datetime.now()) + ': ' + str(message)
    #print("receiving")
    sticky['incon_msg_obj_pose'] = message


        
if 'publisher_options' in sticky:
    if sticky['publisher_options']:
        
        publisher_options = sticky['publisher_options']
        float_array, float_size, size_array = handle_object_options()
        
        float_array, float_size, size_array = handle_object_options()
        msg = {'layout': {'dim': [{'label': 'x', 'size': int(float_size), 'stride':int(len(float_array)) }, {'label': 'x', 'size': int(size_array), 'stride':int(size_array)}], 'data_offset': 0}, 'data': float_array}
        publisher_message_options = publisher_options.publish(msg)
        print('++ Publishing OBJECT OPTIONS')
        #print(msg)
    else:
        print('NOT publishing OBJECT OPTIONS')
"""
if 'incon_msg_obj_pose' in sticky:   
    if sticky['incon_msg_obj_pose']:
        
        incon_msg_obj_pose = sticky['incon_msg_obj_pose']
        p = incon_msg_obj_pose['pose']
        frame_id = eval(incon_msg_obj_pose['header']['frame_id'])
        added_elem_frame = Frame.from_quaternion([p['orientation']['w'],p['orientation']['x'], p['orientation']['y'], p['orientation']['z']], point = [p['position']['x'], p['position']['y'], p['position']['z']] )
        print('++ Listening to INCON MSG OBJECT POSE')
        
        #print added_elem_frame
        #print frame_id
    else:
        print('NOT listening to INCON MSG OBJECT POSE')
"""

if 'listener_obj_pose' in sticky:
    if sticky['listener_obj_pose']:
    
        listener_obj_pose = sticky['listener_obj_pose']
        listener_obj_pose.subscribe(receive_message_object_poses)
    
        if 'incon_msg_obj_pose' in sticky and sticky['incon_msg_obj_pose']:
            #bang = True 
            
            incon_msg_obj_poses = sticky['incon_msg_obj_pose']
            print("amount of object placed:" + " " + str(len(incon_msg_obj_poses['poses'])))
            if len(incon_msg_obj_poses['poses']):
                last_element = incon_msg_obj_poses['poses'][0]
                p = last_element ['pose']
                frame_id = eval(last_element['header']['frame_id'])
                added_elem_frame = Frame.from_quaternion([p['orientation']['w'],p['orientation']['x'], p['orientation']['y'], p['orientation']['z']], point = [p['position']['x'], p['position']['y'], p['position']['z']] )

                print('++ Listening to INCON MSG OBJECT POSE')
                print('frame_id: ', frame_id)
    
        else:
            bang = False
            print('NOT receiving INCON MSG OBJECT POSE')
    else:
        print('NOT listening to INCON MSG OBJECT POSE')

#bang = True if bang else False
    
print added_elem_frame
# ---------- end listening_and_publishing ----------
panel_8 = Panel(listening_and_publishing.out)

list_8 = ValueList({"use from ROS": 0, "use from local package": 1}, selected="use from local package")
filter_2 = StreamFilter(Gate=list_8, Stream0=python, Stream1=set)
robot = Data(filter_2)

# ----
# Base
geo = Geometry([<brep referenced from the Rhino model> x40])
x_axis_2 = Curve(<curve referenced from the Rhino model>)
y_axis_2 = Curve(<curve referenced from the Rhino model>)
x_axis_3 = Curve(<curve referenced from the Rhino model>)
y_axis_3 = Curve(<curve referenced from the Rhino model>)
pup_high = PythonScript(plane_axes=[x_axis_2, y_axis_2])  # -> plane; inputs plane_axes: list of Curve; same code as _9cm_off
base = PythonScript(base_plane=pln)  # -> base_frame
# ---------- base: Python ----------
from compas.geometry import Frame
from compas.geometry import Transformation, Rotation
from compas_ghpython import draw_frame
import math
import Rhino.Geometry as rg




#base_frame = Frame(origin, xaxis, yaxis)
base_frame = Frame(base_plane.Origin, base_plane.XAxis, base_plane.YAxis)

R = Rotation.from_axis_and_angle(base_frame.zaxis, math.radians(-180), point=base_frame.point)
#base_frame.transform(R)
# ---------- end base ----------
plane = PythonScript(plane_axes=[x_axis_3, y_axis_3])  # -> plane; inputs plane_axes: list of Curve; same code as _9cm_off
x_axis_4 = Curve(<curve referenced from the Rhino model>)
y_axis_4 = Curve(<curve referenced from the Rhino model>)
pup_low = PythonScript(plane_axes=[x_axis_4, y_axis_4])  # -> plane; inputs plane_axes: list of Curve; same code as _9cm_off
base_geo = PythonScript(base_plane=pln, base_geo=geo, pick_up_plane=pup_low)  # -> base_geo, pick_up_plane, pick_up_plane_safe; inputs base_plane: Plane, base_geo: list, pick_up_plane: Plane
# ---------- base_geo: Python ----------
from compas.geometry import Frame
from compas.geometry import Transformation, Rotation
from compas_ghpython import draw_frame
import math
import Rhino.Geometry as rg
import ghpythonlib.components as ghcomp

safe_distance = -0.2

T_base = rg.Transform.PlaneToPlane(rg.Plane.WorldXY, base_plane)

base_geo = ghcomp.Transform(base_geo, T_base)

        
pick_up_plane = ghcomp.Transform(pick_up_plane, T_base)

pick_up_plane.Translate(pick_up_plane.ZAxis*0.005)

pick_up_plane_safe = rg.Plane(pick_up_plane)
pick_up_plane_safe.Translate(pick_up_plane_safe.ZAxis*safe_distance)
# ---------- end base_geo ----------
py_9 = PythonScript(robot=robot, base_frame=base, set_to_frame=Toggle(True))  # -> a, bp
# ---------- py_9: Python ----------
from compas_ghpython import draw_frame
from compas.geometry import Frame, Point, Vector, Transformation



frame_zero = Frame(Point(0.000, 0.000, 0.000), Vector(1.000, 0.000, 0.000), Vector(0.000, 1.000, 0.000))
print base_frame

if set_to_frame == True:
    print robot.model.get_link_by_name(robot.get_base_link_name()).parent_joint
    robot.model.get_link_by_name(robot.get_base_link_name()).parent_joint.origin = base_frame
    bp = draw_frame(base_frame)
    
else:
    robot.model.get_link_by_name(robot.get_base_link_name()).parent_joint.origin = frame_zero
    bp = draw_frame(frame_zero)

print robot.transformation_RCF_WCF()


"""
print robot.model.links[0].name

frame = Frame(Point(0.300, 1.000, 0.000), Vector(1.000, 0.000, 0.000), Vector(0.000, 1.000, 0.000))
T = Transformation.from_frame(frame)

#robot.model.get_link_by_name(robot.get_base_link_name()).parent_joint.transform(T)
#robot.model.get_link_by_name(robot.get_base_link_name()).joints[0].origin = frame
#robot.model.get_link_by_name('shoulder_link').parent_joint.transform(T)
print robot.model.get_link_by_name('shoulder_link').parent_joint.origin
print robot.model.get_link_by_name(robot.get_base_link_name()).parent_joint.origin

print robot.get_configurable_joint_names()

print robot.model.links[0]

print robot.get_base_link_name(group=None)
print robot.get_base_frame(group=None, full_configuration=None)

print robot.get_end_effector_link_name(group=None)
print robot.get_link_names()

"""

#f = robot.model.joints[0].origin
#p = draw_frame(f)
# ---------- end py_9 ----------
plane_2 = Plane(base_geo.pick_up_plane)
geo_2 = Geometry(base_geo.base_geo)
preview = CustomPreview(Geometry=geo_2, Shader=ColourSwatch(SwatchColor=RGB(222, 222, 222)))

# ----
# Tool
panel_9 = Panel("Attach a custom tool")
show_2 = BooleanToggle(False)
remove = Button()
add = Button()
python_2 = PythonScript(data_path=data_path, tool=list_3, show=show_2)  # -> tool, M, compas_mesh
# ---------- python_2: Python ----------
import os, math
from compas.geometry import Frame, Rotation
from compas.datastructures import Mesh
from compas_ghpython.artists import MeshArtist
from compas_fab.robots import Tool

tolerance = -0.013
#tolerance = - 0.023

if tool == 0:
    filename = 'measurement_tool_zaxis.stl'
    ee_frame = Frame([0, 0, 0.109], [1, 0, 0], [0, 1, 0])

elif tool == 1:
    filename = 'air_pick_zaxis.stl'
    ee_frame = Frame([0, 0, 0.158 + tolerance], [1, 0, 0], [0, 1, 0])


data_path = os.path.join(data_path, "attached_objects")
fullfilename = os.path.join(data_path, filename)
print fullfilename

ee_mesh = Mesh.from_stl(fullfilename)

#R = Rotation.from_axis_and_angle(ee_frame.zaxis, math.radians(180), point=ee_frame.point)
#ee_frame.transform(R)

if show:
    artist = MeshArtist(ee_mesh)
    M = artist.draw_mesh()

tool = Tool(ee_mesh, ee_frame)
compas_mesh = ee_mesh
# ---------- end python_2 ----------
py_10 = PythonScript(robot=robot, tool=python_2.tool, attach=add, remove=remove)
# ---------- py_10: Python ----------
if attach:
    robot.attach_tool(tool)
if remove:
    robot.detach_tool()
# ---------- end py_10 ----------

plane_3 = Plane(base_geo.pick_up_plane_safe)

# ----
# Planning scene
scene = PythonScript(robot=robot)  # -> scene
# ---------- scene: Python ----------
from scriptcontext import sticky as st

from compas_fab.robots import PlanningScene

# store scene in component
guid = str(ghenv.Component.InstanceGuid)
scene_key = "scene_" + guid

if scene_key not in st:
    st[scene_key] = None

if robot:
    st[scene_key] = PlanningScene(robot)

scene = st[scene_key]
# ---------- end scene ----------
panel_10 = Panel(create.out)

panel_11 = Panel("Define an obstacle")
colour_swatch_2 = ColourSwatch(SwatchColor=RGB(255, 156, 156))  # disabled
brep = Brep(<brep referenced from the Rhino model>)  # disabled
preview_2 = CustomPreview(Geometry=brep, Shader=colour_swatch_2)  # disabled
mesh = Mesh(brep)  # disabled
mesh_2 = PythonScript(mesh=mesh)  # -> compas_mesh; disabled
# ---------- mesh_2: Python ----------
from compas.datastructures import Mesh
from compas_rhino.geometry import RhinoMesh

compas_mesh = RhinoMesh.from_guid(mesh).to_compas()
# ---------- end mesh_2 ----------
remove_2 = Button()
scale = BooleanToggle(False)
add_2 = Button()
collision = PythonScript(
    scene=scene,
    compas_mesh=counter.assembly,
    assembly=counter.assembly,
    counter=counter.counter,
    scale=scale,
    id="60",
    add=add_2,
    remove=remove_2)  # -> out; inputs counter: Int32
# ---------- collision: Python ----------
from compas_fab.robots import CollisionMesh
from compas.datastructures import mesh_transformed

T_to_local = scene.robot.transformation_WCF_RCF(group=None)

cm = []

current_key = counter

for key, element in assembly.elements():
    if key < current_key:
        cmt = mesh_transformed(element.mesh, T_to_local)
        m = CollisionMesh(cmt, str(key))
        cm.append(m)

if scene:
    if add:
        for mesh in cm:
            scene.add_collision_mesh(mesh, scale)
    if remove:
        scene.remove_collision_mesh(id)
# ---------- end collision ----------
panel_12 = Panel(collision)

# ----
# Attach an collision object
# Select link name to attach
# Select the links the object is allowed to touch
yz = YZPlane(Origin=Point(0, 0, 0))
cone = Cone(Base=yz, Radius=0.035, Length=0.1)  # -> Cone, Tip
mesh_3 = Mesh(cone.Cone)
mesh_4 = PythonScript(mesh=mesh_3)  # -> compas_mesh; same code as mesh_2
idxs = Data([3, 4, 5, 6, 7])
py_11 = PythonScript(robot=robot, idxs=idxs)  # -> touch_links; inputs idxs: list of Int32
# ---------- py_11: Python ----------
if robot:
    link_names = robot.get_link_names()
    touch_links = [link_names[i] for i in idxs]
# ---------- end py_11 ----------
py_12 = PythonScript(robot=robot, idx=Slider(7, range=0..7))  # -> link_name; inputs idx: Int32
# ---------- py_12: Python ----------
if robot:
    link_names = robot.get_link_names()
    #print link_names
    link_name = link_names[idx]
# ---------- end py_12 ----------
panel_13 = Panel(py_12)
panel_14 = Panel(py_11)
remove_3 = Button()  # disabled
add_3 = Button()  # disabled
scale_2 = BooleanToggle(False)
attached = PythonScript(
    scene=scene,
    compas_mesh=python_2.compas_mesh,
    scale=scale_2,
    id="tip",
    link_name=py_12,
    touch_links=py_11,
    add=add,
    remove=remove)  # -> acm, out; inputs touch_links: list
# ---------- attached: Python ----------
from compas_fab.robots import CollisionMesh
from compas_fab.robots import AttachedCollisionMesh

cm = CollisionMesh(compas_mesh, id)
acm = AttachedCollisionMesh(cm, link_name, touch_links)

if scene:
    if add:
        scene.add_attached_collision_mesh(acm, scale)
    if remove:
        scene.remove_attached_collision_mesh(id)
        scene.remove_collision_mesh(id)
# ---------- end attached ----------

# ----
# Select link name to attach
# Select the links the object is allowed to touch
brep_2 = Brep(<brep referenced from the Rhino model>)
mesh_5 = Mesh(brep_2)
mesh_6 = PythonScript(mesh=mesh_5)  # -> compas_mesh; same code as mesh_2
idxs_2 = Data([0, 1])
py_13 = PythonScript(robot=robot, idxs=idxs_2)  # -> touch_links; inputs idxs: list of Int32; same code as py_11
py_14 = PythonScript(robot=robot, idx=Slider(0, range=0..7))  # -> link_name; inputs idx: Int32; same code as py_12
panel_15 = Panel(py_14)
panel_16 = Panel(py_13)
remove_4 = Button()
add_4 = Button()
scale_3 = BooleanToggle(False)
attached_2 = PythonScript(
    scene=scene,
    compas_mesh=mesh_6,
    scale=scale_3,
    id="base_coll",
    link_name=py_14,
    touch_links=py_13,
    add=add_4,
    remove=remove_4)  # -> acm, out; inputs touch_links: list; same code as attached

# ----
# App to Rhino:
# Topic: OBJECT POSES
subscribe_incon_object_pose = BooleanToggle(True)
subscribe = PythonScript(ros_client=ros_client, subscribe_to_topic=subscribe_incon_object_pose)  # -> out; inputs subscribe_to_topic: Boolean
# ---------- subscribe: Python ----------
import time
import logging
import datetime
import Grasshopper
from roslibpy import Topic
from scriptcontext import sticky

LOGGER = logging.getLogger('roslibpy')
key = 'listener_obj_pose'
#print key

if subscribe_to_topic:
    if ros_client and ros_client.is_connected:
        print("subscribed to topic")
        #listener = Topic(ros_client, '/incon/object_pose', 'geometry_msgs/PoseStamped', compression=None, latch=False, throttle_rate=0, queue_size=15, queue_length=3)
        listener = Topic(ros_client, '/incon/object_poses', 'incon_msgs/PoseStampedArray')
        sticky[key] = listener
    else:
        sticky[key] = None
else:
    sticky[key] = None
# ---------- end subscribe ----------
panel_17 = Panel(subscribe)

# ----
# Info
info = PythonScript(robot=robot)  # -> out, main_group_name
# ---------- info: Python ----------
if robot:
    robot.info()
    main_group_name = robot.main_group_name
# ---------- end info ----------
panel_18 = Panel(info.out)

# ----
# for testing
pt = Point(<point referenced from the Rhino model>)
x = Curve(<curve referenced from the Rhino model>)
y = Curve(<curve referenced from the Rhino model>)
pl = ConstructPlane(Origin=pt, XAxis=x, YAxis=y)
python_3 = GhPythonScript(plane=pl)  # -> added_elem_frame
# ---------- python_3: Python ----------
import rhinoscriptsyntax as rs
from compas.geometry import Frame


added_elem_frame = Frame(plane.Origin, plane.XAxis, plane.YAxis)
# ---------- end python_3 ----------
frame_id = Data(15)

data = Data(null)
panel_19 = Panel(listening_and_publishing.added_elem_frame)

# ----
# Input
panel_20 = Panel("Start plane")  # disabled
panel_21 = Panel("End plane")  # disabled
pt_2 = Point(Point(0.4148048473, 0.0806959495, 0.2818520837))  # disabled
pt_3 = Point(Point(0.3351751375, 0.6978514459, 0.3015280014))  # disabled
py_15 = GhPythonScript(pt=pt_2)  # -> pln; disabled
# ---------- py_15: Python ----------
import Rhino.Geometry as rg

pln = rg.Plane(pt, -rg.Vector3d.ZAxis)
# ---------- end py_15 ----------
py_16 = GhPythonScript(pt=pt_3)  # -> pln; disabled; same code as py_15
start_plane = Plane(py_16)  # disabled
end_plane = Plane(py_15)  # disabled

num = Number(60)
pt_4 = Point([<point referenced from the Rhino model> x2])

# ----
# 4.
dimensions_w_l_h_a = Panel("""0.025
0.4
0.049
0.049""")
cluster = Cluster(dims=dimensions_w_l_h_a)  # -> elem_center, elem_x, elem_y, elem_z
button_2 = Button()
arrow_viz = ColourSwatch(SwatchColor=RGBA(235, 75, 165, 169))
import_object_pose = GhPythonScript(
    assembly=ros_service_request_2.assembly,
    arrow_viz=arrow_viz,
    elem_center=cluster.elem_center,
    elem_x=cluster.elem_x,
    elem_y=cluster.elem_y,
    elem_z=cluster.elem_z,
    base_plane=pln,
    add_new_elem=button_2,
    added_elem_frame=data,
    targets=pt_4,
    angle_threshold=num,
    frame_id=listening_and_publishing.frame_id)  # -> out, planes, added_elem_geo, assembly, robot_keys, add_new_elem; inputs base_plane: Plane, targets: list of Point3d
# ---------- import_object_pose: Python ----------
import os
import sys
import Rhino.Geometry as rg
import ast

from scriptcontext import sticky

from compas.geometry import Frame, Plane, Point
from compas.geometry import Vector
from compas.geometry import Transformation, Translation
from compas.geometry import distance_point_point, angle_vectors
from compas_ghpython import draw_frame
from compas.utilities import normalize_values

from human_robot_collaborative_assembly.assembly import HRCAssembly as Assembly
from human_robot_collaborative_assembly.assembly import HRCElement as Element

from compas_ghpython.artists import MeshArtist

planes = []
""""
for key, element in assembly.elements():
    print assembly.network.node_attribute(key, 'frame_id')
"""
#print("len")
#print(list(assembly.network.nodes()))
#print(list(assembly.network.nodes_where({'key':0})))
#print(((assembly.element(0, data=True))))
#assembly.add_element(elem_x, elem_type='Y', placed_by='human', on_ground=False, frame_id=frame_id, frame_est="frame_est")

if 'assembly' not in sticky:
    sticky['assembly'] = assembly

if 'robot_keys' not in sticky:
    sticky['robot_keys'] = []

    
# visualise the geo of newly received pose
if added_elem_frame:
    T = Transformation.from_frame(added_elem_frame)
    added_elem = elem_center.transformed(T)
    artist = MeshArtist(added_elem.mesh)
    added_elem_geo = artist.draw_mesh()
    elem_plane = draw_frame(added_elem_frame)
"""
added_elem_geo = []
newly_added = list(assembly.elements())[-2:]
for key, element in newly_added:
    artist = MeshArtist(element.mesh)
    added_elem_geo.append(artist.draw_mesh())
"""
    
    
# params
min_dist = 0.25
object_poses = []
options = []
#sticky['robot_keys'] = []

frame_id = 37



# check if frame_id exists:
key_frame_id = []
if frame_id:
    
    #key_frame_id = list(assembly.network.nodes_where({'frame_id': frame_id})) #[key for key in assembly.network.nodes_where({'frame_id': frame_id})]
    key_frame_id = [key for key in assembly.network.nodes_where({'frame_id': frame_id})]
    
    print "frame_id, key_frame_id: ", frame_id, key_frame_id
    #print assembly.element(key_frame_id[0])
    #print list(assembly.network.nodes())
    #assembly.network.node_attribute(key_frame_id[0], name='frame_est', value=added_elem_frame)
    #print assembly.network.node_attribute(key_frame_id[0], 'frame_est')
   
    

#if not len(key_frame_id) and frame_id and add_new_elem: # if frame_id does not yet exist in the assembly
if len(key_frame_id)<2 and frame_id and add_new_elem: # if frame_id does not yet exist in the assembly
    print('hello')
    
    frame_id = frame_id
    p = added_elem_frame.point
    
    
    #add a new module based on the tracked element's location
    assembly.p_key = assembly.parent_key(p, min_dist) # compute parent key
    current_key = assembly.p_key
    current_key = 70
    print(current_key)
    e = assembly.element(current_key)
    current_type = e._type
    print('type:', current_type)
    #compute direction
    axis_map = {'X': 0, 'Y': 1, 'Z': 2}
    if p[axis_map[current_type]] < e.frame.point[axis_map[current_type]]:
        direction = 0
        connector_frame = e.connector_frame_2
    else:
        direction = 1
        connector_frame = e.connector_frame_1

    a = connector_frame.point[axis_map[current_type]]
    b = p[axis_map[current_type]]

    if current_type == 'Z':
        b -= e._source.xsize/2.
        
    if abs(a) > abs(b): 
        shift_value = abs(a - b)
    else:
        shift_value = -abs(a - b)
        
    #print(shift_value)
    
    if current_type == 'Y':
        c = connector_frame.point.x - added_elem_frame.point.x
        print (c)
        T = Translation(added_elem_frame.xaxis*-c)
    
        new_elem_x = elem_x.transformed(T)
    
    else:
        new_elem_x = elem_x
    

    dict_result = assembly.add_module(new_elem_x, elem_y, elem_z, current_key, direction, shift_value=shift_value, on_ground = False, added_frame_id=frame_id, frame_est=added_elem_frame)
    print(dict_result)
    sticky['robot_keys'] = dict_result['keys_robot'] #maybe the list length needs to be checked, if objects are colliding and are therefore not placed!

    #assembly.add_module(elem_x, elem_y, elem_z, current_key, direction, shift_value, on_ground = False, added_frame_id=frame_id)
    #robot_keys = [key for key in assembly.network.nodes()][-2:]
    #sticky['robot_keys'] = robot_keys

robot_keys = sticky['robot_keys']
print('robot keys: ', robot_keys)

"""
for key, element in assembly.elements():
    planes.append(draw_frame(element.frame))
"""

for key, element in assembly.elements():
    connectors = element.connectors()
    for connector in connectors:
        planes.append(draw_frame(connector))

# Options
# Options visualization settings
r = arrow_viz[0]
g = arrow_viz[1]
b = arrow_viz[2]
a = arrow_viz[3]
min = 0
max = 255

min,r,g,b,a,max = normalize_values([min,r,g,b,a,max], 0.0, 1.0)
#print r,g,b,a 

def range_filter(options, base_plane):
    ur_range_max = 1.2
    ur_range_min = 0.75
        
    base_point= Point(base_plane.Origin.X, base_plane.Origin.Y, base_plane.Origin.Z)
    filtered_options = []
    for key, elem_origin, option_vector in options:
        v = Vector.from_start_end(elem_origin, base_point)
        dist = v.length
        if ur_range_min <= dist <= ur_range_max:
            filtered_options.append((key, elem_origin, option_vector))
    return filtered_options

def filter_options(all_options, target_points):
    tps = [Point(p.X, p.Y, p.Z) for p in target_points]
    filtered_options = []
    for tp in tps:
        for key, elem_origin, option_vector in all_options:
            v = Vector.from_start_end(elem_origin, tp)
            angle = angle_vectors(option_vector, v, deg=True)
            if angle < angle_threshold:
                filtered_options.append((key, elem_origin, option_vector))
    return filtered_options

all_options = []

for key, element in list(assembly.elements())[-12:]:
    for origin, vector in element.options_vectors_(0.3):
        all_options.append((key, origin, vector))

assembly.all_options = all_options

filtered_options = filter_options(all_options, targets)
options_in_range = range_filter(filtered_options, base_plane)

# Assembly options as Float32MultiArray
for key, elem_origin, vector in filtered_options:
    T = Translation(vector)
    position = elem_origin.transformed(T)
    length = vector.length - element._source.xsize
    x_dir = vector
    y_dir = vector.cross(assembly.element(key).frame.zaxis)
    frame = Frame(position, x_dir, y_dir)
    orientation = frame.quaternion
    #[x,y,z,qw,qx,qy,qz,r,g,b,a,length]
    options.append([position[0], position[1], position[2], orientation[0], orientation[1], orientation[2], orientation[3], r, g, b, a, length])


#print(options)
#assembly.current_options = options
assembly.current_options = options#[:5]
# ---------- end import_object_pose ----------
draw = GhPythonScript(
    assembly=import_object_pose.assembly,
    show_assembly=Toggle(True),
    show_options=Toggle(True),
    show_est_poses=Toggle(False),
    plot_rot=Toggle(False),
    plot_pos=Toggle(False))  # -> G_assembly, pr, vr, tag_text, tag_point, new_elems_geo; inputs show_est_poses: Boolean
# ---------- draw: Python ----------
import os
import sys
import Rhino.Geometry as rg
import math

from compas.geometry import Frame, Point, Transformation
from compas_ghpython import draw_frame
from compas_ghpython.artists import MeshArtist
from compas.geometry import Translation, distance_point_point, angle_vectors
from compas.utilities import normalize_values, i_to_red, i_to_blue

G_assembly = []

vr = []
pr = []
tag_text = []
tag_point = []

#key_index = assembly.network.key_index()
#keys = [key_index[key] for key in assembly.network.nodes()]
keys = [key for key, element in assembly.elements()]
elements = [assembly.element(key) for key in keys] 

total = 0
pos_values = []
rot_values = []
colorize = []
min = 0
max = 100
new_elems = []
new_elems_geo = []


for key, element in assembly.elements():
    frame_est = assembly.network.node_attribute(key, 'frame_est')
    if frame_est != None:
        T = Transformation.from_frame_to_frame(element.frame, frame_est)
        new_elems.append(element.transformed(T))
        dist = distance_point_point(frame_est.point, element.frame.point)*1000
        total += dist
    else:
        dist = 0
    pos_values.append(dist)

if show_est_poses:
    for elem in new_elems:
        artist1 = MeshArtist(elem.mesh)
        #mesh = artist.draw_mesh(color=colorize[key])
        mesh1 = artist1.draw_mesh()
        new_elems_geo.append(mesh1)

for key, element in assembly.elements():
    frame_est = assembly.network.node_attribute(key, 'frame_est')
    if frame_est != None:
        rot = math.degrees(angle_vectors(frame_est.xaxis, element.frame.xaxis))
        total += rot
    else:
        rot = 0
    if rot > 178:
        rot = 180 - rot
    #print key, rot
    rot_values.append(rot)


#new_values = normalize_values(pos_values, 0.0, 1.0)
new_values = normalize_values(rot_values, 0.0, 1.0)


for value in new_values:
    if plot_pos and not plot_rot:
        colorize.append(i_to_red(value))
    elif plot_rot and not plot_pos:
        colorize.append(i_to_blue(value))
    


if show_assembly:
    for key, element in assembly.elements():
        T = Translation(element.frame.xaxis*0.25)
        artist = MeshArtist(element.mesh)
        if plot_pos or plot_rot:
            mesh = artist.draw_mesh(color=colorize[key])
        else:
            mesh = artist.draw_mesh()
        G_assembly.append(mesh)
        tag_text.append(str(key))
        tag_point.append(draw_frame(element.frame.transformed(T)).Origin)

if show_options:
    for o in assembly.current_options:
        option_frame = Frame.from_quaternion([o[3], o[4], o[5], o[6]], point=[o[0], o[1], o[2]])
        l = o[11]
        start = option_frame.point - option_frame.xaxis*l 
        pr.append(rg.Point3d(start.x, start.y, start.z))
        v = option_frame.xaxis*l 
        vr.append(rg.Vector3d(*tuple(v)))
# ---------- end draw ----------
vdis = VectorDisplay(Anchor=draw.pr, Vector=draw.vr)
tag = TextTag(Location=draw.tag_point, Text=draw.tag_text, Colour=ColourSwatch(SwatchColor=RGB(255, 0, 0)))
mesh_7 = Mesh(import_object_pose.added_elem_geo)

# ----
# sound
button_3 = Button()
sound = GhPythonScript(init=button_3)  # -> out, ps
# ---------- sound: Python ----------
from threading import Thread, Condition
import time

from scriptcontext import sticky as st
import winsound
import os


sounds = {'add_objects': "add.wav", 'remove_objects': "remove.wav", 'receive_objects': "receive.wav", 'accept_new_object': "accept.wav", 'end': "end.wav"}
DATA = st['DATA_PATH']
#path = os.path.join(DATA, soundfile_name)


     

class PlaySound():
    
    def __init__(self, sounds, path):
        self.sounds = sounds
        self.path = path
        self.sound = sounds['add_objects']
        self.log_messages = []
        self.log_messages_length = 10

        self.iterations = 0        
        self.run_thread_flag = True
        self.log("INIT")
        self.reset()
        self.log("RESET")

    def reset(self):
        self.run_thread_flag = True
        self.t = Thread(target = self.run)
        self.t.daemon = True  # OK for main to exit even if instance is still running
        self.t.paused = True  # start out paused
        self.t.state = Condition()
        
    def resume(self):
        with self.t.state:
            self.t.paused = False
            self.t.state.notify()  # unblock self if waiting

    def pause(self):
        with self.t.state:
            self.t.paused = True  # make self block and wait
    
    def start(self):
        self.t.start()
    
    def join(self):
        self.t.join()
    
    def is_paused(self):
        return self.t.paused
    
    def is_alive(self):
        return self.t.is_alive()
    
    def set_sound(self, sound):
        self.sound = self.sounds[sound]
    
    def run(self):
        self.resume() 
        while True:
            with self.t.state:
                if self.t.paused:
                    self.t.state.wait() # block until notified
                
                if self.run_thread_flag == False:
                    break
                
                ok = self.perform_task()
                
            self.iterations += 1
            
            if self.run_thread_flag == False:
                break

    def perform_task(self):
        """ This method has to be overwitten ... """
        
        self.log("TASK START: ---->>>>>")
        
        # do something
        self.log(self.sound)
        path = os.path.join(DATA, self.sound)
        winsound.PlaySound(path, winsound.SND_FILENAME)
        ok = True
        
        if not ok:
            return False
        
        self.log("----<<<<< TASK FINISHED")
        
        self.run_thread_flag = False
        self.log("run_thread_flag to FALSE")
        return True
    
    def log(self, msg):
        self.log_messages.append("SOUND: " + str(msg))
        if len(self.log_messages) > self.log_messages_length:
            self.log_messages = self.log_messages[-self.log_messages_length:] 
    
    def get_log_messages(self):       
        return "\n".join(self.log_messages)
        

ps = PlaySound(sounds, DATA)
# ---------- end sound ----------
play = GhPythonScript(
    ps=sound.ps,
    sound_add_objects=ros_service_request_2.bang,
    sound_remove=ros_service_request.bang,
    sound_receive=Button(),
    sound_accept_new_object=button_2,
    sound_end=Button(),
    stop=Button())  # -> out
# ---------- play: Python ----------
if sound_add_objects:
    ps.reset()
    ps.set_sound('add_objects')
    ps.run_thread_flag = True
    ps.start()
    
    
if sound_remove:
    ps.reset()
    ps.set_sound('remove_objects')
    ps.run_thread_flag = True
    ps.start()

if sound_receive:
    ps.reset()
    ps.set_sound('receive_objects')
    ps.run_thread_flag = True
    ps.start()

if sound_accept_new_object:
    ps.reset()
    ps.set_sound('accept_new_object')
    ps.run_thread_flag = True
    ps.start()

if sound_end:
    ps.reset()
    ps.set_sound('end')
    ps.run_thread_flag = True
    ps.start()
    
    
if stop:
    ps.run_thread_flag = False
    ps.join()
    
print(ps.get_log_messages())
# ---------- end play ----------

mesh_8 = Mesh(draw.G_assembly)
pln_2 = Plane(import_object_pose.planes)

# ---- group: forward kinematics
a5 = Slider(-90, range=-360..360)
a1 = Slider(-106, range=-360..360)
a2 = Slider(-92, range=-360..360)
a3 = Slider(125, range=-360..360)
a6 = Slider(-195, range=-360..360)
a4 = Slider(-122, range=-360..360)
jp = GhPythonScript()  # -> joint_positions
# ---------- jp: Python ----------
import math

#joint_positions = [-90,-90,90,-90,-90,-180]
#joint_positions = [90,-90,-90,-90,90,0]
#joint_positions = [107.936081, -87.620144,-124.71515,-57.629241,90.148607,-161.978033]
joint_positions = [-106.347424, -92.326992, 124.645822, -122.353418, -89.778476, -195.448509]


#joint_positions = [-93.189867, -88.650322, 113.031968, -149.869716, -69.308986, 33.809094]
joint_positions = [math.radians(a) for a in joint_positions]
#joint_positions = [-3.136, -0.328, -1.218, 3.129, 0.852, 0.008]
#joint_positions = [0] * 6

print joint_positions

-93.189867, -88.650322, 113.031968, -149.869716, -69.308986, 33.809094
# ---------- end jp ----------
forward_kinematics = PythonScript(robot=robot, set_joint_positions=Button(), joint_positions=jp, a1=a1, a2=a2, a3=a3, a4=a4, a5=a5, a6=a6)  # -> full_configuration; inputs joint_positions: list
# ---------- forward_kinematics: Python ----------
import math
import Grasshopper
from compas.robots import Joint
from compas_fab.robots import Configuration

if set_joint_positions:

    j = 0
    for i in range(ghenv.Component.Params.Input.Count):
        nslider = ghenv.Component.Params.Input[i].Sources[0]
        if nslider.GetType() == Grasshopper.Kernel.Special.GH_NumberSlider:
            nslider.TrySetSliderValue(math.degrees(joint_positions[j]))
            j += 1

if robot:
    joint_positions = [a1, a2, a3, a4, a5, a6]
    joint_types = robot.get_configurable_joint_types()
    for i, joint_type in enumerate(joint_types):
        if joint_type == Joint.REVOLUTE:
            joint_positions[i] = math.radians(joint_positions[i])
    full_configuration = Configuration(joint_positions, joint_types)
# ---------- end forward_kinematics ----------

# ----
wbtriangles = WeaverbirdsSplitTrianglesSubdivision(Level=1)
preview_3 = CustomPreview(Geometry=wbtriangles, Shader=ColourSwatch(SwatchColor=RGB(230, 145, 145)))
wbtriangles_2 = WeaverbirdsSplitTrianglesSubdivision(MeshCurves=draw.new_elems_geo, Level=1)
preview_4 = CustomPreview(Geometry=wbtriangles_2, Shader=ColourSwatch(SwatchColor=RGB(237, 202, 202)))
wbtriangles_3 = WeaverbirdsSplitTrianglesSubdivision(MeshCurves=mesh_8, Level=1)
colour_swatch_3 = ColourSwatch(SwatchColor=RGB(255, 255, 255))
preview_5 = CustomPreview(Geometry=wbtriangles_3, Shader=ColourSwatch(SwatchColor=RGB(255, 241, 184)))

# ----
# Rhino receive and compute
panel_22 = Panel(import_object_pose.out)

# ----
# 5.a
# Rhino to App
# All arrows that need to be visualized are published via a ROS topic OPTIONS
# 5.b
publish_rhino_options = BooleanToggle(True)
publish = PythonScript(ros_client=ros_client, publish_topic=publish_rhino_options)  # -> out
# ---------- publish: Python ----------
import logging
from roslibpy import Topic
from roslibpy import ServiceRequest
from roslibpy import Service
from scriptcontext import sticky

LOGGER = logging.getLogger('roslibpy')


#key = 'publisher_%s' % str(ghenv.Component.InstanceGuid)

key = 'publisher_options'
#print key

if publish_topic:
    #print("publish")
    if ros_client and ros_client.is_connected:
        print("published topic")
        publisher = Topic(ros_client, '/incon/arrows_to_draw', 'std_msgs/Float32MultiArray')
        sticky[key] = publisher
    else:
        sticky[key] = None
else:
    sticky[key] = None
# ---------- end publish ----------
panel_23 = Panel(publish)

# ----
# Rhino to App:
# Service: ADD OBJECTS
button_4 = Button()
ros_service_request_3 = PythonScript(ros_client=ros_client, assembly=import_object_pose.assembly, new_keys=import_object_pose.robot_keys, send=button_4)  # -> out, assembly, bang, planes; inputs new_keys: list, send: Boolean
# ---------- ros_service_request_3: Python ----------
import logging
import roslibpy
from roslibpy import Topic
from roslibpy import ServiceRequest
from roslibpy import Service
from roslibpy import Message
from scriptcontext import sticky

from compas.geometry import Frame
from compas_ghpython import draw_frame


LOGGER = logging.getLogger('roslibpy')    

def ros_msg_add_objects():
    ros_msg = {}
    pose_stamped_array = []
    #for key, element in assembly.elements():
    for key in sticky['robot_keys']:
        element = assembly.element(key)
        x,y,z,qw,qx,qy,qz = element.get_pose_quaternion()
        pose_stamped_array.append({'header':{'seq': 0, 'stamp':{'secs': 0, 'nsecs': 0}, 'frame_id': str(key)}, 'pose': {'position': {'x': x, 'y': y, 'z': z}, 'orientation': {'x': qx, 'y': qy, 'z': qz, 'w': qw}}})
    ros_msg['poses'] = pose_stamped_array
    return ros_msg


if send:
    print("send")
    if ros_client and len(sticky['robot_keys']):
            message = ros_msg_add_objects() #geometry_msgs/PoseStamped[] 
            #message = handle_add_two_bricks()[0] #geometry_msgs/PoseStamped[] 
            print (message)                
            service_name = '/incon/add_objects'
            service_type = '/incon_msgs/add_objects'
            service = roslibpy.Service(ros_client, service_name, service_type)
            request = ServiceRequest(message)
            result = service.call(request, timeout=1) #sending of message
            print(result)
            sticky['result_add_objects'] = result
            
            if result:
                
                added_keys, added_ids = (result['added_keys'], result['added_ids']) # set the frame_id as received from the app
                for key, id in zip(added_keys, added_ids):
                    assembly.network.node_attribute(key, 'frame_id', id)
                sticky['robot_keys'] = [] # remove the robot keys, so that they cannot be sent twice
                bang = True if result['success'] == True else False
            
if 'result_add_objects' in sticky:
    print sticky['result_add_objects']
    print 'robot keys: ', sticky['robot_keys']

"""
p1 = ros_msg_add_objects()['poses'][0]['pose']
p2 = ros_msg_add_objects()['poses'][1]['pose']

print p1['orientation']['w']

f1 = Frame.from_quaternion([p1['orientation']['w'], p1['orientation']['x'], p1['orientation']['y'], p1['orientation']['z']], point=[p1['position']['x'], p1['position']['y'], p1['position']['z']])
planes = draw_frame(f1)

"""
# ---------- end ros_service_request_3 ----------
panel_24 = Panel(ros_service_request_3.out)

pln_3 = Plane(ros_service_request_3.planes)

# ----
# Export .json
export = Button()
python_4 = GhPythonScript(
    DATA=py_2.DATA,
    assembly=ros_service_request_3.assembly,
    export_to_json=export,
    add_new_elem=import_object_pose.add_new_elem)  # -> out; inputs export_to_json: Boolean
# ---------- python_4: Python ----------
import os

from datetime import datetime

now = datetime.now() # current date and time

date_time = now.strftime("%Y_%m_%d_%H_%M_%S")
filename = "hrca/hrca_current_assembly_{}.json".format(date_time)
print(filename)


if export_to_json or add_new_elem:
    filename = "hrca/hrca_current_assembly_{}.json".format(date_time)
    PATH = os.path.join(DATA, filename)
    assembly.to_json(PATH, True)
# ---------- end python_4 ----------
filename = Panel(python_4)

# ----
# Settings
# --> Set your IP address
# --> Set robot IP address
server_ip = ValueList({"192.168.10.44", "192.168.10.12", "192.168.10.11", "192.168.10.10", "192.168.10.2", "127.0.0.1", "192.168.10.111"}, selected="192.168.10.11")
ur_ip = ValueList({"192.168.10.10", "192.168.10.20", "192.168.10.11", "192.168.10.12", "127.0.0.1", "192.168.10.111"}, selected="192.168.10.20")
server_port = ValueList({"50002", "50003", "50004", "50005"}, selected="50003")
ur_port = ValueList({"30002"}, selected="30002")
globals = PythonScript(server_address=server_ip, server_port=server_port, ur_ip=ur_ip, ur_port=ur_port, clear=Button())  # inputs server_port: Int32
# ---------- globals: Python ----------
from scriptcontext import sticky as st

st["server_address"] = server_address
st["server_port"] = server_port

st["ur_ip"] = ur_ip
st["ur_port"] = ur_port

if clear:
    st.clear()
# ---------- end globals ----------

# ----
# Check if UR robot
#  is available
ping = Button()
py_17 = PythonScript(ip=ur_ip, ping=ping)  # -> out, trigger
# ---------- py_17: Python ----------
from scriptcontext import sticky as st
from ur_online_control.ur_direct import is_available

guid = str(ghenv.Component.InstanceGuid)
txt_key = "txt_" + guid
if txt_key not in st:
    st[txt_key] = ""

if ping:
    
    available = is_available(ip)
    
    if available:
        st[txt_key] = "%s is up!" % ip
        trigger = True
    else:
        st[txt_key] = "%s is down!" % ip
        trigger = False

print(st[txt_key])
# ---------- end py_17 ----------
panel_25 = Panel(py_17.out)

pi = Pi(Factor=1)

panel_26 = Panel("get pose cartesian")
get = Button()
pose = PythonScript(get=get)  # -> pose_cartesian
# ---------- pose: Python ----------
from scriptcontext import sticky as st
import ur_online_control.ur_direct as urd

server_address = st["server_address"]
server_port = st["server_port"]
ur_port = st["ur_port"]
ur_ip = st["ur_ip"]

robot = st["robot_6e25a56a-ecab-4ebc-a3bd-f9966f8a8dbc"]
tool_angle_axis = list(robot.attached_tool.frame.point) + list(robot.attached_tool.frame.axis_angle_vector)

print(tool_angle_axis)

guid = str(ghenv.Component.InstanceGuid)
pose_cartesian_key = "pose_cartesian" + guid


if get:
    st[pose_cartesian_key] = urd.get_current_pose_cartesian(tool_angle_axis, server_address, server_port, ur_ip, ur_port, send=True)

if pose_cartesian_key not in st:
    pose_cartesian = []
else:
    pose_cartesian = st[pose_cartesian_key]

print(pose_cartesian)
# ---------- end pose ----------
py_18 = PythonScript(robot=robot, pose_cartesian=pose)  # -> frame_WCS, plane_WCS; inputs pose_cartesian: list
# ---------- py_18: Python ----------
import Rhino.Geometry as rg
from scriptcontext import sticky as st
from compas.geometry import Frame
from compas.geometry import Transformation
from compas_ghpython import draw_frame

robot = st["robot_6e25a56a-ecab-4ebc-a3bd-f9966f8a8dbc"]
pose = pose_cartesian

if pose_cartesian:
    #frame_RCS = Frame.from_pose_axis_angle_vector(pose_cartesian)
    frame_RCS = Frame.from_axis_angle_vector(axis_angle_vector=pose[3:], point=pose[:3])
    frame_WCS = robot.to_world_coords(frame_RCS)
    plane_WCS  = draw_frame(frame_WCS)
    print frame_RCS
# ---------- end py_18 ----------
draw_2 = Draw(frame=py_18.frame_WCS)  # -> G, C
panel_27 = Panel(pose)
preview_6 = CustomPreview(Geometry=draw_2.G, Shader=py_18.plane_WCS)

movel = PythonScript()  # -> script
# ---------- movel: Python ----------
import math
from scriptcontext import sticky as st
import ur_online_control.ur_direct as urd

server_address = st["server_address"]
server_port = st["server_port"]
robot = st["robot_6e25a56a-ecab-4ebc-a3bd-f9966f8a8dbc"]
tool_angle_axis = list(robot.attached_tool.frame.point) + list(robot.attached_tool.frame.axis_angle_vector)

commands = urd.URCommandScript(server_address, server_port)
commands.start()
commands.set_tcp(tool_angle_axis)
commands.get_current_pose_cartesian()
commands.add_line("\tmovel(p[current_pose[0], current_pose[1], current_pose[2], {}, {}, {}], a=0.1, v=0.1)".format(math.pi, 0, 0))
commands.end()
script = commands.generate()

print(script)
# ---------- end movel ----------
panel_28 = Panel("reorient tool vertical")
send = Button()
send_2 = GhPythonScript(script=movel, send=send)  # -> out; inputs send: Boolean
# ---------- send_2: Python ----------
from scriptcontext import sticky as st
from ur_online_control.ur_direct import send_script

ur_ip = st["ur_ip"]
ur_port = st["ur_port"]

if send:
    send_script(script, ur_ip, ur_port)
# ---------- end send_2 ----------

stop_2 = Button()
panel_29 = Panel("stop")
stop_3 = PythonScript(stop=stop_2)
# ---------- stop_3: Python ----------
from scriptcontext import sticky as st
import ur_online_control.ur_direct as urd

#ur_ip = st["ur_ip"]
#ur_port = st["ur_port"]

ur_ip = '192.168.10.20'
ur_port = 30002

if stop:
    urd.stop(ur_ip, ur_port)
# ---------- end stop_3 ----------

standard_routine = BooleanToggle(False)
move_to_home = BooleanToggle(True)
move_to_goal = BooleanToggle(False)
joint_positions = Data(forward_kinematics)

# ----
# Calculate basis
# Measure basis:
# 1. Clear the recorded poses
# 2. Move robot to origin and press "get pose"
# 3. Move robot to point in positive x-axis and press "get pose"
# 4. Move robot to an other point in your basis and press "get pose"
# (The further away these positions are, the better)
# 
# 5. Alternatively change the order in the component calc base
# 6. Copy output into base component (TODO: check if it has to be inverted)
list_9 = ValueList({"o, pos.x-axis, xy pl": 0, "o, pos.y-axis, xy pl": 1}, selected="o, pos.x-axis, xy pl")
clear = Button()
rec = PythonScript(msg=pose, rec=get, clear=clear)  # -> rec; inputs msg: list
# ---------- rec: Python ----------
from scriptcontext import sticky as st

guid = str(ghenv.Component.InstanceGuid)
recorded_key =  "recorded_" + guid
just_cleared_key = "just_cleared_" + guid


if recorded_key not in st:
    st[recorded_key] = []

if just_cleared_key not in st:
    st[just_cleared_key] = False

if clear:
    st[recorded_key] = []
    st[just_cleared_key] = True
else:
    if len(msg):
        if msg != [None] and not st[just_cleared_key] and rec:
            st[recorded_key].append(msg)
    st[just_cleared_key] = False
        


rec = st[recorded_key]

print rec
# ---------- end rec ----------
calc_base = PythonScript(poses=rec, input_type=list_9)  # -> out; inputs poses: list
# ---------- calc_base: Python ----------
import Rhino.Geometry as rg
import math


if len(poses) > 2:
    
    O = poses[0]
    P1 = poses[1]
    P2 = poses[2]
    
    if input_type == 0:
        # origin, pt on positive x-axis, pt in xy plane
        origin = rg.Point3d(O[0], O[1], O[2])
        pt_on_xaxis = rg.Point3d(P1[0], P1[1], P1[2])
        pt_in_xyplane = rg.Point3d(P2[0], P2[1], P2[2])
        
        xaxis = pt_on_xaxis - origin
        xaxis.Unitize()
        
        v = pt_in_xyplane - origin
        zaxis = rg.Vector3d.CrossProduct(v, xaxis)
        zaxis.Unitize()
        
        # zaxis must look up!
        if math.acos(rg.Vector3d.ZAxis * zaxis) > math.acos(rg.Vector3d.ZAxis * -zaxis):
            zaxis = -zaxis
        
        yaxis = rg.Vector3d.CrossProduct(zaxis, xaxis)
    
    elif input_type == 1:
        # origin, pt on positive y-axis, pt in xy plane
        origin = rg.Point3d(O[0], O[1], O[2])
        pt_on_yaxis = rg.Point3d(P1[0], P1[1], P1[2])
        pt_in_xyplane = rg.Point3d(P2[0], P2[1], P2[2])
        
        yaxis = pt_on_yaxis - origin
        yaxis.Unitize()
        
        v = pt_in_xyplane - origin
        zaxis = rg.Vector3d.CrossProduct(v, yaxis)
        zaxis.Unitize()
        
        # zaxis must look up!
        if math.acos(rg.Vector3d.ZAxis * zaxis) > math.acos(rg.Vector3d.ZAxis * -zaxis):
            zaxis = -zaxis
        
        xaxis = rg.Vector3d.CrossProduct(yaxis, zaxis)
        
        
    print "Copy the following into base component:"
    print " "
    print "origin = [%.2f, %.2f, %.2f]" % tuple(list(origin))
    print "xaxis = [%.5f, %.5f, %.5f]" % tuple(list(xaxis))
    print "yaxis = [%.5f, %.5f, %.5f]" % tuple(list(yaxis))
    

#print rg.Vector3d.CrossProduct(rg.Vector3d.YAxis, rg.Vector3d.ZAxis)
#print rg.Vector3d.CrossProduct(rg.Vector3d.ZAxis, rg.Vector3d.XAxis)
# ---------- end calc_base ----------
panel_30 = Panel(calc_base)
panel_31 = Panel(rec)

value = BooleanToggle(True)
panel_32 = Panel("set digital out")
number = Slider(7, range=0..10)
digital_out = PythonScript(number=number, value=value)  # -> script; inputs number: Int32, value: Boolean
# ---------- digital_out: Python ----------
import ur_online_control.ur_direct as urd

commands = urd.URCommandScript()
commands.start()
commands.add_line("\tset_digital_out({}, {})".format(number, value))
commands.end()
script = commands.generate()

print(script)
# ---------- end digital_out ----------
send_3 = Button()
send_4 = GhPythonScript(script=digital_out, send=send_3)  # -> out; inputs send: Boolean; same code as send_2

pln_4 = Plane(Plane(origin=(1.20403171, 2.150740913, 0.601961), x=(-0.0004520772686, 0.9999998978, 0), y=(-0.9999998978, -0.0004520772686, 0)))
x_axis_5 = Curve(<curve referenced from the Rhino model>)
y_axis_5 = Curve(<curve referenced from the Rhino model>)

# ----
# move incremental in TCS
number_slider = Slider(-8, range=-10..10)
get_current_pose = Button()
list_10 = ValueList({"xaxis", "yaxis", "zaxis"}, selected="zaxis")
movel_2 = PythonScript(get=get_current_pose, step_size=number_slider, direction=list_10)  # -> script
# ---------- movel_2: Python ----------
from scriptcontext import sticky as st
from compas.geometry import Frame
from compas.geometry import Point, Vector
import ur_online_control.ur_direct as urd

server_address = st["server_address"]
server_port = st["server_port"]
ur_port = st["ur_port"]
ur_ip = st["ur_ip"]
robot = st["robot_6e25a56a-ecab-4ebc-a3bd-f9966f8a8dbc"]

tool_angle_axis = list(robot.attached_tool.frame.point) + list(robot.attached_tool.frame.axis_angle_vector)
x, y, z, ax, ay, az = tool_angle_axis
print(tool_angle_axis)

guid = str(ghenv.Component.InstanceGuid)
pose_cartesian_key = "pose_cartesian" + guid

if get:
    st[pose_cartesian_key] = urd.get_current_pose_cartesian(tool_angle_axis, server_address, server_port, ur_ip, ur_port, send=True)

if pose_cartesian_key not in st:
    pose_cartesian = []
    script = ""
else:
#    frame = Frame.from_pose_axis_angle_vector(pose_cartesian)
    frame = Frame.from_axis_angle_vector([ax, ay, az])
    frame.point = [x, y, z]
    
    def next_vector(direction, frame, step_size):
        dir_vector = {"xaxis": Vector(*frame.xaxis), "yaxis": Vector(*frame.yaxis), "zaxis": Vector(*frame.zaxis)}
        vector = dir_vector[direction] * step_size
        return vector
    
    [x, y, z] = next_vector(direction, frame, step_size)
    commands = urd.URCommandScript(server_address, server_port)
    commands.start()
    commands.set_tcp(tool_angle_axis)
    commands.get_current_pose_cartesian()
    commands.add_line("\tmovel(p[current_pose[0] + {}, current_pose[1] + {}, current_pose[2] + {}, current_pose[3], current_pose[4], current_pose[5]], t={})".format(x/1000, y/1000, z/1000, step_size * 0.1))
    commands.end()
    script = commands.generate()
    
    print(script)
# ---------- end movel_2 ----------
send_5 = Button()
send_6 = GhPythonScript(script=movel_2, send=send_5)  # -> out; inputs send: Boolean; same code as send_2

idx_2 = Slider(0, range=0..100)
panel_33 = Panel("move joints")
joint_configurations = Data(forward_kinematics)
item = ListItem(List=joint_configurations, Index=idx_2, Wrap=True)
list_11 = ValueList({"send all positions": 0, "send only one position": 1}, selected="send all positions")
filter_3 = StreamFilter(Gate=list_11, Stream0=joint_configurations, Stream1=item)
movej = PythonScript(joint_configurations=filter_3, velocity=Slider(7, range=0..200))  # -> script, values; inputs joint_configurations: list
# ---------- movej: Python ----------
import ur_online_control.ur_direct as urd
import math


print joint_configurations

"""
for c in joint_configurations:
    for i,v in enumerate(c.values):
        #print v
        if v>math.pi:
            v-=2*math.pi
        if v<-math.pi:
            v+=2*math.pi
        c.values[i]=v
"""

joint_config = ["movej({}, v={})".format(c.values, velocity/10) for c in joint_configurations]

commands = urd.URCommandScript()
commands.start()
commands.add_lines(joint_config)
commands.end()

script = commands.generate()
values = joint_configurations[0].values

print([math.degrees(v) for v in values])

print(script)
# ---------- end movej ----------
send_7 = Button()
send_8 = GhPythonScript(script=movej.script, send=send_7)  # -> out; inputs send: Boolean
# ---------- send_8: Python ----------
from scriptcontext import sticky as st
from ur_online_control.ur_direct import send_script

#ur_ip = st["ur_ip"]
#ur_port = st["ur_port"]
ur_ip = '192.168.10.20'
ur_port = 30002

if send:
    send_script(script, ur_ip, ur_port)
# ---------- end send_8 ----------

# ---- group: BASE ESTIMATION MTIP POSES
init_guess = Plane(pln_4)
pt_5 = Point([<point referenced from the Rhino model> x3])
calc_base_2 = PythonScript(poses=rec, pts_cad=pt_5, base_plane_init_guess=init_guess, calc=Toggle(False))  # -> out, pts_mtip_init_guess, pts_mtip_fit, base_plane_fit; inputs poses: list, pts_cad: list of Point3d, base_plane_init_guess: Plane
# ---------- calc_base_2: Python ----------
import ghpythonlib.components as ghcomp
import Rhino.Geometry as rg
from scriptcontext import sticky as st
from compas.geometry import Frame
import math as m
import sys
from compas.rpc import Proxy # for calling the numpy function in CPython




if len(poses):
    
    # get points from poses
    pts_mtip = [rg.Point3d(p[0], p[1], p[2]) for p in poses]
    
    T_W_R_init_guess = rg.Transform.PlaneToPlane(rg.Plane.WorldXY, base_plane_init_guess)
    pts_mtip_init_guess = [ghcomp.Transform(pt, T_W_R_init_guess) for pt in pts_mtip]
    
    # format Rhino transformation
    T_W_R_init_guess_flattened = [float(f) for f in T_W_R_init_guess.ToFloatArray(True)]
    T_W_R_init_guess_list = [T_W_R_init_guess_flattened[i:(i + 4)] for i in range(0, len(T_W_R_init_guess_flattened), 4)]  

    # format ptsA and ptsB
    dataB = [list(pt) for pt in pts_cad]
    dataA = [list(pt) for pt in pts_mtip]
    
    # call the function
    max_iterations = 100
    
    if calc:
        icp_func = Proxy('ur_online_control.optimisation.icp', python = 'C://Users//lidet//anaconda3//envs//afab//python.exe')
        
        print icp_func._python
        

        
        transformation, distances = icp_func.icp(dataA, dataB, init_guess=T_W_R_init_guess_list, max_iterations=max_iterations, tolerance=0.000001)
        
        print "distances", distances
        
        # format result
        T = rg.Transform.Identity
        for i in range(4):
            for j in range(4):
                code = "T.M%i%i = %f" % (i, j, transformation[i][j])
                print code
                exec(code)
        #print T
        
        # now transform the points with the transformation calculated
        pts_mtip_fit = [ghcomp.Transform(pt, T) for pt in pts_mtip]
        base_plane_fit = ghcomp.Transform(rg.Plane.WorldXY, T)
        
        
        #f = Frame(base_plane_fit)
        #print f.get_pose_quaternion()
        
        # correct the zvalue
        #base_plane_fit = ghcomp.Transform(base_plane_fit, rg.Transform.Translation(0,0,-3))
# ---------- end calc_base_2 ----------
pt_6 = Point(calc_base_2.pts_mtip_init_guess)
pt_7 = Point(calc_base_2.pts_mtip_fit)
pln_5 = Plane(calc_base_2.base_plane_fit)

# ----
plane_4 = PythonScript(plane_axes=[x_axis_5, y_axis_5])  # -> plane; inputs plane_axes: list of Curve; same code as _9cm_off

panel_34 = Panel("move cartesian single")
movel_3 = PythonScript(plane_WCS=plane_4)  # -> script; inputs plane_WCS: Plane
# ---------- movel_3: Python ----------
import Rhino.Geometry as rg
import ur_online_control.ur_direct as urd
from compas.geometry import Frame
from compas.geometry import Transformation, Rotation
from compas_ghpython import draw_frame
from scriptcontext import sticky as st
import math


robot = st["robot_6e25a56a-ecab-4ebc-a3bd-f9966f8a8dbc"]

def to_local_coords(frame_WCF, group='manipulator'):
    """Represent a frame from the world coordinate system (WCF) in the robot's coordinate system (RCF).
    Parameters
    ----------
    frame_WCF : :class:`compas.geometry.Frame`
        A frame in the world coordinate frame.
    group : :obj:`str`, optional
        The name of the planning group. Defaults to the main planning group.
    Returns
    -------
    :class:`compas.geometry.Frame`
        A frame in the robot's coordinate frame.
    Examples
    --------
    >>> frame_WCF = Frame([-0.363, 0.003, -0.147], [0.388, -0.351, -0.852], [0.276, 0.926, -0.256])
    >>> frame_RCF = robot.to_local_coordinates(frame_WCF)
    >>> frame_RCF
    Frame(Point(-0.363, 0.003, -0.147), Vector(0.388, -0.351, -0.852), Vector(0.276, 0.926, -0.256))
    """
    base_frame =  robot.get_base_frame(group=group)
    R = Rotation.from_axis_and_angle(base_frame.zaxis, math.radians(-180), point=base_frame.point)
    base_frame =  base_frame.transformed(R)
    #T = Transformation.from_change_of_basis(Frame.worldXY(), base_frame)
    T = Transformation.change_basis(Frame.worldXY(), base_frame)
    frame_RCF = frame_WCF.transformed(T)
    return frame_RCF

frame_WCS = Frame(plane_WCS.Origin, plane_WCS.XAxis, plane_WCS.YAxis)
#frame_RCS = robot.get_RCS(frame_WCS)
#frame_RCS = to_local_coords(frame_WCS, group='manipulator')
frame_RCS = robot.to_local_coords(frame_WCS)

cmd = list(frame_RCS.point) + list(frame_RCS.axis_angle_vector) + [0.1, 0.0]
tool_angle_axis = list(robot.attached_tool.frame.point) + list(robot.attached_tool.frame.axis_angle_vector)
commands = urd.generate_moves_linear(tool_angle_axis, cmd, st["ur_ip"], st["ur_port"])
script = commands.script
print(script)
# ---------- end movel_3 ----------
send_9 = Button()
send_10 = GhPythonScript(script=movel_3, send=send_9)  # -> out; inputs send: Boolean
# ---------- send_10: Python ----------
from scriptcontext import sticky as st
from ur_online_control.ur_direct import send_script

"""
ur_ip = st["ur_ip"]
ur_port = st["ur_port"]
"""

ur_ip = '192.168.10.20'
ur_port = 30002

if send:
    send_script(script, ur_ip, ur_port)
# ---------- end send_10 ----------

x_axis_6 = Curve(<curve referenced from the Rhino model>)  # disabled
y_axis_6 = Curve(<curve referenced from the Rhino model>)  # disabled
plane_5 = PythonScript(plane_axes=[x_axis_6, y_axis_6])  # -> plane; inputs plane_axes: list of Curve; disabled; same code as _9cm_off

# ----
# send area_grip vacuum scripts
send_11 = Button()
send_12 = Button()
airpick = GhPythonScript(send_script_areagrip_on=send_11, send_script_areagrip_off=send_12)  # -> out; inputs send_script_areagrip_on: Boolean
# ---------- airpick: Python ----------
import time
from scriptcontext import sticky as st
import ur_online_control.ur_direct as urd

ur_ip = st["ur_ip"]
ur_port = st["ur_port"]

script_on = urd.areagrip_toggle(True, ur_ip, ur_port, sleep = 1.)
script_off = urd.areagrip_toggle(False, ur_ip, ur_port, sleep = 0.1)



if send_script_areagrip_on:
    script_on.send_script()
    
if send_script_areagrip_off:
    script_off.send_script()
# ---------- end airpick ----------

# ----
# send airpick vacuum scripts
send_13 = Button()
send_14 = Button()
send_15 = Button()
airpick_2 = GhPythonScript(send_script_airpick_on=send_13, send_script_airpick_off=send_14, send_script_airpick_onoff=send_15)  # -> out; inputs send_script_airpick_on: Boolean
# ---------- airpick_2: Python ----------
import time
from scriptcontext import sticky as st
import ur_online_control.ur_direct as urd

"""
ur_ip = st["ur_ip"]
ur_port = st["ur_port"]
"""

ur_ip = '192.168.10.20'
ur_port = 30002
script_on = urd.airpick_toggle(True, ur_ip, ur_port)
script_off = urd.airpick_toggle(False, ur_ip, ur_port)



if send_script_airpick_on:
    script_on.send_script()
    
if send_script_airpick_off:
    script_off.send_script()

if send_script_airpick_onoff:
    script_on.send_script()
    time.sleep(5)
    script_off.send_script()
# ---------- end airpick_2 ----------

panel_35 = Panel(pln_5)

# ----
# Store previous poses
clear_2 = Button()
pln_6 = Plane(py_18.plane_WCS)
points = GhPythonScript(plane=pln_6, clear=clear_2, add=get)  # -> out, measured_loc; inputs plane: Plane, clear: Boolean
# ---------- points: Python ----------
import rhinoscriptsyntax as rs
from scriptcontext import sticky as st

guid = str(ghenv.Component.InstanceGuid)
stored_key =  "stored_" + guid


if stored_key not in st:
    st[stored_key] = []

if clear:
    st[stored_key] = []
    
if plane != None and add:
    st[stored_key].append(plane)

measured_loc = st[stored_key]

print measured_loc
# ---------- end points ----------
panel_36 = Panel(points.measured_loc)

pts_02 = Point([Point(1.82, 1.84, -0.02452363965), Point(1.22, 1.24, -0.02452363965), Point(0.62, 1.84, -0.02452363965)])
pts_01 = Point([Point(-0.82, 0, -0.02452363965), Point(-0.6039372244, 0.15, 0.0735), Point(-0.82, 0.82, -0.02452363965), Point(-0.42, 0.82, -0.02452363965)])
pts_00 = Point([Point(-0.82, 0, -0.02452363965), Point(-0.31, -0.2, -0.02452363965), Point(-0.82, -0.2, -0.02452363965), Point(0.2, -0.2, -0.02452363965)])
base_plane_02 = Plane(Plane(origin=(1.19655, 2.161514, 0.605786), x=(-0.001236999481, 0.9999475801, 0.01016399573), y=(-0.9999970623, -0.001215745702, -0.002096997544)))
base_plane_01 = Plane(Plane(origin=(-1.143994, 0.652429, 0.601961), x=(-0.9999822586, -0.0004590001187, 0.005939001536), y=(0.0004520769607, -0.9999992169, -0.00116700071)))
base_plane_00 = Plane(Plane(origin=(-0.158486, -0.798261, 0.611699), x=(-0.006355999169, -0.9997688693, 0.02053799731), y=(0.9999781625, -0.006391821095, -0.001679003967)))
robot_location_01 = Plane(points.measured_loc)
robot_location_00 = Plane([Plane(origin=(0.2488185384, 0.03643091148, 0.3719392951), x=(-0.9368448271, 0.3419284206, -0.07353043659), y=(0.3476304554, 0.9334531646, -0.08842090276)), Plane(origin=(0.007278682921, 0.01275344545, 0.6838869183), x=(-0.9870601552, 0.135736133, -0.08536950362), y=(0.1317403676, 0.9899795923, 0.0508417387)), Plane(origin=(0.0304198695, -0.206916139, 0.3788071862), x=(-0.9549044215, 0.115671919, -0.2734548461), y=(0.1813834359, 0.9564203587, -0.2288233963)), Plane(origin=(-0.2251048388, -0.2244899058, 0.3828572526), x=(-0.9943094523, -0.09111432532, 0.05519866608), y=(-0.09766998489, 0.986579584, -0.1308483797)), Plane(origin=(-0.5555593207, -0.2568892812, 0.3162852616), x=(-0.6943238642, -0.7017757907, -0.1594525358), y=(-0.654991835, 0.7080198615, -0.2639954013)), Plane(origin=(-0.6036302111, -0.04242642984, 0.6202459541), x=(-0.7908405731, -0.5770867624, -0.2038186857), y=(-0.6089173491, 0.7754173539, 0.1671753249))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])
pt_8 = Point(robot_location_00)

# ----
# Assembly
# Draw
show_3 = BooleanToggle(False)
show_4 = BooleanToggle(False)
show_5 = BooleanToggle(False)
show_6 = BooleanToggle(True)
colour_swatch_4 = ColourSwatch(SwatchColor=RGB(255, 143, 143))  # disabled

# ---- group: Network Connectivity Preview
show_7 = BooleanToggle(False)

# ----
draw_3 = PythonScript(
    assembly=counter.assembly,
    show_element=show_3,
    show_all=show_7,
    show_until_counter=show_4,
    show_connections=show_5,
    show_options=show_6,
    show_last=show,
    counter=counter.counter)  # -> G_robot_elements, G_manual_element, G_element, G_all, G_elements_nurbs, G_connections, vector_origins, option_vectors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; inputs counter: Int32
# ---------- draw_3: Python ----------
import os
import sys

import math

import Rhino.Geometry as rg
import rhinoscriptsyntax as rs
import ghpythonlib.components as ghcomp
import math

from compas.geometry import Translation, Rotation
from compas_ghpython.artists import MeshArtist
from compas_ghpython import draw_frame

G_element = []
G_manual_element = []
G_robot_elements = []
G_all = []
G_elements_nurbs = []
G_neighbors = []
G_connections = []
option_vectors = []
vector_origins = []
G_last_module = []

key_index = assembly.network.key_index()
keys = [key_index[key] for key in assembly.network.nodes()]
current_key = counter
safe_distance = 0.2

if show_all and not show_until_counter:
    elements = [assembly.element(key) for key in keys]
    for key, element in assembly.elements():
        artist = MeshArtist(element.mesh)
        mesh = artist.draw_mesh()
        G_all.append(mesh)
        length, width, height = 0.4, 0.025, 0.049
        b = rg.Box(draw_frame(element.frame), rg.Interval(-length/2, length/2), rg.Interval(-width/2, width/2), rg.Interval(-height/2, height/2))
        G_elements_nurbs.append(b)
        artist_h = MeshArtist(assembly.element(61).mesh)
        mesh_h = artist_h.draw_mesh()
        G_manual_element.append(mesh_h)
        
        artist_r1 = MeshArtist(assembly.element(60).mesh)
        mesh_r1 = artist_r1.draw_mesh()
        G_robot_elements.append(mesh_r1)
        
        artist_r2 = MeshArtist(assembly.element(62).mesh)
        mesh_r2 = artist_r2.draw_mesh()
        G_robot_elements.append(mesh_r2)

if show_last:
    elements = [assembly.element(key) for key in keys]
    for key, element in list(assembly.elements())[-3:]:
        artist = MeshArtist(element.mesh)
        mesh = artist.draw_mesh()
        G_last_module.append(mesh)





if show_until_counter:
    elements = [assembly.element(key) for key in keys]
    for element in elements[0:current_key+1]:
        artist = MeshArtist(element.mesh)
        mesh = artist.draw_mesh()
        G_all.append(mesh)


if show_connections:
    #elements = [assembly.element(key) for key in keys]
    #lines = assembly.network.to_lines() #does not work because edges are not transformed!
    edges = list(assembly.connections())
    for e in edges:
        p1 = assembly.element(e[0]).frame.point
        p2 = assembly.element(e[1]).frame.point
        G_connections += [rg.Line(p1[0],p1[1],p1[2],p2[0],p2[1],p2[2])]

if show_element:
    element = assembly.element(current_key)
    artist = MeshArtist(element.mesh)
    mesh = artist.draw_mesh()
    G_element.append(mesh)

if show_options:
    for key, element in assembly.elements():
        for origin, vector in element.options_vectors(0.1):
            option_vectors.append(rg.Vector3d(*tuple(vector)))
            vector_origins.append(rg.Point3d(origin.x, origin.y, origin.z))


print current_key

#tool_planes_WCS = [draw_frame(e.tool_frame) for e in elements]

current_element = assembly.element(current_key)
current_tool_plane = draw_frame(current_element.tool_frame)

#TOOL PLANE with Z-offset on_ground=True, elem_type X,Y
#current_tool_plane.Translate(current_tool_plane.ZAxis*-0.005) 

#TOOL PLANE with Z-offset on_ground=True, elem_type Z
#current_tool_plane.Translate(current_tool_plane.ZAxis*0.005)

#TOOL PLANE with Z-offset on_ground=True, elem_type Z coming from the other side, apply also Rotoation to this one
#current_tool_plane.Translate(current_tool_plane.ZAxis*0.02) 

#TOOL PLANE shifted X-axis on_ground=False elem_type X
current_tool_plane.Translate(current_tool_plane.XAxis*-0.06)

#TOOL PLANE shifted and rotated X-axis on_ground=False elem_type X
#current_tool_plane.Translate(current_tool_plane.XAxis*0.15 + current_tool_plane.ZAxis*-0.01)

#TOOL PLANE shifted X-axis on_ground=False elem_type Y, (Yaxis calibration is an exception)
#current_tool_plane.Translate(current_tool_plane.XAxis*-0.06 - current_tool_plane.YAxis*0.002)

pt = rg.Point3d(current_element.frame.point.x, current_element.frame.point.y, current_element.frame.point.z)
#current_tool_plane.Rotate(math.radians(180), current_tool_plane.XAxis, pt)
current_tool_plane.Rotate(math.radians(90), current_tool_plane.XAxis, pt)
#current_tool_plane.Rotate(math.radians(180), current_tool_plane.ZAxis, current_tool_plane.Origin)

#TOOL PLANE shifted X-axis on_ground=False elem_type Y
current_tool_plane.Translate(current_tool_plane.ZAxis*0.01)


#SAFE PLANE BEFORE
current_tool_plane_safe_before = rg.Plane(current_tool_plane)
if assembly.element(current_key)._type == "Z":
    #current_tool_plane_safe_before.Translate(rg.Vector3d.ZAxis*0.02 + current_tool_plane_safe_before.XAxis*-0.10 + current_tool_plane_safe_before.YAxis*0.01)
    current_tool_plane_safe_before.Translate(rg.Vector3d.ZAxis*0.1 + current_tool_plane_safe_before.YAxis*0.05 + current_tool_plane_safe_before.ZAxis*-0.05)
    
elif assembly.element(current_key)._type == "Y" or assembly.element(current_key)._type == "X":
    #current_tool_plane_safe_before.Translate(current_tool_plane_safe_before.ZAxis*-0.1)
    
    #on_ground=True, elem_type Y
    #current_tool_plane_safe_before.Translate(current_tool_plane_safe_before.ZAxis*-0.2 + current_tool_plane_safe_before.YAxis*0.05 - current_tool_plane_safe_before.XAxis*0.2)
    
    #on_ground=True, elem_type Z
    #current_tool_plane_safe_before.Translate(current_tool_plane_safe_before.ZAxis*0.5 + current_tool_plane_safe_before.YAxis*0.05 - current_tool_plane_safe_before.XAxis*0.2)
    
    #on_ground=False, elem_type X (exception)
    #current_tool_plane_safe_before.Translate(current_tool_plane_safe_before.ZAxis*-0.1)
    
    #on_ground=False, elem_type X (standard)
    #current_tool_plane_safe_before.Translate(current_tool_plane_safe_before.ZAxis*-0.05 + current_tool_plane_safe_before.YAxis*-0.05 + current_tool_plane_safe_before.XAxis*-0.05)

    #on_ground=False, elem_type Y
    current_tool_plane_safe_before.Translate(current_tool_plane_safe_before.ZAxis*-0.05 + current_tool_plane_safe_before.YAxis*-0.15 + current_tool_plane_safe_before.XAxis*-0.05)

#SAFE PLANE AFTER
current_tool_plane_safe_after = rg.Plane(current_tool_plane)

#on_ground=True, elem_type Z
#current_tool_plane_safe_after.Translate(current_tool_plane_safe_after.ZAxis*-0.1 + current_tool_plane_safe_before.YAxis*-0.05 - current_tool_plane_safe_before.XAxis*0.2)

#on_ground=True, elem_type Y
#current_tool_plane_safe_after.Translate(current_tool_plane_safe_after.ZAxis*-0.1 + current_tool_plane_safe_before.YAxis*-0.05 - current_tool_plane_safe_before.XAxis*0.2)

#on_ground=False, elem_type X
#current_tool_plane_safe_after.Translate(current_tool_plane_safe_after.ZAxis*-0.25 + current_tool_plane_safe_after.YAxis*-0.05 + current_tool_plane_safe_after.XAxis*0.5)
#current_tool_plane_safe_after.Translate(current_tool_plane_safe_after.ZAxis*-0.05 + current_tool_plane_safe_before.XAxis*-0.05 + current_tool_plane_safe_before.YAxis*-0.05)

#on_ground=False, elem_type Y
current_tool_plane_safe_after.Translate(current_tool_plane_safe_after.ZAxis*-0.05 + current_tool_plane_safe_after.YAxis*-0.15 + current_tool_plane_safe_after.XAxis*-0.05)

#SAFE PLANE UP
current_tool_plane_safe_up = rg.Plane(current_tool_plane_safe_after)
current_tool_plane_safe_up.Translate(rg.Vector3d.ZAxis*0.6)
# ---------- end draw_3 ----------
vdis_2 = VectorDisplay(Anchor=draw_3.vector_origins, Vector=draw_3.option_vectors)
pln_7 = Plane(draw_3.current_tool_plane)
geo_3 = Geometry(draw_3.G_element)
geo_4 = Geometry(draw_3.G_all)
geo_5 = Geometry(draw_3.G_elements_nurbs)
geo_6 = Geometry(draw_3.G_connections)
pln_8 = Plane(draw_3.current_tool_plane_safe_before)
pln_9 = Plane(draw_3.current_tool_plane_safe_up)
wbtriangles_4 = WeaverbirdsSplitTrianglesSubdivision(MeshCurves=geo_4, Level=1)
preview_7 = CustomPreview(Geometry=wbtriangles_4, Shader=ColourSwatch(SwatchColor=RGB(255, 241, 184)))
preview_8 = CustomPreview(Geometry=geo_3, Shader=colour_swatch_4)

geo_7 = Geometry(draw_3.G_robot_elements)
geo_8 = Geometry(draw_3.G_manual_element)

# ---- group: Network Connectivity Preview (continued)
pln_10 = Plane(draw_3.current_tool_plane_safe_after)

# ----
wbtriangles_5 = WeaverbirdsSplitTrianglesSubdivision(MeshCurves=geo_8, Level=1)
wbtriangles_6 = WeaverbirdsSplitTrianglesSubdivision(MeshCurves=geo_7, Level=1)
preview_9 = CustomPreview(Geometry=wbtriangles_6, Shader=ColourSwatch(SwatchColor=RGB(118, 138, 227)))
preview_10 = CustomPreview(Geometry=wbtriangles_5, Shader=ColourSwatch(SwatchColor=RGB(255, 143, 143)))

# ----
# Input
_2_pick_up_plane_safe = Plane(plane_3)
_1_pick_up_plane = Plane(base_geo.pick_up_plane)
_5_current_tool_plane = Plane(pln_7)
_4_current_tool_plane_safe = Plane(pln_8)
_6_current_tool_plane_safe_up = Plane(pln_9)

pln_11 = Plane(pln_10)

unsubscribe = Button()  # disabled
# Execution
subscribe_2 = Button()  # disabled
joint_states = PythonScript(sub=subscribe_2, unsub=unsubscribe)  # disabled
# ---------- joint_states: Python ----------
import roslibpy
import scriptcontext as sc

key = 'topic_%s' % str(ghenv.Component.InstanceGuid)
previous_topic = sc.sticky.get(key, None)

# Interval in ms between messages
THROTTLE_RATE = 50

if sub:
    if robot.client.is_connected:
        if previous_topic:
            previous_topic.unsubscribe()

        def received_joint_states(message):
            sc.sticky['joint_states'] = message
    
        topic = roslibpy.Topic(robot.client, '/joint_states', 'sensor_msgs/JointState', throttle_rate=THROTTLE_RATE)
        topic.subscribe(received_joint_states)
    
        sc.sticky[key] = topic
        print('Subscribed')
    else:
        print('ROS client not connected')

if unsub:
    if 'joint_states' in sc.sticky:
        del sc.sticky['joint_states']
    if previous_topic:
        previous_topic.unsubscribe()
# ---------- end joint_states ----------
value_list = ValueList({"0 cartesian path": 0, "1 kinematic path": 1}, selected="1 kinematic path")  # disabled
filter_4 = StreamFilter(Gate=value_list)  # disabled
refresh_hz = Slider(2, range=0..30)  # disabled
execute = Button()  # disabled
check = Button()  # disabled
cancel = Button()  # disabled
trajectory = PythonScript(response=filter_4, execute=execute, check=check, cancel=cancel)  # -> out, status; disabled
# ---------- trajectory: Python ----------
import time
import datetime

import roslibpy

import scriptcontext as sc

key = 'trajectory_%s' % str(ghenv.Component.InstanceGuid)
sent_trajectory = sc.sticky.get(key, None)

#joint_trajectory = response.trajectory.joint_trajectory if response else None
joint_trajectory = response if response else None
points = response.points if response else []

print response

if robot and robot.client.is_connected:
    if execute:
        sc.sticky[key] = dict(started_at=time.time(), trajectory=joint_trajectory, state='EXECUTING')

        def completion(result):
            if key in sc.sticky:
                if sc.sticky[key]['state'] == 'EXECUTING':
                    sc.sticky[key]['state'] = 'SUCCESSFUL'
                sc.sticky[key]['completed_at'] = time.time()
                del sc.sticky[key]['cancellable']

        def failure(e):
            if key in sc.sticky:
                sc.sticky[key]['state'] = 'ERROR'
                sc.sticky[key]['completed_at'] = time.time()
                sc.sticky[key]['exception'] = e

        print('Executing trajectory of %d points' % len(points))
        cancellable = robot.client.follow_joint_trajectory(joint_trajectory, completion, failure)
        sc.sticky[key]['cancellable'] = cancellable

    if cancel and 'cancellable' in sc.sticky[key]:
        sc.sticky[key]['state'] = 'CANCELLED'
        sc.sticky[key]['cancellable'].cancel()
        
else:
    status = 'NOT CONNECTED'

try:
    started_at = sc.sticky[key].get('started_at', 'n/a')
    completed_at = sc.sticky[key].get('completed_at', 'n/a')
    exception = sc.sticky[key].get('exception', '')
    execution_state = sc.sticky[key].get('state', '')
    
    if started_at != 'n/a':
        started_at = datetime.datetime.fromtimestamp(started_at).strftime('%H:%M:%S')
    if completed_at != 'n/a':
        completed_at = datetime.datetime.fromtimestamp(completed_at).strftime('%H:%M:%S')
    if exception:
        exception = 'Found an exception during execution: ' + str(exception)
    
    if not joint_trajectory:
        status = 'No trajectory available'
    else:
        status = """execution state: {}
    started at: {}
    completed at: {}
    trajectory of {} points\n{}""".format(execution_state,
                                          started_at,
                                          completed_at,
                                          len(points),
                                          exception)
    
    print(status)
except KeyError:
    pass
# ---------- end trajectory ----------
status = Panel(trajectory.status)  # disabled

# ----
# Configuration
# TODO Example:
# Add path constraints
main_planning_group = Text(info.main_group_name)
compute = Button()
idx_3 = Slider(18, range=0..1)

# ---- group: inverse kinematics
avoid_collisions = BooleanToggle(False)
py_19 = PythonScript(robot=robot)  # -> configuration
# ---------- py_19: Python ----------
from compas_fab.robots import Configuration

if robot:
    types = robot.get_configurable_joint_types()
    values = [0] * len(types)
    configuration = Configuration(values, types)
    print configuration
    print robot.get_configurable_joint_names()
# ---------- end py_19 ----------
start_configuration = Data(forward_kinematics)
list_12 = ValueList({"0", "1"}, selected="0")
filter_5 = StreamFilter(Gate=list_12, Stream0=start_configuration, Stream1=py_19)
inverse = GhPythonScript(
    robot=robot,
    group=main_planning_group,
    plane=_2_pick_up_plane_safe,
    start_configuration=filter_5,
    avoid_collisions=avoid_collisions)  # -> out, group_configuration, full_configuration, plane_RCF
# ---------- inverse: Python ----------
"""Calculate the robot's inverse kinematic for a given plane.
    Inputs:
        robot: The robot
        group: str, optional
            The planning group used for calculation. Defaults to the robot's
            main planning group.
        plane: The plane in world coordinate frame to calculate the inverse for.
        start_configuration: :class:`compas_fab.robots.Configuration`, optional
            If passed, the inverse will be calculated such that the calculated
            joint positions differ the least from the start_configuration.
            Defaults to the init configuration.
        avoid_collisions: bool, optional
            Whether or not to avoid collisions. Defaults to True.
    Output:
        group_configuration: The group configuration
        full_configuration: The full configuration
"""
from __future__ import print_function
import logging

from compas.geometry import Frame
from compas_ghpython import draw_frame

LOGGER = logging.getLogger('roslibpy')

frame_WCF = Frame(plane.Origin, plane.XAxis, plane.YAxis)
frame_RCF = robot.to_local_coords(frame_WCF, group=None)

if robot.attached_tool:
    frame_RCF = robot.from_attached_tool_to_tool0([frame_RCF])[0]

#plane_RCF = draw_frame(frame_RCF)

if robot and robot.client:
    if robot.client.is_connected:
        """
        full_configuration = robot.inverse_kinematics(frame,
                                                      start_configuration,
                                                      group=group,
                                                      options={
                                                        'avoid_collisions':avoid_collisions,
                                                        'return_full_configuration':True,
                                                      })"""
        full_configuration = robot.inverse_kinematics(frame_RCF,
                                                      start_configuration,
                                                      group=group,
                                                      avoid_collisions=avoid_collisions,
                                                      return_full_configuration=True,
                                                      )
        group_configuration = robot.get_group_configuration(group, full_configuration)
        print(group_configuration)
    else:
        print("Robot client is not connected")
# ---------- end inverse ----------
panel_37 = Panel(inverse.out)

# ---- group: cartesian motion
# Plan cartesian motion
group = Data(main_planning_group)
list_13 = ValueList({"don't use attached collision mesh": 0, "use attached collision mesh": 1}, selected="don't use attached collision mesh")
py_20 = PythonScript(robot=robot)  # -> configuration
# ---------- py_20: Python ----------
from compas_fab.robots import Configuration

if robot:
    types = robot.get_configurable_joint_types()
    values = [0] * len(types)

    configuration = Configuration(values, types)
    print configuration
# ---------- end py_20 ----------
start_configuration_2 = Data(inverse.full_configuration)
list_14 = ValueList({"0", "1"}, selected="0")
avoid_collisions_2 = BooleanToggle(False)
py_21 = PythonScript(start_plane=_4_current_tool_plane_safe, end_plane=_5_current_tool_plane)  # -> planes
# ---------- py_21: Python ----------
planes = [start_plane, end_plane]
print planes
# ---------- end py_21 ----------
compute_2 = Button()
filter_6 = StreamFilter(Gate=list_14, Stream0=start_configuration_2, Stream1=py_20)
filter_7 = StreamFilter(Gate=list_13, Stream1=attached.acm)
plan_cartesian_motion = PythonScript(
    robot=robot,
    group=group,
    planes=py_21,
    start_configuration=filter_6,
    max_step=Slider(0.01, range=0..0.01),
    avoid_collisions=avoid_collisions_2,
    attached_collision_meshes=filter_7,
    compute=compute_2)  # -> out, trajectory; inputs planes: list, avoid_collisions: Boolean, attached_collision_meshes: list
# ---------- plan_cartesian_motion: Python ----------
"""Calculates a cartesian motion path (linear in tool space).
    Inputs:
        robot: The robot
        group: str, optional
            The planning group used for calculation. Defaults to the robot's
            main planning group.
        planes: The planes in world coordinate frame through which the path is defined.
        start_configuration: :class:`compas_fab.robots.Configuration`, optional
            The robot's full configuration, i.e. values for all configurable
            joints of the entire robot cell, at the starting position. Defaults
            to the all-zero configuration.
        max_step: float
            The approximate distance between the calculated points. (Defined in
            the robot's units)
        avoid_collisions: bool, optional
            Whether or not to avoid collisions. Defaults to True.
        attached_collision_meshes: list of :class:`compas_fab.robots.AttachedCollisionMesh`
            Defaults to None.
        compute: bool
            Press to calculate solution.
    Output:
        :class:`compas_fab.robots.JointTrajectory`
            The calculated trajectory.
"""
from __future__ import print_function
import logging
import scriptcontext as sc

from compas.geometry import Frame

LOGGER = logging.getLogger('roslibpy')

guid = str(ghenv.Component.InstanceGuid)
response_key = "response_" + guid
if response_key not in sc.sticky:
    sc.sticky[response_key] = None

frames_WCF = [Frame(plane.Origin, plane.XAxis, plane.YAxis) for plane in planes]
frames_RCF = [robot.to_local_coords(frame_WCF, group=None) for frame_WCF in frames_WCF]
if robot.attached_tool:
    frames_RCF = [robot.from_attached_tool_to_tool0([frame])[0] for frame in frames_RCF]


if robot and robot.client and start_configuration and compute:
    if robot.client.is_connected:
        """
        sc.sticky[response_key] = robot.plan_cartesian_motion(frames,
                                                              start_configuration=start_configuration,
                                                              group=group,
                                                              options={
                                                                'max_step': float(max_step),
                                                                'avoid_collisions': bool(avoid_collisions),
                                                                'attached_collision_meshes': list(attached_collision_meshes),
                                                              })"""
        sc.sticky[response_key] = robot.plan_cartesian_motion(frames_RCF,
                                                              start_configuration=start_configuration,
                                                              group=group,
                                                              max_step=float(max_step),
                                                              avoid_collisions=bool(avoid_collisions),
                                                              attached_collision_meshes=list(attached_collision_meshes),
                                                              )
    else:
        print("Robot client is not connected")

trajectory = sc.sticky[response_key]
# ---------- end plan_cartesian_motion ----------
vis = PythonScript(response=plan_cartesian_motion.trajectory)  # -> P, V, A
# ---------- vis: Python ----------
from compas_ghpython import list_to_ghtree

if response:
    #print response.points
    positions = []
    velocities = []
    accelerations = []

    for p in response.points:
        positions.append(p.positions)
        velocities.append(p.velocities)
        accelerations.append(p.accelerations)
    #print positions
    P = list_to_ghtree(list(zip(*positions)))
    V = list_to_ghtree(list(zip(*velocities)))
    A = list_to_ghtree(list(zip(*accelerations)))
# ---------- end vis ----------
prismatic = QuickGraph(vis.P, SortOrder=0)
panel_38 = Panel("positions")
py_22 = PythonScript(robot=robot, group=group, trajectory=plan_cartesian_motion.trajectory)  # -> configurations, full_configurations, fraction, time
# ---------- py_22: Python ----------
if trajectory:
    configurations = trajectory.points
    full_configurations = [robot.merge_group_with_full_configuration(c, trajectory.start_configuration, group) for c in configurations]
    start_configuration = trajectory.start_configuration
    fraction = trajectory.fraction
    time = trajectory.time_from_start
# ---------- end py_22 ----------
fraction = Panel(py_22.fraction)
time_s = Panel(py_22.time)
graph = QuickGraph(vis.V, SortOrder=0)
graph_2 = QuickGraph(vis.A, SortOrder=0)
panel_39 = Panel("velocities")
panel_40 = Panel("accelerations")
path = GhPythonScript(robot=robot, group=group, full_configurations=py_22.full_configurations)  # -> frames, P; inputs full_configurations: list
# ---------- path: Python ----------
import Rhino.Geometry as rg

frames = []

if robot:
    for c in full_configurations:
        
        if c:
            #frame_WCF = robot.forward_kinematics(c, group, options={'backend':'model'})
            frame_RCF = robot.forward_kinematics(c, group, backend='model')
            frame_WCF = robot.to_world_coords(frame_RCF, group=None)
            frames.append(frame_WCF)

    P = [rg.Point3d(*list(frame.point)) for frame in frames]
# ---------- end path ----------
idx_4 = Slider(1, range=0..1)
animate = PythonScript(robot=robot, group=main_planning_group, configurations=py_22.full_configurations, idx=idx_4)  # -> configuration; inputs configurations: list, idx: Int32
# ---------- animate: Python ----------
import Grasshopper
from compas_fab.utilities import map_range
from compas_fab.robots import Configuration

count = len(configurations)

for i in range(ghenv.Component.Params.Input.Count):
    nslider = ghenv.Component.Params.Input[i].Sources[0]
    if nslider.GetType() == Grasshopper.Kernel.Special.GH_NumberSlider and nslider.NickName == 'idx':
        nslider.Slider.Maximum = max(count - 1, 1)
        nslider.Slider.Minimum = 0

if count and robot and configurations[0] != None:
    configuration = configurations[idx]
# ---------- end animate ----------
pline = PolyLine(Vertices=path.P, Closed=False)
preview_11 = CustomPreview(Geometry=[path.P, pline], Material=ColourSwatch(SwatchColor=RGB(59, 137, 161)))

# ----
pln_12 = Plane(inverse.plane_RCF)

# ---- group: forward kinematics
forward = PythonScript(robot=robot, group=main_planning_group, full_configuration=forward_kinematics)  # -> out, frame_WCF
# ---------- forward: Python ----------
"""Calculate the robot's forward kinematic.
    Inputs:
        robot: :class:`compas_fab.robots.Robot`
            The robot.
        group: str, optional
            The planning group used for calculation. Defaults to the robot's
            main planning group.
        full_configuration : :class:`compas_fab.robots.Configuration`
            The full configuration to calculate the forward kinematic for. If no
            full configuration is passed, the zero-joint state for the other
            configurable joints is assumed.
    Output:
        :class:`Frame`
            The frame in the world coordinate frame (WCF).
"""
from __future__ import print_function
import logging

import compas_fab
print(compas_fab.__version__)

LOGGER = logging.getLogger('roslibpy')

if robot and robot.client and full_configuration:
    if robot.client.is_connected:
        #frame_WCF = robot.forward_kinematics(full_configuration, group, options={'backend':'model'})
        frame_WCF = robot.forward_kinematics(full_configuration, group, backend='model')
        print(frame_WCF)
    else:
        print("Robot is not connected")
# ---------- end forward ----------
panel_41 = Panel(forward.out)

# ----
panel_42 = Panel(plan_cartesian_motion.out)

# ---- group: plan motion
# Plan motion
# If you specify the tolerance vector with [360, 1, 1], it means that
#     the frame's y-axis and z-axis are allowed to rotate about the x-axis by an
#     angle of 360 degrees, whereas the x-axis can only change 1 degree.
group_2 = Data(main_planning_group)
list_15 = ValueList({"don't use attached collision mesh": 0, "use attached collision mesh": 1}, selected="use attached collision mesh")
py_23 = PythonScript(robot=robot)  # -> configuration; same code as py_20
python_5 = PythonScript(
    robot=robot,
    group=group_2,
    goal_plane=_4_current_tool_plane_safe,
    tolerance_position=Slider(0.001, range=0..0.001),
    tolerance_xaxis_deg=Slider(1, range=1..360),
    tolerance_yaxis_deg=Slider(1, range=1..360),
    tolerance_zaxis_deg=Slider(1, range=1..360))  # -> goal_constraints
# ---------- python_5: Python ----------
import math
from compas.geometry import Frame



frame_WCF = Frame(goal_plane.Origin, goal_plane.XAxis, goal_plane.YAxis)
frame_RCF = robot.to_local_coords(frame_WCF, group=None)

if robot.attached_tool:
    frame_RCF = robot.from_attached_tool_to_tool0([frame_RCF])[0]

tolerances_axes = [math.radians(tolerance_xaxis_deg), math.radians(tolerance_yaxis_deg), math.radians(tolerance_zaxis_deg)]

if robot:
    goal_constraints = robot.constraints_from_frame(frame_RCF, tolerance_position, tolerances_axes, group)
# ---------- end python_5 ----------
start_configuration_3 = Data(inverse.full_configuration)
list_16 = ValueList({"0", "1"}, selected="0")
filter_8 = StreamFilter(Gate=list_16, Stream0=start_configuration_3, Stream1=py_23)
filter_9 = StreamFilter(Gate=list_15, Stream1=[attached.acm, attached_2.acm])
list_17 = ValueList({"RRT", "RRT*": "RRTStar", "EST", "PRM": "RPM", "PRM*": "RPMStar", "SPARS"}, selected="RRT")

# ----
plan_motion = PythonScript(
    robot=robot,
    group=group_2,
    start_configuration=filter_8,
    goal_constraints=python_5,
    planner_id=list_17,
    attached_collision_meshes=filter_9,
    compute=compute)  # -> out, trajectory; inputs goal_constraints: list, attached_collision_meshes: list
# ---------- plan_motion: Python ----------
"""Calculates a motion path.
    Inputs:
        robot: The robot
        group: str, optional
            The planning group used for calculation. Defaults to the robot's
            main planning group.
        start_configuration: :class:`compas_fab.robots.Configuration`, optional
            The robot's full configuration, i.e. values for all configurable
            joints of the entire robot cell, at the starting position. Defaults
            to the all-zero configuration.
        goal_constraints: list of :class:`compas_fab.robots.Constraint`
            The goal to be achieved, defined in a set of constraints.
            Constraints can be very specific, for example defining value domains
            for each joint, such that the goal configuration is included,
            or defining a volume in space, to which a specific robot link (e.g.
            the end-effector) is required to move to.
        planner_id: str
            The name of the algorithm used for path planning. Defaults to 'RRT'.
        attached_collision_meshes: list of :class:`compas_fab.robots.AttachedCollisionMesh`
            Defaults to None.
        compute: bool
            Press to calculate solution.
    Output:
        :class:`compas_fab.robots.JointTrajectory`
            The calculated trajectory.
"""
from __future__ import print_function
import logging
import scriptcontext as sc

guid = str(ghenv.Component.InstanceGuid)
response_key = "response_" + guid
if response_key not in sc.sticky:
    sc.sticky[response_key] = None

LOGGER = logging.getLogger('roslibpy')

if robot and robot.client and start_configuration and compute:
    if robot.client.is_connected:
        """
        sc.sticky[response_key] = robot.plan_motion(goal_constraints,
                                                    start_configuration,
                                                    group,
                                                    options={
                                                        'planner_id': str(planner_id),
                                                        'attached_collision_meshes': list(attached_collision_meshes),
                                                    })"""
        sc.sticky[response_key] = robot.plan_motion(goal_constraints,
                                                    start_configuration,
                                                    group,
                                                    planner_id=str(planner_id),
                                                    attached_collision_meshes=list(attached_collision_meshes),
                                                    )
    else:
        print("Robot client is not connected.")

trajectory = sc.sticky[response_key]
# ---------- end plan_motion ----------
py_24 = PythonScript(robot=robot, group=group_2, trajectory=plan_motion.trajectory)  # -> configurations, full_configurations, fraction, time; same code as py_22
panel_46 = Panel(plan_motion.out)
animate_2 = PythonScript(robot=robot, group=group_2, configurations=py_24.full_configurations, idx=idx_3)  # -> configuration; inputs configurations: list, idx: Int32; same code as animate

# ---- group: plan motion (continued)
vis_2 = PythonScript(response=plan_motion.trajectory)  # -> P, V, A, time
# ---------- vis_2: Python ----------
from compas_ghpython import list_to_ghtree

if response:

    positions = []
    velocities = []
    accelerations = []
    time_from_start = []

    for p in response.points:
        positions.append(p.positions)
        velocities.append(p.velocities)
        accelerations.append(p.accelerations)
        time_from_start.append(p.time_from_start.seconds)

    P = list_to_ghtree(list(zip(*positions)))
    V = list_to_ghtree(list(zip(*velocities)))
    A = list_to_ghtree(list(zip(*accelerations)))

    time = time_from_start[-1]
    print time
# ---------- end vis_2 ----------
time_s_2 = Panel(vis_2.time)
prismatic_2 = QuickGraph(vis_2.P, SortOrder=0)
fraction_2 = Panel(py_24.fraction)
time_s_3 = Panel(py_24.time)
path_2 = GhPythonScript(robot=robot, group=group_2, full_configurations=py_24.full_configurations)  # -> frames, P; inputs full_configurations: list
# ---------- path_2: Python ----------
import Rhino.Geometry as rg

frames = []

if robot:
    for c in full_configurations:
        if c:
            #frame_WCF = robot.forward_kinematics(c, group, options={'backend':'model'})
            frame_RCF = robot.forward_kinematics(c, group, backend='model')
            frame_WCF = robot.to_world_coords(frame_RCF, group=None)
            frames.append(frame_WCF)

    P = [rg.Point3d(*list(frame.point)) for frame in frames]
# ---------- end path_2 ----------
graph_3 = QuickGraph(vis_2.V, SortOrder=0)
graph_4 = QuickGraph(vis_2.A, SortOrder=0)
pline_2 = PolyLine(Vertices=path_2.P, Closed=False)
preview_12 = CustomPreview(Geometry=[pline_2, path_2.P], Material=ColourSwatch(SwatchColor=RGB(59, 161, 95)))

# ----
# HRCA
panel_47 = Panel("add element")
radius = Slider(0, range=0..0.1)
joint_configurations_2 = Data(py_24.full_configurations)
pln_13 = Plane(_1_pick_up_plane)
pln_14 = Plane(_2_pick_up_plane_safe)
pln_15 = Plane(_5_current_tool_plane)
pln_16 = Plane(_6_current_tool_plane_safe_up)
hrca_ur_script = PythonScript(
    pick_up_plane=pln_13,
    pick_up_plane_safe=pln_14,
    joint_configurations=joint_configurations_2,
    current_tool_plane=pln_15,
    current_tool_plane_safe_up=pln_16,
    current_tool_plane_safe_after=pln_11,
    joint_positions=joint_positions,
    standard_routine=standard_routine,
    move_goal=move_to_goal,
    move_home=move_to_home,
    velocity=Slider(7, range=0..200),
    radius=radius)  # -> script, values, pick_up_plane_vacuum_on; inputs joint_configurations: list, standard_routine: Boolean, move_goal: Boolean, move_home: Boolean
# ---------- hrca_ur_script: Python ----------
import ur_online_control.ur_direct as urd
import math
from scriptcontext import sticky as st
import Rhino.Geometry as rg
from compas.geometry import Frame

robot = st["robot_6e25a56a-ecab-4ebc-a3bd-f9966f8a8dbc"]
tool_angle_axis = list(robot.attached_tool.frame.point) + list(robot.attached_tool.frame.axis_angle_vector)
sleep = 1.0
#print joint_configurations


def move_command(plane_WCS):
    frame_WCS = Frame(plane_WCS.Origin, plane_WCS.XAxis, plane_WCS.YAxis)
    frame_RCS = robot.to_local_coords(frame_WCS)
    cmd = list(frame_RCS.point) + list(frame_RCS.axis_angle_vector) + [velocity, radius]
    move_command = cmd
    return move_command

pick_up_plane_vacuum_on = rg.Plane(pick_up_plane)
pick_up_plane_vacuum_on.Translate(pick_up_plane_vacuum_on.ZAxis*-0.02)

#commands
pick_up_cmd = move_command(pick_up_plane)
pick_up_vacuum_on_cmd = move_command(pick_up_plane_vacuum_on)
pick_up_safe_cmd = move_command(pick_up_plane_safe)
current_tool_cmd = move_command(current_tool_plane)
current_tool_safe2_cmd = move_command(current_tool_plane)
current_tool_safe_up_cmd = move_command(current_tool_plane_safe_up)
current_tool_plane_safe_after_cmd = move_command(current_tool_plane_safe_after)


joint_config = ["movej({}, v={}, r={})".format(c.values, velocity/10, 0.05) for c in joint_configurations[:-1]]
joint_config += ["movej({}, v={}, r={})".format(c.values, velocity/10, 0.0) for c in joint_configurations[-1:]]
#joint_config_start = "movej({}, v={}, r={})".format(joint_positions.values, velocity/10, 0.0)
joint_config_end = ["movej({}, v={}, r={})".format(c.values, velocity/10, 0.05) for c in list(reversed(joint_configurations))[:-1]]
joint_config_end += ["movej({}, v={}, r={})".format(c.values, velocity/10, 0.0) for c in list(reversed(joint_configurations))[-1:]]


if move_goal:
    #MOVE TO GOAL
    commands = urd.URCommandScript()
    commands.start()
    commands.set_tcp(tool_angle_axis)
    commands.add_airpick_commands()
    commands.add_move_linear(pick_up_safe_cmd)                      #1
    commands.add_move_linear(pick_up_cmd)
    commands.airpick_on(max_vac=65, min_vac=35)                     #3
    commands.add_line("\tsleep({})".format(sleep))
    commands.add_move_linear(pick_up_safe_cmd)                      #4
    commands.add_lines(joint_config)                                #5 
    commands.add_move_linear(current_tool_cmd)                      #6
    commands.end()


if standard_routine:
    #STANDARD ROUTINE
    commands = urd.URCommandScript()
    commands.start()
    commands.set_tcp(tool_angle_axis)
    commands.add_airpick_commands()
    commands.add_move_linear(pick_up_safe_cmd)                      #1
    commands.add_move_linear(pick_up_cmd)
    commands.airpick_on(max_vac=65, min_vac=35)                    #3
    commands.add_line("\tsleep({})".format(sleep))
    commands.add_move_linear(pick_up_safe_cmd)                      #4
    commands.add_lines(joint_config)                                #5 
    commands.add_move_linear(current_tool_cmd)                      #6
    commands.airpick_off(pressure=40, timeout=2)                   #vacuum_off
    commands.add_line("\tsleep({})".format(1.))
    commands.add_move_linear(current_tool_plane_safe_after_cmd)
    commands.add_move_linear(current_tool_safe_up_cmd)              #7
    commands.add_lines(joint_config_end)
    commands.end()

    
if move_home:
    #MOVE TO HOME
    commands = urd.URCommandScript()
    commands.start()
    commands.set_tcp(tool_angle_axis)
    commands.add_airpick_commands()
    commands.airpick_off(pressure=40, timeout=2)                   #vacuum_off
    commands.add_move_linear(current_tool_plane_safe_after_cmd)
    #commands.add_move_linear(current_tool_safe_up_cmd)              #7
    commands.add_lines(joint_config_end)
    commands.add_move_linear(pick_up_safe_cmd)   
    commands.end()


script = commands.generate()

#values = joint_configurations[0].values

#print([math.degrees(v) for v in values])

print(script)
# ---------- end hrca_ur_script ----------
send_16 = Button()
send_17 = GhPythonScript(script=hrca_ur_script.script, send=send_16)  # -> out; inputs send: Boolean
# ---------- send_17: Python ----------
from scriptcontext import sticky as st
from ur_online_control.ur_direct import send_script

#ur_ip = st["ur_ip"]
#ur_port = st["ur_port"]

ur_ip = '192.168.10.20'
ur_port = 30002

if send:
    send_script(script, ur_ip, ur_port)
# ---------- end send_17 ----------

start_timer_update = Button()  # disabled
stop_timer_update = Button()  # disabled
data_recorder = DataRecorder(trajectory.out, DataLimit=-10, RecordData=False)  # disabled
panel_48 = Panel(data_recorder)  # disabled

current = PythonScript(
    rate=refresh_hz,
    subscribe=subscribe_2,
    unsubscribe=unsubscribe,
    start_update=start_timer_update,
    stop_update=stop_timer_update)  # -> out, configuration; inputs subscribe: Boolean, unsubscribe: Boolean, start_update: Boolean, stop_update: Boolean; disabled
# ---------- current: Python ----------
import scriptcontext as sc
from compas_fab.robots import Configuration
from compas_ghpython import update_component
from datetime import datetime


guid = str(ghenv.Component.InstanceGuid)
timer_running_key = "timer_running_" + guid

if stop_update or timer_running_key not in sc.sticky or unsubscribe:
    sc.sticky[timer_running_key] = False

if start_update or subscribe:
    sc.sticky[timer_running_key] = True



values = []
types = []

now = datetime.now()
timestamp = datetime.time(now)


print('receiving joint states at: ' + str(timestamp))


if 'joint_states' in sc.sticky:
    
    joint_states = sc.sticky['joint_states']
    joint_states = dict(zip(joint_states['name'], joint_states['position']))

    for joint in robot.get_configurable_joints():
        values.append(joint_states[joint.name])
        types.append(joint.type)
    
    configuration = Configuration(values, types)
    print(configuration)

else:
    configuration = robot.get_configuration()
    configuration.values = [0,0,0,0,0,0]
    
    

data_coming_in = robot.client.is_connected and 'joint_states' in sc.sticky

slow_interval = 2000
if rate != 0:
    refresh_interval = (1. / rate) * 1000
else:
    refresh_interval = slow_interval
interval = refresh_interval if data_coming_in else slow_interval

if sc.sticky[timer_running_key]==True:
    print sc.sticky[timer_running_key]
    update_component(ghenv, interval)

#update_component(ghenv, interval)
print('Interval: %dms' % interval)
# ---------- end current ----------

panel_49 = Panel(current.out)  # disabled

# ----
# Visualisation
# Select configuration input: from fk, ik, path, or from real robot
list_18 = ValueList({"0 forward_kinematics": 0, "1 inverse_kinematics": 1, "2 cartesian motion": 2, "3 free-space motion": 3}, selected="3 free-space motion")
filter_10 = StreamFilter(Gate=list_18, Stream0=forward_kinematics, Stream1=inverse.full_configuration, Stream2=animate, Stream3=animate_2)
show_end_effector_frame = BooleanToggle(True)
show_base_frame = BooleanToggle(True)
show_collision = BooleanToggle(False)
show_frames = BooleanToggle(True)
show_visual = BooleanToggle(True)
visualize = PythonScript(
    robot=robot,
    redraw=py_9.a,
    full_configuration=filter_10,
    show_visual=show_visual,
    show_collision=show_collision,
    show_frames=show_frames,
    show_base_frame=show_base_frame,
    show_end_effector_frame=show_end_effector_frame)  # -> out, visual, collision, frames, base_frame_WCF, ee_frame_WCF
# ---------- visualize: Python ----------
"""Calculates a cartesian motion path (linear in tool space).
    Inputs:
        robot: The robot
        group: str
            The planning group used for visualisation
        full_configuration: :class:`compas_fab.robots.Configuration`
            The robot's full configuration to display.
        show_visual: bool
           Whether or not to show the robot's visual meshes.
        show_collision: bool
           Whether or not to show the robot's collision meshes.
        show_frames: bool
           Whether or not to show the robot's joint frames.
        show_base_frame: bool
           Whether or not to show the robot's base frame.
        show_end_effector_frame: bool
            Whether or not to show the robot's end-effector frame.
    Output:
        visual: The robot's visual meshes.
        collision: The robot's collision meshes.
        frames: The robot's joint frames.
        base_frame_WCF: The robot's base frame.
        ee_frame_WCF: The robot's end-effector frame.
"""
from __future__ import print_function
import ghpythonlib.components as ghcomp
from compas_ghpython.geometry import xform_from_transformation

if robot and full_configuration:
    robot.update(full_configuration, visual=show_visual, collision=show_collision)
    print(full_configuration)
    T = robot.transformation_RCF_WCF()

    if show_visual:
        visual = robot.draw_visual() #visual = ([v for v in visual])
        visual = ghcomp.Transform(visual, xform_from_transformation(T))
        print(T)

    if show_collision:
        collision = robot.draw_collision()
        collision = ghcomp.Transform(collision, xform_from_transformation(T))

    if show_frames:
        axes = robot.transformed_axes(full_configuration)
        frames = robot.transformed_frames(full_configuration)
        [f.transform(T) for f in frames[1:]]

    if show_base_frame:
        base_frame_WCF = robot.get_base_frame(group, full_configuration)

    if show_end_effector_frame:
        ee_frame_WCF = robot.get_end_effector_frame(group, full_configuration)
        if robot.attached_tool:
            ee_frame_WCF = robot.from_tool0_to_attached_tool([ee_frame_WCF])[0]
        
        ee_frame_WCF.transform(T)
        print("End-effector", ee_frame_WCF)
# ---------- end visualize ----------
geo_9 = Geometry(visualize.collision)
py_25 = PythonScript(robot=robot)  # -> scale
# ---------- py_25: Python ----------
if robot:
    scale = robot.scale_factor * 0.1
else:
    scale = 1.
# ---------- end py_25 ----------
draw_4 = GhPythonScript(frames=[visualize.base_frame_WCF, visualize.frames, visualize.ee_frame_WCF], scale=py_25)  # -> P, V, C, W; inputs frames: list
# ---------- draw_4: Python ----------
from System.Drawing import Color
from compas_ghpython import draw_frame

red = Color.FromArgb(255, 0, 0)
green = Color.FromArgb(0, 255, 0)
blue = Color.FromArgb(0, 0, 255)

P = []
V = []
C = []

scale = float(scale)

for frame in frames:
    if not frame:
        continue
    plane = draw_frame(frame)
    P += [plane.Origin] * 3
    V.append(plane.XAxis * scale)
    V.append(plane.YAxis * scale)
    V.append(plane.ZAxis * scale)
    C += [red, green, blue]

W = 3
# ---------- end draw_4 ----------
vdisex = VectorDisplayEx(Point=draw_4.P, Vector=draw_4.V, Colour=draw_4.C, Width=draw_4.W)
panel_50 = Panel(visualize.out)

wbtriangles_7 = WeaverbirdsSplitTrianglesSubdivision(MeshCurves=visualize.visual, Level=1)

preview_13 = CustomPreview(Geometry=wbtriangles_7, Shader=ColourSwatch(SwatchColor=RGB(168, 168, 168)))

get_2 = Button()
pose_2 = PythonScript(get=get_2)  # -> configuration, pose_joints
# ---------- pose_2: Python ----------
from scriptcontext import sticky as st
import ur_online_control.ur_direct as urd
from ur_online_control.ur.configuration import Configuration


server_address = st["server_address"]
server_port = st["server_port"]
ur_port = st["ur_port"]
ur_ip = st["ur_ip"]
robot = st["robot_6e25a56a-ecab-4ebc-a3bd-f9966f8a8dbc"]
tool_angle_axis = list(robot.attached_tool.frame.point) + list(robot.attached_tool.frame.axis_angle_vector)

#print(tool_angle_axis)

guid = str(ghenv.Component.InstanceGuid)
pose_joints_key = "pose_joints" + guid


if get:
    st[pose_joints_key] = urd.get_current_pose_joints(tool_angle_axis, server_address, server_port, ur_ip, ur_port, send=True)
if pose_joints_key not in st:
    #pose_joints = Configuration.from_revolute_values([0,0,0,0,0,0])
    configuration = Configuration.from_revolute_values([0,0,0,0,0,0])
else:
    #pose_joints = Configuration.from_revolute_values(st[pose_joints_key])
    configuration = Configuration.from_revolute_values(st[pose_joints_key])

pose_joints = configuration.values
# ---------- end pose_2 ----------
panel_51 = Panel("get pose joint")

multiplication = Multiplication(A=pose_2.pose_joints, B=180)
division = Division(A=multiplication, B=pi)

panel_52 = Panel(division)

idx_5 = Slider(0, range=0..100)
panel_53 = Panel("move cartesian")
planes_wcs = Data(_4_current_tool_plane_safe)
list_19 = ValueList({"send all positions": 0, "send only one position": 1}, selected="send only one position")
send_18 = Button()

# ----
# Direct UR control
item_2 = ListItem(List=planes_wcs, Index=idx_2, Wrap=True)
filter_11 = StreamFilter(Gate=list_19, Stream0=planes_wcs, Stream1=item_2)

movel_4 = PythonScript(commands_input=list_19, planes_WCS=filter_11, idx=idx_5)  # -> script; inputs planes_WCS: list
# ---------- movel_4: Python ----------
import Rhino.Geometry as rg
from compas.geometry import Frame
from compas.geometry import Transformation
from compas_ghpython import draw_frame
from compas_fab.robots import robot

from scriptcontext import sticky as st
import ur_online_control.ur_direct as urd

robot = st["robot_6e25a56a-ecab-4ebc-a3bd-f9966f8a8dbc"]
tool_angle_axis = list(robot.attached_tool.frame.point) + list(robot.attached_tool.frame.axis_angle_vector)


#robot = st["robot"]
#tool_angle_axis = list(robot.tool.tcp_frame.point) + list(robot.tool.tcp_frame.axis_angle_vector)


move_commands = []
for plane_WCS in planes_WCS:
    frame_WCS = Frame(plane_WCS.Origin, plane_WCS.XAxis, plane_WCS.YAxis)
    frame_RCS = robot.to_local_coords(frame_WCS)
    if robot.attached_tool:
        frame_RCS = robot.from_attached_tool_to_tool0([frame_RCS])[0]
    cmd = list(frame_RCS.point) + list(frame_RCS.axis_angle_vector) + [50.0, 0.0]
    move_commands.append(cmd)

commands = urd.generate_moves_linear(tool_angle_axis, move_commands, st["ur_ip"], st["ur_port"])
script = commands.script
print(script)
# ---------- end movel_4 ----------
send_19 = GhPythonScript(script=movel_4, send=send_18)  # -> out; inputs send: Boolean; same code as send_2

# ==== cluster Draw
frame = ClusterInput()
size = ClusterInput()
draw = PythonScript(frame=frame, size=size)  # -> G, C
# ---------- draw: Python ----------
import Rhino.Geometry as rg
from System.Drawing import Color

if not size:
    size = 100

if frame:
    
    plane = rg.Plane(rg.Point3d(*list(frame.point)), rg.Vector3d(*list(frame.xaxis)), rg.Vector3d(*list(frame.yaxis)))

    G = []
    G.append(rg.Line(plane.Origin, size * plane.XAxis))
    G.append(rg.Line(plane.Origin, size * plane.YAxis))
    G.append(rg.Line(plane.Origin, size * plane.ZAxis))
    
    C = []
    C.append(Color.FromArgb(255, 0, 0))
    C.append(Color.FromArgb(0, 255, 0))
    C.append(Color.FromArgb(0, 0, 255))
# ---------- end draw ----------
G = ClusterOutput(draw.G)
C = ClusterOutput(draw.C)

# ==== cluster Cluster
dims = ClusterInput()
# Visualise the defined element
show = BooleanToggle(False)
show_2 = BooleanToggle(True)
# Visualise the defined element
show_3 = BooleanToggle(True)
show_4 = BooleanToggle(True)
elem_def = GhPythonScript()  # -> out, elem_center
# ---------- elem_def: Python ----------
import os
import sys
import json

from compas.geometry import Frame
from compas.geometry import Box
from human_robot_collaborative_assembly.assembly import HRCElement as Element

#element'S dimensions
width = 0.025
length = 0.4
height = 0.049
a = 0.049

# element x
box_frame = Frame([0, 0, 0], [1, 0, 0], [0, 1, 0]) #center of the box frame 
box = Box(box_frame, length, width, height)
tool_frame =  Frame([0, 0, height], [1, 0, 0], [0, 1, 0])
conn_frame_1 = Frame([length-a, width, 0], [1, 0, 0], [0, 1, 0])
conn_frame_2 = Frame([-length+a, -width, 0], [1, 0, 0], [0, 1, 0])

elem_center = Element.from_shape(box, box_frame)

#assign attributes
elem_center.tool_frame = tool_frame
elem_center.connector_frame_1 = conn_frame_1
elem_center.connector_frame_2 = conn_frame_2
elem_center._type = 'X'
elem_center._base_frame = Frame([0, 0, 0], [1, 0, 0], [0, 1, 0])
# ---------- end elem_def ----------
draw = PythonScript(elem_center=elem_def.elem_center, show=show)  # -> M, F, C, F_2, T
# ---------- draw: Python ----------
from compas.geometry import Transformation
from compas.geometry import Frame
from compas.datastructures import mesh_transformed
from compas_ghpython.artists import MeshArtist
from compas_ghpython import draw_frame

connectors = []

connectors.append(elem_center.connector_frame_1)
connectors.append(elem_center.connector_frame_2)

if show:
    artist = MeshArtist(elem_center.mesh)
    M = artist.draw_mesh()
    C = [draw_frame(frame) for frame in connectors]
    F = draw_frame(elem_center.frame)
    T = draw_frame(elem_center.tool_frame)
# ---------- end draw ----------
elem_def_2 = GhPythonScript(dims=dims)  # -> out, elem_z; inputs dims: list
# ---------- elem_def_2: Python ----------
import os
import sys
import json

from compas.geometry import Frame
from compas.geometry import Box
from human_robot_collaborative_assembly.assembly import HRCElement as Element

#element's dimensions
width, length, height, a = dims
shift_tool = 0.05

# element z
box_frame = Frame([-width, height/2.+width/2., length/2.], [0, 0, 1], [-1, 0, 0]) #center of the box frame 
box = Box(box_frame, length, width, height)
tool_frame = Frame([-width, 0.5*width, length/2.+shift_tool], [0, 0, -1], [-1, 0, 0])
conn_frame_1 = Frame([width, 0, length-height], [1, 0, 0], [0, 1, 0])
conn_frame_2 = Frame([width, 0, -length + height], [1, 0, 0], [0, 1, 0])

elem_z = Element.from_shape(box, box_frame)

# assign attributes
elem_z.tool_frame = tool_frame
elem_z.connector_frame_1 = conn_frame_1
elem_z.connector_frame_2 = conn_frame_2
elem_z._type = 'Z'
elem_z._base_frame = Frame([0, 0, 0], [1, 0, 0], [0, 1, 0])
# ---------- end elem_def_2 ----------
elem_def_3 = GhPythonScript(dims=dims)  # -> out, elem_x; inputs dims: list
# ---------- elem_def_3: Python ----------
import os
import sys
import json

from compas.geometry import Frame
from compas.geometry import Box
from human_robot_collaborative_assembly.assembly import HRCElement as Element

#element's dimensions
width, length, height, a = dims
shift_tool = 0.05

# element x
box_frame = Frame([0, 0, height/2.], [1, 0, 0], [0, -1, 0]) #center of the box frame 
box = Box(box_frame, length, width, height)
tool_frame =  Frame([shift_tool, 0, height], [-1, 0, 0], [0, 1, 0])
conn_frame_1 = Frame([length-a, width, 0], [1, 0, 0], [0, 1, 0])
conn_frame_2 = Frame([-length+a, -width, 0], [1, 0, 0], [0, 1, 0])

elem_x = Element.from_shape(box, box_frame)

#assign attributes
elem_x.tool_frame = tool_frame
elem_x.connector_frame_1 = conn_frame_1
elem_x.connector_frame_2 = conn_frame_2
elem_x._type = 'X'
elem_x._base_frame = Frame([0, 0, 0], [1, 0, 0], [0, 1, 0])
# ---------- end elem_def_3 ----------
elem_def_4 = GhPythonScript(dims=dims)  # -> out, elem_y; inputs dims: list
# ---------- elem_def_4: Python ----------
import os
import sys
import json

from compas.geometry import Frame
from compas.geometry import Box
from human_robot_collaborative_assembly.assembly import HRCElement as Element

#element's dimensions
width, length, height, a = dims
shift_tool = 0.05

# element
box_frame = Frame([0, 0, height*1.5], [0, 1, 0], [-1, 0, 0]) #center of the box frame 
box = Box(box_frame, length, width, height)
tool_frame = Frame([0, -shift_tool, height*2], [0, 1, 0], [1, 0, 0])
conn_frame_1 = Frame([-width, length-a, 0], [1, 0, 0], [0, 1, 0])
conn_frame_2 = Frame([width, -length+a, 0], [1, 0, 0], [0, 1, 0])

elem_y = Element.from_shape(box, box_frame)

#assign attributes
elem_y.tool_frame = tool_frame
elem_y.connector_frame_1 = conn_frame_1
elem_y.connector_frame_2 = conn_frame_2
elem_y._type = 'Y'
elem_y._base_frame = Frame([0, 0, 0], [1, 0, 0], [0, 1, 0])
# ---------- end elem_def_4 ----------
draw_2 = PythonScript(elem=elem_def_3.elem_x, show=show_3)  # -> M, F, C, T
# ---------- draw_2: Python ----------
from compas.geometry import Transformation
from compas.geometry import Frame
from compas.datastructures import mesh_transformed
from compas_ghpython.artists import MeshArtist
from compas_ghpython import draw_frame

connectors = []

connectors.append(elem.connector_frame_1)
connectors.append(elem.connector_frame_2)

if show:
    artist = MeshArtist(elem.mesh)
    M = artist.draw_mesh()
    C = [draw_frame(frame) for frame in connectors]
    F = draw_frame(elem.frame)
    T = draw_frame(elem.tool_frame)
# ---------- end draw_2 ----------
draw_3 = PythonScript(elem=elem_def_4.elem_y, show=show_4)  # -> M, F, C, T; same code as draw_2
draw_4 = PythonScript(elem=elem_def_2.elem_z, show=show_2)  # -> M, F, C, T; same code as draw_2
elem_y = ClusterOutput(elem_def_4.elem_y)
elem_z = ClusterOutput(elem_def_2.elem_z)
elem_x = ClusterOutput(elem_def_3.elem_x)
elem_center = ClusterOutput(elem_def.elem_center)
