# Grasshopper definition ur_robots_setup_mobile_hrca_example.ghx (Grasshopper 1.0.7)
# plug-ins: Weaverbird

panel = Panel("Unload libraries")
# Load initial assembly
bang = Button()
unload = PythonScript(bang=bang)
# ---------- unload: Python ----------
from compas_rhino.utilities.misc import get_tolerance
from compas_rhino.utilities.misc import unload_modules

unload_modules("compas")
unload_modules("compas_fab")
unload_modules("ur_online_control")
unload_modules("roslibpy")
unload_modules("human_robot_collaborative_assembly")
# ---------- end unload ----------

# ----
# Import initial assembly (or first module)
import = Button(ExpressionNormal="True", ExpressionPressed="False")
py = PythonScript(import_from_json=import)  # -> HERE, DATA, import_from_json
# ---------- py: Python ----------
import os
from scriptcontext import sticky as st

HERE = os.path.dirname(ghdoc.Path)
DATA = os.path.abspath(os.path.join(HERE, "..", "data"))
print(HERE)
print(DATA)

st.clear()
st['DATA_PATH'] = DATA
# ---------- end py ----------
initial_assembly = GhPythonScript(DATA=py.DATA, import_from_json=py.import_from_json)  # -> out, assembly; inputs import_from_json: Boolean
# ---------- initial_assembly: Python ----------
import os
import json
from scriptcontext import sticky

from compas.geometry import Translation
from assembly_information_model.assembly import Assembly
from assembly_information_model.assembly import Element


if import_from_json:
    filename = "hrca/assembly_example.json"
    PATH = os.path.join(DATA, filename)
    assembly = Assembly.from_json(PATH)
# ---------- end initial_assembly ----------

py_2 = PythonScript()  # -> HERE, DATA
# ---------- py_2: Python ----------
import os

HERE = os.path.dirname(ghdoc.Path)
DATA = os.path.abspath(os.path.join(HERE, "..", "data"))
print(HERE)
print(DATA)
# ---------- end py_2 ----------
panel_2 = Panel(py_2.DATA)
data_path = Data(py_2.DATA)

# ---- group: Assembly Visualization
reset = Button()
back = Button()
start = Button()
step = Button()
stop = Button()
full = Button()
list = ValueList({"20", "50", "100", "500", "1000", "5000"}, selected="50")

# Count
counter = CountThroughList(
    assembly=initial_assembly.assembly,
    start=start,
    stop=stop,
    step=step,
    step_back=back,
    reset=reset,
    full=full,
    interval=list)  # -> item, counter, assembly; inputs start: Boolean, stop: Boolean, step_back: Boolean
# ---------- counter: Python ----------
from scriptcontext import sticky as st
from compas_ghpython import update_component


L = list(assembly.elements())

# store data in component
guid = str(ghenv.Component.InstanceGuid)
counter_key = "counter_" + guid
running_key = "running_" + guid

if counter_key not in st:
    st[counter_key] = 0

if running_key not in st:
    st[running_key] = False


if st[running_key]:
    if st[counter_key] < len(L) - 1:
        st[counter_key] += 1
        update_component(ghenv, interval)
    else:
        st[counter_key] = 0
        st[running_key] = False


if start:
    st[running_key] = True

if stop:
    st[running_key] = False

if step:
    if st[counter_key] < len(L) - 1:
        st[counter_key] += 1

if step_back:
    if st[counter_key] <= len(L) - 1:
        st[counter_key] -= 1

if reset:
    st[counter_key] = -1

if full:
    st[counter_key] = len(L)-1

if len(L):
    item = L[st[counter_key]]


counter = st[counter_key]
# ---------- end counter ----------
idx = Panel(counter.counter)

# ----
pln = Plane(Plane(origin=(-0.158486, -0.798261, 0.611699), x=(-0.006355999169, -0.9997688693, 0.02053799731), y=(0.9999781625, -0.006391821095, -0.001679003967)))

# ---- group: ROS client
panel_3 = Panel("127.0.0.1")
disconnect = Button()
connect = Button()
restart = Button()
ros = PythonScript(ip="10.181.163.92", restart=restart)  # -> out, ros_client
# ---------- ros: Python ----------
import sys
import time
import logging
import scriptcontext as sc

from compas_fab.backends import RosClient

from System import TimeSpan
from System.Threading import ManualResetEventSlim

LOGGER = logging.getLogger('roslibpy')

key = 'rosclient_%s' % str(ghenv.Component.InstanceGuid)
previous_client = sc.sticky.get(key, None)
if previous_client:
    previous_client.terminate()

ros_client = RosClient(ip, 9090)
sc.sticky[key] = ros_client

waitLock = ManualResetEventSlim(False)

ros_client.on_ready(lambda: waitLock.Set())

if not waitLock.Wait(TimeSpan.FromSeconds(5)):
    raise Exception('Unable to connect to ROS')

LOGGER.info('ROS connection opened')
# ---------- end ros ----------
connect_2 = PythonScript(ros_client=ros.ros_client, connect=connect, disconnect=disconnect)  # -> out, ros_client
# ---------- connect_2: Python ----------
import logging
from System import TimeSpan
from System.Threading import ManualResetEventSlim

LOGGER = logging.getLogger('roslibpy')

if connect:
    if not ros_client.is_connected:
        LOGGER.debug('Connecting...')
        waitLock = ManualResetEventSlim(False)
        ros_client.on_ready(lambda: waitLock.Set())
        ros_client.connect()

        if not waitLock.Wait(TimeSpan.FromSeconds(5)):
            raise Exception('Unable to connect to ROS')
        LOGGER.debug('Reconnected')

if disconnect:
    if ros_client.is_connected:
        ros_client.terminate()
        LOGGER.debug('Terminated')

print ros_client.is_connected
# ---------- end connect_2 ----------
is_connected = Panel(connect_2.out)

# ----
# Robot
load = Button()

list_2 = ValueList({"measurement_tool": 0, "air_pick_15mm": 1}, selected="air_pick_15mm")
ros_client = Data(connect_2.ros_client)

# ----
# Load robot from local package
list_3 = ValueList({"ur3.urdf", "ur5.urdf", "ur10.urdf", "ur3e.urdf", "ur5e.urdf", "ur10e.urdf", "ur10e_rot.urdf", "ur3_with_measurement_tool.urdf", "ur5_with_measurement_tool.urdf", "ur10_with_measurement_tool.urdf", "ur10e_vacuumgripper.urdf"}, selected="ur10e_rot.urdf")
list_4 = ValueList({"ur3.srdf", "ur5.srdf", "ur10.srdf", "ur3e.srdf", "ur5e.srdf", "ur10e.srdf", "ur3_with_measurement_tool.srdf", "ur5_with_measurement_tool.srdf", "ur10_with_measurement_tool.srdf", "ur10e_vacuumgripper.srdf"}, selected="ur10e.srdf")
py_3 = PythonScript()  # -> ghfile_path
# ---------- py_3: Python ----------
import os

filepath = ghenv.Component.OnPingDocument().FilePath
ghfile_path = os.path.dirname(filepath)
# ---------- end py_3 ----------
list_5 = ValueList({"ur_description", "ur_e_description", "ur_setups"}, selected="ur_e_description")
py_4 = PythonScript(ghfile_path=py_3)  # -> robot_description
# ---------- py_4: Python ----------
import os

robot_description = os.path.join(ghfile_path, "..", "data", "robot_description")
robot_description = os.path.abspath(robot_description)

print robot_description
# ---------- end py_4 ----------
py_5 = PythonScript()  # -> packages
# ---------- py_5: Python ----------
packages = ["ur_description", "ur_e_description", "ur_end_effectors", "ur_setups"]
# ---------- end py_5 ----------
py_6 = PythonScript(path=py_4, package=list_5, urdf_name=list_3, srdf_name=list_4)  # -> package_path, urdf_filename, srdf_filename
# ---------- py_6: Python ----------
import os

package_path = os.path.join(path, package)

urdf_filename = os.path.join(package_path, "urdf", urdf_name)
srdf_filename = os.path.join(package_path, srdf_name)

assert os.path.isfile(urdf_filename)
assert os.path.isfile(srdf_filename)
# ---------- end py_6 ----------
py_7 = PythonScript(path=py_4, packages=py_5)  # -> loaders; inputs packages: list
# ---------- py_7: Python ----------
from compas.robots import LocalPackageMeshLoader

loaders = []
print packages


for package in packages:
    loaders.append(LocalPackageMeshLoader(path, package))
# ---------- end py_7 ----------
load_2 = Button()
units = ValueList({"m": 1, "cm": 100, "mm": 1000}, selected="m")
create = PythonScript(loaders=py_7, urdf_filename=py_6.urdf_filename, srdf_filename=py_6.srdf_filename, scale_factor=units, load=load_2)  # -> out, robot; inputs loaders: list
# ---------- create: Python ----------
import os
from scriptcontext import sticky as st

import compas

from compas.robots import RobotModel
from compas.robots import LocalPackageMeshLoader

from compas_fab.robots import Robot
from compas_fab.robots import RobotSemantics

from compas_fab.ghpython import RobotArtist

compas.PRECISION = '12f'

# store robot in component
guid = str(ghenv.Component.InstanceGuid)
robot_key = "robot_" + guid
print guid

if robot_key not in st:
    st[robot_key] = None

print loaders
if load:
    model = RobotModel.from_urdf_file(urdf_filename)
    
    model.load_geometry(*loaders)
    artist = RobotArtist(model)
    semantics = RobotSemantics.from_srdf_file(srdf_filename, model)
    robot = Robot(model, artist, semantics, client=None)
    
    st[robot_key] = robot

robot = st[robot_key]

"""
if robot:
    robot.scale(scale_factor)
"""
# ---------- end create ----------
set = PythonScript(robot=create.robot, client=ros_client)  # -> robot
# ---------- set: Python ----------
if robot and client:
    robot.client = client
# ---------- end set ----------

# ----
# Load robot directly from ROS
# (only working if connected and file_server launched)
units_2 = ValueList({"m": 1, "cm": 100, "mm": 1000}, selected="m")
python = PythonScript(client=ros_client, scale_factor=units_2, load=load)  # -> robot; inputs load: Boolean
# ---------- python: Python ----------
import os
from scriptcontext import sticky as st
import compas
from compas.robots import RobotModel
from compas_fab.backends import RosClient
from compas_fab.backends import RosFileServerLoader
from compas_fab.robots import Robot
from compas_fab.robots import RobotSemantics
from compas_fab.ghpython import RobotArtist

# Set high precision to import meshes defined in meters
compas.PRECISION = '24f'

# store robot in component
guid = str(ghenv.Component.InstanceGuid)
robot_key = "robot_" + guid

if robot_key not in st:
    st[robot_key] = None

if client and client.is_connected and load:
    # Load URDF from ROS
    loader = RosFileServerLoader(client)
    urdf = loader.load_urdf()
    srdf = loader.load_srdf()

    # Create robot model from URDF and load geometry
    model = RobotModel.from_urdf_string(urdf)
    model.load_geometry(loader)
    
    semantics = RobotSemantics.from_srdf_string(srdf, model)
    
    robot = Robot(model, semantics=semantics)
    robot.artist = RobotArtist(robot.model)
    robot.scale(scale_factor)
    st[robot_key] = robot

robot = st[robot_key]
if robot:
    robot.client = client
# ---------- end python ----------

list_6 = ValueList({"use from ROS": 0, "use from local package": 1}, selected="use from local package")
filter = StreamFilter(Gate=list_6, Stream0=python, Stream1=set)
robot = Data(filter)

# ----
# Base
x_axis = Curve(<curve referenced from the Rhino model>)
y_axis = Curve(<curve referenced from the Rhino model>)
geo = Geometry([<brep referenced from the Rhino model> x40])
x_axis_2 = Curve(<curve referenced from the Rhino model>)
y_axis_2 = Curve(<curve referenced from the Rhino model>)
pup = PythonScript(plane_axes=[x_axis, y_axis])  # -> plane; inputs plane_axes: list of Curve
# ---------- pup: Python ----------
import Rhino.Geometry as rg

x_axis, y_axis = plane_axes

x_axis = rg.Line(x_axis.PointAtStart, x_axis.PointAtEnd)
y_axis = rg.Line(y_axis.PointAtStart, y_axis.PointAtEnd)

if x_axis.From.DistanceTo(y_axis.From) < 0.01:
    origin = x_axis.From
    xvec = x_axis.Direction
    yvec = y_axis.Direction
elif x_axis.To.DistanceTo(y_axis.To) < 0.01:
    origin = x_axis.To
    xvec = -x_axis.Direction
    yvec = -y_axis.Direction
elif x_axis.From.DistanceTo(y_axis.To) < 0.01:
    origin = x_axis.From
    xvec = x_axis.Direction
    yvec = -y_axis.Direction
elif x_axis.To.DistanceTo(y_axis.From) < 0.01:
    origin = x_axis.To
    xvec = -x_axis.Direction
    yvec = y_axis.Direction

plane = rg.Plane(origin, xvec, yvec)
# ---------- end pup ----------
base = PythonScript(base_plane=pln)  # -> base_frame
# ---------- base: Python ----------
from compas.geometry import Frame
from compas.geometry import Transformation, Rotation
from compas_ghpython import draw_frame
import math
import Rhino.Geometry as rg




#base_frame = Frame(origin, xaxis, yaxis)
base_frame = Frame(base_plane.Origin, base_plane.XAxis, base_plane.YAxis)

R = Rotation.from_axis_and_angle(base_frame.zaxis, math.radians(-180), point=base_frame.point)
#base_frame.transform(R)
# ---------- end base ----------
base_geo = PythonScript(base_plane=pln, base_geo=geo, pick_up_plane=pup)  # -> base_geo, pick_up_plane, pick_up_plane_safe; inputs base_plane: Plane, base_geo: list, pick_up_plane: Plane
# ---------- base_geo: Python ----------
from compas.geometry import Frame
from compas.geometry import Transformation, Rotation
from compas_ghpython import draw_frame
import math
import Rhino.Geometry as rg
import ghpythonlib.components as ghcomp

safe_distance = -0.2

T_base = rg.Transform.PlaneToPlane(rg.Plane.WorldXY, base_plane)

base_geo = ghcomp.Transform(base_geo, T_base)


pick_up_plane = ghcomp.Transform(pick_up_plane, T_base)


pick_up_plane_safe = rg.Plane(pick_up_plane)
pick_up_plane_safe.Translate(pick_up_plane_safe.ZAxis*safe_distance)
# ---------- end base_geo ----------
plane = PythonScript(plane_axes=[x_axis_2, y_axis_2])  # -> plane; inputs plane_axes: list of Curve; same code as pup
py_8 = PythonScript(robot=robot, base_frame=base, set_to_frame=Toggle(True))  # -> a, bp
# ---------- py_8: Python ----------
from compas_ghpython import draw_frame
from compas.geometry import Frame, Point, Vector, Transformation



frame_zero = Frame(Point(0.000, 0.000, 0.000), Vector(1.000, 0.000, 0.000), Vector(0.000, 1.000, 0.000))
print base_frame

if set_to_frame == True:
    print robot.model.get_link_by_name(robot.get_base_link_name()).parent_joint
    robot.model.get_link_by_name(robot.get_base_link_name()).parent_joint.origin = base_frame
    bp = draw_frame(base_frame)
    
else:
    robot.model.get_link_by_name(robot.get_base_link_name()).parent_joint.origin = frame_zero
    bp = draw_frame(frame_zero)

print robot.transformation_RCF_WCF()


"""
print robot.model.links[0].name

frame = Frame(Point(0.300, 1.000, 0.000), Vector(1.000, 0.000, 0.000), Vector(0.000, 1.000, 0.000))
T = Transformation.from_frame(frame)

#robot.model.get_link_by_name(robot.get_base_link_name()).parent_joint.transform(T)
#robot.model.get_link_by_name(robot.get_base_link_name()).joints[0].origin = frame
#robot.model.get_link_by_name('shoulder_link').parent_joint.transform(T)
print robot.model.get_link_by_name('shoulder_link').parent_joint.origin
print robot.model.get_link_by_name(robot.get_base_link_name()).parent_joint.origin

print robot.get_configurable_joint_names()

print robot.model.links[0]

print robot.get_base_link_name(group=None)
print robot.get_base_frame(group=None, full_configuration=None)

print robot.get_end_effector_link_name(group=None)
print robot.get_link_names()

"""

#f = robot.model.joints[0].origin
#p = draw_frame(f)
# ---------- end py_8 ----------
geo_2 = Geometry(base_geo.base_geo)
plane_2 = Plane(base_geo.pick_up_plane)
preview = CustomPreview(Geometry=geo_2, Shader=ColourSwatch(SwatchColor=RGB(201, 201, 201)))

# ----
# Tool
panel_4 = Panel("Attach a custom tool")
show = BooleanToggle(False)
remove = Button()
add = Button()
python_2 = PythonScript(data_path=data_path, tool=list_2, show=show)  # -> tool, M, compas_mesh
# ---------- python_2: Python ----------
import os, math
from compas.geometry import Frame, Rotation
from compas.datastructures import Mesh
from compas_ghpython.artists import MeshArtist
from compas_fab.robots import Tool

tolerance = -0.013
#tolerance = - 0.023

if tool == 0:
    filename = 'measurement_tool_zaxis.stl'
    ee_frame = Frame([0, 0, 0.109], [1, 0, 0], [0, 1, 0])

elif tool == 1:
    filename = 'air_pick_zaxis.stl'
    ee_frame = Frame([0, 0, 0.158 + tolerance], [1, 0, 0], [0, 1, 0])


data_path = os.path.join(data_path, "attached_objects")
fullfilename = os.path.join(data_path, filename)
print fullfilename

ee_mesh = Mesh.from_stl(fullfilename)

#R = Rotation.from_axis_and_angle(ee_frame.zaxis, math.radians(180), point=ee_frame.point)
#ee_frame.transform(R)

if show:
    artist = MeshArtist(ee_mesh)
    M = artist.draw_mesh()

tool = Tool(ee_mesh, ee_frame)
compas_mesh = ee_mesh
# ---------- end python_2 ----------
py_9 = PythonScript(robot=robot, tool=python_2.tool, attach=add, remove=remove)
# ---------- py_9: Python ----------
if attach:
    robot.attach_tool(tool)
if remove:
    robot.detach_tool()
# ---------- end py_9 ----------

plane_3 = Plane(base_geo.pick_up_plane_safe)

# ----
# Planning scene
scene = PythonScript(robot=robot)  # -> scene
# ---------- scene: Python ----------
from scriptcontext import sticky as st

from compas_fab.robots import PlanningScene

# store scene in component
guid = str(ghenv.Component.InstanceGuid)
scene_key = "scene_" + guid

if scene_key not in st:
    st[scene_key] = None

if robot:
    st[scene_key] = PlanningScene(robot)

scene = st[scene_key]
# ---------- end scene ----------
panel_5 = Panel(create.out)

panel_6 = Panel("Define an obstacle")
colour_swatch = ColourSwatch(SwatchColor=RGB(255, 156, 156))  # disabled
brep = Brep(<brep referenced from the Rhino model>)  # disabled
preview_2 = CustomPreview(Geometry=brep, Shader=colour_swatch)  # disabled
mesh = Mesh(brep)  # disabled
mesh_2 = PythonScript(mesh=mesh)  # -> compas_mesh; disabled
# ---------- mesh_2: Python ----------
from compas.datastructures import Mesh
from compas_rhino.geometry import RhinoMesh

compas_mesh = RhinoMesh.from_guid(mesh).to_compas()
# ---------- end mesh_2 ----------
remove_2 = Button()
scale = BooleanToggle(False)
add_2 = Button()
collision = PythonScript(
    scene=scene,
    compas_mesh=counter.assembly,
    assembly=counter.assembly,
    counter=counter.counter,
    scale=scale,
    id="101",
    add=add_2,
    remove=remove_2)  # -> out; inputs counter: Int32
# ---------- collision: Python ----------
from compas_fab.robots import CollisionMesh
from compas.datastructures import mesh_transformed

T_to_local = scene.robot.transformation_WCF_RCF(group=None)

cm = []

current_key = counter+1

for key, element in assembly.elements():
    if key < current_key:
        cmt = mesh_transformed(element.mesh, T_to_local)
        m = CollisionMesh(cmt, str(key))
        cm.append(m)

if scene:
    if add:
        for mesh in cm:
            scene.add_collision_mesh(mesh, scale)
    if remove:
        scene.remove_collision_mesh(id)
# ---------- end collision ----------
panel_7 = Panel(collision)

# ----
# Attach an collision object
# Select link name to attach
# Select the links the object is allowed to touch
yz = YZPlane(Origin=Point(0, 0, 0))
cone = Cone(Base=yz, Radius=0.035, Length=0.1)  # -> Cone, Tip
mesh_3 = Mesh(cone.Cone)
mesh_4 = PythonScript(mesh=mesh_3)  # -> compas_mesh; same code as mesh_2
idxs = Data([3, 4, 5, 6, 7])
py_10 = PythonScript(robot=robot, idxs=idxs)  # -> touch_links; inputs idxs: list of Int32
# ---------- py_10: Python ----------
if robot:
    link_names = robot.get_link_names()
    touch_links = [link_names[i] for i in idxs]
# ---------- end py_10 ----------
py_11 = PythonScript(robot=robot, idx=Slider(7, range=0..7))  # -> link_name; inputs idx: Int32
# ---------- py_11: Python ----------
if robot:
    link_names = robot.get_link_names()
    #print link_names
    link_name = link_names[idx]
# ---------- end py_11 ----------
panel_8 = Panel(py_11)
panel_9 = Panel(py_10)
remove_3 = Button()  # disabled
add_3 = Button()  # disabled
scale_2 = BooleanToggle(False)
attached = PythonScript(
    scene=scene,
    compas_mesh=python_2.compas_mesh,
    scale=scale_2,
    id="tip",
    link_name=py_11,
    touch_links=py_10,
    add=add,
    remove=remove)  # -> acm, out; inputs touch_links: list
# ---------- attached: Python ----------
from compas_fab.robots import CollisionMesh
from compas_fab.robots import AttachedCollisionMesh

cm = CollisionMesh(compas_mesh, id)
acm = AttachedCollisionMesh(cm, link_name, touch_links)

if scene:
    if add:
        scene.add_attached_collision_mesh(acm, scale)
    if remove:
        scene.remove_attached_collision_mesh(id)
        scene.remove_collision_mesh(id)
# ---------- end attached ----------

# ----
# Select link name to attach
# Select the links the object is allowed to touch
brep_2 = Brep(<brep referenced from the Rhino model>)
mesh_5 = Mesh(brep_2)
mesh_6 = PythonScript(mesh=mesh_5)  # -> compas_mesh; same code as mesh_2
idxs_2 = Data([0, 1])
py_12 = PythonScript(robot=robot, idxs=idxs_2)  # -> touch_links; inputs idxs: list of Int32; same code as py_10
py_13 = PythonScript(robot=robot, idx=Slider(0, range=0..7))  # -> link_name; inputs idx: Int32; same code as py_11
panel_10 = Panel(py_13)
panel_11 = Panel(py_12)
remove_4 = Button()
add_4 = Button()
scale_3 = BooleanToggle(False)
attached_2 = PythonScript(
    scene=scene,
    compas_mesh=mesh_6,
    scale=scale_3,
    id="base_coll",
    link_name=py_13,
    touch_links=py_12,
    add=add_4,
    remove=remove_4)  # -> acm, out; inputs touch_links: list; same code as attached

# ----
# Info
info = PythonScript(robot=robot)  # -> out, main_group_name
# ---------- info: Python ----------
if robot:
    robot.info()
    main_group_name = robot.main_group_name
# ---------- end info ----------
panel_12 = Panel(info.out)

# ----
# Input
panel_13 = Panel("Start plane")  # disabled
panel_14 = Panel("End plane")  # disabled
pt = Point(Point(0.4148048473, 0.0806959495, 0.2818520837))  # disabled
pt_2 = Point(Point(0.3351751375, 0.6978514459, 0.3015280014))  # disabled
py_14 = GhPythonScript(pt=pt)  # -> pln; disabled
# ---------- py_14: Python ----------
import Rhino.Geometry as rg

pln = rg.Plane(pt, -rg.Vector3d.ZAxis)
# ---------- end py_14 ----------
py_15 = GhPythonScript(pt=pt_2)  # -> pln; disabled; same code as py_14
start_plane = Plane(py_15)  # disabled
end_plane = Plane(py_14)  # disabled

# ---- group: forward kinematics
a5 = Slider(-90, range=-360..360)
a3 = Slider(125, range=-360..360)
a6 = Slider(-195, range=-360..360)
a1 = Slider(-106, range=-360..360)
a2 = Slider(-92, range=-360..360)
a4 = Slider(-122, range=-360..360)
jp = GhPythonScript()  # -> joint_positions
# ---------- jp: Python ----------
import math

#joint_positions = [-90,-90,90,-90,-90,-180]
#joint_positions = [90,-90,-90,-90,90,0]
#joint_positions = [107.936081, -87.620144,-124.71515,-57.629241,90.148607,-161.978033]
joint_positions = [-106.347424, -92.326992, 124.645822, -122.353418, -89.778476, -195.448509]


#joint_positions = [-93.189867, -88.650322, 113.031968, -149.869716, -69.308986, 33.809094]
joint_positions = [math.radians(a) for a in joint_positions]
#joint_positions = [-3.136, -0.328, -1.218, 3.129, 0.852, 0.008]
#joint_positions = [0] * 6

print joint_positions

-93.189867, -88.650322, 113.031968, -149.869716, -69.308986, 33.809094
# ---------- end jp ----------
forward_kinematics = PythonScript(robot=robot, set_joint_positions=Button(), joint_positions=jp, a1=a1, a2=a2, a3=a3, a4=a4, a5=a5, a6=a6)  # -> full_configuration; inputs joint_positions: list
# ---------- forward_kinematics: Python ----------
import math
import Grasshopper
from compas.robots import Joint
from compas_fab.robots import Configuration

if set_joint_positions:

    j = 0
    for i in range(ghenv.Component.Params.Input.Count):
        nslider = ghenv.Component.Params.Input[i].Sources[0]
        if nslider.GetType() == Grasshopper.Kernel.Special.GH_NumberSlider:
            nslider.TrySetSliderValue(math.degrees(joint_positions[j]))
            j += 1

if robot:
    joint_positions = [a1, a2, a3, a4, a5, a6]
    joint_types = robot.get_configurable_joint_types()
    for i, joint_type in enumerate(joint_types):
        if joint_type == Joint.REVOLUTE:
            joint_positions[i] = math.radians(joint_positions[i])
    full_configuration = Configuration(joint_positions, joint_types)
# ---------- end forward_kinematics ----------

# ----
data = Data(["Grasshopper.Kernel.Types.GH_ObjectWrapper", "Grasshopper.Kernel.Types.GH_ObjectWrapper", "Grasshopper.Kernel.Types.GH_ObjectWrapper", "Grasshopper.Kernel.Types.GH_ObjectWrapper", "Grasshopper.Kernel.Types.GH_ObjectWrapper", "Grasshopper.Kernel.Types.GH_ObjectWrapper", "Grasshopper.Kernel.Types.GH_ObjectWrapper", "Grasshopper.Kernel.Types.GH_ObjectWrapper", "Grasshopper.Kernel.Types.GH_ObjectWrapper", "Grasshopper.Kernel.Types.GH_ObjectWrapper", "Grasshopper.Kernel.Types.GH_ObjectWrapper", "Grasshopper.Kernel.Types.GH_ObjectWrapper", "Grasshopper.Kernel.Types.GH_ObjectWrapper", "Grasshopper.Kernel.Types.GH_ObjectWrapper", "Grasshopper.Kernel.Types.GH_ObjectWrapper", "Grasshopper.Kernel.Types.GH_ObjectWrapper", "Grasshopper.Kernel.Types.GH_ObjectWrapper", "Grasshopper.Kernel.Types.GH_ObjectWrapper", "Grasshopper.Kernel.Types.GH_ObjectWrapper", "Grasshopper.Kernel.Types.GH_ObjectWrapper", "Grasshopper.Kernel.Types.GH_ObjectWrapper", "Grasshopper.Kernel.Types.GH_ObjectWrapper", "Grasshopper.Kernel.Types.GH_ObjectWrapper", "Grasshopper.Kernel.Types.GH_ObjectWrapper"])

# ----
# Settings
# --> Set your IP address
# --> Set robot IP address
server_ip = ValueList({"192.168.10.44", "192.168.10.12", "192.168.10.11", "192.168.10.10", "192.168.10.2", "127.0.0.1", "192.168.10.111"}, selected="192.168.10.11")
ur_ip = ValueList({"192.168.10.10", "192.168.10.20", "192.168.10.11", "192.168.10.12", "127.0.0.1", "192.168.10.111"}, selected="192.168.10.20")
server_port = ValueList({"50002", "50003", "50004", "50005"}, selected="50003")
ur_port = ValueList({"30002"}, selected="30002")
globals = PythonScript(server_address=server_ip, server_port=server_port, ur_ip=ur_ip, ur_port=ur_port, clear=Button())  # inputs server_port: Int32
# ---------- globals: Python ----------
from scriptcontext import sticky as st

st["server_address"] = server_address
st["server_port"] = server_port

st["ur_ip"] = ur_ip
st["ur_port"] = ur_port

if clear:
    st.clear()
# ---------- end globals ----------

# ----
# Check if UR robot
#  is available
ping = Button()
py_16 = PythonScript(ip=ur_ip, ping=ping)  # -> out, trigger
# ---------- py_16: Python ----------
from scriptcontext import sticky as st
from ur_online_control.ur_direct import is_available

guid = str(ghenv.Component.InstanceGuid)
txt_key = "txt_" + guid
if txt_key not in st:
    st[txt_key] = ""

if ping:
    
    available = is_available(ip)
    
    if available:
        st[txt_key] = "%s is up!" % ip
        trigger = True
    else:
        st[txt_key] = "%s is down!" % ip
        trigger = False

print(st[txt_key])
# ---------- end py_16 ----------
panel_15 = Panel(py_16.out)

panel_16 = Panel("get pose cartesian")
get = Button()
pose = PythonScript(get=get)  # -> pose_cartesian
# ---------- pose: Python ----------
from scriptcontext import sticky as st
import ur_online_control.ur_direct as urd

server_address = st["server_address"]
server_port = st["server_port"]
ur_port = st["ur_port"]
ur_ip = st["ur_ip"]

robot = st["robot_6e25a56a-ecab-4ebc-a3bd-f9966f8a8dbc"]
tool_angle_axis = list(robot.attached_tool.frame.point) + list(robot.attached_tool.frame.axis_angle_vector)

print(tool_angle_axis)

guid = str(ghenv.Component.InstanceGuid)
pose_cartesian_key = "pose_cartesian" + guid


if get:
    st[pose_cartesian_key] = urd.get_current_pose_cartesian(tool_angle_axis, server_address, server_port, ur_ip, ur_port, send=True)

if pose_cartesian_key not in st:
    pose_cartesian = []
else:
    pose_cartesian = st[pose_cartesian_key]

print(pose_cartesian)
# ---------- end pose ----------
py_17 = PythonScript(robot=robot, pose_cartesian=pose)  # -> frame_WCS, plane_WCS; inputs pose_cartesian: list
# ---------- py_17: Python ----------
import Rhino.Geometry as rg
from scriptcontext import sticky as st
from compas.geometry import Frame
from compas.geometry import Transformation
from compas_ghpython import draw_frame

robot = st["robot_6e25a56a-ecab-4ebc-a3bd-f9966f8a8dbc"]
pose = pose_cartesian

if pose_cartesian:
    #frame_RCS = Frame.from_pose_axis_angle_vector(pose_cartesian)
    frame_RCS = Frame.from_axis_angle_vector(axis_angle_vector=pose[3:], point=pose[:3])
    frame_WCS = robot.to_world_coords(frame_RCS)
    plane_WCS  = draw_frame(frame_WCS)
    print frame_RCS
# ---------- end py_17 ----------
draw = Draw(frame=py_17.frame_WCS)  # -> G, C
panel_17 = Panel(pose)
preview_3 = CustomPreview(Geometry=draw.G, Shader=py_17.plane_WCS)

get_2 = Button()
pose_2 = PythonScript(get=get_2)  # -> configuration, pose_joints
# ---------- pose_2: Python ----------
from scriptcontext import sticky as st
import ur_online_control.ur_direct as urd
from ur_online_control.ur.configuration import Configuration


server_address = st["server_address"]
server_port = st["server_port"]
ur_port = st["ur_port"]
ur_ip = st["ur_ip"]
robot = st["robot_6e25a56a-ecab-4ebc-a3bd-f9966f8a8dbc"]
tool_angle_axis = list(robot.attached_tool.frame.point) + list(robot.attached_tool.frame.axis_angle_vector)

#print(tool_angle_axis)

guid = str(ghenv.Component.InstanceGuid)
pose_joints_key = "pose_joints" + guid


if get:
    st[pose_joints_key] = urd.get_current_pose_joints(tool_angle_axis, server_address, server_port, ur_ip, ur_port, send=True)
if pose_joints_key not in st:
    #pose_joints = Configuration.from_revolute_values([0,0,0,0,0,0])
    configuration = Configuration.from_revolute_values([0,0,0,0,0,0])
else:
    #pose_joints = Configuration.from_revolute_values(st[pose_joints_key])
    configuration = Configuration.from_revolute_values(st[pose_joints_key])

pose_joints = configuration.values
# ---------- end pose_2 ----------
panel_18 = Panel("get pose joint")
panel_19 = Panel(pose_2.pose_joints)

movel = PythonScript()  # -> script
# ---------- movel: Python ----------
import math
from scriptcontext import sticky as st
import ur_online_control.ur_direct as urd

server_address = st["server_address"]
server_port = st["server_port"]
robot = st["robot_6e25a56a-ecab-4ebc-a3bd-f9966f8a8dbc"]
tool_angle_axis = list(robot.attached_tool.frame.point) + list(robot.attached_tool.frame.axis_angle_vector)

commands = urd.URCommandScript(server_address, server_port)
commands.start()
commands.set_tcp(tool_angle_axis)
commands.get_current_pose_cartesian()
commands.add_line("\tmovel(p[current_pose[0], current_pose[1], current_pose[2], {}, {}, {}], a=0.1, v=0.1)".format(math.pi, 0, 0))
commands.end()
script = commands.generate()

print(script)
# ---------- end movel ----------
panel_20 = Panel("reorient tool vertical")
send = Button()
send_2 = GhPythonScript(script=movel, send=send)  # -> out; inputs send: Boolean
# ---------- send_2: Python ----------
from scriptcontext import sticky as st
from ur_online_control.ur_direct import send_script

ur_ip = st["ur_ip"]
ur_port = st["ur_port"]

if send:
    send_script(script, ur_ip, ur_port)
# ---------- end send_2 ----------

stop_2 = Button()
panel_21 = Panel("stop")
stop_3 = PythonScript(stop=stop_2)
# ---------- stop_3: Python ----------
from scriptcontext import sticky as st
import ur_online_control.ur_direct as urd

#ur_ip = st["ur_ip"]
#ur_port = st["ur_port"]

ur_ip = '192.168.10.20'
ur_port = 30002

if stop:
    urd.stop(ur_ip, ur_port)
# ---------- end stop_3 ----------

# ----
# Calculate basis
# Measure basis:
# 1. Clear the recorded poses
# 2. Move robot to origin and press "get pose"
# 3. Move robot to point in positive x-axis and press "get pose"
# 4. Move robot to an other point in your basis and press "get pose"
# (The further away these positions are, the better)
# 
# 5. Alternatively change the order in the component calc base
# 6. Copy output into base component (TODO: check if it has to be inverted)
list_7 = ValueList({"o, pos.x-axis, xy pl": 0, "o, pos.y-axis, xy pl": 1}, selected="o, pos.x-axis, xy pl")
clear = Button()
rec = PythonScript(msg=pose, rec=get, clear=clear)  # -> rec; inputs msg: list
# ---------- rec: Python ----------
from scriptcontext import sticky as st

guid = str(ghenv.Component.InstanceGuid)
recorded_key =  "recorded_" + guid
just_cleared_key = "just_cleared_" + guid


if recorded_key not in st:
    st[recorded_key] = []

if just_cleared_key not in st:
    st[just_cleared_key] = False

if clear:
    st[recorded_key] = []
    st[just_cleared_key] = True
else:
    if len(msg):
        if msg != [None] and not st[just_cleared_key] and rec:
            st[recorded_key].append(msg)
    st[just_cleared_key] = False
        


rec = st[recorded_key]

print rec
# ---------- end rec ----------
calc_base = PythonScript(poses=rec, input_type=list_7)  # -> out; inputs poses: list
# ---------- calc_base: Python ----------
import Rhino.Geometry as rg
import math


if len(poses) > 2:
    
    O = poses[0]
    P1 = poses[1]
    P2 = poses[2]
    
    if input_type == 0:
        # origin, pt on positive x-axis, pt in xy plane
        origin = rg.Point3d(O[0], O[1], O[2])
        pt_on_xaxis = rg.Point3d(P1[0], P1[1], P1[2])
        pt_in_xyplane = rg.Point3d(P2[0], P2[1], P2[2])
        
        xaxis = pt_on_xaxis - origin
        xaxis.Unitize()
        
        v = pt_in_xyplane - origin
        zaxis = rg.Vector3d.CrossProduct(v, xaxis)
        zaxis.Unitize()
        
        # zaxis must look up!
        if math.acos(rg.Vector3d.ZAxis * zaxis) > math.acos(rg.Vector3d.ZAxis * -zaxis):
            zaxis = -zaxis
        
        yaxis = rg.Vector3d.CrossProduct(zaxis, xaxis)
    
    elif input_type == 1:
        # origin, pt on positive y-axis, pt in xy plane
        origin = rg.Point3d(O[0], O[1], O[2])
        pt_on_yaxis = rg.Point3d(P1[0], P1[1], P1[2])
        pt_in_xyplane = rg.Point3d(P2[0], P2[1], P2[2])
        
        yaxis = pt_on_yaxis - origin
        yaxis.Unitize()
        
        v = pt_in_xyplane - origin
        zaxis = rg.Vector3d.CrossProduct(v, yaxis)
        zaxis.Unitize()
        
        # zaxis must look up!
        if math.acos(rg.Vector3d.ZAxis * zaxis) > math.acos(rg.Vector3d.ZAxis * -zaxis):
            zaxis = -zaxis
        
        xaxis = rg.Vector3d.CrossProduct(yaxis, zaxis)
        
        
    print "Copy the following into base component:"
    print " "
    print "origin = [%.2f, %.2f, %.2f]" % tuple(list(origin))
    print "xaxis = [%.5f, %.5f, %.5f]" % tuple(list(xaxis))
    print "yaxis = [%.5f, %.5f, %.5f]" % tuple(list(yaxis))
    

#print rg.Vector3d.CrossProduct(rg.Vector3d.YAxis, rg.Vector3d.ZAxis)
#print rg.Vector3d.CrossProduct(rg.Vector3d.ZAxis, rg.Vector3d.XAxis)
# ---------- end calc_base ----------
panel_22 = Panel(calc_base)
panel_23 = Panel(rec)

value = BooleanToggle(True)
panel_24 = Panel("set digital out")
number = Slider(7, range=0..10)
digital_out = PythonScript(number=number, value=value)  # -> script; inputs number: Int32, value: Boolean
# ---------- digital_out: Python ----------
import ur_online_control.ur_direct as urd

commands = urd.URCommandScript()
commands.start()
commands.add_line("\tset_digital_out({}, {})".format(number, value))
commands.end()
script = commands.generate()

print(script)
# ---------- end digital_out ----------
send_3 = Button()
send_4 = GhPythonScript(script=digital_out, send=send_3)  # -> out; inputs send: Boolean; same code as send_2

pln_2 = Plane(Plane(origin=(1.20403171, 2.150740913, 0.601961), x=(-0.0004520772686, 0.9999998978, 0), y=(-0.9999998978, -0.0004520772686, 0)))
x_axis_3 = Curve(<curve referenced from the Rhino model>)
y_axis_3 = Curve(<curve referenced from the Rhino model>)

# ----
# move incremental in TCS
number_slider = Slider(-8, range=-10..10)
get_current_pose = Button()
list_8 = ValueList({"xaxis", "yaxis", "zaxis"}, selected="zaxis")
movel_2 = PythonScript(get=get_current_pose, step_size=number_slider, direction=list_8)  # -> script
# ---------- movel_2: Python ----------
from scriptcontext import sticky as st
from compas.geometry import Frame
from compas.geometry import Point, Vector
import ur_online_control.ur_direct as urd

server_address = st["server_address"]
server_port = st["server_port"]
ur_port = st["ur_port"]
ur_ip = st["ur_ip"]
robot = st["robot_6e25a56a-ecab-4ebc-a3bd-f9966f8a8dbc"]

tool_angle_axis = list(robot.attached_tool.frame.point) + list(robot.attached_tool.frame.axis_angle_vector)
x, y, z, ax, ay, az = tool_angle_axis
print(tool_angle_axis)

guid = str(ghenv.Component.InstanceGuid)
pose_cartesian_key = "pose_cartesian" + guid

if get:
    st[pose_cartesian_key] = urd.get_current_pose_cartesian(tool_angle_axis, server_address, server_port, ur_ip, ur_port, send=True)

if pose_cartesian_key not in st:
    pose_cartesian = []
    script = ""
else:
#    frame = Frame.from_pose_axis_angle_vector(pose_cartesian)
    frame = Frame.from_axis_angle_vector([ax, ay, az])
    frame.point = [x, y, z]
    
    def next_vector(direction, frame, step_size):
        dir_vector = {"xaxis": Vector(*frame.xaxis), "yaxis": Vector(*frame.yaxis), "zaxis": Vector(*frame.zaxis)}
        vector = dir_vector[direction] * step_size
        return vector
    
    [x, y, z] = next_vector(direction, frame, step_size)
    commands = urd.URCommandScript(server_address, server_port)
    commands.start()
    commands.set_tcp(tool_angle_axis)
    commands.get_current_pose_cartesian()
    commands.add_line("\tmovel(p[current_pose[0] + {}, current_pose[1] + {}, current_pose[2] + {}, current_pose[3], current_pose[4], current_pose[5]], t={})".format(x/1000, y/1000, z/1000, step_size * 0.1))
    commands.end()
    script = commands.generate()
    
    print(script)
# ---------- end movel_2 ----------
send_5 = Button()
send_6 = GhPythonScript(script=movel_2, send=send_5)  # -> out; inputs send: Boolean; same code as send_2

idx_2 = Slider(0, range=0..100)
panel_25 = Panel("move joints")
joint_configurations = Data(forward_kinematics)
item = ListItem(List=joint_configurations, Index=idx_2, Wrap=True)
list_9 = ValueList({"send all positions": 0, "send only one position": 1}, selected="send all positions")
filter_2 = StreamFilter(Gate=list_9, Stream0=joint_configurations, Stream1=item)
movej = PythonScript(joint_configurations=filter_2, velocity=Slider(7, range=0..200))  # -> script, values; inputs joint_configurations: list
# ---------- movej: Python ----------
import ur_online_control.ur_direct as urd
import math


print joint_configurations

"""
for c in joint_configurations:
    for i,v in enumerate(c.values):
        #print v
        if v>math.pi:
            v-=2*math.pi
        if v<-math.pi:
            v+=2*math.pi
        c.values[i]=v
"""

joint_config = ["movej({}, v={})".format(c.values, velocity/10) for c in joint_configurations]

commands = urd.URCommandScript()
commands.start()
commands.add_lines(joint_config)
commands.end()

script = commands.generate()
values = joint_configurations[0].values

print([math.degrees(v) for v in values])

print(script)
# ---------- end movej ----------
send_7 = Button()
send_8 = GhPythonScript(script=movej.script, send=send_7)  # -> out; inputs send: Boolean
# ---------- send_8: Python ----------
from scriptcontext import sticky as st
from ur_online_control.ur_direct import send_script

#ur_ip = st["ur_ip"]
#ur_port = st["ur_port"]
ur_ip = '192.168.10.20'
ur_port = 30002

if send:
    send_script(script, ur_ip, ur_port)
# ---------- end send_8 ----------

# ---- group: BASE ESTIMATION MTIP POSES
init_guess = Plane(pln_2)
pt_3 = Point([<point referenced from the Rhino model> x3])
calc_base_2 = PythonScript(poses=rec, pts_cad=pt_3, base_plane_init_guess=init_guess, calc=Toggle(False))  # -> out, pts_mtip_init_guess, pts_mtip_fit, base_plane_fit; inputs poses: list, pts_cad: list of Point3d, base_plane_init_guess: Plane
# ---------- calc_base_2: Python ----------
import ghpythonlib.components as ghcomp
import Rhino.Geometry as rg
from scriptcontext import sticky as st
from compas.geometry import Frame
import math as m
import sys
from compas.rpc import Proxy # for calling the numpy function in CPython




if len(poses):
    
    # get points from poses
    pts_mtip = [rg.Point3d(p[0], p[1], p[2]) for p in poses]
    
    T_W_R_init_guess = rg.Transform.PlaneToPlane(rg.Plane.WorldXY, base_plane_init_guess)
    pts_mtip_init_guess = [ghcomp.Transform(pt, T_W_R_init_guess) for pt in pts_mtip]
    
    # format Rhino transformation
    T_W_R_init_guess_flattened = [float(f) for f in T_W_R_init_guess.ToFloatArray(True)]
    T_W_R_init_guess_list = [T_W_R_init_guess_flattened[i:(i + 4)] for i in range(0, len(T_W_R_init_guess_flattened), 4)]  

    # format ptsA and ptsB
    dataB = [list(pt) for pt in pts_cad]
    dataA = [list(pt) for pt in pts_mtip]
    
    # call the function
    max_iterations = 100
    
    if calc:
        icp_func = Proxy('ur_online_control.optimisation.icp', python = 'C://Users//lidet//anaconda3//envs//afab//python.exe')
        
        print icp_func._python
        

        
        transformation, distances = icp_func.icp(dataA, dataB, init_guess=T_W_R_init_guess_list, max_iterations=max_iterations, tolerance=0.000001)
        
        print "distances", distances
        
        # format result
        T = rg.Transform.Identity
        for i in range(4):
            for j in range(4):
                code = "T.M%i%i = %f" % (i, j, transformation[i][j])
                print code
                exec(code)
        #print T
        
        # now transform the points with the transformation calculated
        pts_mtip_fit = [ghcomp.Transform(pt, T) for pt in pts_mtip]
        base_plane_fit = ghcomp.Transform(rg.Plane.WorldXY, T)
        
        
        #f = Frame(base_plane_fit)
        #print f.get_pose_quaternion()
        
        # correct the zvalue
        #base_plane_fit = ghcomp.Transform(base_plane_fit, rg.Transform.Translation(0,0,-3))
# ---------- end calc_base_2 ----------
pt_4 = Point(calc_base_2.pts_mtip_fit)
pt_5 = Point(calc_base_2.pts_mtip_init_guess)
pln_3 = Plane(calc_base_2.base_plane_fit)

# ----
plane_4 = PythonScript(plane_axes=[x_axis_3, y_axis_3])  # -> plane; inputs plane_axes: list of Curve; same code as pup

panel_26 = Panel("move cartesian single")
movel_3 = PythonScript(plane_WCS=plane_4)  # -> script; inputs plane_WCS: Plane
# ---------- movel_3: Python ----------
import Rhino.Geometry as rg
import ur_online_control.ur_direct as urd
from compas.geometry import Frame
from compas.geometry import Transformation, Rotation
from compas_ghpython import draw_frame
from scriptcontext import sticky as st
import math


robot = st["robot_6e25a56a-ecab-4ebc-a3bd-f9966f8a8dbc"]

def to_local_coords(frame_WCF, group='manipulator'):
    """Represent a frame from the world coordinate system (WCF) in the robot's coordinate system (RCF).
    Parameters
    ----------
    frame_WCF : :class:`compas.geometry.Frame`
        A frame in the world coordinate frame.
    group : :obj:`str`, optional
        The name of the planning group. Defaults to the main planning group.
    Returns
    -------
    :class:`compas.geometry.Frame`
        A frame in the robot's coordinate frame.
    Examples
    --------
    >>> frame_WCF = Frame([-0.363, 0.003, -0.147], [0.388, -0.351, -0.852], [0.276, 0.926, -0.256])
    >>> frame_RCF = robot.to_local_coordinates(frame_WCF)
    >>> frame_RCF
    Frame(Point(-0.363, 0.003, -0.147), Vector(0.388, -0.351, -0.852), Vector(0.276, 0.926, -0.256))
    """
    base_frame =  robot.get_base_frame(group=group)
    R = Rotation.from_axis_and_angle(base_frame.zaxis, math.radians(-180), point=base_frame.point)
    base_frame =  base_frame.transformed(R)
    #T = Transformation.from_change_of_basis(Frame.worldXY(), base_frame)
    T = Transformation.change_basis(Frame.worldXY(), base_frame)
    frame_RCF = frame_WCF.transformed(T)
    return frame_RCF

frame_WCS = Frame(plane_WCS.Origin, plane_WCS.XAxis, plane_WCS.YAxis)
#frame_RCS = robot.get_RCS(frame_WCS)
#frame_RCS = to_local_coords(frame_WCS, group='manipulator')
frame_RCS = robot.to_local_coords(frame_WCS)

cmd = list(frame_RCS.point) + list(frame_RCS.axis_angle_vector) + [0.1, 0.0]
tool_angle_axis = list(robot.attached_tool.frame.point) + list(robot.attached_tool.frame.axis_angle_vector)
commands = urd.generate_moves_linear(tool_angle_axis, cmd, st["ur_ip"], st["ur_port"])
script = commands.script
print(script)
# ---------- end movel_3 ----------
send_9 = Button()
send_10 = GhPythonScript(script=movel_3, send=send_9)  # -> out; inputs send: Boolean
# ---------- send_10: Python ----------
from scriptcontext import sticky as st
from ur_online_control.ur_direct import send_script

"""
ur_ip = st["ur_ip"]
ur_port = st["ur_port"]
"""

ur_ip = '192.168.10.20'
ur_port = 30002

if send:
    send_script(script, ur_ip, ur_port)
# ---------- end send_10 ----------

x_axis_4 = Curve(<curve referenced from the Rhino model>)  # disabled
y_axis_4 = Curve(<curve referenced from the Rhino model>)  # disabled
plane_5 = PythonScript(plane_axes=[x_axis_4, y_axis_4])  # -> plane; inputs plane_axes: list of Curve; disabled; same code as pup

# ----
# send area_grip vacuum scripts
send_11 = Button()
send_12 = Button()
airpick = GhPythonScript(send_script_areagrip_on=send_11, send_script_areagrip_off=send_12)  # -> out; inputs send_script_areagrip_on: Boolean
# ---------- airpick: Python ----------
import time
from scriptcontext import sticky as st
import ur_online_control.ur_direct as urd

ur_ip = st["ur_ip"]
ur_port = st["ur_port"]

script_on = urd.areagrip_toggle(True, ur_ip, ur_port, sleep = 1.)
script_off = urd.areagrip_toggle(False, ur_ip, ur_port, sleep = 0.1)



if send_script_areagrip_on:
    script_on.send_script()
    
if send_script_areagrip_off:
    script_off.send_script()
# ---------- end airpick ----------

# ----
# send airpick vacuum scripts
send_13 = Button()
send_14 = Button()
send_15 = Button()
airpick_2 = GhPythonScript(send_script_airpick_on=send_13, send_script_airpick_off=send_14, send_script_airpick_onoff=send_15)  # -> out; inputs send_script_airpick_on: Boolean
# ---------- airpick_2: Python ----------
import time
from scriptcontext import sticky as st
import ur_online_control.ur_direct as urd

"""
ur_ip = st["ur_ip"]
ur_port = st["ur_port"]
"""

ur_ip = '192.168.10.20'
ur_port = 30002
script_on = urd.airpick_toggle(True, ur_ip, ur_port)
script_off = urd.airpick_toggle(False, ur_ip, ur_port)



if send_script_airpick_on:
    script_on.send_script()
    
if send_script_airpick_off:
    script_off.send_script()

if send_script_airpick_onoff:
    script_on.send_script()
    time.sleep(5)
    script_off.send_script()
# ---------- end airpick_2 ----------

panel_27 = Panel(pln_3)

# ----
# Assembly
# Draw
show_2 = BooleanToggle(True)
show_3 = BooleanToggle(True)
show_4 = BooleanToggle(False)
show_5 = BooleanToggle(True)

# ---- group: Network Connectivity Preview
show_6 = BooleanToggle(False)

# ----
draw_2 = PythonScript(
    assembly=counter.assembly,
    show_element=show_2,
    show_all=show_6,
    show_until_counter=show_3,
    show_connections=show_4,
    show_options=show_5,
    counter=counter.counter)  # -> G_element, G_all, G_connections, vector_origins, option_vectors, current_tool_plane, current_tool_plane_safe_before, current_tool_plane_safe_up, current_tool_plane_safe_after; inputs counter: Int32
# ---------- draw_2: Python ----------
import os
import sys

import math

import Rhino.Geometry as rg
import rhinoscriptsyntax as rs
import ghpythonlib.components as ghcomp
import math

from compas.geometry import Translation, Rotation
from compas_ghpython.artists import MeshArtist
from compas_ghpython import draw_frame

G_element = []
G_all = []
G_connections = []

key_index = assembly.network.key_index()
keys = [key_index[key] for key in assembly.network.nodes()]
current_key = counter
safe_distance = 0.2

if show_all and not show_until_counter:
    elements = [assembly.element(key) for key in keys]
    for key, element in assembly.elements():
        artist = MeshArtist(element.mesh)
        mesh = artist.draw_mesh()
        G_all.append(mesh)


if show_until_counter:
    elements = [assembly.element(key) for key in keys]
    for element in elements[0:current_key+1]:
        artist = MeshArtist(element.mesh)
        mesh = artist.draw_mesh()
        G_all.append(mesh)


if show_connections:
    #elements = [assembly.element(key) for key in keys]
    #lines = assembly.network.to_lines() #does not work because edges are not transformed!
    edges = list(assembly.connections())
    for e in edges:
        p1 = assembly.element(e[0]).frame.point
        p2 = assembly.element(e[1]).frame.point
        G_connections += [rg.Line(p1[0],p1[1],p1[2],p2[0],p2[1],p2[2])]

if show_element:
    element = assembly.element(current_key)
    artist = MeshArtist(element.mesh)
    mesh = artist.draw_mesh()
    G_element.append(mesh)


print current_key

#tool_planes_WCS = [draw_frame(e.tool_frame) for e in elements]

current_element = assembly.element(current_key)
current_tool_plane = draw_frame(current_element.tool_frame)

#SAFE PLANE BEFORE
current_tool_plane_safe_before = rg.Plane(current_tool_plane)
current_tool_plane_safe_before.Translate(current_tool_plane_safe_before.ZAxis*-0.015 + current_tool_plane_safe_before.YAxis*0.05)

#SAFE PLANE AFTER
current_tool_plane_safe_after = rg.Plane(current_tool_plane)
current_tool_plane_safe_after.Translate(current_tool_plane_safe_after.ZAxis*-0.05 + current_tool_plane_safe_after.YAxis*0.05)

#SAFE PLANE UP
current_tool_plane_safe_up = rg.Plane(current_tool_plane_safe_after)
current_tool_plane_safe_up.Translate(rg.Vector3d.ZAxis*0.6)
# ---------- end draw_2 ----------
vdis = VectorDisplay(Anchor=draw_2.vector_origins, Vector=draw_2.option_vectors)
pln_4 = Plane(draw_2.current_tool_plane)
pln_5 = Plane(draw_2.current_tool_plane_safe_before)
pln_6 = Plane(draw_2.current_tool_plane_safe_up)
geo_3 = Geometry(draw_2.G_element)
geo_4 = Geometry(draw_2.G_all)
wbtriangles = WeaverbirdsSplitTrianglesSubdivision(MeshCurves=geo_4, Level=1)
preview_4 = CustomPreview(Geometry=geo_3, Shader=ColourSwatch(SwatchColor=RGB(255, 143, 143)))
preview_5 = CustomPreview(Geometry=wbtriangles, Shader=ColourSwatch(SwatchColor=RGB(255, 241, 184)))

# ---- group: Network Connectivity Preview (continued)
pln_7 = Plane(draw_2.current_tool_plane_safe_after)

# ----
crv = Curve(draw_2.G_connections)

# ----
# Input
_1_pick_up_plane = Plane(base_geo.pick_up_plane)
_2_pick_up_plane_safe = Plane(plane_3)
_4_current_tool_plane_safe = Plane(pln_5)
_5_current_tool_plane = Plane(pln_4)
_6_current_tool_plane_safe_up = Plane(pln_6)

unsubscribe = Button()  # disabled
# Execution
subscribe = Button()  # disabled
joint_states = PythonScript(sub=subscribe, unsub=unsubscribe)  # disabled
# ---------- joint_states: Python ----------
import roslibpy
import scriptcontext as sc

key = 'topic_%s' % str(ghenv.Component.InstanceGuid)
previous_topic = sc.sticky.get(key, None)

# Interval in ms between messages
THROTTLE_RATE = 50

if sub:
    if robot.client.is_connected:
        if previous_topic:
            previous_topic.unsubscribe()

        def received_joint_states(message):
            sc.sticky['joint_states'] = message
    
        topic = roslibpy.Topic(robot.client, '/joint_states', 'sensor_msgs/JointState', throttle_rate=THROTTLE_RATE)
        topic.subscribe(received_joint_states)
    
        sc.sticky[key] = topic
        print('Subscribed')
    else:
        print('ROS client not connected')

if unsub:
    if 'joint_states' in sc.sticky:
        del sc.sticky['joint_states']
    if previous_topic:
        previous_topic.unsubscribe()
# ---------- end joint_states ----------
value_list = ValueList({"0 cartesian path": 0, "1 kinematic path": 1}, selected="1 kinematic path")  # disabled
filter_3 = StreamFilter(Gate=value_list)  # disabled
refresh_hz = Slider(2, range=0..30)  # disabled
execute = Button()  # disabled
check = Button()  # disabled
cancel = Button()  # disabled
trajectory = PythonScript(response=filter_3, execute=execute, check=check, cancel=cancel)  # -> out, status; disabled
# ---------- trajectory: Python ----------
import time
import datetime

import roslibpy

import scriptcontext as sc

key = 'trajectory_%s' % str(ghenv.Component.InstanceGuid)
sent_trajectory = sc.sticky.get(key, None)

#joint_trajectory = response.trajectory.joint_trajectory if response else None
joint_trajectory = response if response else None
points = response.points if response else []

print response

if robot and robot.client.is_connected:
    if execute:
        sc.sticky[key] = dict(started_at=time.time(), trajectory=joint_trajectory, state='EXECUTING')

        def completion(result):
            if key in sc.sticky:
                if sc.sticky[key]['state'] == 'EXECUTING':
                    sc.sticky[key]['state'] = 'SUCCESSFUL'
                sc.sticky[key]['completed_at'] = time.time()
                del sc.sticky[key]['cancellable']

        def failure(e):
            if key in sc.sticky:
                sc.sticky[key]['state'] = 'ERROR'
                sc.sticky[key]['completed_at'] = time.time()
                sc.sticky[key]['exception'] = e

        print('Executing trajectory of %d points' % len(points))
        cancellable = robot.client.follow_joint_trajectory(joint_trajectory, completion, failure)
        sc.sticky[key]['cancellable'] = cancellable

    if cancel and 'cancellable' in sc.sticky[key]:
        sc.sticky[key]['state'] = 'CANCELLED'
        sc.sticky[key]['cancellable'].cancel()
        
else:
    status = 'NOT CONNECTED'

try:
    started_at = sc.sticky[key].get('started_at', 'n/a')
    completed_at = sc.sticky[key].get('completed_at', 'n/a')
    exception = sc.sticky[key].get('exception', '')
    execution_state = sc.sticky[key].get('state', '')
    
    if started_at != 'n/a':
        started_at = datetime.datetime.fromtimestamp(started_at).strftime('%H:%M:%S')
    if completed_at != 'n/a':
        completed_at = datetime.datetime.fromtimestamp(completed_at).strftime('%H:%M:%S')
    if exception:
        exception = 'Found an exception during execution: ' + str(exception)
    
    if not joint_trajectory:
        status = 'No trajectory available'
    else:
        status = """execution state: {}
    started at: {}
    completed at: {}
    trajectory of {} points\n{}""".format(execution_state,
                                          started_at,
                                          completed_at,
                                          len(points),
                                          exception)
    
    print(status)
except KeyError:
    pass
# ---------- end trajectory ----------
status = Panel(trajectory.status)  # disabled

# ---- group: inverse kinematics
avoid_collisions = BooleanToggle(False)
py_18 = PythonScript(robot=robot)  # -> configuration
# ---------- py_18: Python ----------
from compas_fab.robots import Configuration

if robot:
    types = robot.get_configurable_joint_types()
    values = [0] * len(types)
    configuration = Configuration(values, types)
    print configuration
    print robot.get_configurable_joint_names()
# ---------- end py_18 ----------
start_configuration = Data(forward_kinematics)
list_10 = ValueList({"0", "1"}, selected="0")
filter_4 = StreamFilter(Gate=list_10, Stream0=start_configuration, Stream1=py_18)

# ----
# Configuration
# TODO Example:
# Add path constraints
main_planning_group = Text(info.main_group_name)
compute = Button()
idx_3 = Slider(1, range=0..1)

# ---- group: inverse kinematics (continued)
inverse = GhPythonScript(
    robot=robot,
    group=main_planning_group,
    plane=_2_pick_up_plane_safe,
    start_configuration=filter_4,
    avoid_collisions=avoid_collisions)  # -> out, group_configuration, full_configuration, plane_RCF
# ---------- inverse: Python ----------
"""Calculate the robot's inverse kinematic for a given plane.
    Inputs:
        robot: The robot
        group: str, optional
            The planning group used for calculation. Defaults to the robot's
            main planning group.
        plane: The plane in world coordinate frame to calculate the inverse for.
        start_configuration: :class:`compas_fab.robots.Configuration`, optional
            If passed, the inverse will be calculated such that the calculated
            joint positions differ the least from the start_configuration.
            Defaults to the init configuration.
        avoid_collisions: bool, optional
            Whether or not to avoid collisions. Defaults to True.
    Output:
        group_configuration: The group configuration
        full_configuration: The full configuration
"""
from __future__ import print_function
import logging

from compas.geometry import Frame
from compas_ghpython import draw_frame

LOGGER = logging.getLogger('roslibpy')

frame_WCF = Frame(plane.Origin, plane.XAxis, plane.YAxis)
frame_RCF = robot.to_local_coords(frame_WCF, group=None)

if robot.attached_tool:
    frame_RCF = robot.from_attached_tool_to_tool0([frame_RCF])[0]

#plane_RCF = draw_frame(frame_RCF)

if robot and robot.client:
    if robot.client.is_connected:
        """
        full_configuration = robot.inverse_kinematics(frame,
                                                      start_configuration,
                                                      group=group,
                                                      options={
                                                        'avoid_collisions':avoid_collisions,
                                                        'return_full_configuration':True,
                                                      })"""
        full_configuration = robot.inverse_kinematics(frame_RCF,
                                                      start_configuration,
                                                      group=group,
                                                      avoid_collisions=avoid_collisions,
                                                      return_full_configuration=True,
                                                      )
        group_configuration = robot.get_group_configuration(group, full_configuration)
        print(group_configuration)
    else:
        print("Robot client is not connected")
# ---------- end inverse ----------
panel_28 = Panel(inverse.out)

# ---- group: cartesian motion
# Plan cartesian motion
group = Data(main_planning_group)
list_11 = ValueList({"don't use attached collision mesh": 0, "use attached collision mesh": 1}, selected="don't use attached collision mesh")
py_19 = PythonScript(robot=robot)  # -> configuration
# ---------- py_19: Python ----------
from compas_fab.robots import Configuration

if robot:
    types = robot.get_configurable_joint_types()
    values = [0] * len(types)

    configuration = Configuration(values, types)
    print configuration
# ---------- end py_19 ----------
start_configuration_2 = Data(inverse.full_configuration)
list_12 = ValueList({"0", "1"}, selected="0")
avoid_collisions_2 = BooleanToggle(False)
py_20 = PythonScript(start_plane=_4_current_tool_plane_safe, end_plane=_5_current_tool_plane)  # -> planes
# ---------- py_20: Python ----------
planes = [start_plane, end_plane]
print planes
# ---------- end py_20 ----------
compute_2 = Button()
filter_5 = StreamFilter(Gate=list_12, Stream0=start_configuration_2, Stream1=py_19)
filter_6 = StreamFilter(Gate=list_11, Stream1=attached.acm)
plan_cartesian_motion = PythonScript(
    robot=robot,
    group=group,
    planes=py_20,
    start_configuration=filter_5,
    max_step=Slider(0.01, range=0..0.01),
    avoid_collisions=avoid_collisions_2,
    attached_collision_meshes=filter_6,
    compute=compute_2)  # -> out, trajectory; inputs planes: list, avoid_collisions: Boolean, attached_collision_meshes: list
# ---------- plan_cartesian_motion: Python ----------
"""Calculates a cartesian motion path (linear in tool space).
    Inputs:
        robot: The robot
        group: str, optional
            The planning group used for calculation. Defaults to the robot's
            main planning group.
        planes: The planes in world coordinate frame through which the path is defined.
        start_configuration: :class:`compas_fab.robots.Configuration`, optional
            The robot's full configuration, i.e. values for all configurable
            joints of the entire robot cell, at the starting position. Defaults
            to the all-zero configuration.
        max_step: float
            The approximate distance between the calculated points. (Defined in
            the robot's units)
        avoid_collisions: bool, optional
            Whether or not to avoid collisions. Defaults to True.
        attached_collision_meshes: list of :class:`compas_fab.robots.AttachedCollisionMesh`
            Defaults to None.
        compute: bool
            Press to calculate solution.
    Output:
        :class:`compas_fab.robots.JointTrajectory`
            The calculated trajectory.
"""
from __future__ import print_function
import logging
import scriptcontext as sc

from compas.geometry import Frame

LOGGER = logging.getLogger('roslibpy')

guid = str(ghenv.Component.InstanceGuid)
response_key = "response_" + guid
if response_key not in sc.sticky:
    sc.sticky[response_key] = None

frames_WCF = [Frame(plane.Origin, plane.XAxis, plane.YAxis) for plane in planes]
frames_RCF = [robot.to_local_coords(frame_WCF, group=None) for frame_WCF in frames_WCF]
if robot.attached_tool:
    frames_RCF = [robot.from_attached_tool_to_tool0([frame])[0] for frame in frames_RCF]


if robot and robot.client and start_configuration and compute:
    if robot.client.is_connected:
        """
        sc.sticky[response_key] = robot.plan_cartesian_motion(frames,
                                                              start_configuration=start_configuration,
                                                              group=group,
                                                              options={
                                                                'max_step': float(max_step),
                                                                'avoid_collisions': bool(avoid_collisions),
                                                                'attached_collision_meshes': list(attached_collision_meshes),
                                                              })"""
        sc.sticky[response_key] = robot.plan_cartesian_motion(frames_RCF,
                                                              start_configuration=start_configuration,
                                                              group=group,
                                                              max_step=float(max_step),
                                                              avoid_collisions=bool(avoid_collisions),
                                                              attached_collision_meshes=list(attached_collision_meshes),
                                                              )
    else:
        print("Robot client is not connected")

trajectory = sc.sticky[response_key]
# ---------- end plan_cartesian_motion ----------
vis = PythonScript(response=plan_cartesian_motion.trajectory)  # -> P, V, A
# ---------- vis: Python ----------
from compas_ghpython import list_to_ghtree

if response:
    #print response.points
    positions = []
    velocities = []
    accelerations = []

    for p in response.points:
        positions.append(p.positions)
        velocities.append(p.velocities)
        accelerations.append(p.accelerations)
    #print positions
    P = list_to_ghtree(list(zip(*positions)))
    V = list_to_ghtree(list(zip(*velocities)))
    A = list_to_ghtree(list(zip(*accelerations)))
# ---------- end vis ----------
prismatic = QuickGraph(vis.P, SortOrder=0)
panel_29 = Panel("positions")
py_21 = PythonScript(robot=robot, group=group, trajectory=plan_cartesian_motion.trajectory)  # -> configurations, full_configurations, fraction, time
# ---------- py_21: Python ----------
if trajectory:
    configurations = trajectory.points
    full_configurations = [robot.merge_group_with_full_configuration(c, trajectory.start_configuration, group) for c in configurations]
    start_configuration = trajectory.start_configuration
    fraction = trajectory.fraction
    time = trajectory.time_from_start
# ---------- end py_21 ----------
time_s = Panel(py_21.time)
fraction = Panel(py_21.fraction)
graph = QuickGraph(vis.V, SortOrder=0)
graph_2 = QuickGraph(vis.A, SortOrder=0)
panel_30 = Panel("velocities")
panel_31 = Panel("accelerations")
path = GhPythonScript(robot=robot, group=group, full_configurations=py_21.full_configurations)  # -> frames, P; inputs full_configurations: list
# ---------- path: Python ----------
import Rhino.Geometry as rg

frames = []

if robot:
    for c in full_configurations:
        
        if c:
            #frame_WCF = robot.forward_kinematics(c, group, options={'backend':'model'})
            frame_RCF = robot.forward_kinematics(c, group, backend='model')
            frame_WCF = robot.to_world_coords(frame_RCF, group=None)
            frames.append(frame_WCF)

    P = [rg.Point3d(*list(frame.point)) for frame in frames]
# ---------- end path ----------
idx_4 = Slider(1, range=0..1)
animate = PythonScript(robot=robot, group=main_planning_group, configurations=py_21.full_configurations, idx=idx_4)  # -> configuration; inputs configurations: list, idx: Int32
# ---------- animate: Python ----------
import Grasshopper
from compas_fab.utilities import map_range
from compas_fab.robots import Configuration

count = len(configurations)

for i in range(ghenv.Component.Params.Input.Count):
    nslider = ghenv.Component.Params.Input[i].Sources[0]
    if nslider.GetType() == Grasshopper.Kernel.Special.GH_NumberSlider and nslider.NickName == 'idx':
        nslider.Slider.Maximum = max(count - 1, 1)
        nslider.Slider.Minimum = 0

if count and robot and configurations[0] != None:
    configuration = configurations[idx]
# ---------- end animate ----------
pline = PolyLine(Vertices=path.P, Closed=False)
preview_6 = CustomPreview(Geometry=[path.P, pline], Material=ColourSwatch(SwatchColor=RGB(59, 137, 161)))

# ----
pln_8 = Plane(inverse.plane_RCF)

# ---- group: forward kinematics
forward = PythonScript(robot=robot, group=main_planning_group, full_configuration=forward_kinematics)  # -> out, frame_WCF
# ---------- forward: Python ----------
"""Calculate the robot's forward kinematic.
    Inputs:
        robot: :class:`compas_fab.robots.Robot`
            The robot.
        group: str, optional
            The planning group used for calculation. Defaults to the robot's
            main planning group.
        full_configuration : :class:`compas_fab.robots.Configuration`
            The full configuration to calculate the forward kinematic for. If no
            full configuration is passed, the zero-joint state for the other
            configurable joints is assumed.
    Output:
        :class:`Frame`
            The frame in the world coordinate frame (WCF).
"""
from __future__ import print_function
import logging

import compas_fab
print(compas_fab.__version__)

LOGGER = logging.getLogger('roslibpy')

if robot and robot.client and full_configuration:
    if robot.client.is_connected:
        #frame_WCF = robot.forward_kinematics(full_configuration, group, options={'backend':'model'})
        frame_WCF = robot.forward_kinematics(full_configuration, group, backend='model')
        print(frame_WCF)
    else:
        print("Robot is not connected")
# ---------- end forward ----------
panel_32 = Panel(forward.out)

# ----
panel_33 = Panel(plan_cartesian_motion.out)

# ---- group: plan motion
# Plan motion
# If you specify the tolerance vector with [360, 1, 1], it means that
#     the frame's y-axis and z-axis are allowed to rotate about the x-axis by an
#     angle of 360 degrees, whereas the x-axis can only change 1 degree.
group_2 = Data(main_planning_group)
list_13 = ValueList({"don't use attached collision mesh": 0, "use attached collision mesh": 1}, selected="use attached collision mesh")
py_22 = PythonScript(robot=robot)  # -> configuration; same code as py_19
python_3 = PythonScript(
    robot=robot,
    group=group_2,
    goal_plane=_4_current_tool_plane_safe,
    tolerance_position=Slider(0.001, range=0..0.001),
    tolerance_xaxis_deg=Slider(1, range=1..360),
    tolerance_yaxis_deg=Slider(1, range=1..360),
    tolerance_zaxis_deg=Slider(1, range=1..360))  # -> goal_constraints
# ---------- python_3: Python ----------
import math
from compas.geometry import Frame



frame_WCF = Frame(goal_plane.Origin, goal_plane.XAxis, goal_plane.YAxis)
frame_RCF = robot.to_local_coords(frame_WCF, group=None)

if robot.attached_tool:
    frame_RCF = robot.from_attached_tool_to_tool0([frame_RCF])[0]

tolerances_axes = [math.radians(tolerance_xaxis_deg), math.radians(tolerance_yaxis_deg), math.radians(tolerance_zaxis_deg)]

if robot:
    goal_constraints = robot.constraints_from_frame(frame_RCF, tolerance_position, tolerances_axes, group)
# ---------- end python_3 ----------
start_configuration_3 = Data(inverse.full_configuration)
list_14 = ValueList({"0", "1"}, selected="0")
filter_7 = StreamFilter(Gate=list_14, Stream0=start_configuration_3, Stream1=py_22)
filter_8 = StreamFilter(Gate=list_13, Stream1=[attached.acm, attached_2.acm])
list_15 = ValueList({"RRT", "RRT*": "RRTStar", "EST", "PRM": "RPM", "PRM*": "RPMStar", "SPARS"}, selected="RRT")

# ----
plan_motion = PythonScript(
    robot=robot,
    group=group_2,
    start_configuration=filter_7,
    goal_constraints=python_3,
    planner_id=list_15,
    attached_collision_meshes=filter_8,
    compute=compute)  # -> out, trajectory; inputs goal_constraints: list, attached_collision_meshes: list
# ---------- plan_motion: Python ----------
"""Calculates a motion path.
    Inputs:
        robot: The robot
        group: str, optional
            The planning group used for calculation. Defaults to the robot's
            main planning group.
        start_configuration: :class:`compas_fab.robots.Configuration`, optional
            The robot's full configuration, i.e. values for all configurable
            joints of the entire robot cell, at the starting position. Defaults
            to the all-zero configuration.
        goal_constraints: list of :class:`compas_fab.robots.Constraint`
            The goal to be achieved, defined in a set of constraints.
            Constraints can be very specific, for example defining value domains
            for each joint, such that the goal configuration is included,
            or defining a volume in space, to which a specific robot link (e.g.
            the end-effector) is required to move to.
        planner_id: str
            The name of the algorithm used for path planning. Defaults to 'RRT'.
        attached_collision_meshes: list of :class:`compas_fab.robots.AttachedCollisionMesh`
            Defaults to None.
        compute: bool
            Press to calculate solution.
    Output:
        :class:`compas_fab.robots.JointTrajectory`
            The calculated trajectory.
"""
from __future__ import print_function
import logging
import scriptcontext as sc

guid = str(ghenv.Component.InstanceGuid)
response_key = "response_" + guid
if response_key not in sc.sticky:
    sc.sticky[response_key] = None

LOGGER = logging.getLogger('roslibpy')

if robot and robot.client and start_configuration and compute:
    if robot.client.is_connected:
        """
        sc.sticky[response_key] = robot.plan_motion(goal_constraints,
                                                    start_configuration,
                                                    group,
                                                    options={
                                                        'planner_id': str(planner_id),
                                                        'attached_collision_meshes': list(attached_collision_meshes),
                                                    })"""
        sc.sticky[response_key] = robot.plan_motion(goal_constraints,
                                                    start_configuration,
                                                    group,
                                                    planner_id=str(planner_id),
                                                    attached_collision_meshes=list(attached_collision_meshes),
                                                    )
    else:
        print("Robot client is not connected.")

trajectory = sc.sticky[response_key]
# ---------- end plan_motion ----------
py_23 = PythonScript(robot=robot, group=group_2, trajectory=plan_motion.trajectory)  # -> configurations, full_configurations, fraction, time; same code as py_21
panel_37 = Panel(plan_motion.out)
animate_2 = PythonScript(robot=robot, group=group_2, configurations=py_23.full_configurations, idx=idx_3)  # -> configuration; inputs configurations: list, idx: Int32; same code as animate

# ---- group: plan motion (continued)
vis_2 = PythonScript(response=plan_motion.trajectory)  # -> P, V, A, time
# ---------- vis_2: Python ----------
from compas_ghpython import list_to_ghtree

if response:

    positions = []
    velocities = []
    accelerations = []
    time_from_start = []

    for p in response.points:
        positions.append(p.positions)
        velocities.append(p.velocities)
        accelerations.append(p.accelerations)
        time_from_start.append(p.time_from_start.seconds)

    P = list_to_ghtree(list(zip(*positions)))
    V = list_to_ghtree(list(zip(*velocities)))
    A = list_to_ghtree(list(zip(*accelerations)))

    time = time_from_start[-1]
    print time
# ---------- end vis_2 ----------
time_s_2 = Panel(vis_2.time)
prismatic_2 = QuickGraph(vis_2.P, SortOrder=0)
fraction_2 = Panel(py_23.fraction)
time_s_3 = Panel(py_23.time)
graph_3 = QuickGraph(vis_2.V, SortOrder=0)
graph_4 = QuickGraph(vis_2.A, SortOrder=0)
path_2 = GhPythonScript(robot=robot, group=group_2, full_configurations=py_23.full_configurations)  # -> frames, P; inputs full_configurations: list
# ---------- path_2: Python ----------
import Rhino.Geometry as rg

frames = []

if robot:
    for c in full_configurations:
        if c:
            #frame_WCF = robot.forward_kinematics(c, group, options={'backend':'model'})
            frame_RCF = robot.forward_kinematics(c, group, backend='model')
            frame_WCF = robot.to_world_coords(frame_RCF, group=None)
            frames.append(frame_WCF)

    P = [rg.Point3d(*list(frame.point)) for frame in frames]
# ---------- end path_2 ----------
pline_2 = PolyLine(Vertices=path_2.P, Closed=False)
preview_7 = CustomPreview(Geometry=[pline_2, path_2.P], Material=ColourSwatch(SwatchColor=RGB(59, 161, 95)))

# ----
# Human-Robot Collaborative Assembly Fabrication Routine
standard_routine = BooleanToggle(False)
radius = Slider(0, range=0..0.1)
move_to_home = BooleanToggle(True)
move_to_goal = BooleanToggle(False)
joint_configurations_2 = Data(py_23.full_configurations)
joint_positions = Data(forward_kinematics)
pln_9 = Plane(_1_pick_up_plane)
pln_10 = Plane(_2_pick_up_plane_safe)
pln_11 = Plane(_5_current_tool_plane)
pln_12 = Plane(_6_current_tool_plane_safe_up)
pln_13 = Plane(pln_7)
hrca_ur_script = PythonScript(
    pick_up_plane=pln_9,
    pick_up_plane_safe=pln_10,
    joint_configurations=joint_configurations_2,
    current_tool_plane=pln_11,
    current_tool_plane_safe_up=pln_12,
    current_tool_plane_safe_after=pln_13,
    joint_positions=joint_positions,
    standard_routine=standard_routine,
    move_goal=move_to_goal,
    move_home=move_to_home,
    velocity=Slider(7, range=0..200),
    radius=radius)  # -> script, values, pick_up_plane_vacuum_on; inputs joint_configurations: list, standard_routine: Boolean, move_goal: Boolean, move_home: Boolean
# ---------- hrca_ur_script: Python ----------
import ur_online_control.ur_direct as urd
import math
from scriptcontext import sticky as st
import Rhino.Geometry as rg
from compas.geometry import Frame

robot = st["robot_6e25a56a-ecab-4ebc-a3bd-f9966f8a8dbc"]
tool_angle_axis = list(robot.attached_tool.frame.point) + list(robot.attached_tool.frame.axis_angle_vector)
sleep = 1.0
#print joint_configurations


def move_command(plane_WCS):
    frame_WCS = Frame(plane_WCS.Origin, plane_WCS.XAxis, plane_WCS.YAxis)
    frame_RCS = robot.to_local_coords(frame_WCS)
    cmd = list(frame_RCS.point) + list(frame_RCS.axis_angle_vector) + [velocity, radius]
    move_command = cmd
    return move_command

pick_up_plane_vacuum_on = rg.Plane(pick_up_plane)
pick_up_plane_vacuum_on.Translate(pick_up_plane_vacuum_on.ZAxis*-0.02)

#commands
pick_up_cmd = move_command(pick_up_plane)
pick_up_vacuum_on_cmd = move_command(pick_up_plane_vacuum_on)
pick_up_safe_cmd = move_command(pick_up_plane_safe)
current_tool_cmd = move_command(current_tool_plane)
current_tool_safe2_cmd = move_command(current_tool_plane)
current_tool_safe_up_cmd = move_command(current_tool_plane_safe_up)
current_tool_plane_safe_after_cmd = move_command(current_tool_plane_safe_after)


joint_config = ["movej({}, v={}, r={})".format(c.values, velocity/10, 0.05) for c in joint_configurations[:-1]]
joint_config += ["movej({}, v={}, r={})".format(c.values, velocity/10, 0.0) for c in joint_configurations[-1:]]
#joint_config_start = "movej({}, v={}, r={})".format(joint_positions.values, velocity/10, 0.0)
joint_config_end = ["movej({}, v={}, r={})".format(c.values, velocity/10, 0.05) for c in list(reversed(joint_configurations))[:-1]]
joint_config_end += ["movej({}, v={}, r={})".format(c.values, velocity/10, 0.0) for c in list(reversed(joint_configurations))[-1:]]


if move_goal:
    #MOVE TO GOAL
    commands = urd.URCommandScript()
    commands.start()
    commands.set_tcp(tool_angle_axis)
    commands.add_airpick_commands()
    commands.add_move_linear(pick_up_safe_cmd)                      #1
    commands.add_move_linear(pick_up_cmd)
    commands.airpick_on(max_vac=65, min_vac=35)                     #3
    commands.add_line("\tsleep({})".format(sleep))
    commands.add_move_linear(pick_up_safe_cmd)                      #4
    commands.add_lines(joint_config)                                #5 
    commands.add_move_linear(current_tool_cmd)                      #6
    commands.end()


if standard_routine:
    #STANDARD ROUTINE
    commands = urd.URCommandScript()
    commands.start()
    commands.set_tcp(tool_angle_axis)
    commands.add_airpick_commands()
    commands.add_move_linear(pick_up_safe_cmd)                      #1
    commands.add_move_linear(pick_up_cmd)
    commands.airpick_on(max_vac=65, min_vac=35)                    #3
    commands.add_line("\tsleep({})".format(sleep))
    commands.add_move_linear(pick_up_safe_cmd)                      #4
    commands.add_lines(joint_config)                                #5 
    commands.add_move_linear(current_tool_cmd)                      #6
    commands.airpick_off(pressure=40, timeout=2)                   #vacuum_off
    commands.add_line("\tsleep({})".format(1.))
    commands.add_move_linear(current_tool_plane_safe_after_cmd)
    commands.add_move_linear(current_tool_safe_up_cmd)              #7
    commands.add_lines(joint_config_end)
    commands.end()

    
if move_home:
    #MOVE TO HOME
    commands = urd.URCommandScript()
    commands.start()
    commands.set_tcp(tool_angle_axis)
    commands.add_airpick_commands()
    commands.airpick_off(pressure=40, timeout=2)                   #vacuum_off
    commands.add_move_linear(current_tool_plane_safe_after_cmd)
    #commands.add_move_linear(current_tool_safe_up_cmd)              #7
    commands.add_lines(joint_config_end)
    commands.add_move_linear(pick_up_safe_cmd)   
    commands.end()


script = commands.generate()

#values = joint_configurations[0].values

#print([math.degrees(v) for v in values])

print(script)
# ---------- end hrca_ur_script ----------
send_16 = Button()
send_17 = GhPythonScript(script=hrca_ur_script.script, send=send_16)  # -> out; inputs send: Boolean
# ---------- send_17: Python ----------
from scriptcontext import sticky as st
from ur_online_control.ur_direct import send_script

#ur_ip = st["ur_ip"]
#ur_port = st["ur_port"]

ur_ip = '192.168.10.20'
ur_port = 30002

if send:
    send_script(script, ur_ip, ur_port)
# ---------- end send_17 ----------

start_timer_update = Button()  # disabled
stop_timer_update = Button()  # disabled
data_recorder = DataRecorder(trajectory.out, DataLimit=-10, RecordData=False)  # disabled
panel_38 = Panel(data_recorder)  # disabled

current = PythonScript(
    rate=refresh_hz,
    subscribe=subscribe,
    unsubscribe=unsubscribe,
    start_update=start_timer_update,
    stop_update=stop_timer_update)  # -> out, configuration; inputs subscribe: Boolean, unsubscribe: Boolean, start_update: Boolean, stop_update: Boolean; disabled
# ---------- current: Python ----------
import scriptcontext as sc
from compas_fab.robots import Configuration
from compas_ghpython import update_component
from datetime import datetime


guid = str(ghenv.Component.InstanceGuid)
timer_running_key = "timer_running_" + guid

if stop_update or timer_running_key not in sc.sticky or unsubscribe:
    sc.sticky[timer_running_key] = False

if start_update or subscribe:
    sc.sticky[timer_running_key] = True



values = []
types = []

now = datetime.now()
timestamp = datetime.time(now)


print('receiving joint states at: ' + str(timestamp))


if 'joint_states' in sc.sticky:
    
    joint_states = sc.sticky['joint_states']
    joint_states = dict(zip(joint_states['name'], joint_states['position']))

    for joint in robot.get_configurable_joints():
        values.append(joint_states[joint.name])
        types.append(joint.type)
    
    configuration = Configuration(values, types)
    print(configuration)

else:
    configuration = robot.get_configuration()
    configuration.values = [0,0,0,0,0,0]
    
    

data_coming_in = robot.client.is_connected and 'joint_states' in sc.sticky

slow_interval = 2000
if rate != 0:
    refresh_interval = (1. / rate) * 1000
else:
    refresh_interval = slow_interval
interval = refresh_interval if data_coming_in else slow_interval

if sc.sticky[timer_running_key]==True:
    print sc.sticky[timer_running_key]
    update_component(ghenv, interval)

#update_component(ghenv, interval)
print('Interval: %dms' % interval)
# ---------- end current ----------

panel_39 = Panel(current.out)  # disabled

# ----
# Visualisation
# Select configuration input: from fk, ik, path, or from real robot
list_16 = ValueList({"0 forward_kinematics": 0, "1 inverse_kinematics": 1, "2 cartesian motion": 2, "3 free-space motion": 3}, selected="0 forward_kinematics")
filter_9 = StreamFilter(Gate=list_16, Stream0=forward_kinematics, Stream1=inverse.full_configuration, Stream2=animate, Stream3=animate_2)
show_end_effector_frame = BooleanToggle(True)
show_base_frame = BooleanToggle(True)
show_collision = BooleanToggle(False)
show_frames = BooleanToggle(True)
show_visual = BooleanToggle(True)
visualize = PythonScript(
    robot=robot,
    redraw=py_8.a,
    full_configuration=filter_9,
    show_visual=show_visual,
    show_collision=show_collision,
    show_frames=show_frames,
    show_base_frame=show_base_frame,
    show_end_effector_frame=show_end_effector_frame)  # -> out, visual, collision, frames, base_frame_WCF, ee_frame_WCF
# ---------- visualize: Python ----------
"""Calculates a cartesian motion path (linear in tool space).
    Inputs:
        robot: The robot
        group: str
            The planning group used for visualisation
        full_configuration: :class:`compas_fab.robots.Configuration`
            The robot's full configuration to display.
        show_visual: bool
           Whether or not to show the robot's visual meshes.
        show_collision: bool
           Whether or not to show the robot's collision meshes.
        show_frames: bool
           Whether or not to show the robot's joint frames.
        show_base_frame: bool
           Whether or not to show the robot's base frame.
        show_end_effector_frame: bool
            Whether or not to show the robot's end-effector frame.
    Output:
        visual: The robot's visual meshes.
        collision: The robot's collision meshes.
        frames: The robot's joint frames.
        base_frame_WCF: The robot's base frame.
        ee_frame_WCF: The robot's end-effector frame.
"""
from __future__ import print_function
import ghpythonlib.components as ghcomp
from compas_ghpython.geometry import xform_from_transformation

if robot and full_configuration:
    robot.update(full_configuration, visual=show_visual, collision=show_collision)
    print(full_configuration)
    T = robot.transformation_RCF_WCF()

    if show_visual:
        visual = robot.draw_visual() #visual = ([v for v in visual])
        visual = ghcomp.Transform(visual, xform_from_transformation(T))
        print(T)

    if show_collision:
        collision = robot.draw_collision()
        collision = ghcomp.Transform(collision, xform_from_transformation(T))

    if show_frames:
        axes = robot.transformed_axes(full_configuration)
        frames = robot.transformed_frames(full_configuration)
        [f.transform(T) for f in frames[1:]]

    if show_base_frame:
        base_frame_WCF = robot.get_base_frame(group, full_configuration)

    if show_end_effector_frame:
        ee_frame_WCF = robot.get_end_effector_frame(group, full_configuration)
        if robot.attached_tool:
            ee_frame_WCF = robot.from_tool0_to_attached_tool([ee_frame_WCF])[0]
        
        ee_frame_WCF.transform(T)
        print("End-effector", ee_frame_WCF)
# ---------- end visualize ----------
py_24 = PythonScript(robot=robot)  # -> scale
# ---------- py_24: Python ----------
if robot:
    scale = robot.scale_factor * 0.1
else:
    scale = 1.
# ---------- end py_24 ----------
draw_3 = GhPythonScript(frames=[visualize.base_frame_WCF, visualize.frames, visualize.ee_frame_WCF], scale=py_24)  # -> P, V, C, W; inputs frames: list
# ---------- draw_3: Python ----------
from System.Drawing import Color
from compas_ghpython import draw_frame

red = Color.FromArgb(255, 0, 0)
green = Color.FromArgb(0, 255, 0)
blue = Color.FromArgb(0, 0, 255)

P = []
V = []
C = []

scale = float(scale)

for frame in frames:
    if not frame:
        continue
    plane = draw_frame(frame)
    P += [plane.Origin] * 3
    V.append(plane.XAxis * scale)
    V.append(plane.YAxis * scale)
    V.append(plane.ZAxis * scale)
    C += [red, green, blue]

W = 3
# ---------- end draw_3 ----------
geo_5 = Geometry(visualize.collision)
vdisex = VectorDisplayEx(Point=draw_3.P, Vector=draw_3.V, Colour=draw_3.C, Width=draw_3.W)
panel_40 = Panel(visualize.out)

wbtriangles_2 = WeaverbirdsSplitTrianglesSubdivision(MeshCurves=visualize.visual, Level=1)

preview_8 = CustomPreview(Geometry=wbtriangles_2, Shader=ColourSwatch(SwatchColor=RGB(176, 176, 176)))

idx_5 = Slider(0, range=0..100)
panel_41 = Panel("move cartesian")
planes_wcs = Data(_4_current_tool_plane_safe)
list_17 = ValueList({"send all positions": 0, "send only one position": 1}, selected="send only one position")
send_18 = Button()

# ----
# Direct UR control
item_2 = ListItem(List=planes_wcs, Index=idx_2, Wrap=True)
filter_10 = StreamFilter(Gate=list_17, Stream0=planes_wcs, Stream1=item_2)

movel_4 = PythonScript(commands_input=list_17, planes_WCS=filter_10, idx=idx_5)  # -> script; inputs planes_WCS: list
# ---------- movel_4: Python ----------
import Rhino.Geometry as rg
from compas.geometry import Frame
from compas.geometry import Transformation
from compas_ghpython import draw_frame
from compas_fab.robots import robot

from scriptcontext import sticky as st
import ur_online_control.ur_direct as urd

robot = st["robot_6e25a56a-ecab-4ebc-a3bd-f9966f8a8dbc"]
tool_angle_axis = list(robot.attached_tool.frame.point) + list(robot.attached_tool.frame.axis_angle_vector)


#robot = st["robot"]
#tool_angle_axis = list(robot.tool.tcp_frame.point) + list(robot.tool.tcp_frame.axis_angle_vector)


move_commands = []
for plane_WCS in planes_WCS:
    frame_WCS = Frame(plane_WCS.Origin, plane_WCS.XAxis, plane_WCS.YAxis)
    frame_RCS = robot.to_local_coords(frame_WCS)
    if robot.attached_tool:
        frame_RCS = robot.from_attached_tool_to_tool0([frame_RCS])[0]
    cmd = list(frame_RCS.point) + list(frame_RCS.axis_angle_vector) + [50.0, 0.0]
    move_commands.append(cmd)

commands = urd.generate_moves_linear(tool_angle_axis, move_commands, st["ur_ip"], st["ur_port"])
script = commands.script
print(script)
# ---------- end movel_4 ----------
send_19 = GhPythonScript(script=movel_4, send=send_18)  # -> out; inputs send: Boolean; same code as send_2

# ==== cluster Draw
frame = ClusterInput()
size = ClusterInput()
draw = PythonScript(frame=frame, size=size)  # -> G, C
# ---------- draw: Python ----------
import Rhino.Geometry as rg
from System.Drawing import Color

if not size:
    size = 100

if frame:
    
    plane = rg.Plane(rg.Point3d(*list(frame.point)), rg.Vector3d(*list(frame.xaxis)), rg.Vector3d(*list(frame.yaxis)))

    G = []
    G.append(rg.Line(plane.Origin, size * plane.XAxis))
    G.append(rg.Line(plane.Origin, size * plane.YAxis))
    G.append(rg.Line(plane.Origin, size * plane.ZAxis))
    
    C = []
    C.append(Color.FromArgb(255, 0, 0))
    C.append(Color.FromArgb(0, 255, 0))
    C.append(Color.FromArgb(0, 0, 255))
# ---------- end draw ----------
G = ClusterOutput(draw.G)
C = ClusterOutput(draw.C)
