# Grasshopper definition ur_robots_setup_mobile_hrca_tests_with_base_frame.ghx (Grasshopper 1.0.7)
# plug-ins: Weaverbird

reload = Button()
py = PythonScript(reload=reload)
# ---------- py: Python ----------
from compas_rhino.utilities.misc import get_tolerance
from compas_rhino.utilities.misc import unload_modules

from compas_ghpython import unload_modules
unload_modules("compas")
unload_modules("compas_fab")
unload_modules("roslibpy")
# ---------- end py ----------

pln = Plane(Plane(origin=(-0.151004, -0.8072, 0.625169), x=(0.0007330000209, -0.9999970285, 0.002325000066), y=(0.9999621868, 0.0007128236381, -0.008667003539)))
panel = Panel("measurement_tool.stl")
panel_2 = Panel("10.181.69.122")

# ---- group: ROS client
disconnect = Button()
connect = Button()
restart = Button()
ros = PythonScript(ip="127.0.0.1", restart=restart)  # -> out, ros_client
# ---------- ros: Python ----------
import sys
import time
import logging
import scriptcontext as sc

from compas_fab.backends import RosClient

from System import TimeSpan
from System.Threading import ManualResetEventSlim

LOGGER = logging.getLogger('roslibpy')

key = 'rosclient_%s' % str(ghenv.Component.InstanceGuid)
previous_client = sc.sticky.get(key, None)
if previous_client:
    previous_client.terminate()

ros_client = RosClient(ip, 9090)
sc.sticky[key] = ros_client

waitLock = ManualResetEventSlim(False)

ros_client.on_ready(lambda: waitLock.Set())

if not waitLock.Wait(TimeSpan.FromSeconds(5)):
    raise Exception('Unable to connect to ROS')

LOGGER.info('ROS connection opened')
# ---------- end ros ----------
connect_2 = PythonScript(ros_client=ros.ros_client, connect=connect, disconnect=disconnect)  # -> out, ros_client
# ---------- connect_2: Python ----------
import logging
from System import TimeSpan
from System.Threading import ManualResetEventSlim

LOGGER = logging.getLogger('roslibpy')

if connect:
    if not ros_client.is_connected:
        LOGGER.debug('Connecting...')
        waitLock = ManualResetEventSlim(False)
        ros_client.on_ready(lambda: waitLock.Set())
        ros_client.connect()

        if not waitLock.Wait(TimeSpan.FromSeconds(5)):
            raise Exception('Unable to connect to ROS')
        LOGGER.debug('Reconnected')

if disconnect:
    if ros_client.is_connected:
        ros_client.terminate()
        LOGGER.debug('Terminated')

print ros_client.is_connected
# ---------- end connect_2 ----------
is_connected = Panel(connect_2.out)

# ----
# Load robot from local package
list = ValueList({"ur3.urdf", "ur5.urdf", "ur10.urdf", "ur3e.urdf", "ur5e.urdf", "ur10e.urdf", "ur3_with_measurement_tool.urdf", "ur5_with_measurement_tool.urdf", "ur10_with_measurement_tool.urdf", "ur10e_vacuumgripper.urdf"}, selected="ur10e.urdf")
list_2 = ValueList({"ur3.srdf", "ur5.srdf", "ur10.srdf", "ur3e.srdf", "ur5e.srdf", "ur10e.srdf", "ur3_with_measurement_tool.srdf", "ur5_with_measurement_tool.srdf", "ur10_with_measurement_tool.srdf", "ur10e_vacuumgripper.srdf"}, selected="ur10e.srdf")
py_2 = PythonScript()  # -> ghfile_path
# ---------- py_2: Python ----------
import os

filepath = ghenv.Component.OnPingDocument().FilePath
ghfile_path = os.path.dirname(filepath)
# ---------- end py_2 ----------
list_3 = ValueList({"ur_description", "ur_e_description", "ur_setups"}, selected="ur_e_description")
py_3 = PythonScript(ghfile_path=py_2)  # -> robot_description
# ---------- py_3: Python ----------
import os

robot_description = os.path.join(ghfile_path, "..", "data", "robot_description")
robot_description = os.path.abspath(robot_description)

print robot_description
# ---------- end py_3 ----------
py_4 = PythonScript()  # -> packages
# ---------- py_4: Python ----------
packages = ["ur_description", "ur_e_description", "ur_end_effectors", "ur_setups"]
# ---------- end py_4 ----------
py_5 = PythonScript(path=py_3, package=list_3, urdf_name=list, srdf_name=list_2)  # -> package_path, urdf_filename, srdf_filename
# ---------- py_5: Python ----------
import os

package_path = os.path.join(path, package)

urdf_filename = os.path.join(package_path, "urdf", urdf_name)
srdf_filename = os.path.join(package_path, srdf_name)

assert os.path.isfile(urdf_filename)
assert os.path.isfile(srdf_filename)
# ---------- end py_5 ----------
py_6 = PythonScript(path=py_3, packages=py_4)  # -> loaders; inputs packages: list
# ---------- py_6: Python ----------
from compas.robots import LocalPackageMeshLoader

loaders = []
print packages


for package in packages:
    loaders.append(LocalPackageMeshLoader(path, package))
# ---------- end py_6 ----------
load = Button()
units = ValueList({"m": 1, "cm": 100, "mm": 1000}, selected="m")
create = PythonScript(loaders=py_6, urdf_filename=py_5.urdf_filename, srdf_filename=py_5.srdf_filename, scale_factor=units, load=load)  # -> out, robot; inputs loaders: list
# ---------- create: Python ----------
import os
from scriptcontext import sticky as st

import compas

from compas.robots import RobotModel
from compas.robots import LocalPackageMeshLoader

from compas_fab.robots import Robot
from compas_fab.robots import RobotSemantics

from compas_fab.ghpython import RobotArtist

compas.PRECISION = '12f'

# store robot in component
guid = str(ghenv.Component.InstanceGuid)
robot_key = "robot_" + guid
print guid

if robot_key not in st:
    st[robot_key] = None

print loaders
if load:
    model = RobotModel.from_urdf_file(urdf_filename)
    
    model.load_geometry(*loaders)
    artist = RobotArtist(model)
    semantics = RobotSemantics.from_srdf_file(srdf_filename, model)
    robot = Robot(model, artist, semantics, client=None)
    
    st[robot_key] = robot

robot = st[robot_key]

"""
if robot:
    robot.scale(scale_factor)
"""
# ---------- end create ----------
set = PythonScript(robot=create.robot, client=connect_2.ros_client)  # -> robot
# ---------- set: Python ----------
if robot and client:
    robot.client = client
# ---------- end set ----------

py_7 = PythonScript()  # -> HERE, DATA
# ---------- py_7: Python ----------
import os

HERE = os.path.dirname(ghdoc.Path)
DATA = os.path.abspath(os.path.join(HERE, "..", "data"))
print(HERE)
print(DATA)
# ---------- end py_7 ----------
panel_3 = Panel(py_7.DATA)

# ----
# Robot
load_2 = Button()

# ----
# Load robot directly from ROS
# (only working if connected and file_server launched)
units_2 = ValueList({"m": 1, "cm": 100, "mm": 1000}, selected="m")
python = PythonScript(client=connect_2.ros_client, scale_factor=units_2, load=load_2)  # -> robot; inputs load: Boolean
# ---------- python: Python ----------
import os
from scriptcontext import sticky as st
import compas
from compas.robots import RobotModel
from compas_fab.backends import RosClient
from compas_fab.backends import RosFileServerLoader
from compas_fab.robots import Robot
from compas_fab.robots import RobotSemantics
from compas_fab.ghpython import RobotArtist

# Set high precision to import meshes defined in meters
compas.PRECISION = '24f'

# store robot in component
guid = str(ghenv.Component.InstanceGuid)
robot_key = "robot_" + guid

if robot_key not in st:
    st[robot_key] = None

if client and client.is_connected and load:
    # Load URDF from ROS
    loader = RosFileServerLoader(client)
    urdf = loader.load_urdf()
    srdf = loader.load_srdf()

    # Create robot model from URDF and load geometry
    model = RobotModel.from_urdf_string(urdf)
    model.load_geometry(loader)
    
    semantics = RobotSemantics.from_srdf_string(srdf, model)
    
    robot = Robot(model, semantics=semantics)
    robot.artist = RobotArtist(robot.model)
    robot.scale(scale_factor)
    st[robot_key] = robot

robot = st[robot_key]
if robot:
    robot.client = client
# ---------- end python ----------

data_path = Data(py_7.DATA)

import = Button(ExpressionNormal="True", ExpressionPressed="False")
py_8 = PythonScript()  # -> HERE, DATA; same code as py_7
initial_assembly = GhPythonScript(DATA=py_8.DATA, import_from_json=import)  # -> out, assembly; inputs import_from_json: Boolean
# ---------- initial_assembly: Python ----------
import os
import json

from human_robot_collaborative_assembly.assembly import HRCAssembly as Assembly
from human_robot_collaborative_assembly.assembly import HRCElement as Element

#assembly = Assembly()

if import_from_json:
    filename = "hrca/hrca_first_tracking_test_generated.json"
    PATH = os.path.join(DATA, filename)
    assembly = Assembly.from_json(PATH)
# ---------- end initial_assembly ----------

list_4 = ValueList({"use from ROS": 0, "use from local package": 1}, selected="use from local package")
filter = StreamFilter(Gate=list_4, Stream0=python, Stream1=set)
robot = Data(filter)

# ----
# Base
geo = Geometry([<brep referenced from the Rhino model> x40])
x_axis = Curve(<curve referenced from the Rhino model>)  # disabled
y_axis = Curve(<curve referenced from the Rhino model>)  # disabled
base = PythonScript(base_plane=pln)  # -> base_frame
# ---------- base: Python ----------
from compas.geometry import Frame
from compas.geometry import Transformation, Rotation
from compas_ghpython import draw_frame
import math
import Rhino.Geometry as rg




#base_frame = Frame(origin, xaxis, yaxis)
base_frame = Frame(base_plane.Origin, base_plane.XAxis, base_plane.YAxis)

R = Rotation.from_axis_and_angle(base_frame.zaxis, math.radians(180), point=base_frame.point)
#base_frame.transform(R)
# ---------- end base ----------
x_axis_2 = Curve(<curve referenced from the Rhino model>)
y_axis_2 = Curve(<curve referenced from the Rhino model>)
plane = PythonScript(plane_axes=[x_axis, y_axis])  # -> plane; inputs plane_axes: list of Curve; disabled
# ---------- plane: Python ----------
import Rhino.Geometry as rg

x_axis, y_axis = plane_axes

x_axis = rg.Line(x_axis.PointAtStart, x_axis.PointAtEnd)
y_axis = rg.Line(y_axis.PointAtStart, y_axis.PointAtEnd)

if x_axis.From.DistanceTo(y_axis.From) < 0.01:
    origin = x_axis.From
    xvec = x_axis.Direction
    yvec = y_axis.Direction
elif x_axis.To.DistanceTo(y_axis.To) < 0.01:
    origin = x_axis.To
    xvec = -x_axis.Direction
    yvec = -y_axis.Direction
elif x_axis.From.DistanceTo(y_axis.To) < 0.01:
    origin = x_axis.From
    xvec = x_axis.Direction
    yvec = -y_axis.Direction
elif x_axis.To.DistanceTo(y_axis.From) < 0.01:
    origin = x_axis.To
    xvec = -x_axis.Direction
    yvec = y_axis.Direction

plane = rg.Plane(origin, xvec, yvec)
# ---------- end plane ----------
plane_2 = PythonScript(plane_axes=[x_axis_2, y_axis_2])  # -> plane; inputs plane_axes: list of Curve; same code as plane
py_9 = PythonScript(robot=robot, base_frame=base, set_to_frame=Toggle(True))  # -> a, bp
# ---------- py_9: Python ----------
from compas_ghpython import draw_frame
from compas.geometry import Frame, Point, Vector, Transformation



frame_zero = Frame(Point(0.000, 0.000, 0.000), Vector(1.000, 0.000, 0.000), Vector(0.000, 1.000, 0.000))
print base_frame



if set_to_frame == True:
    T = Transformation.from_frame_to_frame(frame_zero, robot.get_joint_by_name("base_link-base_fixed_joint").origin)
    #print T
    print T
    f = robot.get_joint_by_name("base_link-base_fixed_joint").origin.copy()
    b = f.transformed(Transformation.from_frame(base_frame))
    #b = base_frame.transformed(T)
    b = base_frame
    
    print robot.model.get_link_by_name(robot.get_base_link_name()).parent_joint
    robot.model.get_link_by_name(robot.get_base_link_name()).parent_joint.origin = b #base_frame
    bp = draw_frame(b)
    
else:
    robot.model.get_link_by_name(robot.get_base_link_name()).parent_joint.origin = frame_zero
    bp = draw_frame(frame_zero)

#print robot.transformation_RCF_WCF()


"""
print robot.model.links[0].name

frame = Frame(Point(0.300, 1.000, 0.000), Vector(1.000, 0.000, 0.000), Vector(0.000, 1.000, 0.000))
T = Transformation.from_frame(frame)

#robot.model.get_link_by_name(robot.get_base_link_name()).parent_joint.transform(T)
#robot.model.get_link_by_name(robot.get_base_link_name()).joints[0].origin = frame
#robot.model.get_link_by_name('shoulder_link').parent_joint.transform(T)
print robot.model.get_link_by_name('shoulder_link').parent_joint.origin
print robot.model.get_link_by_name(robot.get_base_link_name()).parent_joint.origin

print robot.get_configurable_joint_names()

print robot.model.links[0]

print robot.get_base_link_name(group=None)
print robot.get_base_frame(group=None, full_configuration=None)

print robot.get_end_effector_link_name(group=None)
print robot.get_link_names()

"""

#f = robot.model.joints[0].origin
#p = draw_frame(f)
# ---------- end py_9 ----------
base_geo = PythonScript(base_plane=py_9.bp, base_geo=geo, pick_up_plane=plane_2)  # -> base_geo, pick_up_plane, pick_up_plane_safe, end_plane_safe; inputs base_plane: Plane, base_geo: list, pick_up_plane: Plane
# ---------- base_geo: Python ----------
from compas.geometry import Frame
from compas.geometry import Transformation, Rotation
from compas_ghpython import draw_frame
import math
import Rhino.Geometry as rg
import ghpythonlib.components as ghcomp

safe_distance = 0.2

T_base = rg.Transform.PlaneToPlane(rg.Plane.WorldXY, base_plane)

base_geo = ghcomp.Transform(base_geo, T_base)

pick_up_plane = ghcomp.Transform(pick_up_plane, T_base)

pick_up_plane_safe = rg.Plane(pick_up_plane)
pick_up_plane_safe.Translate(pick_up_plane_safe.ZAxis* -safe_distance)

# just for testing
end_plane_safe = rg.Plane(pick_up_plane_safe)
end_plane_safe.Translate(pick_up_plane_safe.XAxis*0.2)
# ---------- end base_geo ----------
geo_2 = Geometry(base_geo.base_geo)
plane_3 = Plane(base_geo.pick_up_plane)
preview = CustomPreview(Geometry=geo_2, Shader=ColourSwatch(SwatchColor=RGB(140, 140, 140)))

# ----
# Tool
panel_4 = Panel("air_pick.stl")
panel_5 = Panel("Attach a custom tool")
show = BooleanToggle(False)
remove = Button()
add = Button()
python_2 = PythonScript(data_path=data_path, filename=panel_4, show=show)  # -> tool, M, compas_mesh
# ---------- python_2: Python ----------
import os, math
from compas.geometry import Frame, Rotation
from compas.datastructures import Mesh
from compas_ghpython.artists import MeshArtist
from compas_fab.robots import Tool

data_path = os.path.join(data_path, "attached_objects")
fullfilename = os.path.join(data_path, filename)
print fullfilename
ee_mesh = Mesh.from_stl(fullfilename)
ee_frame = Frame([0.158, 0, 0], [0, 1, 0], [0, 0, 1])
#R = Rotation.from_axis_and_angle(ee_frame.zaxis, math.radians(180), point=ee_frame.point)
#ee_frame.transform(R)
#ee_frame = Frame([0.07, 0, 0], [1, 0, 0], [0, 0, -1])


if show:
    artist = MeshArtist(ee_mesh)
    M = artist.draw_mesh()

tool = Tool(ee_mesh, ee_frame)
compas_mesh = ee_mesh
# ---------- end python_2 ----------
py_10 = PythonScript(robot=robot, tool=python_2.tool, attach=add, remove=remove)
# ---------- py_10: Python ----------
if attach:
    robot.attach_tool(tool)
if remove:
    robot.detach_tool()
# ---------- end py_10 ----------

# ----
# Planning scene
scene = PythonScript(robot=robot)  # -> scene
# ---------- scene: Python ----------
from scriptcontext import sticky as st

from compas_fab.robots import PlanningScene

# store scene in component
guid = str(ghenv.Component.InstanceGuid)
scene_key = "scene_" + guid

if scene_key not in st:
    st[scene_key] = None

if robot:
    st[scene_key] = PlanningScene(robot)

scene = st[scene_key]
# ---------- end scene ----------
panel_6 = Panel(create.out)

# ----
# Attach an collision object
# Select link name to attach
# Select the links the object is allowed to touch
yz = YZPlane(Origin=Point(0, 0, 0))
cone = Cone(Base=yz, Radius=0.035, Length=0.1)  # -> Cone, Tip
mesh = Mesh(cone.Cone)
mesh_2 = PythonScript(mesh=mesh)  # -> compas_mesh
# ---------- mesh_2: Python ----------
from compas.datastructures import Mesh
from compas_rhino.geometry import RhinoMesh

compas_mesh = RhinoMesh.from_guid(mesh).to_compas()
# ---------- end mesh_2 ----------
idxs = Data([3, 4, 5, 6, 7])
py_11 = PythonScript(robot=robot, idxs=idxs)  # -> touch_links; inputs idxs: list of Int32
# ---------- py_11: Python ----------
if robot:
    link_names = robot.get_link_names()
    touch_links = [link_names[i] for i in idxs]
# ---------- end py_11 ----------
py_12 = PythonScript(robot=robot, idx=Slider(7, range=0..7))  # -> link_name; inputs idx: Int32
# ---------- py_12: Python ----------
if robot:
    link_names = robot.get_link_names()
    #print link_names
    link_name = link_names[idx]
    #print robot.get_end_effector_link_name()
# ---------- end py_12 ----------
panel_7 = Panel(py_12)
panel_8 = Panel(py_11)
remove_2 = Button()  # disabled
add_2 = Button()  # disabled
scale = BooleanToggle(False)
attached = PythonScript(
    scene=scene,
    compas_mesh=python_2.compas_mesh,
    scale=scale,
    id="tip",
    link_name=py_12,
    touch_links=py_11,
    add=add,
    remove=remove)  # -> acm, out; inputs touch_links: list
# ---------- attached: Python ----------
from compas_fab.robots import CollisionMesh
from compas_fab.robots import AttachedCollisionMesh

cm = CollisionMesh(compas_mesh, id)
acm = AttachedCollisionMesh(cm, link_name, touch_links)

if scene:
    if add:
        scene.add_attached_collision_mesh(acm, scale)
    if remove:
        scene.remove_attached_collision_mesh(id)
        scene.remove_collision_mesh(id)
# ---------- end attached ----------

# ----
# Select link name to attach
# Select the links the object is allowed to touch
brep = Brep(<brep referenced from the Rhino model>)
mesh_3 = Mesh(brep)
mesh_4 = PythonScript(mesh=mesh_3)  # -> compas_mesh; same code as mesh_2
idxs_2 = Data([0, 1])
py_13 = PythonScript(robot=robot, idxs=idxs_2)  # -> touch_links; inputs idxs: list of Int32; same code as py_11
py_14 = PythonScript(robot=robot, idx=Slider(0, range=0..7))  # -> link_name; inputs idx: Int32
# ---------- py_14: Python ----------
if robot:
    link_names = robot.get_link_names()
    #print link_names
    link_name = link_names[idx]
# ---------- end py_14 ----------
panel_9 = Panel(py_14)
panel_10 = Panel(py_13)
remove_3 = Button()
add_3 = Button()
scale_2 = BooleanToggle(False)
attached_2 = PythonScript(
    scene=scene,
    compas_mesh=mesh_4,
    scale=scale_2,
    id="base_coll",
    link_name=py_14,
    touch_links=py_13,
    add=add_3,
    remove=remove_3)  # -> acm, out; inputs touch_links: list; same code as attached

# ----
# Info
info = PythonScript(robot=robot)  # -> out, main_group_name
# ---------- info: Python ----------
if robot:
    robot.info()
    main_group_name = robot.main_group_name
# ---------- end info ----------
panel_11 = Panel(info.out)

# ---- group: Assembly Visualization
reset = Button()
back = Button()
start = Button()
step = Button()
stop = Button()
full = Button()
list_5 = ValueList({"20", "50", "100", "500", "1000", "5000"}, selected="50")

# ----
# Input
panel_12 = Panel("Start plane")  # disabled
panel_13 = Panel("End plane")  # disabled
pt = Point(Point(0.4148048473, 0.0806959495, 0.2818520837))  # disabled
pt_2 = Point(Point(0.3351751375, 0.6978514459, 0.3015280014))  # disabled
py_15 = GhPythonScript(pt=pt)  # -> pln; disabled
# ---------- py_15: Python ----------
import Rhino.Geometry as rg

pln = rg.Plane(pt, -rg.Vector3d.ZAxis)
# ---------- end py_15 ----------
py_16 = GhPythonScript(pt=pt_2)  # -> pln; disabled; same code as py_15
start_plane = Plane(py_16)  # disabled
end_plane = Plane(py_15)  # disabled

X = UnitX(Factor=Slider(-1.3, range=-1.5..1))

# ---- group: forward kinematics
a1 = Slider(0, range=-360..360)
a2 = Slider(0, range=-360..360)
a3 = Slider(0, range=-360..360)
a4 = Slider(0, range=-360..360)
a5 = Slider(0, range=-360..360)
a6 = Slider(0, range=-360..360)
jp = GhPythonScript()  # -> joint_positions
# ---------- jp: Python ----------
import math

joint_positions = [-90,-90,90,-90,-90,0]
#joint_positions = [-93.189867, -88.650322, 113.031968, -149.869716, -69.308986, 33.809094]
joint_positions = [math.radians(a) for a in joint_positions]
#joint_positions = [-3.136, -0.328, -1.218, 3.129, 0.852, 0.008]
joint_positions = [0] * 6

print joint_positions

#-93.189867, -88.650322, 113.031968, -149.869716, -69.308986, 33.809094
# ---------- end jp ----------
forward_kinematics = PythonScript(robot=robot, set_joint_positions=Button(), joint_positions=jp, a1=a1, a2=a2, a3=a3, a4=a4, a5=a5, a6=a6)  # -> full_configuration; inputs joint_positions: list
# ---------- forward_kinematics: Python ----------
import math
import Grasshopper
from compas.robots import Joint
from compas_fab.robots import Configuration

if set_joint_positions:

    j = 0
    for i in range(ghenv.Component.Params.Input.Count):
        nslider = ghenv.Component.Params.Input[i].Sources[0]
        if nslider.GetType() == Grasshopper.Kernel.Special.GH_NumberSlider:
            nslider.TrySetSliderValue(math.degrees(joint_positions[j]))
            j += 1

if robot:
    joint_positions = [a1, a2, a3, a4, a5, a6]
    joint_types = robot.get_configurable_joint_types()
    print(joint_types)
    for i, joint_type in enumerate(joint_types):
        if joint_type == Joint.REVOLUTE:
            joint_positions[i] = math.radians(joint_positions[i])
    full_configuration = Configuration(joint_positions, joint_types)
# ---------- end forward_kinematics ----------

# ----
# Settings
# --> Set your IP address
# --> Set robot IP address
server_ip = ValueList({"192.168.10.44", "192.168.10.12", "192.168.10.11", "192.168.10.10", "192.168.10.2", "127.0.0.1", "192.168.10.111"}, selected="192.168.10.11")
ur_ip = ValueList({"192.168.10.10", "192.168.10.20", "192.168.10.11", "192.168.10.12", "127.0.0.1", "192.168.10.111"}, selected="192.168.10.20")
server_port = ValueList({"50002", "50003", "50004", "50005"}, selected="50003")
ur_port = ValueList({"30002"}, selected="30002")
globals = PythonScript(server_address=server_ip, server_port=server_port, ur_ip=ur_ip, ur_port=ur_port, clear=Button())  # inputs server_port: Int32
# ---------- globals: Python ----------
from scriptcontext import sticky as st

st["server_address"] = server_address
st["server_port"] = server_port

st["ur_ip"] = ur_ip
st["ur_port"] = ur_port

if clear:
    st.clear()
# ---------- end globals ----------

# ----
# Check if UR robot
#  is available
ping = Button()
py_17 = PythonScript(ip=ur_ip, ping=ping)  # -> out, trigger
# ---------- py_17: Python ----------
from scriptcontext import sticky as st
from ur_online_control.ur_direct import is_available

guid = str(ghenv.Component.InstanceGuid)
txt_key = "txt_" + guid
if txt_key not in st:
    st[txt_key] = ""

if ping:
    
    available = is_available(ip)
    
    if available:
        st[txt_key] = "%s is up!" % ip
        trigger = True
    else:
        st[txt_key] = "%s is down!" % ip
        trigger = False

print(st[txt_key])
# ---------- end py_17 ----------
panel_14 = Panel(py_17.out)

pi = Pi(Factor=1)

panel_15 = Panel("get pose cartesian")
get = Button()
pose = PythonScript(get=get)  # -> pose_cartesian
# ---------- pose: Python ----------
from scriptcontext import sticky as st
import ur_online_control.ur_direct as urd

server_address = st["server_address"]
server_port = st["server_port"]
ur_port = st["ur_port"]
ur_ip = st["ur_ip"]
robot = st["robot_6e25a56a-ecab-4ebc-a3bd-f9966f8a8dbc"]
tool_angle_axis = list(robot.attached_tool.frame.point) + list(robot.attached_tool.frame.axis_angle_vector)

print(tool_angle_axis)

guid = str(ghenv.Component.InstanceGuid)
pose_cartesian_key = "pose_cartesian" + guid


if get:
    st[pose_cartesian_key] = urd.get_current_pose_cartesian(tool_angle_axis, server_address, server_port, ur_ip, ur_port, send=True)

if pose_cartesian_key not in st:
    pose_cartesian = []
else:
    pose_cartesian = st[pose_cartesian_key]

print(pose_cartesian)
# ---------- end pose ----------
py_18 = PythonScript(robot=robot, pose_cartesian=pose)  # -> frame_WCS, plane_WCS; inputs pose_cartesian: list
# ---------- py_18: Python ----------
import Rhino.Geometry as rg
from scriptcontext import sticky as st
from compas.geometry import Frame
from compas.geometry import Transformation
from compas_ghpython import draw_frame

robot = st["robot_6e25a56a-ecab-4ebc-a3bd-f9966f8a8dbc"]
pose = pose_cartesian

if pose_cartesian:
    #frame_RCS = Frame.from_pose_axis_angle_vector(pose_cartesian)
    frame_RCS = Frame.from_axis_angle_vector(axis_angle_vector=pose[3:], point=pose[:3])
    frame_WCS = robot.to_world_coords(frame_RCS)
    plane_WCS  = draw_frame(frame_WCS)
    print frame_RCS
# ---------- end py_18 ----------
draw = Draw(frame=py_18.frame_WCS)  # -> G, C
panel_16 = Panel(pose)
preview_2 = CustomPreview(Geometry=draw.G, Shader=draw.C)

movel = PythonScript()  # -> script
# ---------- movel: Python ----------
import math
from scriptcontext import sticky as st
import ur_online_control.ur_direct as urd

server_address = st["server_address"]
server_port = st["server_port"]
robot = st["robot_6e25a56a-ecab-4ebc-a3bd-f9966f8a8dbc"]
tool_angle_axis = list(robot.attached_tool.frame.point) + list(robot.attached_tool.frame.axis_angle_vector)

commands = urd.URCommandScript(server_address, server_port)
commands.start()
commands.set_tcp(tool_angle_axis)
commands.get_current_pose_cartesian()
commands.add_line("\tmovel(p[current_pose[0], current_pose[1], current_pose[2], {}, {}, {}], a=0.1, v=0.1)".format(math.pi, 0, 0))
commands.end()
script = commands.generate()

print(script)
# ---------- end movel ----------
panel_17 = Panel("reorient tool vertical")
send = Button()
send_2 = GhPythonScript(script=movel, send=send)  # -> out; inputs send: Boolean
# ---------- send_2: Python ----------
from scriptcontext import sticky as st
from ur_online_control.ur_direct import send_script

ur_ip = st["ur_ip"]
ur_port = st["ur_port"]

if send:
    send_script(script, ur_ip, ur_port)
# ---------- end send_2 ----------

stop_2 = Button()
panel_18 = Panel("stop")
stop_3 = PythonScript(stop=stop_2)
# ---------- stop_3: Python ----------
from scriptcontext import sticky as st
import ur_online_control.ur_direct as urd

ur_ip = st["ur_ip"]
ur_port = st["ur_port"]

if stop:
    urd.stop(ur_ip, ur_port)
# ---------- end stop_3 ----------

# ----
# Calculate basis
# Measure basis:
# 1. Clear the recorded poses
# 2. Move robot to origin and press "get pose"
# 3. Move robot to point in positive x-axis and press "get pose"
# 4. Move robot to an other point in your basis and press "get pose"
# (The further away these positions are, the better)
# 
# 5. Alternatively change the order in the component calc base
# 6. Copy output into base component (TODO: check if it has to be inverted)
list_6 = ValueList({"o, pos.x-axis, xy pl": 0, "o, pos.y-axis, xy pl": 1}, selected="o, pos.x-axis, xy pl")
clear = Button()
rec = PythonScript(msg=pose, rec=get, clear=clear)  # -> rec; inputs msg: list
# ---------- rec: Python ----------
from scriptcontext import sticky as st

guid = str(ghenv.Component.InstanceGuid)
recorded_key =  "recorded_" + guid
just_cleared_key = "just_cleared_" + guid


if recorded_key not in st:
    st[recorded_key] = []

if just_cleared_key not in st:
    st[just_cleared_key] = False

if clear:
    st[recorded_key] = []
    st[just_cleared_key] = True
else:
    if len(msg):
        if msg != [None] and not st[just_cleared_key] and rec:
            st[recorded_key].append(msg)
    st[just_cleared_key] = False
        


rec = st[recorded_key]

print rec
# ---------- end rec ----------
calc_base = PythonScript(poses=rec, input_type=list_6)  # -> out; inputs poses: list
# ---------- calc_base: Python ----------
import Rhino.Geometry as rg
import math


if len(poses) > 2:
    
    O = poses[0]
    P1 = poses[1]
    P2 = poses[2]
    
    if input_type == 0:
        # origin, pt on positive x-axis, pt in xy plane
        origin = rg.Point3d(O[0], O[1], O[2])
        pt_on_xaxis = rg.Point3d(P1[0], P1[1], P1[2])
        pt_in_xyplane = rg.Point3d(P2[0], P2[1], P2[2])
        
        xaxis = pt_on_xaxis - origin
        xaxis.Unitize()
        
        v = pt_in_xyplane - origin
        zaxis = rg.Vector3d.CrossProduct(v, xaxis)
        zaxis.Unitize()
        
        # zaxis must look up!
        if math.acos(rg.Vector3d.ZAxis * zaxis) > math.acos(rg.Vector3d.ZAxis * -zaxis):
            zaxis = -zaxis
        
        yaxis = rg.Vector3d.CrossProduct(zaxis, xaxis)
    
    elif input_type == 1:
        # origin, pt on positive y-axis, pt in xy plane
        origin = rg.Point3d(O[0], O[1], O[2])
        pt_on_yaxis = rg.Point3d(P1[0], P1[1], P1[2])
        pt_in_xyplane = rg.Point3d(P2[0], P2[1], P2[2])
        
        yaxis = pt_on_yaxis - origin
        yaxis.Unitize()
        
        v = pt_in_xyplane - origin
        zaxis = rg.Vector3d.CrossProduct(v, yaxis)
        zaxis.Unitize()
        
        # zaxis must look up!
        if math.acos(rg.Vector3d.ZAxis * zaxis) > math.acos(rg.Vector3d.ZAxis * -zaxis):
            zaxis = -zaxis
        
        xaxis = rg.Vector3d.CrossProduct(yaxis, zaxis)
        
        
    print "Copy the following into base component:"
    print " "
    print "origin = [%.2f, %.2f, %.2f]" % tuple(list(origin))
    print "xaxis = [%.5f, %.5f, %.5f]" % tuple(list(xaxis))
    print "yaxis = [%.5f, %.5f, %.5f]" % tuple(list(yaxis))
    

#print rg.Vector3d.CrossProduct(rg.Vector3d.YAxis, rg.Vector3d.ZAxis)
#print rg.Vector3d.CrossProduct(rg.Vector3d.ZAxis, rg.Vector3d.XAxis)
# ---------- end calc_base ----------
panel_19 = Panel(calc_base)
panel_20 = Panel(rec)

value = BooleanToggle(True)
panel_21 = Panel("set digital out")
number = Slider(7, range=0..10)
digital_out = PythonScript(number=number, value=value)  # -> script; inputs number: Int32, value: Boolean
# ---------- digital_out: Python ----------
import ur_online_control.ur_direct as urd

commands = urd.URCommandScript()
commands.start()
commands.add_line("\tset_digital_out({}, {})".format(number, value))
commands.end()
script = commands.generate()

print(script)
# ---------- end digital_out ----------
send_3 = Button()
send_4 = GhPythonScript(script=digital_out, send=send_3)  # -> out; inputs send: Boolean; same code as send_2

pick_up_plane_safe = Plane(base_geo.pick_up_plane_safe)
x_axis_3 = Curve(<curve referenced from the Rhino model>)
y_axis_3 = Curve(<curve referenced from the Rhino model>)

# ----
# move incremental in TCS
number_slider = Slider(-8, range=-10..10)
get_current_pose = Button()
list_7 = ValueList({"xaxis", "yaxis", "zaxis"}, selected="zaxis")
movel_2 = PythonScript(get=get_current_pose, step_size=number_slider, direction=list_7)  # -> script
# ---------- movel_2: Python ----------
from scriptcontext import sticky as st
from compas.geometry import Frame
from compas.geometry import Point, Vector
import ur_online_control.ur_direct as urd

server_address = st["server_address"]
server_port = st["server_port"]
ur_port = st["ur_port"]
ur_ip = st["ur_ip"]
robot = st["robot_6e25a56a-ecab-4ebc-a3bd-f9966f8a8dbc"]

tool_angle_axis = list(robot.attached_tool.frame.point) + list(robot.attached_tool.frame.axis_angle_vector)
x, y, z, ax, ay, az = tool_angle_axis
print(tool_angle_axis)

guid = str(ghenv.Component.InstanceGuid)
pose_cartesian_key = "pose_cartesian" + guid

if get:
    st[pose_cartesian_key] = urd.get_current_pose_cartesian(tool_angle_axis, server_address, server_port, ur_ip, ur_port, send=True)

if pose_cartesian_key not in st:
    pose_cartesian = []
    script = ""
else:
#    frame = Frame.from_pose_axis_angle_vector(pose_cartesian)
    frame = Frame.from_axis_angle_vector([ax, ay, az])
    frame.point = [x, y, z]
    
    def next_vector(direction, frame, step_size):
        dir_vector = {"xaxis": Vector(*frame.xaxis), "yaxis": Vector(*frame.yaxis), "zaxis": Vector(*frame.zaxis)}
        vector = dir_vector[direction] * step_size
        return vector
    
    [x, y, z] = next_vector(direction, frame, step_size)
    commands = urd.URCommandScript(server_address, server_port)
    commands.start()
    commands.set_tcp(tool_angle_axis)
    commands.get_current_pose_cartesian()
    commands.add_line("\tmovel(p[current_pose[0] + {}, current_pose[1] + {}, current_pose[2] + {}, current_pose[3], current_pose[4], current_pose[5]], t={})".format(x/1000, y/1000, z/1000, step_size * 0.1))
    commands.end()
    script = commands.generate()
    
    print(script)
# ---------- end movel_2 ----------
send_5 = Button()
send_6 = GhPythonScript(script=movel_2, send=send_5)  # -> out; inputs send: Boolean; same code as send_2

plane_4 = PythonScript(plane_axes=[x_axis_3, y_axis_3])  # -> plane; inputs plane_axes: list of Curve; same code as plane

panel_22 = Panel("move cartesian single")
movel_3 = PythonScript(plane_WCS=plane_4)  # -> script, plane_RCS; inputs plane_WCS: Plane
# ---------- movel_3: Python ----------
import Rhino.Geometry as rg
import ur_online_control.ur_direct as urd
from compas.geometry import Frame
from compas.geometry import Transformation
from compas_ghpython import draw_frame
from scriptcontext import sticky as st


robot = st["robot_6e25a56a-ecab-4ebc-a3bd-f9966f8a8dbc"]


frame_WCS = Frame(plane_WCS.Origin, plane_WCS.XAxis, plane_WCS.YAxis)
#frame_RCS = robot.get_RCS(frame_WCS)
frame_RCS = robot.to_local_coords(frame_WCS)
#if robot.attached_tool:
#   frame_RCS = robot.from_attached_tool_to_tool0([frame_RCS])[0]

plane_RCS = draw_frame(frame_RCS)
cmd = list(frame_RCS.point) + list(frame_RCS.axis_angle_vector) + [0.2, 0.0]
tool_angle_axis = list(robot.attached_tool.frame.point) + list(robot.attached_tool.frame.axis_angle_vector)

commands = urd.generate_moves_linear(tool_angle_axis, cmd, st["ur_ip"], st["ur_port"])
script = commands.script
print(script)

"""
def program():
	textmsg(">> Entering program.")
	# open line for airpick commands
	set_tcp(p[0.0, -2.8878212124549688e-14, 0.15828878352076936, 0.0, 0.0, 0.0])
	movel(p[-0.614842500262, 0.873731877582, -0.405256114106, 0.0264829026455, 3.11890916258, 0.0101767670369], v=0.2, r=0.0)
	textmsg("<< Exiting program.")
end
program()
"""
# ---------- end movel_3 ----------
send_7 = Button()
send_8 = GhPythonScript(script=movel_3.script, send=send_7)  # -> out; inputs send: Boolean; same code as send_2

x_axis_4 = Curve(<curve referenced from the Rhino model>)
y_axis_4 = Curve(<curve referenced from the Rhino model>)
plane_5 = PythonScript(plane_axes=[x_axis_4, y_axis_4])  # -> plane; inputs plane_axes: list of Curve; same code as plane

# ---- group: BASE ESTIMATION MTIP POSES
init_guess = Plane(plane_5)
pt_3 = Point([<point referenced from the Rhino model> x4])
calc_base_2 = PythonScript(poses=rec, pts_cad=pt_3, base_plane_init_guess=init_guess, calc=Toggle(False))  # -> out, pts_mtip_init_guess, pts_mtip_fit, base_plane_fit; inputs poses: list, pts_cad: list of Point3d, base_plane_init_guess: Plane
# ---------- calc_base_2: Python ----------
import ghpythonlib.components as ghcomp
import Rhino.Geometry as rg
from scriptcontext import sticky as st
from compas.geometry import Frame
import math as m
import sys
from compas.rpc import Proxy # for calling the numpy function in CPython




if len(poses):
    
    # get points from poses
    pts_mtip = [rg.Point3d(p[0], p[1], p[2]) for p in poses]
    
    T_W_R_init_guess = rg.Transform.PlaneToPlane(rg.Plane.WorldXY, base_plane_init_guess)
    pts_mtip_init_guess = [ghcomp.Transform(pt, T_W_R_init_guess) for pt in pts_mtip]
    
    # format Rhino transformation
    T_W_R_init_guess_flattened = [float(f) for f in T_W_R_init_guess.ToFloatArray(True)]
    T_W_R_init_guess_list = [T_W_R_init_guess_flattened[i:(i + 4)] for i in range(0, len(T_W_R_init_guess_flattened), 4)]  

    # format ptsA and ptsB
    dataB = [list(pt) for pt in pts_cad]
    dataA = [list(pt) for pt in pts_mtip]
    
    # call the function
    max_iterations = 100
    
    if calc:
        icp_func = Proxy('ur_online_control.optimisation.icp', python = 'C://Users//lidet//anaconda3//envs//afab//python.exe')
        
        print icp_func._python
        

        
        transformation, distances = icp_func.icp(dataA, dataB, init_guess=T_W_R_init_guess_list, max_iterations=max_iterations, tolerance=0.000001)
        
        print "distances", distances
        
        # format result
        T = rg.Transform.Identity
        for i in range(4):
            for j in range(4):
                code = "T.M%i%i = %f" % (i, j, transformation[i][j])
                print code
                exec(code)
        #print T
        
        # now transform the points with the transformation calculated
        pts_mtip_fit = [ghcomp.Transform(pt, T) for pt in pts_mtip]
        base_plane_fit = ghcomp.Transform(rg.Plane.WorldXY, T)
        
        
        #f = Frame(base_plane_fit)
        #print f.get_pose_quaternion()
        
        # correct the zvalue
        #base_plane_fit = ghcomp.Transform(base_plane_fit, rg.Transform.Translation(0,0,-3))
# ---------- end calc_base_2 ----------
pt_4 = Point(calc_base_2.pts_mtip_init_guess)
pt_5 = Point(calc_base_2.pts_mtip_fit)
pln_2 = Plane(calc_base_2.base_plane_fit)

# ----
pln_3 = Plane(movel_3.plane_RCS)

# ----
# send area_grip vacuum scripts
send_9 = Button()
send_10 = Button()
airpick = GhPythonScript(send_script_areagrip_on=send_9, send_script_areagrip_off=send_10)  # -> out; inputs send_script_areagrip_on: Boolean
# ---------- airpick: Python ----------
import time
from scriptcontext import sticky as st
import ur_online_control.ur_direct as urd

ur_ip = st["ur_ip"]
ur_port = st["ur_port"]

script_on = urd.areagrip_toggle(True, ur_ip, ur_port, sleep = 1.)
script_off = urd.areagrip_toggle(False, ur_ip, ur_port, sleep = 0.1)



if send_script_areagrip_on:
    script_on.send_script()
    
if send_script_areagrip_off:
    script_off.send_script()
# ---------- end airpick ----------

# ----
# send airpick vacuum scripts
send_11 = Button()
send_12 = Button()
send_13 = Button()
airpick_2 = GhPythonScript(send_script_airpick_on=send_11, send_script_airpick_off=send_12, send_script_airpick_onoff=send_13)  # -> out; inputs send_script_airpick_on: Boolean
# ---------- airpick_2: Python ----------
import time
from scriptcontext import sticky as st
import ur_online_control.ur_direct as urd

ur_ip = st["ur_ip"]
ur_port = st["ur_port"]

script_on = urd.airpick_toggle(True, ur_ip, ur_port)
script_off = urd.airpick_toggle(False, ur_ip, ur_port)



if send_script_airpick_on:
    script_on.send_script()
    
if send_script_airpick_off:
    script_off.send_script()

if send_script_airpick_onoff:
    script_on.send_script()
    time.sleep(5)
    script_off.send_script()
# ---------- end airpick_2 ----------

panel_23 = Panel(pln_2)

panel_24 = Panel("Define an obstacle")
colour_swatch = ColourSwatch(SwatchColor=RGB(255, 156, 156))  # disabled
brep_2 = Brep(<brep referenced from the Rhino model>)  # disabled
preview_3 = CustomPreview(Geometry=brep_2, Shader=colour_swatch)  # disabled
mesh_5 = Mesh(brep_2)  # disabled
mesh_6 = PythonScript(mesh=mesh_5)  # -> compas_mesh; disabled; same code as mesh_2
remove_4 = Button()
scale_3 = BooleanToggle(False)
add_4 = Button()

# ----
# To ROS:
# 
# object_poses = [[key, [position, orientation]]]
# Assembly
# Import initial assembly (first module)
elements = Elements()  # -> elem_center, elem_x, elem_y, elem_z
pt_6 = Point("-0.32, -0.024, 0.024")

object_poses = GhPythonScript(
    assembly=initial_assembly.assembly,
    elem_x=elements.elem_x,
    elem_y=elements.elem_y,
    elem_z=elements.elem_z,
    base_plane=pln,
    p="-0.32, -0.024, 0.024",
    add_to_assembly=Button(),
    add_2_and_3=Button())  # -> out, assembly, object_poses; inputs base_plane: Plane, p: Point3d, add_to_assembly: Boolean
# ---------- object_poses: Python ----------
import os
import sys
import Rhino.Geometry as rg

from compas.geometry import Translation
from compas.geometry import Plane, Frame

from human_robot_collaborative_assembly.assembly import HRCAssembly as Assembly
from human_robot_collaborative_assembly.assembly import HRCElement as Element

object_poses = []
min_dist = 0.2

#add a new module based on the tracked element's location
if add_to_assembly:
    current_key = assembly.parent_key(p, min_dist) # compute parent key
    e = assembly.element(current_key)
    current_type = e._type

    #compute direction
    axis_map = {'X': 0, 'Y': 1, 'Z': 2}
    if p[axis_map[current_type]] < e.frame.point[axis_map[current_type]]:
        direction = 0
        connector_frame = e.connector_frame_2
    else:
        direction = 1
        connector_frame = e.connector_frame_1

    a = connector_frame.point[axis_map[current_type]]
    b = p[axis_map[current_type]]
    shift_value = abs(a - b)

    type_map = {'X': elem_x, 'Y': elem_y, 'Z': elem_z}

    elem = type_map[current_type]
    assembly.add_module(elem_x, elem_y, elem_z, current_key, direction, shift_value, on_ground = False)


"""
    assembly.add_element_(elem, current_key, direction, shift_value, placed_by = 'human', on_ground = False, module_index = 0)
    
if add_2_and_3:
        assembly.add_element_(elem, current_key, direction, shift_value, placed_by = 'robot', on_ground = False, module_index = 1)
        assembly.add_element_(elem, current_key, direction, shift_value, placed_by = 'robot', on_ground = False, module_index = 2)
"""

#return object poses
for key, element in assembly.elements():
    object_poses.append([key, element.get_pose_quaternion()]) 

print object_poses


bp = base_plane
base_frame = Frame(bp.Origin, bp.XAxis, bp.YAxis)

new = assembly.range_filter(base_frame)
# ---------- end object_poses ----------
panel_25 = Panel(object_poses.object_poses)

# ---- group: Assembly Visualization
# Count
counter = CountThroughList(
    assembly=object_poses.assembly,
    start=start,
    stop=stop,
    step=step,
    step_back=back,
    reset=reset,
    full=full,
    interval=list_5)  # -> item, counter, assembly; inputs start: Boolean, stop: Boolean, step_back: Boolean
# ---------- counter: Python ----------
from scriptcontext import sticky as st
from compas_ghpython import update_component


L = list(assembly.elements())

# store data in component
guid = str(ghenv.Component.InstanceGuid)
counter_key = "counter_" + guid
running_key = "running_" + guid

if counter_key not in st:
    st[counter_key] = 0

if running_key not in st:
    st[running_key] = False


if st[running_key]:
    if st[counter_key] < len(L) - 1:
        st[counter_key] += 1
        update_component(ghenv, interval)
    else:
        st[counter_key] = 0
        st[running_key] = False


if start:
    st[running_key] = True

if stop:
    st[running_key] = False

if step:
    if st[counter_key] < len(L) - 1:
        st[counter_key] += 1

if step_back:
    if st[counter_key] < len(L) - 1:
        st[counter_key] -= 1

if reset:
    st[counter_key] = 0

if full:
    st[counter_key] = len(L)-1

if len(L):
    item = L[st[counter_key]]


counter = st[counter_key]
# ---------- end counter ----------
idx = Panel(counter.counter)

# ----
# Draw
show_2 = BooleanToggle(True)
show_3 = BooleanToggle(False)
show_4 = BooleanToggle(True)
show_5 = BooleanToggle(False)
show_6 = BooleanToggle(True)
draw_2 = PythonScript(
    assembly=counter.assembly,
    show_element=show_2,
    show_all=show_3,
    show_until_counter=show_4,
    show_connections=show_5,
    show_options=show_6,
    counter=counter.counter)  # -> G_element, G_all, G_elements_nurbs, G_connections, vector_origins, option_vectors, current_key, current_tool_plane, current_tool_plane_safe; inputs counter: Int32
# ---------- draw_2: Python ----------
import os
import sys

import math

import Rhino.Geometry as rg
import rhinoscriptsyntax as rs
import ghpythonlib.components as ghcomp

from compas.geometry import Translation
from compas_ghpython.artists import MeshArtist
from compas_ghpython import draw_frame

G_element = []
G_all = []
G_elements_nurbs = []
G_neighbors = []
G_connections = []
option_vectors = []
vector_origins = []
arrows_planes = []

key_index = assembly.network.key_index()
keys = [key_index[key] for key in assembly.network.nodes()]
current_key = counter
safe_distance = 0.2

if show_all and not show_until_counter:
    elements = [assembly.element(key) for key in keys]
    for key, element in assembly.elements():
        artist = MeshArtist(element.mesh)
        mesh = artist.draw_mesh()
        G_all.append(mesh)
        length, width, height = 0.4, 0.025, 0.049
        b = rg.Box(draw_frame(element.frame), rg.Interval(-length/2, length/2), rg.Interval(-width/2, width/2), rg.Interval(-height/2, height/2))
        G_elements_nurbs.append(b)

if show_until_counter:
    elements = [assembly.element(key) for key in keys]
    for element in elements[0:current_key+1]:
        artist = MeshArtist(element.mesh)
        mesh = artist.draw_mesh()
        G_all.append(mesh)


if show_connections:
    #elements = [assembly.element(key) for key in keys]
    #lines = assembly.network.to_lines() #does not work because edges are not transformed!
    edges = list(assembly.connections())
    for e in edges:
        p1 = assembly.element(e[0]).frame.point
        p2 = assembly.element(e[1]).frame.point
        G_connections += [rg.Line(p1[0],p1[1],p1[2],p2[0],p2[1],p2[2])]

if show_element:
    element = assembly.element(current_key)
    artist = MeshArtist(element.mesh)
    mesh = artist.draw_mesh()
    G_element.append(mesh)

if show_options:
    for key, element in assembly.elements():
        elem_origin = element.frame.point
        options_vectors = element.options_vectors()
        for vector in options_vectors:
            option_vectors.append(rg.Vector3d(*tuple(vector)))
            vector_origins.append(rg.Point3d(elem_origin.x, elem_origin.y, elem_origin.z))


for key, element in assembly.elements():
    #if assembly.network.node_attribute(key, 'placed_by') == 'robot':
        tool_planes_WCS = [draw_frame(e.tool_frame) for e in elements]
        current_tool_plane = draw_frame(assembly.element(current_key).tool_frame)
        current_tool_plane_safe = rg.Plane(current_tool_plane)
        if assembly.element(current_key)._type != 'Z':
            current_tool_plane_safe.Translate(current_tool_plane_safe.ZAxis*-0.01 + current_tool_plane_safe.XAxis*-0.05 + current_tool_plane_safe.YAxis*0.01)
        else:
            current_tool_plane_safe.Translate(current_tool_plane_safe.ZAxis* -safe_distance)

current_path_planes = [draw_frame(plane) for plane in assembly.element(current_key).path]
# ---------- end draw_2 ----------
geo_3 = Geometry(draw_2.G_element)
geo_4 = Geometry(draw_2.G_elements_nurbs)
geo_5 = Geometry(draw_2.G_all)
geo_6 = Geometry(draw_2.G_connections)
vdis = VectorDisplay(Anchor=draw_2.vector_origins, Vector=draw_2.option_vectors)
key = Panel(draw_2.current_key)
wbtriangles = WeaverbirdsSplitTrianglesSubdivision(MeshCurves=geo_5, Level=1)
pln_4 = Plane(draw_2.current_tool_plane_safe)
pln_5 = Plane(draw_2.current_tool_plane)
preview_4 = CustomPreview(Geometry=geo_3, Shader=ColourSwatch(SwatchColor=RGB(255, 143, 143)))
preview_5 = CustomPreview(Geometry=wbtriangles, Shader=ColourSwatch(SwatchColor=RGB(255, 241, 184)))

collision = PythonScript(scene=scene, assembly=object_poses.assembly, scale=scale_3, id="5", add=add_4, remove=remove_4)  # -> out
# ---------- collision: Python ----------
from compas_fab.robots import CollisionMesh
from compas.datastructures import mesh_transformed

T_to_local = scene.robot.transformation_WCF_RCF(group=None)

cm = []

for key, element in assembly.elements():
    cmt = mesh_transformed(element.mesh, T_to_local)
    m = CollisionMesh(cmt, str(key))
    cm.append(m)
    
if scene:
    if add:
        for mesh in cm:
            scene.add_collision_mesh(mesh, scale)
    if remove:
        scene.remove_collision_mesh(id)
# ---------- end collision ----------
panel_26 = Panel(collision)

pick_up_plane = Plane(base_geo.pick_up_plane)
pick_up_plane_safe_2 = Plane(base_geo.pick_up_plane_safe)
current_tool_plane_safe = Plane(pln_4)
current_tool_plane = Plane(draw_2.current_tool_plane)

move = Move(Geometry=pick_up_plane_safe_2, Motion=X)  # -> Geometry, Transform

# ----
# Fabrication
send_task = Button()
step_2 = Button()
stop_robot = Button()
set_tasks = Button()
init = Button()
fabricate = GhPythonScript(
    assembly=counter.assembly,
    robot=robot,
    dfillet=Slider(0.02, range=0..0.1),
    speed=Slider(1, range=0..300),
    speed_mod=Slider(2, range=0..10),
    init=init,
    set_tasks=set_tasks,
    stop_robot=stop_robot,
    send_task=send_task,
    index=key)  # -> out, log, msgs, task, srv, script; inputs speed_mod: Int32, stop_robot: Boolean, index: Int32
# ---------- fabricate: Python ----------
from scriptcontext import sticky as st
import ur_online_control.ur_direct as urd
from compas_ghpython import update_component
from ur_online_control.ur_direct import URCommandScript
from ur_online_control.communication.tcp_server import TCPFeedbackServer
from ur_online_control.fabrication_process import Fabrication
from ur_online_control.ur.configuration import Configuration
import math


def get_radius(i, frames, buffer = 0.7):
    if i == 1 or i == len(frames) - 3 or i == len(frames)-1:
        radius = 0.
    else:
        prev, current, next = frames[i-1].point, frames[i].point, frames[i+1].point
        radius = min((prev - current).length/2 * buffer, (next - current).length/2 * buffer, dfillet)
        radius = 0.
    return radius


def get_velocity(i, frames):
    if i == len(frames) - 3 or i == 1:
        speedval = speed/speed_mod
    else:
        speedval = speed
    return speedval

def get_move_commands(frames, robot):
    movel_commands = []
    for i, frame_WCS in enumerate(frames):
        frame_RCS = robot.get_frame_in_RCS(frame_WCS)
        radius = 0.
        velocity = get_velocity(i, frames)
        cmd = list(frame_RCS.point) + list(frame_RCS.axis_angle_vector) + [velocity, radius]
        movel_commands.append(cmd)
    return movel_commands

def get_joint_value(configuration):
    joint_values = []
    return joint_values


server_ip = st["server_address"]
server_port = st["server_port"]
ur_port = st["ur_port"]
ur_ip = st["ur_ip"]
robot = st["robot_6e25a56a-ecab-4ebc-a3bd-f9966f8a8dbc"]

#print robot.attached_tool.frame

def get_ur_script(key, element, data):
    movel_start_commands = get_move_commands(element.path, robot)
    movel_end_commands = get_move_commands(element.path, robot)
    joint_values = get_joint_values(configuration)
    
    tool_angle_axis = list(robot.attached_tool.frame.point) + list(robot.attached_tool.frame.axis_angle_vector)
    ur_script = URCommandScript(server_ip=server_ip, server_port=server_port, ur_ip=ur_ip, ur_port=ur_port)
    ur_script.start()
    ur_script.set_tcp(tool_angle_axis)
    for i, move_command in enumerate(movel_start_commands):
        if i == 1:
            ur_script.add_areagrip_on(sleep = 1)
        ur_script.add_move_linear(movel_start_commands, feedback="Full")
    ur_script.add_move_joints(joint_values)
    for i, move_command in enummerate(movel_end_commands):
        if i == 1:
            ur_script.add_areagrip_off(sleep = 0.1)
    ur_script.add_move_linear(movel_end_commands, feedback="Full")
    ur_script.end(feedback=True)
    ur_script.generate()
    if exit_at_index:
        ur_script.exit_message = move_commands[exit_index][:6]
    return ur_script


def create_tasks():
    #return [get_ur_script(key,element,data) for key, element, data in assembly.elements(data=True) if key >= index]
    return [get_ur_script(key, element, data) for key, element, data in assembly.elements(data = True)]


class Fabrication_UR(Fabrication):
    def perform_task(self, task):
        self.log("TASK START: ---->>>>>")
        task.send_script()
        ok = self.server.listen(task.exit_message, 50)
        self.log(task.received_messages)
        if not ok:
            self.log("----<<<<< TASK FAILED")
            return False
        self.log("----<<<<< TASK FINISHED")
        return True

if init:
    fabrication = Fabrication_UR()
    server = TCPFeedbackServer()
    server.start()

if set_tasks:
    tasks = create_tasks()
    fabrication.clear_tasks()
    fabrication.set_tasks(tasks)

if stop_robot:
    urd.stop(ur_ip, ur_port)
    fabrication.is_paused

if send_task:
    rt = fabrication.perform_task(fabrication.tasks[index])
    print(rt)
    if rt:
        urd.stop(ur_ip, ur_port)

try:
    srv = server
    fab = fabrication
except NameError:
    srv = None
    fab = None
else:
    if len(fabrication.tasks) > 0:
        msgs = [str(task.exit_message) for task in fabrication.tasks]
        task = fabrication.tasks[0]
    log = fabrication.log_messages
# ---------- end fabricate ----------
panel_27 = Panel(fabricate.out)

unsubscribe = Button()  # disabled
# Execution
subscribe = Button()  # disabled
joint_states = PythonScript(sub=subscribe, unsub=unsubscribe)  # disabled
# ---------- joint_states: Python ----------
import roslibpy
import scriptcontext as sc

key = 'topic_%s' % str(ghenv.Component.InstanceGuid)
previous_topic = sc.sticky.get(key, None)

# Interval in ms between messages
THROTTLE_RATE = 50

if sub:
    if robot.client.is_connected:
        if previous_topic:
            previous_topic.unsubscribe()

        def received_joint_states(message):
            sc.sticky['joint_states'] = message
    
        topic = roslibpy.Topic(robot.client, '/joint_states', 'sensor_msgs/JointState', throttle_rate=THROTTLE_RATE)
        topic.subscribe(received_joint_states)
    
        sc.sticky[key] = topic
        print('Subscribed')
    else:
        print('ROS client not connected')

if unsub:
    if 'joint_states' in sc.sticky:
        del sc.sticky['joint_states']
    if previous_topic:
        previous_topic.unsubscribe()
# ---------- end joint_states ----------
value_list = ValueList({"0 cartesian path": 0, "1 kinematic path": 1}, selected="1 kinematic path")  # disabled
refresh_hz = Slider(2, range=0..30)  # disabled
filter_2 = StreamFilter(Gate=value_list)  # disabled
execute = Button()  # disabled
check = Button()  # disabled
cancel = Button()  # disabled
trajectory = PythonScript(response=filter_2, execute=execute, check=check, cancel=cancel)  # -> out, status; disabled
# ---------- trajectory: Python ----------
import time
import datetime

import roslibpy

import scriptcontext as sc

key = 'trajectory_%s' % str(ghenv.Component.InstanceGuid)
sent_trajectory = sc.sticky.get(key, None)

#joint_trajectory = response.trajectory.joint_trajectory if response else None
joint_trajectory = response if response else None
points = response.points if response else []

print response

if robot and robot.client.is_connected:
    if execute:
        sc.sticky[key] = dict(started_at=time.time(), trajectory=joint_trajectory, state='EXECUTING')

        def completion(result):
            if key in sc.sticky:
                if sc.sticky[key]['state'] == 'EXECUTING':
                    sc.sticky[key]['state'] = 'SUCCESSFUL'
                sc.sticky[key]['completed_at'] = time.time()
                del sc.sticky[key]['cancellable']

        def failure(e):
            if key in sc.sticky:
                sc.sticky[key]['state'] = 'ERROR'
                sc.sticky[key]['completed_at'] = time.time()
                sc.sticky[key]['exception'] = e

        print('Executing trajectory of %d points' % len(points))
        cancellable = robot.client.follow_joint_trajectory(joint_trajectory, completion, failure)
        sc.sticky[key]['cancellable'] = cancellable

    if cancel and 'cancellable' in sc.sticky[key]:
        sc.sticky[key]['state'] = 'CANCELLED'
        sc.sticky[key]['cancellable'].cancel()
        
else:
    status = 'NOT CONNECTED'

try:
    started_at = sc.sticky[key].get('started_at', 'n/a')
    completed_at = sc.sticky[key].get('completed_at', 'n/a')
    exception = sc.sticky[key].get('exception', '')
    execution_state = sc.sticky[key].get('state', '')
    
    if started_at != 'n/a':
        started_at = datetime.datetime.fromtimestamp(started_at).strftime('%H:%M:%S')
    if completed_at != 'n/a':
        completed_at = datetime.datetime.fromtimestamp(completed_at).strftime('%H:%M:%S')
    if exception:
        exception = 'Found an exception during execution: ' + str(exception)
    
    if not joint_trajectory:
        status = 'No trajectory available'
    else:
        status = """execution state: {}
    started at: {}
    completed at: {}
    trajectory of {} points\n{}""".format(execution_state,
                                          started_at,
                                          completed_at,
                                          len(points),
                                          exception)
    
    print(status)
except KeyError:
    pass
# ---------- end trajectory ----------
status = Panel(trajectory.status)  # disabled

# ----
# Configuration
# TODO Example:
# Add path constraints
main_planning_group = Text(info.main_group_name)
compute = Button()
idx_2 = Slider(1, range=0..1)

# ---- group: inverse kinematics
py_19 = PythonScript(robot=robot)  # -> configuration
# ---------- py_19: Python ----------
from compas_fab.robots import Configuration

if robot:
    types = robot.get_configurable_joint_types()
    values = [0] * len(types)
    configuration = Configuration(values, types)
    print configuration
    print robot.get_configurable_joint_names()
# ---------- end py_19 ----------
avoid_collisions = BooleanToggle(False)
start_configuration = Data(forward_kinematics)
list_8 = ValueList({"0", "1"}, selected="1")
filter_3 = StreamFilter(Gate=list_8, Stream0=start_configuration, Stream1=py_19)
inverse = GhPythonScript(robot=robot, group=main_planning_group, plane=plane_4, start_configuration=filter_3, avoid_collisions=avoid_collisions)  # -> out, group_configuration, full_configuration
# ---------- inverse: Python ----------
"""Calculate the robot's inverse kinematic for a given plane.
    Inputs:
        robot: The robot
        group: str, optional
            The planning group used for calculation. Defaults to the robot's
            main planning group.
        plane: The plane in world coordinate frame to calculate the inverse for.
        start_configuration: :class:`compas_fab.robots.Configuration`, optional
            If passed, the inverse will be calculated such that the calculated
            joint positions differ the least from the start_configuration.
            Defaults to the init configuration.
        avoid_collisions: bool, optional
            Whether or not to avoid collisions. Defaults to True.
    Output:
        group_configuration: The group configuration
        full_configuration: The full configuration
"""
from __future__ import print_function
import logging

from compas.geometry import Frame

LOGGER = logging.getLogger('roslibpy')

frame_WCF = Frame(plane.Origin, plane.XAxis, plane.YAxis)
frame_RCF = robot.to_local_coords(frame_WCF, group=None)

if robot.attached_tool:
    frame_RCF = robot.from_attached_tool_to_tool0([frame_RCF])[0]


if robot and robot.client:
    if robot.client.is_connected:
        """
        full_configuration = robot.inverse_kinematics(frame,
                                                      start_configuration,
                                                      group=group,
                                                      options={
                                                        'avoid_collisions':avoid_collisions,
                                                        'return_full_configuration':True,
                                                      })"""
        full_configuration = robot.inverse_kinematics(frame_RCF,
                                                      start_configuration,
                                                      group=group,
                                                      avoid_collisions=avoid_collisions,
                                                      return_full_configuration=True,
                                                      )
        group_configuration = robot.get_group_configuration(group, full_configuration)
        print(group_configuration)
    else:
        print("Robot client is not connected")
# ---------- end inverse ----------
panel_28 = Panel(inverse.out)

# ---- group: cartesian motion
# Plan cartesian motion
list_9 = ValueList({"don't use attached collision mesh": 0, "use attached collision mesh": 1}, selected="don't use attached collision mesh")
group = Data(main_planning_group)
py_20 = PythonScript(robot=robot)  # -> configuration
# ---------- py_20: Python ----------
from compas_fab.robots import Configuration

if robot:
    types = robot.get_configurable_joint_types()
    values = [0] * len(types)

    configuration = Configuration(values, types)
    print configuration
# ---------- end py_20 ----------
start_configuration_2 = Data(inverse.full_configuration)
list_10 = ValueList({"0", "1"}, selected="0")
avoid_collisions_2 = BooleanToggle(False)
py_21 = PythonScript(start_plane=pick_up_plane_safe_2, end_plane=current_tool_plane)  # -> planes
# ---------- py_21: Python ----------
planes = [start_plane, end_plane]
print planes
# ---------- end py_21 ----------
compute_2 = Button()
filter_4 = StreamFilter(Gate=list_10, Stream0=start_configuration_2, Stream1=py_20)
filter_5 = StreamFilter(Gate=list_9, Stream1=attached.acm)
plan_cartesian_motion = PythonScript(
    robot=robot,
    group=group,
    planes=py_21,
    start_configuration=filter_4,
    max_step=Slider(0.01, range=0..0.01),
    avoid_collisions=avoid_collisions_2,
    attached_collision_meshes=filter_5,
    compute=compute_2)  # -> out, trajectory; inputs planes: list, avoid_collisions: Boolean, attached_collision_meshes: list
# ---------- plan_cartesian_motion: Python ----------
"""Calculates a cartesian motion path (linear in tool space).
    Inputs:
        robot: The robot
        group: str, optional
            The planning group used for calculation. Defaults to the robot's
            main planning group.
        planes: The planes in world coordinate frame through which the path is defined.
        start_configuration: :class:`compas_fab.robots.Configuration`, optional
            The robot's full configuration, i.e. values for all configurable
            joints of the entire robot cell, at the starting position. Defaults
            to the all-zero configuration.
        max_step: float
            The approximate distance between the calculated points. (Defined in
            the robot's units)
        avoid_collisions: bool, optional
            Whether or not to avoid collisions. Defaults to True.
        attached_collision_meshes: list of :class:`compas_fab.robots.AttachedCollisionMesh`
            Defaults to None.
        compute: bool
            Press to calculate solution.
    Output:
        :class:`compas_fab.robots.JointTrajectory`
            The calculated trajectory.
"""
from __future__ import print_function
import logging
import scriptcontext as sc

from compas.geometry import Frame

LOGGER = logging.getLogger('roslibpy')

guid = str(ghenv.Component.InstanceGuid)
response_key = "response_" + guid
if response_key not in sc.sticky:
    sc.sticky[response_key] = None

frames_WCF = [Frame(plane.Origin, plane.XAxis, plane.YAxis) for plane in planes]
frames_RCF = [robot.to_local_coords(frame_WCF, group=None) for frame_WCF in frames_WCF]
if robot.attached_tool:
    frames_RCF = [robot.from_attached_tool_to_tool0([frame])[0] for frame in frames_RCF]


if robot and robot.client and start_configuration and compute:
    if robot.client.is_connected:
        """
        sc.sticky[response_key] = robot.plan_cartesian_motion(frames,
                                                              start_configuration=start_configuration,
                                                              group=group,
                                                              options={
                                                                'max_step': float(max_step),
                                                                'avoid_collisions': bool(avoid_collisions),
                                                                'attached_collision_meshes': list(attached_collision_meshes),
                                                              })"""
        sc.sticky[response_key] = robot.plan_cartesian_motion(frames_RCF,
                                                              start_configuration=start_configuration,
                                                              group=group,
                                                              max_step=float(max_step),
                                                              avoid_collisions=bool(avoid_collisions),
                                                              attached_collision_meshes=list(attached_collision_meshes),
                                                              )
    else:
        print("Robot client is not connected")

trajectory = sc.sticky[response_key]
# ---------- end plan_cartesian_motion ----------
vis = PythonScript(response=plan_cartesian_motion.trajectory)  # -> P, V, A
# ---------- vis: Python ----------
from compas_ghpython import list_to_ghtree

if response:
    #print response.points
    positions = []
    velocities = []
    accelerations = []

    for p in response.points:
        positions.append(p.positions)
        velocities.append(p.velocities)
        accelerations.append(p.accelerations)
    #print positions
    P = list_to_ghtree(list(zip(*positions)))
    V = list_to_ghtree(list(zip(*velocities)))
    A = list_to_ghtree(list(zip(*accelerations)))
# ---------- end vis ----------
prismatic = QuickGraph(vis.P, SortOrder=0)
panel_29 = Panel("positions")
py_22 = PythonScript(robot=robot, group=group, trajectory=plan_cartesian_motion.trajectory)  # -> configurations, full_configurations, fraction, time
# ---------- py_22: Python ----------
if trajectory:
    configurations = trajectory.points
    full_configurations = [robot.merge_group_with_full_configuration(c, trajectory.start_configuration, group) for c in configurations]
    start_configuration = trajectory.start_configuration
    fraction = trajectory.fraction
    time = trajectory.time_from_start
# ---------- end py_22 ----------
fraction = Panel(py_22.fraction)
time_s = Panel(py_22.time)
graph = QuickGraph(vis.V, SortOrder=0)
graph_2 = QuickGraph(vis.A, SortOrder=0)
panel_30 = Panel("velocities")
panel_31 = Panel("accelerations")
path = GhPythonScript(robot=robot, group=group, full_configurations=py_22.full_configurations)  # -> frames, P; inputs full_configurations: list
# ---------- path: Python ----------
import Rhino.Geometry as rg

frames = []

if robot:
    for c in full_configurations:
        
        if c:
            #frame_WCF = robot.forward_kinematics(c, group, options={'backend':'model'})
            frame_RCF = robot.forward_kinematics(c, group, backend='model')
            frame_WCF = robot.to_world_coords(frame_RCF, group=None)
            frames.append(frame_WCF)

    P = [rg.Point3d(*list(frame.point)) for frame in frames]
# ---------- end path ----------
idx_3 = Slider(0, range=0..1)
animate = PythonScript(robot=robot, group=main_planning_group, configurations=py_22.full_configurations, idx=idx_3)  # -> configuration; inputs configurations: list, idx: Int32
# ---------- animate: Python ----------
import Grasshopper
from compas_fab.utilities import map_range
from compas_fab.robots import Configuration

count = len(configurations)

for i in range(ghenv.Component.Params.Input.Count):
    nslider = ghenv.Component.Params.Input[i].Sources[0]
    if nslider.GetType() == Grasshopper.Kernel.Special.GH_NumberSlider and nslider.NickName == 'idx':
        nslider.Slider.Maximum = max(count - 1, 1)
        nslider.Slider.Minimum = 0

if count and robot and configurations[0] != None:
    configuration = configurations[idx]
# ---------- end animate ----------
pline = PolyLine(Vertices=path.P, Closed=False)
preview_6 = CustomPreview(Geometry=[path.P, pline], Material=ColourSwatch(SwatchColor=RGB(59, 137, 161)))

# ---- group: forward kinematics
forward = PythonScript(robot=robot, group=main_planning_group, full_configuration=forward_kinematics)  # -> out, frame_WCF
# ---------- forward: Python ----------
"""Calculate the robot's forward kinematic.
    Inputs:
        robot: :class:`compas_fab.robots.Robot`
            The robot.
        group: str, optional
            The planning group used for calculation. Defaults to the robot's
            main planning group.
        full_configuration : :class:`compas_fab.robots.Configuration`
            The full configuration to calculate the forward kinematic for. If no
            full configuration is passed, the zero-joint state for the other
            configurable joints is assumed.
    Output:
        :class:`Frame`
            The frame in the world coordinate frame (WCF).
"""
from __future__ import print_function
import logging

import compas_fab
print(compas_fab.__version__)

LOGGER = logging.getLogger('roslibpy')

if robot and robot.client and full_configuration:
    if robot.client.is_connected:
        #frame_WCF = robot.forward_kinematics(full_configuration, group, options={'backend':'model'})
        frame_WCF = robot.forward_kinematics(full_configuration, group, backend='model')
        print(frame_WCF)
    else:
        print("Robot is not connected")
# ---------- end forward ----------
panel_32 = Panel(forward.out)

# ----
panel_33 = Panel(plan_cartesian_motion.out)

# ---- group: plan motion
# Plan motion
# If you specify the tolerance vector with [360, 1, 1], it means that
#     the frame's y-axis and z-axis are allowed to rotate about the x-axis by an
#     angle of 360 degrees, whereas the x-axis can only change 1 degree.
group_2 = Data(main_planning_group)
list_11 = ValueList({"don't use attached collision mesh": 0, "use attached collision mesh": 1}, selected="use attached collision mesh")
py_23 = PythonScript(robot=robot)  # -> configuration; same code as py_20
python_3 = PythonScript(
    robot=robot,
    group=group_2,
    goal_plane=current_tool_plane_safe,
    tolerance_position=Slider(0.001, range=0..0.001),
    tolerance_xaxis_deg=Slider(1, range=1..360),
    tolerance_yaxis_deg=Slider(1, range=1..360),
    tolerance_zaxis_deg=Slider(1, range=1..360))  # -> goal_constraints
# ---------- python_3: Python ----------
import math
from compas.geometry import Frame



frame_WCF = Frame(goal_plane.Origin, goal_plane.XAxis, goal_plane.YAxis)
frame_RCF = robot.to_local_coords(frame_WCF, group=None)

if robot.attached_tool:
    frame_RCF = robot.from_attached_tool_to_tool0([frame_RCF])[0]

tolerances_axes = [math.radians(tolerance_xaxis_deg), math.radians(tolerance_yaxis_deg), math.radians(tolerance_zaxis_deg)]

if robot:
    goal_constraints = robot.constraints_from_frame(frame_RCF, tolerance_position, tolerances_axes, group)
# ---------- end python_3 ----------
start_configuration_3 = Data(inverse.full_configuration)
list_12 = ValueList({"0", "1"}, selected="0")
filter_6 = StreamFilter(Gate=list_12, Stream0=start_configuration_3, Stream1=py_23)
list_13 = ValueList({"RRT", "RRT*": "RRTStar", "EST", "PRM": "RPM", "PRM*": "RPMStar", "SPARS"}, selected="RRT")
filter_7 = StreamFilter(Gate=list_11, Stream1=[attached.acm, attached_2.acm])

# ----
plan_motion = PythonScript(
    robot=robot,
    group=group_2,
    start_configuration=filter_6,
    goal_constraints=python_3,
    planner_id=list_13,
    attached_collision_meshes=filter_7,
    compute=compute)  # -> out, trajectory; inputs goal_constraints: list, attached_collision_meshes: list
# ---------- plan_motion: Python ----------
"""Calculates a motion path.
    Inputs:
        robot: The robot
        group: str, optional
            The planning group used for calculation. Defaults to the robot's
            main planning group.
        start_configuration: :class:`compas_fab.robots.Configuration`, optional
            The robot's full configuration, i.e. values for all configurable
            joints of the entire robot cell, at the starting position. Defaults
            to the all-zero configuration.
        goal_constraints: list of :class:`compas_fab.robots.Constraint`
            The goal to be achieved, defined in a set of constraints.
            Constraints can be very specific, for example defining value domains
            for each joint, such that the goal configuration is included,
            or defining a volume in space, to which a specific robot link (e.g.
            the end-effector) is required to move to.
        planner_id: str
            The name of the algorithm used for path planning. Defaults to 'RRT'.
        attached_collision_meshes: list of :class:`compas_fab.robots.AttachedCollisionMesh`
            Defaults to None.
        compute: bool
            Press to calculate solution.
    Output:
        :class:`compas_fab.robots.JointTrajectory`
            The calculated trajectory.
"""
from __future__ import print_function
import logging
import scriptcontext as sc

guid = str(ghenv.Component.InstanceGuid)
response_key = "response_" + guid
if response_key not in sc.sticky:
    sc.sticky[response_key] = None

LOGGER = logging.getLogger('roslibpy')

if robot and robot.client and start_configuration and compute:
    if robot.client.is_connected:
        """
        sc.sticky[response_key] = robot.plan_motion(goal_constraints,
                                                    start_configuration,
                                                    group,
                                                    options={
                                                        'planner_id': str(planner_id),
                                                        'attached_collision_meshes': list(attached_collision_meshes),
                                                    })"""
        sc.sticky[response_key] = robot.plan_motion(goal_constraints,
                                                    start_configuration,
                                                    group,
                                                    planner_id=str(planner_id),
                                                    attached_collision_meshes=list(attached_collision_meshes),
                                                    )
    else:
        print("Robot client is not connected.")

trajectory = sc.sticky[response_key]
# ---------- end plan_motion ----------
py_24 = PythonScript(robot=robot, group=group_2, trajectory=plan_motion.trajectory)  # -> configurations, full_configurations, fraction, time; same code as py_22
panel_37 = Panel(plan_motion.out)
animate_2 = PythonScript(robot=robot, group=group_2, configurations=py_24.full_configurations, idx=idx_2)  # -> configuration; inputs configurations: list, idx: Int32; same code as animate

# ---- group: plan motion (continued)
vis_2 = PythonScript(response=plan_motion.trajectory)  # -> P, V, A, time
# ---------- vis_2: Python ----------
from compas_ghpython import list_to_ghtree

if response:

    positions = []
    velocities = []
    accelerations = []
    time_from_start = []

    for p in response.points:
        positions.append(p.positions)
        velocities.append(p.velocities)
        accelerations.append(p.accelerations)
        time_from_start.append(p.time_from_start.seconds)

    P = list_to_ghtree(list(zip(*positions)))
    V = list_to_ghtree(list(zip(*velocities)))
    A = list_to_ghtree(list(zip(*accelerations)))

    time = time_from_start[-1]
    print time
# ---------- end vis_2 ----------
time_s_2 = Panel(vis_2.time)
prismatic_2 = QuickGraph(vis_2.P, SortOrder=0)
fraction_2 = Panel(py_24.fraction)
time_s_3 = Panel(py_24.time)
graph_3 = QuickGraph(vis_2.V, SortOrder=0)
graph_4 = QuickGraph(vis_2.A, SortOrder=0)
path_2 = GhPythonScript(robot=robot, group=group_2, full_configurations=py_24.full_configurations)  # -> frames, P; inputs full_configurations: list
# ---------- path_2: Python ----------
import Rhino.Geometry as rg

frames = []

if robot:
    for c in full_configurations:
        if c:
            #frame_WCF = robot.forward_kinematics(c, group, options={'backend':'model'})
            frame_RCF = robot.forward_kinematics(c, group, backend='model')
            frame_WCF = robot.to_world_coords(frame_RCF, group=None)
            frames.append(frame_WCF)

    P = [rg.Point3d(*list(frame.point)) for frame in frames]
# ---------- end path_2 ----------
pline_2 = PolyLine(Vertices=path_2.P, Closed=False)
preview_7 = CustomPreview(Geometry=[path_2.P, pline_2], Material=ColourSwatch(SwatchColor=RGB(59, 161, 95)))

# ----
start_timer_update = Button()  # disabled
stop_timer_update = Button()  # disabled
data_recorder = DataRecorder(trajectory.out, DataLimit=-10, RecordData=False)  # disabled
panel_38 = Panel(data_recorder)  # disabled

current = PythonScript(
    rate=refresh_hz,
    subscribe=subscribe,
    unsubscribe=unsubscribe,
    start_update=start_timer_update,
    stop_update=stop_timer_update)  # -> out, configuration; inputs subscribe: Boolean, unsubscribe: Boolean, start_update: Boolean, stop_update: Boolean; disabled
# ---------- current: Python ----------
import scriptcontext as sc
from compas_fab.robots import Configuration
from compas_ghpython import update_component
from datetime import datetime


guid = str(ghenv.Component.InstanceGuid)
timer_running_key = "timer_running_" + guid

if stop_update or timer_running_key not in sc.sticky or unsubscribe:
    sc.sticky[timer_running_key] = False

if start_update or subscribe:
    sc.sticky[timer_running_key] = True



values = []
types = []

now = datetime.now()
timestamp = datetime.time(now)


print('receiving joint states at: ' + str(timestamp))


if 'joint_states' in sc.sticky:
    
    joint_states = sc.sticky['joint_states']
    joint_states = dict(zip(joint_states['name'], joint_states['position']))

    for joint in robot.get_configurable_joints():
        values.append(joint_states[joint.name])
        types.append(joint.type)
    
    configuration = Configuration(values, types)
    print(configuration)

else:
    configuration = robot.get_configuration()
    configuration.values = [0,0,0,0,0,0]
    
    

data_coming_in = robot.client.is_connected and 'joint_states' in sc.sticky

slow_interval = 2000
if rate != 0:
    refresh_interval = (1. / rate) * 1000
else:
    refresh_interval = slow_interval
interval = refresh_interval if data_coming_in else slow_interval

if sc.sticky[timer_running_key]==True:
    print sc.sticky[timer_running_key]
    update_component(ghenv, interval)

#update_component(ghenv, interval)
print('Interval: %dms' % interval)
# ---------- end current ----------

panel_39 = Panel(current.out)  # disabled

# ----
# Visualisation
# Select configuration input: from fk, ik, path, or from real robot
list_14 = ValueList({"0 forward_kinematics": 0, "1 inverse_kinematics": 1, "2 cartesian motion": 2, "3 free-space motion": 3}, selected="1 inverse_kinematics")
filter_8 = StreamFilter(Gate=list_14, Stream0=forward_kinematics, Stream1=inverse.full_configuration, Stream2=animate, Stream3=animate_2)
show_end_effector_frame = BooleanToggle(True)
show_base_frame = BooleanToggle(True)
show_collision = BooleanToggle(False)
show_frames = BooleanToggle(True)
show_visual = BooleanToggle(True)
visualize = PythonScript(
    robot=robot,
    redraw=py_9.a,
    full_configuration=filter_8,
    show_visual=show_visual,
    show_collision=show_collision,
    show_frames=show_frames,
    show_base_frame=show_base_frame,
    show_end_effector_frame=show_end_effector_frame)  # -> out, visual, collision, frames, base_frame_WCF, ee_frame_WCF
# ---------- visualize: Python ----------
"""Calculates a cartesian motion path (linear in tool space).
    Inputs:
        robot: The robot
        group: str
            The planning group used for visualisation
        full_configuration: :class:`compas_fab.robots.Configuration`
            The robot's full configuration to display.
        show_visual: bool
           Whether or not to show the robot's visual meshes.
        show_collision: bool
           Whether or not to show the robot's collision meshes.
        show_frames: bool
           Whether or not to show the robot's joint frames.
        show_base_frame: bool
           Whether or not to show the robot's base frame.
        show_end_effector_frame: bool
            Whether or not to show the robot's end-effector frame.
    Output:
        visual: The robot's visual meshes.
        collision: The robot's collision meshes.
        frames: The robot's joint frames.
        base_frame_WCF: The robot's base frame.
        ee_frame_WCF: The robot's end-effector frame.
"""
from __future__ import print_function
import ghpythonlib.components as ghcomp
from compas_ghpython.geometry import xform_from_transformation

if robot and full_configuration:
    robot.update(full_configuration, visual=show_visual, collision=show_collision)
    #print(full_configuration)
    T = robot.transformation_RCF_WCF()

    if show_visual:
        visual = robot.draw_visual() #visual = ([v for v in visual])
        visual = ghcomp.Transform(visual, xform_from_transformation(T))
        #print(T)

    if show_collision:
        collision = robot.draw_collision()
        collision = ghcomp.Transform(collision, xform_from_transformation(T))

    if show_frames:
        axes = robot.transformed_axes(full_configuration)
        frames = robot.transformed_frames(full_configuration)
        [f.transform(T) for f in frames[1:]]
        #print(frames)
        #[Frame(Point(-0.151, -0.807, 0.625), Vector(0.001, -1.000, 0.002), Vector(1.000, 0.001, -0.009)), Frame(Point(-0.149, -0.807, 0.806), Vector(0.001, -1.000, 0.002), Vector(1.000, 0.001, -0.009)), Frame(Point(-0.151, -0.807, 0.625), Vector(0.001, -1.000, 0.002), Vector(1.000, 0.001, -0.009)), Frame(Point(0.027, -0.807, 0.805), Vector(0.001, -1.000, 0.002), Vector(1.000, 0.001, -0.009)), Frame(Point(-0.105, -0.805, 1.419), Vector(-0.009, -0.002, -1.000), Vector(1.000, 0.001, -0.009)), Frame(Point(-0.105, -1.376, 1.420), Vector(-0.009, -0.002, -1.000), Vector(1.000, 0.001, -0.009)), Frame(Point(0.030, -1.376, 1.419), Vector(-1.000, -0.001, 0.009), Vector(-0.009, -0.002, -1.000)), Frame(Point(0.030, -1.496, 1.419), Vector(-1.000, -0.001, 0.009), Vector(-0.009, -0.002, -1.000)), Frame(Point(0.029, -1.496, 1.302), Vector(-0.009, -0.002, -1.000), Vector(1.000, 0.001, -0.009)), Frame(Point(0.029, -1.496, 1.302), Vector(-1.000, -0.001, 0.009), Vector(-0.001, 1.000, -0.002))]
        #[Frame(Point(-0.151, -0.807, 0.625), Vector(0.001, -1.000, 0.002), Vector(1.000, 0.001, -0.009)), Frame(Point(-0.149, -0.807, 0.806), Vector(0.001, -1.000, 0.002), Vector(1.000, 0.001, -0.009)), Frame(Point(-0.151, -0.807, 0.625), Vector(-0.001, 1.000, -0.002), Vector(-1.000, -0.001, 0.009)), Frame(Point(0.027, -0.807, 0.805), Vector(0.001, -1.000, 0.002), Vector(1.000, 0.001, -0.009)), Frame(Point(-0.105, -0.805, 1.419), Vector(-0.009, -0.002, -1.000), Vector(1.000, 0.001, -0.009)), Frame(Point(-0.105, -1.376, 1.420), Vector(-0.009, -0.002, -1.000), Vector(1.000, 0.001, -0.009)), Frame(Point(0.030, -1.376, 1.419), Vector(-1.000, -0.001, 0.009), Vector(-0.009, -0.002, -1.000)), Frame(Point(0.030, -1.496, 1.419), Vector(-1.000, -0.001, 0.009), Vector(-0.009, -0.002, -1.000)), Frame(Point(0.029, -1.496, 1.302), Vector(-0.009, -0.002, -1.000), Vector(1.000, 0.001, -0.009)), Frame(Point(0.029, -1.496, 1.302), Vector(-1.000, -0.001, 0.009), Vector(-0.001, 1.000, -0.002))]
        print(robot.get_joint_by_name("base_link-base_fixed_joint").origin)
    
    if show_base_frame:
        base_frame_WCF = robot.get_base_frame(group, full_configuration)
        print(base_frame_WCF)
        #Frame(Point(-0.151, -0.807, 0.625), Vector(0.001, -1.000, 0.002), Vector(1.000, 0.001, -0.009))
        print(robot.get_base_link().joints[1].origin)
        #Frame(Point(0.000, 0.000, 0.000), Vector(1.000, 0.000, 0.000), Vector(-0.000, 1.000, 0.000))
        #Frame(Point(0.000, 0.000, 0.000), Vector(-1.000, 0.000, 0.000), Vector(-0.000, -1.000, 0.000))

    if show_end_effector_frame:
        ee_frame_WCF = robot.get_end_effector_frame(group, full_configuration)
        if robot.attached_tool:
            ee_frame_WCF = robot.from_tool0_to_attached_tool([ee_frame_WCF])[0]
        
        ee_frame_WCF.transform(T)
        #print("End-effector", ee_frame_WCF)
# ---------- end visualize ----------
geo_7 = Geometry(visualize.collision)
py_25 = PythonScript(robot=robot)  # -> scale
# ---------- py_25: Python ----------
if robot:
    scale = robot.scale_factor * 0.1
else:
    scale = 1.
# ---------- end py_25 ----------
draw_3 = GhPythonScript(frames=visualize.frames, scale=py_25)  # -> P, V, C, W; inputs frames: list
# ---------- draw_3: Python ----------
from System.Drawing import Color
from compas_ghpython import draw_frame

red = Color.FromArgb(255, 0, 0)
green = Color.FromArgb(0, 255, 0)
blue = Color.FromArgb(0, 0, 255)

P = []
V = []
C = []

scale = float(scale)

for frame in frames:
    if not frame:
        continue
    plane = draw_frame(frame)
    P += [plane.Origin] * 3
    V.append(plane.XAxis * scale)
    V.append(plane.YAxis * scale)
    V.append(plane.ZAxis * scale)
    C += [red, green, blue]

W = 3
# ---------- end draw_3 ----------
vdisex = VectorDisplayEx(Point=draw_3.P, Vector=draw_3.V, Colour=draw_3.C, Width=draw_3.W)
panel_40 = Panel(visualize.out)

wbtriangles_2 = WeaverbirdsSplitTrianglesSubdivision(MeshCurves=visualize.visual, Level=1)

preview_8 = CustomPreview(Geometry=wbtriangles_2, Shader=ColourSwatch(SwatchColor=RGBA(184, 184, 184, 201)))

idx_4 = Slider(0, range=0..100)
panel_41 = Panel("move joints")
joint_configurations = Data(filter_8)
item = ListItem(List=joint_configurations, Index=idx_4, Wrap=True)
list_15 = ValueList({"send all positions": 0, "send only one position": 1}, selected="send only one position")
filter_9 = StreamFilter(Gate=list_15, Stream0=joint_configurations, Stream1=item)
movej = PythonScript(joint_configurations=filter_9, velocity=Slider(5, range=0..200))  # -> script, values; inputs joint_configurations: list
# ---------- movej: Python ----------
import ur_online_control.ur_direct as urd
import math


print joint_configurations


for c in joint_configurations:
    for i,v in enumerate(c.values):
        #print v
        if v>math.pi:
            v-=2*math.pi
        if v<-math.pi:
            v+=2*math.pi
        c.values[i]=v
         

joint_config = ["movej({}, v={})".format(c.values, velocity/10) for c in joint_configurations]

commands = urd.URCommandScript()
commands.start()
commands.add_lines(joint_config)
commands.end()

script = commands.generate()
values = joint_configurations[0].values

print([math.degrees(v) for v in values])

print(script)
# ---------- end movej ----------
send_14 = Button()
send_15 = GhPythonScript(script=movej.script, send=send_14)  # -> out; inputs send: Boolean; same code as send_2

get_2 = Button()
pose_2 = PythonScript(get=get_2)  # -> configuration, pose_joints
# ---------- pose_2: Python ----------
from scriptcontext import sticky as st
import ur_online_control.ur_direct as urd
from ur_online_control.ur.configuration import Configuration

server_address = st["server_address"]
server_port = st["server_port"]
ur_port = st["ur_port"]
ur_ip = st["ur_ip"]
robot = st["robot_6e25a56a-ecab-4ebc-a3bd-f9966f8a8dbc"]
tool_angle_axis = list(robot.attached_tool.frame.point) + list(robot.attached_tool.frame.axis_angle_vector)

#print(tool_angle_axis)

guid = str(ghenv.Component.InstanceGuid)
pose_joints_key = "pose_joints" + guid


if get:
    st[pose_joints_key] = urd.get_current_pose_joints(tool_angle_axis, server_address, server_port, ur_ip, ur_port, send=True)
if pose_joints_key not in st:
    #pose_joints = Configuration.from_revolute_values([0,0,0,0,0,0])
    configuration = Configuration.from_revolute_values([0,0,0,0,0,0])
else:
    #pose_joints = Configuration.from_revolute_values(st[pose_joints_key])
    configuration = Configuration.from_revolute_values(st[pose_joints_key])

pose_joints = configuration.values
# ---------- end pose_2 ----------
panel_42 = Panel("get pose joint")

multiplication = Multiplication(A=pose_2.pose_joints, B=180)
division = Division(A=multiplication, B=pi)

panel_43 = Panel(division)

idx_5 = Slider(0, range=0..100)
panel_44 = Panel("move cartesian")
planes_wcs = Data(current_tool_plane_safe)
list_16 = ValueList({"send all positions": 0, "send only one position": 1}, selected="send only one position")
send_16 = Button()

# ----
# Direct UR control
item_2 = ListItem(List=planes_wcs, Index=idx_4, Wrap=True)
filter_10 = StreamFilter(Gate=list_16, Stream0=planes_wcs, Stream1=item_2)

movel_4 = PythonScript(commands_input=list_16, planes_WCS=filter_10, idx=idx_5)  # -> script; inputs planes_WCS: list
# ---------- movel_4: Python ----------
import Rhino.Geometry as rg
from compas.geometry import Frame
from compas.geometry import Transformation
from compas_ghpython import draw_frame
from compas_fab.robots import robot

from scriptcontext import sticky as st
import ur_online_control.ur_direct as urd

robot = st["robot_6e25a56a-ecab-4ebc-a3bd-f9966f8a8dbc"]
tool_angle_axis = list(robot.attached_tool.frame.point) + list(robot.attached_tool.frame.axis_angle_vector)


#robot = st["robot"]
#tool_angle_axis = list(robot.tool.tcp_frame.point) + list(robot.tool.tcp_frame.axis_angle_vector)


move_commands = []
for plane_WCS in planes_WCS:
    frame_WCS = Frame(plane_WCS.Origin, plane_WCS.XAxis, plane_WCS.YAxis)
    frame_RCS = robot.to_local_coords(frame_WCS)
    if robot.attached_tool:
        frame_RCS = robot.from_attached_tool_to_tool0([frame_RCS])[0]
    cmd = list(frame_RCS.point) + list(frame_RCS.axis_angle_vector) + [50.0, 0.0]
    move_commands.append(cmd)

commands = urd.generate_moves_linear(tool_angle_axis, move_commands, st["ur_ip"], st["ur_port"])
script = commands.script
print(script)
# ---------- end movel_4 ----------
send_17 = GhPythonScript(script=movel_4, send=send_16)  # -> out; inputs send: Boolean; same code as send_2

# ==== cluster Elements
# Visualise the defined element
show = BooleanToggle(False)
elem_def = GhPythonScript()  # -> out, elem_center
# ---------- elem_def: Python ----------
import os
import sys
import json

from compas.geometry import Frame
from compas.geometry import Box
from human_robot_collaborative_assembly.assembly import HRCElement as Element

#element'S dimensions
width = 0.025
length = 0.4
height = 0.049
a = 0.049

# element x
box_frame = Frame([0, 0, 0], [1, 0, 0], [0, 1, 0]) #center of the box frame 
box = Box(box_frame, length, width, height)
tool_frame =  Frame([0, 0, height], [1, 0, 0], [0, 1, 0])
conn_frame_1 = Frame([length-a, width, 0], [1, 0, 0], [0, 1, 0])
conn_frame_2 = Frame([-length+a, -width, 0], [1, 0, 0], [0, 1, 0])

elem_center = Element.from_shape(box, box_frame)

#assign attributes
elem_center.tool_frame = tool_frame
elem_center.connector_frame_1 = conn_frame_1
elem_center.connector_frame_2 = conn_frame_2
elem_center._type = 'X'
elem_center._base_frame = Frame([0, 0, 0], [1, 0, 0], [0, 1, 0])
# ---------- end elem_def ----------

# ----
# Visualise the defined element
show_2 = BooleanToggle(True)
show_3 = BooleanToggle(False)
show_4 = BooleanToggle(False)
elem_def_2 = GhPythonScript()  # -> out, elem_y
# ---------- elem_def_2: Python ----------
import os
import sys
import json

from compas.geometry import Frame
from compas.geometry import Box
from human_robot_collaborative_assembly.assembly import HRCElement as Element

#element's dimensions
width = 0.025
length = 0.4
height = 0.049
a = 0.049

# element
box_frame = Frame([0, 0, height*1.5], [0, -1, 0], [1, 0, 0]) #center of the box frame 
box = Box(box_frame, length, width, height)
tool_frame = Frame([0, 0, height*2], [0, 1, 0], [1, 0, 0])
conn_frame_1 = Frame([-width, length-a, 0], [1, 0, 0], [0, 1, 0])
conn_frame_2 = Frame([width, -length+a, 0], [1, 0, 0], [0, 1, 0])

elem_y = Element.from_shape(box, box_frame)

#assign attributes
elem_y.tool_frame = tool_frame
elem_y.connector_frame_1 = conn_frame_1
elem_y.connector_frame_2 = conn_frame_2
elem_y._type = 'Y'
elem_y._base_frame = Frame([0, 0, 0], [1, 0, 0], [0, 1, 0])
# ---------- end elem_def_2 ----------
draw = PythonScript(elem=elem_def_2.elem_y, show=show_3)  # -> M, F, C, B
# ---------- draw: Python ----------
from compas.geometry import Transformation
from compas.geometry import Frame
from compas.datastructures import mesh_transformed
from compas_ghpython.artists import MeshArtist
from compas_ghpython import draw_frame

connectors = []

connectors.append(elem.connector_frame_1)
connectors.append(elem.connector_frame_2)

if show:
    artist = MeshArtist(elem.mesh)
    M = artist.draw_mesh()
    F = draw_frame(elem.tool_frame)
    C = [draw_frame(frame) for frame in connectors]
    B = draw_frame(elem.frame)
# ---------- end draw ----------
elem_def_3 = GhPythonScript()  # -> out, elem_x
# ---------- elem_def_3: Python ----------
import os
import sys
import json

from compas.geometry import Frame
from compas.geometry import Box
from human_robot_collaborative_assembly.assembly import HRCElement as Element

#element'S dimensions
width = 0.025
length = 0.4
height = 0.049
a = 0.049

# element x
box_frame = Frame([0, 0, height/2.], [1, 0, 0], [0, 1, 0]) #center of the box frame 
box = Box(box_frame, length, width, height)
tool_frame =  Frame([0, 0, height], [-1, 0, 0], [0, 1, 0])
conn_frame_1 = Frame([length-a, width, 0], [1, 0, 0], [0, 1, 0])
conn_frame_2 = Frame([-length+a, -width, 0], [1, 0, 0], [0, 1, 0])

elem_x = Element.from_shape(box, box_frame)

#assign attributes
elem_x.tool_frame = tool_frame
elem_x.connector_frame_1 = conn_frame_1
elem_x.connector_frame_2 = conn_frame_2
elem_x._type = 'X'
elem_x._base_frame = Frame([0, 0, 0], [1, 0, 0], [0, 1, 0])
# ---------- end elem_def_3 ----------
draw_2 = PythonScript(elem=elem_def_3.elem_x, show=show_2)  # -> M, F, C, F_2, T
# ---------- draw_2: Python ----------
from compas.geometry import Transformation
from compas.geometry import Frame
from compas.datastructures import mesh_transformed
from compas_ghpython.artists import MeshArtist
from compas_ghpython import draw_frame

connectors = []

connectors.append(elem.connector_frame_1)
connectors.append(elem.connector_frame_2)

if show:
    artist = MeshArtist(elem.mesh)
    M = artist.draw_mesh()
    C = [draw_frame(frame) for frame in connectors]
    F = draw_frame(elem.frame)
    T = draw_frame(elem.tool_frame)
# ---------- end draw_2 ----------
elem_def_4 = GhPythonScript()  # -> out, elem_z
# ---------- elem_def_4: Python ----------
import os
import sys
import json

from compas.geometry import Frame
from compas.geometry import Box
from human_robot_collaborative_assembly.assembly import HRCElement as Element

#element'S dimensions
width = 0.025
length = 0.4
height = 0.049
a = 0.049

# element z
box_frame = Frame([-width, 1.5*width, length/2.], [0, 0, 1], [-1, 0, 0]) #center of the box frame 
box = Box(box_frame, length, width, height)
tool_frame = Frame([-width, 0.5*width, length/2.], [0, 0, -1], [-1, 0, 0])
conn_frame_1 = Frame([width, 0, length-height], [1, 0, 0], [0, 1, 0])
conn_frame_2 = Frame([width, 0, -length + height], [1, 0, 0], [0, 1, 0])

elem_z = Element.from_shape(box, box_frame)

# assign attributes
elem_z.tool_frame = tool_frame
elem_z.connector_frame_1 = conn_frame_1
elem_z.connector_frame_2 = conn_frame_2
elem_z._type = 'Z'
elem_z._base_frame = Frame([0, 0, 0], [1, 0, 0], [0, 1, 0])
# ---------- end elem_def_4 ----------
draw_3 = PythonScript(elem=elem_def_4.elem_z, show=show_4)  # -> M, F, C, B; same code as draw

draw_4 = PythonScript(elem_center=elem_def.elem_center, show=show)  # -> M, F, C, F_2, T
# ---------- draw_4: Python ----------
from compas.geometry import Transformation
from compas.geometry import Frame
from compas.datastructures import mesh_transformed
from compas_ghpython.artists import MeshArtist
from compas_ghpython import draw_frame

connectors = []

connectors.append(elem_center.connector_frame_1)
connectors.append(elem_center.connector_frame_2)

if show:
    artist = MeshArtist(elem_center.mesh)
    M = artist.draw_mesh()
    C = [draw_frame(frame) for frame in connectors]
    F = draw_frame(elem_center.frame)
    T = draw_frame(elem_center.tool_frame)
# ---------- end draw_4 ----------
elem_x = ClusterOutput(elem_def_3.elem_x)
elem_y = ClusterOutput(elem_def_2.elem_y)
elem_z = ClusterOutput(elem_def_4.elem_z)
elem_center = ClusterOutput(elem_def.elem_center)

# ==== cluster Draw
frame = ClusterInput()
size = ClusterInput()
draw = PythonScript(frame=frame, size=size)  # -> G, C
# ---------- draw: Python ----------
import Rhino.Geometry as rg
from System.Drawing import Color

if not size:
    size = 100

if frame:
    
    plane = rg.Plane(rg.Point3d(*list(frame.point)), rg.Vector3d(*list(frame.xaxis)), rg.Vector3d(*list(frame.yaxis)))

    G = []
    G.append(rg.Line(plane.Origin, size * plane.XAxis))
    G.append(rg.Line(plane.Origin, size * plane.YAxis))
    G.append(rg.Line(plane.Origin, size * plane.ZAxis))
    
    C = []
    C.append(Color.FromArgb(255, 0, 0))
    C.append(Color.FromArgb(0, 255, 0))
    C.append(Color.FromArgb(0, 0, 255))
# ---------- end draw ----------
G = ClusterOutput(draw.G)
C = ClusterOutput(draw.C)
