# Grasshopper definition ur_robots_setup_ur_direct.ghx (Grasshopper 1.0.7)

panel = Panel("Unload libraries")
bang = Button()
unload = PythonScript(bang=bang)
# ---------- unload: Python ----------
from compas_rhino.utilities.misc import get_tolerance
from compas_rhino.utilities.misc import unload_modules

unload_modules("compas")
unload_modules("compas_fab")
unload_modules("ur_fabrication_control")
unload_modules("roslibpy")
unload_modules("human_robot_collaborative_assembly")
# ---------- end unload ----------

panel_2 = Panel("10.181.163.92")

# ---- group: ROS client
disconnect = Button()
connect = Button()
connect_2 = PythonScript(ip="127.0.0.1", connect=connect, disconnect=disconnect)  # -> out, ros_client
# ---------- connect_2: Python ----------
import sys
import scriptcontext as sc
from compas_fab.backends import RosClient

key = 'rosclient_%s' % str(ghenv.Component.InstanceGuid)
previous_client = sc.sticky.get(key, None)

if previous_client and (connect or disconnect):
    previous_client.close()

if connect:
    ros_client = RosClient(ip, 9090)
    sc.sticky[key] = ros_client
    ros_client.run(5)

ros_client = sc.sticky.get(key, None)
print('ROS connected: {}'.format(ros_client.is_connected if ros_client else 'False'))
# ---------- end connect_2 ----------
is_connected = Panel(connect_2.out)

# ----
# Robot
# Load robot from ROS
units = ValueList({"m": 1, "cm": 100, "mm": 1000}, selected="m")
load = Button()
create = PythonScript(ros_client=connect_2.ros_client, scale_factor=units, load=load)  # -> robot
# ---------- create: Python ----------
import os
from scriptcontext import sticky as st
import compas
from compas.robots import RobotModel
from compas_fab.backends import RosClient
from compas_fab.backends import RosFileServerLoader
from compas_fab.robots import Robot
from compas_fab.robots import RobotSemantics
from compas_ghpython.artists import RobotModelArtist

# Set high precision to import meshes defined in meters
compas.PRECISION = '24f'

# store robot in component
guid = str(ghenv.Component.InstanceGuid)
robot_key = "robot_" + guid


if robot_key not in st:
    st[robot_key] = None

if ros_client and ros_client.is_connected and load:
    # Load URDF from ROS
    loader = RosFileServerLoader(ros_client)
    urdf = loader.load_urdf()
    srdf = loader.load_srdf()

    # Create robot model from URDF and load geometry
    model = RobotModel.from_urdf_string(urdf)
    model.load_geometry(loader)

    semantics = RobotSemantics.from_srdf_string(srdf, model)

    robot = Robot(model, semantics=semantics)
    robot.artist = RobotModelArtist(robot.model)
    robot.scale(scale_factor)
    st[robot_key] = robot

robot = st[robot_key]
if robot:
    robot.client = ros_client
# ---------- end create ----------

py = PythonScript()  # -> HERE, DATA
# ---------- py: Python ----------
import os

HERE = os.path.dirname(ghdoc.Path)
DATA = os.path.abspath(os.path.join(HERE, "..", "data"))
print(HERE)
print(DATA)
# ---------- end py ----------
panel_3 = Panel(py.DATA)
data_path = Data(py.DATA)
robot = Data(create)

# ----
# Tool
list = ValueList({"measurement_tool": 0, "air_pick_15mm": 1}, selected="measurement_tool")
panel_4 = Panel("Attach a custom tool")
show = BooleanToggle(False)
python = PythonScript(data_path=data_path, tool=list, show=show)  # -> tool, M, compas_mesh
# ---------- python: Python ----------
import os, math
from compas.geometry import Frame, Rotation
from compas.datastructures import Mesh
from compas_ghpython.artists import MeshArtist
from compas_fab.robots import Tool

tolerance = -0.013
#tolerance = - 0.023

if tool == 0:
    filename = 'measurement_tool_zaxis.stl'
    ee_frame = Frame([0, 0, 0.109], [1, 0, 0], [0, 1, 0])

elif tool == 1:
    filename = 'air_pick_zaxis.stl'
    ee_frame = Frame([0, 0, 0.158 + tolerance], [1, 0, 0], [0, 1, 0])


data_path = os.path.join(data_path, "attached_objects")
fullfilename = os.path.join(data_path, filename)
print fullfilename

ee_mesh = Mesh.from_stl(fullfilename)

#R = Rotation.from_axis_and_angle(ee_frame.zaxis, math.radians(180), point=ee_frame.point)
#ee_frame.transform(R)

if show:
    artist = MeshArtist(ee_mesh)
    M = artist.draw_mesh()

tool = Tool(ee_mesh, ee_frame)
compas_mesh = ee_mesh
# ---------- end python ----------
py_2 = PythonScript(robot=robot, tool=python.tool, attach=Toggle(True))  # -> a
# ---------- py_2: Python ----------
if attach:
    robot.attach_tool(tool)
else:
    robot.detach_tool()
# ---------- end py_2 ----------

# ----
# Planning scene
# Pass collision objects to planning scene
scene = PythonScript(robot=robot)  # -> scene
# ---------- scene: Python ----------
from scriptcontext import sticky as st

from compas_fab.robots import PlanningScene

# store scene in component
guid = str(ghenv.Component.InstanceGuid)
scene_key = "scene_" + guid

if scene_key not in st:
    st[scene_key] = None

if robot:
    st[scene_key] = PlanningScene(robot)

scene = st[scene_key]
# ---------- end scene ----------

panel_5 = Panel("Define an obstacle")
brep = Brep(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)
mesh = Mesh(brep)
preview = CustomPreview(Geometry=brep, Shader=ColourSwatch(SwatchColor=RGB(255, 255, 255)))
mesh_2 = PythonScript(mesh=mesh)  # -> compas_mesh
# ---------- mesh_2: Python ----------
from compas_rhino.geometry import RhinoMesh

compas_mesh = RhinoMesh.from_geometry(mesh).to_compas()
# ---------- end mesh_2 ----------
remove = Button()
scale = BooleanToggle(False)
add = Button()
collision = PythonScript(scene=scene, compas_mesh=mesh_2, scale=scale, id="floor", add=add, remove=remove)  # -> out
# ---------- collision: Python ----------
from compas_fab.robots import CollisionMesh

cm = CollisionMesh(compas_mesh, id)

if scene:
    if add:
        scene.add_collision_mesh(cm, scale)
    if remove:
        scene.remove_collision_mesh(id)
# ---------- end collision ----------
panel_6 = Panel(collision)

# ----
# Add or remove tool
remove_2 = Button()
add_2 = Button()
tool = PythonScript(scene=scene, add=add_2, remove=remove_2)  # -> out
# ---------- tool: Python ----------
if scene:
    if add:
        scene.add_attached_tool()
    if remove:
        scene.remove_attached_tool()
# ---------- end tool ----------

# ----
# Info
info = PythonScript(robot=robot)  # -> out, main_group_name
# ---------- info: Python ----------
if robot:
    robot.info()
    main_group_name = robot.main_group_name
# ---------- end info ----------
panel_7 = Panel(info.out)

# ----
# Configuration
main_planning_group = Text(info.main_group_name)

# ---- group: forward kinematics
a1 = Slider(0, range=-360..360)
a2 = Slider(0, range=-360..360)
a3 = Slider(0, range=-360..360)
a4 = Slider(0, range=-360..360)
a5 = Slider(0, range=-360..360)
a6 = Slider(0, range=-360..360)
jp = GhPythonScript()  # -> joint_positions
# ---------- jp: Python ----------
import math
joint_positions = [-3.136, -0.328, -1.218, 3.129, 0.852, 0.008]
joint_positions = [0] * 6
#joint_positions = [-6.023, 4.448, -2.312, 5.718, 1.571, -2.882]
#joint_positions = [0.968, 4.863, 2.683, 3.450, -1.571, 0.968]
print joint_positions
# ---------- end jp ----------
forward_kinematics = PythonScript(
    robot=robot,
    group=main_planning_group,
    set_joint_positions=Button(),
    joint_positions=jp,
    a1=a1,
    a2=a2,
    a3=a3,
    a4=a4,
    a5=a5,
    a6=a6)  # -> configuration; inputs joint_positions: list
# ---------- forward_kinematics: Python ----------
import math
import Grasshopper
from compas_fab.robots import Configuration

if set_joint_positions:

    j = 0
    for i in range(ghenv.Component.Params.Input.Count):
        nslider = ghenv.Component.Params.Input[i].Sources[0]
        if nslider.GetType() == Grasshopper.Kernel.Special.GH_NumberSlider:
            nslider.TrySetSliderValue(math.degrees(joint_positions[j]))
            j += 1

if robot:
    joint_positions = [a1, a2, a3, a4, a5, a6]
    joint_positions = [math.radians(a) for a in joint_positions]
    types = robot.get_configurable_joint_types(group)
    configuration = Configuration(joint_positions, types)
    print configuration
# ---------- end forward_kinematics ----------

# ---- group: inverse kinematics
pt = Point(Point(0.075, 0.3691277358, 0.5390284739))
xy = XYPlane(Origin=pt)
python_2 = PythonScript(robot=robot, plane=xy)  # -> out, frame
# ---------- python_2: Python ----------
from compas.geometry import Frame

if robot:
    frame = Frame(plane.Origin, plane.XAxis, -plane.YAxis)
    if robot.attached_tool:
        frame = robot.from_tcf_to_t0cf([frame])[0]
# ---------- end python_2 ----------
ik = PythonScript(robot=robot, group=main_planning_group, start_configuration=forward_kinematics, frame=python_2.frame)  # -> out, configuration
# ---------- ik: Python ----------
from compas.geometry import Frame
from compas_fab.backends.ros import RosError
from compas_fab.robots import Configuration

if robot and robot.client and robot.client.is_connected:
    configuration = robot.inverse_kinematics(frame, start_configuration, group)
# ---------- end ik ----------
panel_8 = Panel(ik.out)

# ---- group: forward kinematics
fk = PythonScript(robot=robot, group=main_planning_group, configuration=ik.configuration)  # -> out, frame_WCF
# ---------- fk: Python ----------
from compas_fab.robots import Configuration

if robot and robot.client and robot.client.is_connected and configuration:
    configuration = robot.get_group_configuration(group, configuration)
    frame_RCF = robot.forward_kinematics(configuration, group)
    frame_WCF = robot.to_world_coordinates(frame_RCF, group)
    print frame_WCF
# ---------- end fk ----------
panel_9 = Panel(fk.out)

# ----
# Visualisation
# Select configuration input: from fk, ik, path, or from real robot
list_2 = ValueList({"0 forward_kinematics": 0, "1 inverse_kinematics": 1, "2 'pick_and_place'": 2, "3 from assembly": 3}, selected="1 inverse_kinematics")
filter = StreamFilter(Gate=list_2, Stream0=forward_kinematics, Stream1=ik.configuration)
show_end_effector_frame = BooleanToggle(True)
show_base_frame = BooleanToggle(True)
show_collision = BooleanToggle(False)
show_frames = BooleanToggle(False)
show_visual = BooleanToggle(True)
show_acm = BooleanToggle(True)
visualize = PythonScript(
    robot=robot,
    group=main_planning_group,
    configuration=filter,
    redraw=py_2,
    show_visual=show_visual,
    show_collision=show_collision,
    show_end_effector_frame=show_end_effector_frame,
    show_frames=show_frames,
    show_base_frame=show_base_frame,
    show_acm=show_acm)  # -> out, robot, visual, collision, attached_meshes, frames, ee_frame, base_plane, base_frame; inputs redraw: list, attached_collision_meshes: list
# ---------- visualize: Python ----------
from compas.geometry import Vector
from compas.geometry import Point
from compas.geometry import Transformation
from compas.geometry import Frame
from compas_ghpython.artists import MeshArtist
from compas_fab.robots import Configuration

if robot and configuration:
    
    robot.update(configuration, visual=show_visual, collision=show_collision)

    if show_visual:
        visual = robot.artist.draw_visual()

    if show_collision:
        collision = robot.artist.draw_collision()
    
    frames = robot.transformed_frames(configuration, group)

    if show_base_frame:
        base_frame = frames[0]

    if show_end_effector_frame:
        ee_frame = robot.forward_kinematics(configuration, group)
        print("End-effector", ee_frame)
    
    if not show_frames:
        frames = None
    
    if robot.attached_tool:
        frame = robot.forward_kinematics(configuration, options=dict(solver='model', link_name=robot.attached_tool.link_name))
        robot.artist.update_tool(visual=visual, collision=collision, transformation=Transformation.from_frame_to_frame(Frame.worldXY(), frame))
    
    if show_acm:
        M = []
        for acm in attached_collision_meshes:
            frame = robot.forward_kinematics(configuration, options=dict(solver='model', link_name=acm.link_name))
            T = Transformation.from_frame_to_frame(Frame.worldXY(), frame)
            mesh = acm.collision_mesh.mesh.transformed(T)
            M.append(MeshArtist(mesh).draw())
        attached_meshes = M
# ---------- end visualize ----------
geo = Geometry(visualize.visual)
geo_2 = Geometry(visualize.collision)
draw = GhPythonScript(frames=[visualize.frames, visualize.ee_frame, visualize.base_frame], scale=Slider(0.1, range=0..1))  # -> P, V, C, W; inputs frames: list
# ---------- draw: Python ----------
from System.Drawing import Color
from compas_ghpython.utilities import draw_frame

red = Color.FromArgb(255, 0, 0)
green = Color.FromArgb(0, 255, 0)
blue = Color.FromArgb(0, 0, 255)

P = []
V = []
C = []

scale = float(scale)

for frame in frames:
    if not frame:
        continue
    plane = draw_frame(frame)
    P += [plane.Origin] * 3
    V.append(plane.XAxis * scale)
    V.append(plane.YAxis * scale)
    V.append(plane.ZAxis * scale)
    C += [red, green, blue]

W = 3
# ---------- end draw ----------
preview_2 = CustomPreview(Geometry=geo, Shader=ColourSwatch(SwatchColor=RGB(105, 105, 105)))
vdisex = VectorDisplayEx(Point=draw.P, Vector=draw.V, Colour=draw.C, Width=draw.W)

# ----
# Settings
# --> Set your IP address
# --> Set robot IP address
server_ip = ValueList({"192.168.10.44", "192.168.10.12", "192.168.10.11", "192.168.10.10", "192.168.10.2", "127.0.0.1", "192.168.10.111"}, selected="192.168.10.11")
ur_ip = ValueList({"192.168.10.10", "192.168.10.20", "192.168.10.11", "192.168.10.12", "127.0.0.1", "192.168.10.111"}, selected="192.168.10.20")
server_port = ValueList({"50002", "50003", "50004", "50005"}, selected="50003")
ur_port = ValueList({"30002"}, selected="30002")
globals = PythonScript(server_address=server_ip, server_port=server_port, ur_ip=ur_ip, ur_port=ur_port, clear=Button())  # inputs server_port: Int32
# ---------- globals: Python ----------
from scriptcontext import sticky as st

st["server_address"] = server_address
st["server_port"] = server_port

st["ur_ip"] = ur_ip
st["ur_port"] = ur_port

if clear:
    st.clear()
# ---------- end globals ----------

# ----
# Check if UR robot
#  is available
ping = Button()
py_3 = PythonScript(ip=ur_ip, ping=ping)  # -> out, trigger
# ---------- py_3: Python ----------
from scriptcontext import sticky as st
from ur_fabrication_control.ur_direct import is_available

guid = str(ghenv.Component.InstanceGuid)
txt_key = "txt_" + guid
if txt_key not in st:
    st[txt_key] = ""

if ping:
    
    available = is_available(ip)
    
    if available:
        st[txt_key] = "%s is up!" % ip
        trigger = True
    else:
        st[txt_key] = "%s is down!" % ip
        trigger = False

print(st[txt_key])
# ---------- end py_3 ----------
panel_10 = Panel(py_3.out)

get = Button()
panel_11 = Panel("get pose joint")
pose = PythonScript(get=get)  # -> configuration, pose_joints
# ---------- pose: Python ----------
from scriptcontext import sticky as st
import ur_fabrication_control.ur_direct as urd
from compas_fab.robots import Configuration


server_address = st["server_address"]
server_port = st["server_port"]
ur_port = st["ur_port"]
ur_ip = st["ur_ip"]
robot = st["robot_4fdced2c-76eb-46ec-8e4c-a337dedcc275"]
tool_angle_axis = list(robot.attached_tool.frame.point) + list(robot.attached_tool.frame.axis_angle_vector)

#print(tool_angle_axis)

guid = str(ghenv.Component.InstanceGuid)
pose_joints_key = "pose_joints" + guid


if get:
    st[pose_joints_key] = urd.get_current_pose_joints(tool_angle_axis, server_address, server_port, ur_ip, ur_port, send=True)
if pose_joints_key not in st:
    #pose_joints = Configuration.from_revolute_values([0,0,0,0,0,0])
    configuration = Configuration.from_revolute_values([0,0,0,0,0,0])
else:
    #pose_joints = Configuration.from_revolute_values(st[pose_joints_key])
    configuration = Configuration.from_revolute_values(st[pose_joints_key])

pose_joints = configuration.values
# ---------- end pose ----------
panel_12 = Panel(pose.pose_joints)

stop = Button()
panel_13 = Panel("stop")
stop_2 = PythonScript(stop=stop)
# ---------- stop_2: Python ----------
from scriptcontext import sticky as st
import ur_online_control.ur_direct as urd

#ur_ip = st["ur_ip"]
#ur_port = st["ur_port"]

ur_ip = '192.168.10.20'
ur_port = 30002

if stop:
    urd.stop(ur_ip, ur_port)
# ---------- end stop_2 ----------

get_2 = Button()
# Direct UR control
panel_14 = Panel("get pose cartesian")
pose_2 = PythonScript(get=get_2)  # -> pose_cartesian
# ---------- pose_2: Python ----------
from scriptcontext import sticky as st
import ur_fabrication_control.ur_direct as urd

server_address = st["server_address"]
server_port = st["server_port"]
ur_port = st["ur_port"]
ur_ip = st["ur_ip"]
robot = st["robot_4fdced2c-76eb-46ec-8e4c-a337dedcc275"]

tool_angle_axis = list(robot.attached_tool.frame.point) + list(robot.attached_tool.frame.axis_angle_vector)

print(tool_angle_axis)

guid = str(ghenv.Component.InstanceGuid)
pose_cartesian_key = "pose_cartesian" + guid


if get:
    st[pose_cartesian_key] = urd.get_current_pose_cartesian(tool_angle_axis, server_address, server_port, ur_ip, ur_port, send=True)

if pose_cartesian_key not in st:
    pose_cartesian = []
else:
    pose_cartesian = st[pose_cartesian_key]

print(pose_cartesian)
# ---------- end pose_2 ----------
py_4 = PythonScript(pose_cartesian=pose_2)  # -> frame_WCS, plane_WCS; inputs pose_cartesian: list
# ---------- py_4: Python ----------
import Rhino.Geometry as rg
from scriptcontext import sticky as st
from compas.geometry import Frame
from compas.geometry import Transformation
from compas_ghpython import draw_frame

robot = st["robot_4fdced2c-76eb-46ec-8e4c-a337dedcc275"]

pose = pose_cartesian

if pose_cartesian:
    #frame_RCS = Frame.from_pose_axis_angle_vector(pose_cartesian)
    frame_RCS = Frame.from_axis_angle_vector(axis_angle_vector=pose[3:], point=pose[:3])
    frame_WCS = robot.to_world_coords(frame_RCS)
    plane_WCS  = draw_frame(frame_WCS)
    print frame_RCS
# ---------- end py_4 ----------
draw_2 = Draw(frame=py_4.frame_WCS)  # -> G, C
panel_15 = Panel(pose_2)
preview_3 = CustomPreview(Geometry=draw_2.G, Shader=py_4.plane_WCS)

preview_4 = CustomPreview(Geometry=visualize.attached_meshes, Shader=ColourSwatch(SwatchColor=RGB(255, 255, 255)))

# ----
# Calculate basis
# Measure basis:
# 1. Clear the recorded poses
# 2. Move robot to origin and press "get pose"
# 3. Move robot to point in positive x-axis and press "get pose"
# 4. Move robot to an other point in your basis and press "get pose"
# (The further away these positions are, the better)
# 
# 5. Alternatively change the order in the component calc base
# 6. Copy output into base component (TODO: check if it has to be inverted)
list_3 = ValueList({"o, pos.x-axis, xy pl": 0, "o, pos.y-axis, xy pl": 1}, selected="o, pos.x-axis, xy pl")
clear = Button()
rec = PythonScript(msg=pose_2, rec=get_2, clear=clear)  # -> rec; inputs msg: list
# ---------- rec: Python ----------
from scriptcontext import sticky as st

guid = str(ghenv.Component.InstanceGuid)
recorded_key =  "recorded_" + guid
just_cleared_key = "just_cleared_" + guid


if recorded_key not in st:
    st[recorded_key] = []

if just_cleared_key not in st:
    st[just_cleared_key] = False

if clear:
    st[recorded_key] = []
    st[just_cleared_key] = True
else:
    if len(msg):
        if msg != [None] and not st[just_cleared_key] and rec:
            st[recorded_key].append(msg)
    st[just_cleared_key] = False
        


rec = st[recorded_key]

print rec
# ---------- end rec ----------
calc_base = PythonScript(poses=rec, input_type=list_3)  # -> out; inputs poses: list
# ---------- calc_base: Python ----------
import Rhino.Geometry as rg
import math


if len(poses) > 2:
    
    O = poses[0]
    P1 = poses[1]
    P2 = poses[2]
    
    if input_type == 0:
        # origin, pt on positive x-axis, pt in xy plane
        origin = rg.Point3d(O[0], O[1], O[2])
        pt_on_xaxis = rg.Point3d(P1[0], P1[1], P1[2])
        pt_in_xyplane = rg.Point3d(P2[0], P2[1], P2[2])
        
        xaxis = pt_on_xaxis - origin
        xaxis.Unitize()
        
        v = pt_in_xyplane - origin
        zaxis = rg.Vector3d.CrossProduct(v, xaxis)
        zaxis.Unitize()
        
        # zaxis must look up!
        if math.acos(rg.Vector3d.ZAxis * zaxis) > math.acos(rg.Vector3d.ZAxis * -zaxis):
            zaxis = -zaxis
        
        yaxis = rg.Vector3d.CrossProduct(zaxis, xaxis)
    
    elif input_type == 1:
        # origin, pt on positive y-axis, pt in xy plane
        origin = rg.Point3d(O[0], O[1], O[2])
        pt_on_yaxis = rg.Point3d(P1[0], P1[1], P1[2])
        pt_in_xyplane = rg.Point3d(P2[0], P2[1], P2[2])
        
        yaxis = pt_on_yaxis - origin
        yaxis.Unitize()
        
        v = pt_in_xyplane - origin
        zaxis = rg.Vector3d.CrossProduct(v, yaxis)
        zaxis.Unitize()
        
        # zaxis must look up!
        if math.acos(rg.Vector3d.ZAxis * zaxis) > math.acos(rg.Vector3d.ZAxis * -zaxis):
            zaxis = -zaxis
        
        xaxis = rg.Vector3d.CrossProduct(yaxis, zaxis)
        
        
    print "Copy the following into base component:"
    print " "
    print "origin = [%.2f, %.2f, %.2f]" % tuple(list(origin))
    print "xaxis = [%.5f, %.5f, %.5f]" % tuple(list(xaxis))
    print "yaxis = [%.5f, %.5f, %.5f]" % tuple(list(yaxis))
    

#print rg.Vector3d.CrossProduct(rg.Vector3d.YAxis, rg.Vector3d.ZAxis)
#print rg.Vector3d.CrossProduct(rg.Vector3d.ZAxis, rg.Vector3d.XAxis)
# ---------- end calc_base ----------
panel_16 = Panel(calc_base)
panel_17 = Panel(rec)

panel_18 = Panel("set digital out")
value = BooleanToggle(True)
number = Slider(7, range=0..10)
digital_out = PythonScript(number=number, value=value)  # -> script; inputs number: Int32, value: Boolean
# ---------- digital_out: Python ----------
import ur_fabrication_control.ur_direct as urd

commands = urd.URCommandScript()
commands.start()
commands.add_line("\tset_digital_out({}, {})".format(number, value))
commands.end()
script = commands.generate()

print(script)
# ---------- end digital_out ----------
send = Button()
send_2 = GhPythonScript(script=digital_out, send=send)  # -> out; inputs send: Boolean
# ---------- send_2: Python ----------
from scriptcontext import sticky as st
from ur_fabrication_control.ur_direct import send_script

ur_ip = st["ur_ip"]
ur_port = st["ur_port"]

if send:
    send_script(script, ur_ip, ur_port)
# ---------- end send_2 ----------

panel_19 = Panel("move joints")
movej = PythonScript(joint_configuration=filter, velocity=Slider(6, range=0..200))  # -> script, values; inputs joint_configuration: list
# ---------- movej: Python ----------
import ur_fabrication_control.ur_direct as urd
import math


print joint_configuration

"""
for c in joint_configurations:
    for i,v in enumerate(c.values):
        #print v
        if v>math.pi:
            v-=2*math.pi
        if v<-math.pi:
            v+=2*math.pi
        c.values[i]=v
"""

joint_config = ["movej({}, v={})".format(c.values, velocity/10) for c in joint_configuration]

commands = urd.URCommandScript()
commands.start()
commands.add_lines(joint_config)
commands.end()

script = commands.generate()
values = joint_configuration[0].values

print([math.degrees(v) for v in values])

print(script)
# ---------- end movej ----------
send_3 = Button()
send_4 = GhPythonScript(script=movej.script, send=send_3)  # -> out; inputs send: Boolean
# ---------- send_4: Python ----------
from scriptcontext import sticky as st
from ur_fabrication_control.ur_direct import send_script

#ur_ip = st["ur_ip"]
#ur_port = st["ur_port"]
ur_ip = '192.168.10.20'
ur_port = 30002

if send:
    send_script(script, ur_ip, ur_port)
# ---------- end send_4 ----------

movel = PythonScript(plane_WCS=xy)  # -> script; inputs plane_WCS: Plane
# ---------- movel: Python ----------
import Rhino.Geometry as rg
import ur_fabrication_control.ur_direct as urd
from compas.geometry import Frame
from compas.geometry import Transformation, Rotation
from compas_ghpython import draw_frame
from scriptcontext import sticky as st
import math


robot = st["robot_4fdced2c-76eb-46ec-8e4c-a337dedcc275"]

def to_local_coords(frame_WCF, group='manipulator'):
    """Represent a frame from the world coordinate system (WCF) in the robot's coordinate system (RCF).
    Parameters
    ----------
    frame_WCF : :class:`compas.geometry.Frame`
        A frame in the world coordinate frame.
    group : :obj:`str`, optional
        The name of the planning group. Defaults to the main planning group.
    Returns
    -------
    :class:`compas.geometry.Frame`
        A frame in the robot's coordinate frame.
    Examples
    --------
    >>> frame_WCF = Frame([-0.363, 0.003, -0.147], [0.388, -0.351, -0.852], [0.276, 0.926, -0.256])
    >>> frame_RCF = robot.to_local_coordinates(frame_WCF)
    >>> frame_RCF
    Frame(Point(-0.363, 0.003, -0.147), Vector(0.388, -0.351, -0.852), Vector(0.276, 0.926, -0.256))
    """
    base_frame =  robot.get_base_frame(group=group)
    R = Rotation.from_axis_and_angle(base_frame.zaxis, math.radians(-180), point=base_frame.point)
    base_frame =  base_frame.transformed(R)
    #T = Transformation.from_change_of_basis(Frame.worldXY(), base_frame)
    T = Transformation.change_basis(Frame.worldXY(), base_frame)
    frame_RCF = frame_WCF.transformed(T)
    return frame_RCF

frame_WCS = Frame(plane_WCS.Origin, plane_WCS.XAxis, plane_WCS.YAxis)
#frame_RCS = robot.get_RCS(frame_WCS)
#frame_RCS = to_local_coords(frame_WCS, group='manipulator')
frame_RCS = robot.to_local_coordinates(frame_WCS)

cmd = list(frame_RCS.point) + list(frame_RCS.axis_angle_vector) + [0.1, 0.0]
tool_angle_axis = list(robot.attached_tool.frame.point) + list(robot.attached_tool.frame.axis_angle_vector)
commands = urd.generate_moves_linear(tool_angle_axis, cmd, st["ur_ip"], st["ur_port"])
script = commands.script
print(script)
# ---------- end movel ----------
panel_20 = Panel("move cartesian")
send_5 = Button()
send_6 = GhPythonScript(script=movel, send=send_5)  # -> out; inputs send: Boolean
# ---------- send_6: Python ----------
from scriptcontext import sticky as st
from ur_fabrication_control.ur_direct import send_script

"""
ur_ip = st["ur_ip"]
ur_port = st["ur_port"]
"""

ur_ip = '192.168.10.20'
ur_port = 30002

if send:
    send_script(script, ur_ip, ur_port)
# ---------- end send_6 ----------

# ----
# send airpick vacuum scripts
send_7 = Button()
send_8 = Button()
send_9 = Button()
airpick = GhPythonScript(send_script_airpick_on=send_7, send_script_airpick_off=send_8, send_script_airpick_onoff=send_9)  # -> out; inputs send_script_airpick_on: Boolean
# ---------- airpick: Python ----------
import time
from scriptcontext import sticky as st
import ur_fabrication_control.ur_direct as urd

"""
ur_ip = st["ur_ip"]
ur_port = st["ur_port"]
"""

ur_ip = '192.168.10.20'
ur_port = 30002
script_on = urd.airpick_toggle(True, ur_ip, ur_port)
script_off = urd.airpick_toggle(False, ur_ip, ur_port)



if send_script_airpick_on:
    script_on.send_script()
    
if send_script_airpick_off:
    script_off.send_script()

if send_script_airpick_onoff:
    script_on.send_script()
    time.sleep(5)
    script_off.send_script()
# ---------- end airpick ----------

# ----
# send area_grip vacuum scripts
send_10 = Button()
send_11 = Button()
airpick_2 = GhPythonScript(send_script_areagrip_on=send_10, send_script_areagrip_off=send_11)  # -> out; inputs send_script_areagrip_on: Boolean
# ---------- airpick_2: Python ----------
import time
from scriptcontext import sticky as st
import ur_fabrication_control.ur_direct as urd

ur_ip = st["ur_ip"]
ur_port = st["ur_port"]

script_on = urd.areagrip_toggle(True, ur_ip, ur_port, sleep = 1.)
script_off = urd.areagrip_toggle(False, ur_ip, ur_port, sleep = 0.1)



if send_script_areagrip_on:
    script_on.send_script()
    
if send_script_areagrip_off:
    script_off.send_script()
# ---------- end airpick_2 ----------

# ==== cluster Draw
frame = ClusterInput()
size = ClusterInput()
draw = PythonScript(frame=frame, size=size)  # -> G, C
# ---------- draw: Python ----------
import Rhino.Geometry as rg
from System.Drawing import Color

if not size:
    size = 100

if frame:
    
    plane = rg.Plane(rg.Point3d(*list(frame.point)), rg.Vector3d(*list(frame.xaxis)), rg.Vector3d(*list(frame.yaxis)))

    G = []
    G.append(rg.Line(plane.Origin, size * plane.XAxis))
    G.append(rg.Line(plane.Origin, size * plane.YAxis))
    G.append(rg.Line(plane.Origin, size * plane.ZAxis))
    
    C = []
    C.append(Color.FromArgb(255, 0, 0))
    C.append(Color.FromArgb(0, 255, 0))
    C.append(Color.FromArgb(0, 0, 255))
# ---------- end draw ----------
G = ClusterOutput(draw.G)
C = ClusterOutput(draw.C)
