# Grasshopper definition icp_results.gh (Grasshopper 0.9.76)
# plug-ins: Python Interpreter

py = PythonScript()  # -> A, B
# ---------- py: Python ----------
import Rhino.Geometry as rg

dataA =  [[-36.135, -1273.399, 8.321], [0.0, 0.0, 0.0], [49.187, -874.668, 8.534000000000001], [106.173, -468.376, 8.750999999999999], [133.328, -1251.509, 5.334], [217.033, -842.73, 5.553], [270.129, -420.269, 5.778], [499.999, -0.017999999999999999, 0.0040000000000000001]]
dataB =  [[1014.74, -590.91, -767.45], [1092.76, -743.6, -770.22], [1420.28, -537.33, -767.88], [1507.31, -685.55, -770.85], [1823.42, -454.48, -768.71], [1924.34, -593.59, -771.24], [2229.307, -198.723, -777.062], [2398.372, -669.331, -777.991]]


A = [rg.Point3d(x, y, z) for x, y, z in dataA]
B = [rg.Point3d(x, y, z) for x, y, z in dataB]
# ---------- end py ----------

# ----
# icp solution WITHOUT init guess
py_2 = PythonScript()  # -> T
# ---------- py_2: Python ----------
import Rhino.Geometry as rg

T = rg.Transform.Identity

T.M00 = -0.052382
T.M01 = -0.998627
T.M02 = 0.000638
T.M03 = 762.163476

T.M10 = -0.998623
T.M11 = 0.052383
T.M12 = 0.002767
T.M13 = -484.165227

T.M20 = -0.002797
T.M21 = -0.000493
T.M22 = -0.999996
T.M23 = -764.884426

T.M30 = 0.000000
T.M31 = 0.000000
T.M32 = 0.000000
T.M33 = 1.000000


print T
# ---------- end py_2 ----------
transform = Transform(Geometry=py.A, Transform=py_2)
preview = CustomPreview(Geometry=transform, Shader=ColourSwatch(SwatchColor=RGB(22, 80, 130)))

# ----
# icp solution WITH init guess
py_3 = PythonScript()  # -> T
# ---------- py_3: Python ----------
import Rhino.Geometry as rg

T = rg.Transform.Identity

T.M00 = -0.064670
T.M01 = 0.997847
T.M02 = -0.010871
T.M03 = 2326.385650

T.M10 = 0.997906
T.M11 = 0.064658
T.M12 = -0.001454
T.M13 = -672.351775

T.M20 = -0.000748
T.M21 = -0.010943
T.M22 = -0.999940
T.M23 = -773.043780

T.M30 = 0.000000
T.M31 = 0.000000
T.M32 = 0.000000
T.M33 = 1.000000

print T
# ---------- end py_3 ----------
transform_2 = Transform(Geometry=py.A, Transform=py_3)
preview_2 = CustomPreview(Geometry=transform_2, Shader=ColourSwatch(SwatchColor=RGB(22, 130, 107)))

preview_3 = CustomPreview(Geometry=py.B, Shader=ColourSwatch(SwatchColor=RGB(150, 34, 178)))
preview_4 = CustomPreview(Geometry=py.A, Shader=ColourSwatch(SwatchColor=RGB(61, 133, 196)))
line = Line(Line((488.2719644, -923.0122154, 0), (488.2719644, -923.0122154, 820.2578211)))
vec = Vector(Vector(978.9692179, -414.3611687, 0))
panel = Panel("init guess")
rad = Radians(Degrees=Slider(296, range=0..1000))
move = Move(Geometry=line, Motion=vec)  # -> Geometry, Transform
rotax = RotateAxis(Geometry=py.A, Angle=rad, Axis=move.Geometry)  # -> Geometry, Transform
py_4 = PythonScript(X=rotax.Transform)
# ---------- py_4: Python ----------
"""
for i in range(4):
    str = "T.append(["
    for j in range(4):
        str += "X.M%i%i, " % (i,j)
    print str[:-2], "])"
"""

T = []
T.append([X.M00, X.M01, X.M02, X.M03 ])
T.append([X.M10, X.M11, X.M12, X.M13 ])
T.append([X.M20, X.M21, X.M22, X.M23 ])
T.append([X.M30, X.M31, X.M32, X.M33 ])

print T
# ---------- end py_4 ----------
preview_5 = CustomPreview(Geometry=rotax.Geometry, Shader=ColourSwatch(SwatchColor=RGB(255, 255, 255)))
