# Grasshopper definition xfunc_call.gh (Grasshopper 0.9.76)
# plug-ins: Python Interpreter

init_guess = Transform({TransformCount=1, m00=0.438371, m01=0.898794, m02=0, m03=2026.068218, m10=-0.898794, m11=0.438371, m12=0, m13=0, m20=0, m21=0, m22=1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})
ptsa = Point([Point(-36.135, -1273.399, 8.321), Point(0, 0, 0), Point(49.187, -874.668, 8.534), Point(106.173, -468.376, 8.751), Point(133.328, -1251.509, 5.334), Point(217.033, -842.73, 5.553), Point(270.129, -420.269, 5.778), Point(499.999, -0.018, 0.004)])
ptsb = Point([Point(1014.74, -590.91, -767.45), Point(1092.76, -743.6, -770.22), Point(1420.28, -537.33, -767.88), Point(1507.31, -685.55, -770.85), Point(1823.42, -454.48, -768.71), Point(1924.34, -593.59, -771.24), Point(2229.307, -198.723, -777.062), Point(2398.372, -669.331, -777.991)])
py = PythonScript(ptsA=ptsa, ptsB=ptsb, init_guess=init_guess, max_iterations=Slider(20, range=0..100))  # -> T, distances; inputs ptsA: list of Point3d, ptsB: list of Point3d, max_iterations: Int32
# ---------- py: Python ----------
from compas.utilities.xfunc import XFunc
import Rhino.Geometry as rg

# format ptsA and ptsB
dataA = [list(pt) for pt in ptsA]
dataB = [list(pt) for pt in ptsB]

# format Rhino transformation
init_guess_flattened = [float(f) for f in init_guess.ToFloatArray(True)]
init_guess_list = [init_guess_flattened[i:(i + 4)] for i in range(0, len(init_guess_flattened), 4)]  

basepath = r"C:\Users\kathrind\workspace"

# call the function
xfunc = XFunc(basepath, basepath, mode=1)
fname = 'mas_lib.optimisation.icp.icp'
xfunc(fname, dataA, dataB, init_guess_list, max_iterations)
print(xfunc.data)
#print(xfunc.error)
#print(xfunc.profile)
transformation, distances = xfunc.data

print "distances", distances

# format result
T = rg.Transform.Identity
for i in range(4):
    for j in range(4):
        code = "T.M%i%i = %f" % (i, j, transformation[i][j])
        print code
        exec(code)

print T
# ---------- end py ----------
transform = Transform(Geometry=ptsa, Transform=py.T)
distances = Panel(py.distances)
preview = CustomPreview(
    Geometry=transform,
    Shader={ambient=RGB(0, 0, 0), diffuse=RGB(255, 105, 180), emission=RGB(76, 32, 54), shine=0.5, specular=RGB(255, 255, 255), transparency=0})
