# Grasshopper definition add2floats.ghx (Grasshopper 1.0.7)

panel = Panel("Unload libraries")
bang = Button()
unload = PythonScript(bang=bang)
# ---------- unload: Python ----------
from compas_ghpython import unload_modules

unload_modules("compas")
unload_modules("ur_online_control")
# ---------- end unload ----------

# ----
# 0a
# Check your IP address and set UR IP address
server_address = ValueList({"192.168.10.12", "192.168.10.11", "127.0.0.1"}, selected="127.0.0.1")
server_port = Integer(30003)
globals = PythonScript(server_address=server_address, server_port=server_port)  # inputs server_port: Int32
# ---------- globals: Python ----------
from scriptcontext import sticky as st

st["server_address"] = server_address
st["server_port"] = server_port
# ---------- end globals ----------

# ----
# Settings
panel_2 = Panel("Set library path")
py = PythonScript()  # -> path
# ---------- py: Python ----------
import sys
import os

ghComp = ghenv.Component
ghDoc = ghComp.OnPingDocument()

# the full path of the gh file
path = ghDoc.FilePath
# the directory of the gh file
path = os.path.dirname(path)

idx = path.find("ur_online_control")
libpath = os.path.abspath(path[:(idx)])
sys.path.append(libpath)
# ---------- end py ----------

# ----
# Executing
# 1
panel_3 = Panel("Start communication server")
panel_4 = Panel(py)
# or start main.py from command prompt
start = Button()
server = PythonScript(path=panel_4, filename="main.py", start=start)
# ---------- server: Python ----------
import os
import threading
from scriptcontext import sticky as st

server_address = st["server_address"]
server_port = st["server_port"]
 
main = os.path.join(path, filename)

if os.path.isfile(main):
        
    def myfunc():
        syscall = "python %s %s %s" % (main, server_address, server_port)
        os.system(syscall)
    
    if start:
        t = threading.Thread(target=myfunc)
        t.start()
# ---------- end server ----------

connect = Button()
disconnect = Button()
# 2
panel_5 = Panel("Get Grasshopper connected")
client = PythonScript(connect=connect, disconnect=disconnect)  # -> connected, client
# ---------- client: Python ----------
import sys

import time
from scriptcontext import sticky as st
from Rhino.RhinoApp import WriteLine
from ur_online_control.grasshopper import GHClient, gh_component_timer
import time

server_address = st["server_address"]
server_port = st["server_port"]

guid = str(ghenv.Component.InstanceGuid)

client_key = "client_" + guid
run_key = "run_" + guid

if connect:
    if client_key not in st:
        st[client_key] = GHClient(server_address, server_port)
        client = st[client_key]
        client.connect_to_server()
        client.start()
        
    else:
        if st[client_key].running:
            WriteLine("Client is already connected.")
            
        else:
            st[client_key] = GHClient(server_address, server_port)
            client = st[client_key]
            client.connect_to_server()
            client.start()
"""
else:
    if client_key in st:
        # we need a timer to ask if we have something on the rcv queue
        client = st[client_key]
        #if client.running:
        #    #client.run_inner_while()
        #    gh_component_timer(ghenv, True, 1000)
"""

if disconnect:
    if client_key in st:
        client = st[client_key]
        if client.running:
            client.close()

if client_key in st:
    connected =  st[client_key].running
    client = st[client_key]
    print st[client_key].rcv_queue.qsize()
    print st[client_key].snd_queue.qsize()
else:
    connected = False
# ---------- end client ----------
panel_6 = Panel(client.connected)

# ----
# Here you can contiously change values and resend..
# you receive the result here:
continue_fabrication = BooleanToggle(True)
panel_7 = Panel("Send a message")
send = Button()
# 3
send_2 = PythonScript(
    client=client.client,
    send=send,
    continue_fabrication=continue_fabrication,
    x=Slider(7, range=0..10),
    y=Slider(2, range=0..10))  # -> out
# ---------- send_2: Python ----------
from ur_online_control.communication.msg_identifiers import *
from ur_online_control.utilities.lists import flatten_list

if send and client:
    client.send(MSG_INT, bool(continue_fabrication))
    client.send(MSG_FLOAT_LIST, [float(x), float(y)])
# ---------- end send_2 ----------

# ----
# This component updates on receive
bang_2 = Button()
receive = PythonScript(client=client.client, bang=bang_2)  # -> qsize, client
# ---------- receive: Python ----------
from ur_online_control.communication.msg_identifiers import *
from ur_online_control.utilities.lists import flatten_list
from Rhino.RhinoApp import WriteLine


if client:
    if not client.ghenv:
        client.ghenv = ghenv
    qsize = client.rcv_queue.qsize()
# ---------- end receive ----------
# This can be connected to something that is recalculated and sent again to the server
panel_8 = Panel(receive.qsize)

send_3 = PythonScript(client=receive.client)  # -> out
# ---------- send_3: Python ----------
from ur_online_control.communication.msg_identifiers import *
from ur_online_control.utilities.lists import flatten_list

if client:
    qsize = client.rcv_queue.qsize()
    if qsize:
        msg = client.rcv_queue.get()
        print msg
# ---------- end send_3 ----------
panel_9 = Panel(send_2)
panel_10 = Panel(send_3)
