# Grasshopper definition ur_online_communication_dj.gh (Grasshopper 0.9.76)
# plug-ins: Python Interpreter

py = PythonScript()  # -> path
# ---------- py: Python ----------
import sys
import os

ghComp = ghenv.Component
ghDoc = ghComp.OnPingDocument()

# the full path of the gh file
path = ghDoc.FilePath
# the directory of the gh file
path = os.path.dirname(path)

path = os.path.abspath(os.path.join(path, ".."))

print path
# ---------- end py ----------
panel = Panel(py)

# ----
# Check your IP address and set UR IP address
server_port = Integer(30003)
ur_ip = ValueList({"192.168.10.11", "192.168.10.10", "127.0.0.1"}, selected="192.168.10.10")
# 0a
# Settings
server_address = ValueList({"192.168.10.12", "192.168.10.11", "127.0.0.1"}, selected="192.168.10.11")
globals = PythonScript(server_address=server_address, server_port=server_port, ur_ip=ur_ip)  # inputs server_port: Int32
# ---------- globals: Python ----------
from scriptcontext import sticky as st

st["server_address"] = server_address
st["server_port"] = server_port

st["ur_ip"] = ur_ip
# ---------- end globals ----------

# ----
# Check if UR is available
ping = Button()
py_2 = PythonScript(ip=ur_ip, ping=ping)  # -> out
# ---------- py_2: Python ----------
from scriptcontext import sticky as st
from ur_online_control.communication import is_available


guid = str(ghenv.Component.InstanceGuid)
txt_key = "txt_" + guid
if txt_key not in st:
    st[txt_key] = ""

if ping:
    
    available = is_available(ip)
    
    if available:
        st[txt_key] = "%s is up!" % ip
    else:
        st[txt_key] = "%s is down!" % ip

print st[txt_key]
# ---------- end py_2 ----------
# Planning
panel_2 = Panel(py_2)

# ----
# 1
# TOPICS: overhangs
# surface based
# volume based
# mesh optimisation
start = Button()
panel_3 = Panel("C:\Users\jennyd\Documents\DavidJenny\GIT\ur_online_control")
# Executing
panel_4 = Panel("Start communication server")
server = PythonScript(path=py, start=start)
# ---------- server: Python ----------
import os
import threading
from scriptcontext import sticky as st

server_address = st["server_address"]
server_port = st["server_port"]
ur_ip = st["ur_ip"]
 
main = os.path.join(path, "communication", "main.py")

if os.path.isfile(main):
        
    def myfunc():
        syscall = "python %s %s %s %s" % (main, server_address, server_port, ur_ip)
        os.system(syscall)
    
    if start:
        t = threading.Thread(target=myfunc)
        t.start()
# ---------- end server ----------

# ---- group: Define path
# 0b
number = Slider(30, range=0..100)
Z = UnitZ(Factor=1)
crv = Curve(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)
py_3 = PythonScript(crv=crv, number=number, normal=Z)  # -> planes
# ---------- py_3: Python ----------
import Rhino.Geometry as rg

normal.Unitize()

# 1. Divide curve
params = rg.Curve.DivideByCount(crv, number - 1, True)
planes = []
for param in params:
    point = rg.Curve.PointAt(crv, param)
    tangent = rg.Curve.TangentAt(crv, param)
    tangent.Unitize()
    # tangent = xaxis, normal is given, so we calculate yaxis
    yaxis = rg.Vector3d.CrossProduct(normal, tangent)
    yaxis.Unitize()
    planes.append(rg.Plane(point, tangent, yaxis))
    
print len(params)
# ---------- end py_3 ----------

# ---- group: Define commands
python = PythonScript(planes_WCS=py_3, dfillet=Slider(20, range=0..100), speed=Slider(30, range=0..100))  # -> commands; inputs planes_WCS: list
# ---------- python: Python ----------
import Rhino.Geometry as rg
from compas_fabrication.fabrication.geometry import Frame, Transformation
from compas_fabrication.fabrication.grasshopper import xdraw_frame
from scriptcontext import sticky as st

robot = st["robot"]
buffer = 0.7

# TODO this must be optimized! matrix multiplication!
commands = []
for i, plane_WCS in enumerate(planes_WCS):
    tcp_WCS = Frame(plane_WCS.Origin, plane_WCS.XAxis, plane_WCS.YAxis)
    if i == 0 or i == len(planes_WCS) - 1:
        radius = 0.
    else:
        # calculate blend radius
        prev, current, next = planes_WCS[i-1].Origin, planes_WCS[i].Origin, planes_WCS[i+1].Origin
        radius = min((prev - current).Length/2 * buffer, (next - current).Length/2 * buffer, dfillet)
        
    tcp_RCS = robot.get_frame_in_RCS(tcp_WCS)
    cmd = tcp_RCS.pose_axis_angle_vector + [speed, radius]
    commands.append(cmd)
# ---------- end python ----------

# ----
panel_5 = Panel("Unload libraries")
bang = Button()
unload = PythonScript(bang=bang)
# ---------- unload: Python ----------
from compas_fabrication.fabrication.grasshopper.utilities import unload_modules

unload_modules("compas")
unload_modules("ur_online_control")
# ---------- end unload ----------

send = Button()
# 2
panel_6 = Panel("Get UR connected")
ur = PythonScript(send=send)
# ---------- ur: Python ----------
from scriptcontext import sticky as st
from ur_online_control.ur_driver import URDriver

server_address = st["server_address"]
server_port = st["server_port"]
ur_ip = st["ur_ip"]
robot = st["robot"]

tool_angle_axis = robot.tool.tcp_frame.pose_axis_angle_vector
print tool_angle_axis

ur_driver = URDriver(server_address, server_port, tool_angle_axis, ur_ip, "UR")
print ur_driver

if send:
    ur_driver.send()
# ---------- end ur ----------

# ---- group: Robot
# 1. load robot model
# 2. set tool
# 3. set basis
list = ValueList({"no_tool", "measurement_tool"}, selected="measurement_tool")
tools = Tools(tool_name=list)
base = PythonScript()  # -> base_frame
# ---------- base: Python ----------
from compas_fabrication.fabrication.geometry import Frame

origin = [300,300,0]
xaxis  = [0, 1, 0]
yaxis  = [1, 0, 0]

base_frame = Frame(list(origin), list(xaxis), list(yaxis))
# ---------- end base ----------
list_2 = ValueList({"UR5", "UR10"}, selected="UR5")
robot = PythonScript(model=list_2, tool=tools)  # -> robot
# ---------- robot: Python ----------
from compas_fabrication.fabrication.robots.ur.ur10 import UR10
from compas_fabrication.fabrication.robots.ur.ur5 import UR5
from scriptcontext import sticky as st

if model == "UR5":
    robot = UR5()
elif model == "UR10":
    robot = UR10()

if tool:
    robot.set_tool(tool)
if base_frame:
    robot.set_base(base_frame)

st["robot"] = robot
# ---------- end robot ----------

# ----
connect = Button()
disconnect = Button()
# 3
panel_7 = Panel("Get Grasshopper connected")
client = PythonScript(connect=connect, disconnect=disconnect)  # -> connected, client
# ---------- client: Python ----------
import time
from scriptcontext import sticky as st
from Rhino.RhinoApp import WriteLine
from ur_online_control.grasshopper import GHClient, gh_component_timer
import time

server_address = st["server_address"]
server_port = st["server_port"]

guid = str(ghenv.Component.InstanceGuid)

client_key = "client_" + guid
run_key = "run_" + guid

if connect:
    if client_key not in st:
        st[client_key] = GHClient(server_address, server_port)
        client = st[client_key]
        client.connect_to_server()
        client.start()
        
    else:
        if st[client_key].running:
            WriteLine("Client is already connected.")
            # close client and restart
            client.close()
            st[client_key] = GHClient(server_address, server_port)
            client = st[client_key]
            client.connect_to_server()
            client.start()
            
        else:
            st[client_key] = GHClient(server_address, server_port)
            client = st[client_key]
            client.connect_to_server()
            client.start()
"""
else:
    if client_key in st:
        # we need a timer to ask if we have something on the rcv queue
        client = st[client_key]
        #if client.running:
        #    #client.run_inner_while()
        #    gh_component_timer(ghenv, True, 1000)
"""

if disconnect:
    if client_key in st:
        client = st[client_key]
        if client.running:
            client.close()

if client_key in st:
    connected =  st[client_key].running
    client = st[client_key]
    print st[client_key].rcv_queue.qsize()
    print st[client_key].snd_queue.qsize()
else:
    connected = False
# ---------- end client ----------
panel_8 = Panel(client.connected)

# ----
# This component updates on receive
bang_2 = Button()
# TODO
receive = PythonScript(client=client.client, bang=bang_2)  # -> qsize, client
# ---------- receive: Python ----------
from ur_online_control.communication.msg_identifiers import *
from ur_online_control.utilities.lists import flatten_list
from Rhino.RhinoApp import WriteLine


if client:
    if not client.ghenv:
        client.ghenv = ghenv
    qsize = client.rcv_queue.qsize()
# ---------- end receive ----------
# * implement client wrapper completely
# * waypoint executed
# * direct UR control
panel_9 = Panel(receive.qsize)

panel_10 = Panel("Send a message")
send_2 = Button()
commands = Data(python)
# 4
send_3 = PythonScript(client=client.client, send=send_2, commands=commands)  # -> out; inputs commands: list
# ---------- send_3: Python ----------
from ur_online_control.communication.msg_identifiers import *
from ur_online_control.utilities.lists import flatten_list

print len(commands)
commands_flattened = flatten_list(commands)
print len(commands_flattened)
print commands_flattened
print len(commands_flattened)/8

if send and client:
    client.send(MSG_INT, 1)
    client.send(MSG_FLOAT_LIST, commands_flattened)
# ---------- end send_3 ----------

send_4 = PythonScript(client=receive.client)  # -> out
# ---------- send_4: Python ----------
from ur_online_control.communication.msg_identifiers import *
from ur_online_control.utilities.lists import flatten_list

if client:
    qsize = client.rcv_queue.qsize()
    if qsize:
        msg = client.rcv_queue.get()
        print msg
# ---------- end send_4 ----------
panel_11 = Panel(send_4)

# ----
# Direct UR control
get = Button()
get_2 = Button()
pose = PythonScript(get=get_2)  # -> pose_joints
# ---------- pose: Python ----------
from scriptcontext import sticky as st
from ur_online_control.ur_direct import get_current_pose_joints

server_address = st["server_address"]
server_port = 30005
ur_ip = st["ur_ip"]
robot = st["robot"]
tool_angle_axis = robot.tool.tcp_frame.pose_axis_angle_vector
print tool_angle_axis

guid = str(ghenv.Component.InstanceGuid)
pose_joints_key = "pose_joints" + guid


if get:
    st[pose_joints_key] = get_current_pose_joints(server_address, server_port, ur_ip, tool_angle_axis)
    
if pose_joints_key not in st:
    pose_joints = []
else:
    pose_joints = st[pose_joints_key]
# ---------- end pose ----------
pose_2 = PythonScript(get=get)  # -> pose_cartesian
# ---------- pose_2: Python ----------
from scriptcontext import sticky as st
from ur_online_control.ur_direct import get_current_pose_cartesian

server_address = st["server_address"]
server_port = 30005
ur_ip = st["ur_ip"]
robot = st["robot"]
tool_angle_axis = robot.tool.tcp_frame.pose_axis_angle_vector
print tool_angle_axis

guid = str(ghenv.Component.InstanceGuid)
pose_cartesian_key = "pose_cartesian" + guid


if get:
    st[pose_cartesian_key] = get_current_pose_cartesian(server_address, server_port, ur_ip, tool_angle_axis)

if pose_cartesian_key not in st:
    pose_cartesian = []
else:
    pose_cartesian = st[pose_cartesian_key]
# ---------- end pose_2 ----------
stop = Button()
stop_2 = PythonScript(stop=stop)
# ---------- stop_2: Python ----------
from scriptcontext import sticky as st
from ur_online_control.ur_direct import stop as stop_robot

ur_ip = st["ur_ip"]

if stop:
    stop_robot(ur_ip)
# ---------- end stop_2 ----------
panel_12 = Panel(pose)
panel_13 = Panel(pose_2)

panel_14 = Panel(send_3)

# ----
# Calculate basis
# Measure basis:
# 1. Clear the recorded poses
# 2. Move robot to origin and press "get pose"
# 3. Move robot to point in positive x-axis and press "get pose"
# 4. Move robot to an other point in your basis and press "get pose"
# (The farer away these positions are, the better)
# 
# 5. Alternatively change the order in the component calc base
# 6. Copy output into base component
list_3 = ValueList({"origin, pt on positive x-axis, pt in xy plane": 0, "origin, pt on positive y-axis, pt in xy plane": 1}, selected="origin, pt on positive x-axis, pt in xy plane")
clear = Button()
rec = PythonScript(msg=pose_2, rec=get, clear=clear)  # -> rec; inputs msg: list
# ---------- rec: Python ----------
from scriptcontext import sticky as st

guid = str(ghenv.Component.InstanceGuid)
recorded_key =  "recorded_" + guid
just_cleared_key = "just_cleared_" + guid

if recorded_key not in st:
    st[recorded_key] = []

if just_cleared_key not in st:
    st[just_cleared_key] = False

if clear:
    st[recorded_key] = []
    st[just_cleared_key] = True
else:
    if len(msg):
        if msg != [None] and not st[just_cleared_key] and rec:
            st[recorded_key].append(msg)
    st[just_cleared_key] = False
        


rec = st[recorded_key]

print rec
# ---------- end rec ----------
calc_base = PythonScript(poses=rec, input_type=list_3)  # -> out; inputs poses: list
# ---------- calc_base: Python ----------
import Rhino.Geometry as rg
import math


if len(poses) > 2:
    
    O = poses[0]
    P1 = poses[1]
    P2 = poses[2]
    
    if input_type == 0:
        # origin, pt on positive x-axis, pt in xy plane
        origin = rg.Point3d(O[0], O[1], O[2])
        pt_on_xaxis = rg.Point3d(P1[0], P1[1], P1[2])
        pt_in_xyplane = rg.Point3d(P2[0], P2[1], P2[2])
        
        xaxis = pt_on_xaxis - origin
        xaxis.Unitize()
        
        v = pt_in_xyplane - origin
        zaxis = rg.Vector3d.CrossProduct(v, xaxis)
        zaxis.Unitize()
        
        # zaxis must look up!
        if math.acos(rg.Vector3d.ZAxis * zaxis) > math.acos(rg.Vector3d.ZAxis * -zaxis):
            zaxis = -zaxis
        
        yaxis = rg.Vector3d.CrossProduct(zaxis, xaxis)
    
    elif input_type == 1:
        # origin, pt on positive y-axis, pt in xy plane
        origin = rg.Point3d(O[0], O[1], O[2])
        pt_on_yaxis = rg.Point3d(P1[0], P1[1], P1[2])
        pt_in_xyplane = rg.Point3d(P2[0], P2[1], P2[2])
        
        yaxis = pt_on_yaxis - origin
        yaxis.Unitize()
        
        v = pt_in_xyplane - origin
        zaxis = rg.Vector3d.CrossProduct(v, yaxis)
        zaxis.Unitize()
        
        # zaxis must look up!
        if math.acos(rg.Vector3d.ZAxis * zaxis) > math.acos(rg.Vector3d.ZAxis * -zaxis):
            zaxis = -zaxis
        
        xaxis = rg.Vector3d.CrossProduct(yaxis, zaxis)
        
        
    print "Copy the following into base component:"
    print "origin = [%.2f, %.2f, %.2f]" % tuple(list(origin))
    print "x_axis = [%.5f, %.5f, %.5f]" % tuple(list(xaxis))
    print "y_axis = [%.5f, %.5f, %.5f]" % tuple(list(yaxis))
    

#print rg.Vector3d.CrossProduct(rg.Vector3d.YAxis, rg.Vector3d.ZAxis)
#print rg.Vector3d.CrossProduct(rg.Vector3d.ZAxis, rg.Vector3d.XAxis)
# ---------- end calc_base ----------
panel_15 = Panel(rec)
panel_16 = Panel(calc_base)

# ----
# Visualisation
pose_joints = Data(pose)
planes_wcs = Plane(py_3)
robot_2 = Data(robot)

# ---- group: Calculate joint positions for path
# Add init joint states
joint_states = Data([-0.1728179112, -1.415058186, 1.813991282, -1.971940356, -1.571654205, -3.308720436])
init_configuration = Slider(2, range=0..7)
py_4 = PythonScript(robot=robot_2, planes_WCS=planes_wcs, configuration_idx=init_configuration, init_configuration=joint_states)  # -> configurations; inputs planes_WCS: list, configuration_idx: Int32, init_configuration: list
# ---------- py_4: Python ----------
import Rhino.Geometry as rg
from compas_fabrication.fabrication.geometry import Frame, Transformation
from compas_fabrication.fabrication.grasshopper import xdraw_frame
from compas_fabrication.fabrication.robots.ur.kinematics import calculate_configurations_for_path, format_joint_positions


# TODO this must be optimized! matrix multiplication!
frames_tool0_RCS = []
for plane_WCS in planes_WCS:
    tcp_WCS = Frame(plane_WCS.Origin, plane_WCS.XAxis, plane_WCS.YAxis)
    tcp_RCS = robot.get_frame_in_RCS(tcp_WCS)
    frames_tool0_RCS.append(robot.get_tool0_frame_from_tcp_frame(tcp_RCS))
    

configurations = calculate_configurations_for_path(frames_tool0_RCS, robot.params, init_configuration)

configurations = configurations[min([configuration_idx, len(configurations) - 1])]

def format(numbers, k=4):
    #numbers = format_joint_positions(numbers)
    return "[" + ", ".join([("%." + str(k) + "f") % n for n in numbers]) + "]"

print "Q1 = ", format(configurations[0])
print "Q2 = ", format(configurations[10])
print "Q3 = ", format(configurations[20])

"""
Q1 =  [-0.1727, -1.4144, 1.8145, -1.9709, -1.5708, 2.9757]
Q2 =  [-0.6497, -1.4872, 1.7623, -1.7329, -1.7115, -2.4608]
Q3 =  [-1.2111, -1.9716, 2.4040, -1.9940, -1.6098, -2.9102]
"""
# ---------- end py_4 ----------
start_2 = Button()
stop_3 = Button()
step = Button()
counter = CountThroughList(L=py_4, start=start_2, stop=stop_3, step=step, interval=100)  # -> item; inputs L: list, start: Boolean, stop: Boolean
# ---------- counter: Python ----------
from scriptcontext import sticky as st
from compas_fabrication.fabrication.grasshopper import gh_component_timer


# store data in component
guid = str(ghenv.Component.InstanceGuid)
counter_key = "counter_" + guid
running_key = "running_" + guid

if counter_key not in st:
    st[counter_key] = 0

if running_key not in st:
    st[running_key] = False

if start:
    st[running_key] = True

if stop:
    st[running_key] = False

if step:
    if st[counter_key] < len(L) - 1:
        st[counter_key] += 1
    
if len(L):
    item = L[st[counter_key]]

if st[running_key]:
    if st[counter_key] < len(L) - 1:
        st[counter_key] += 1
        gh_component_timer(ghenv, interval)
    else:
        st[counter_key] = 0
        st[running_key] = False
# ---------- end counter ----------

# ---- group: Define plane in WCS, calculate joint positions
select_configuration = Slider(0, range=0..7)
pt = Point(Point(-360.5993803, 127.1359598, 433.9356602))
xy = XYPlane(Origin=pt)
plane_wcs = Plane(xy)
inverse = PythonScript(robot=robot_2, plane_WCS=plane_wcs, idx=select_configuration)  # -> configuration; inputs plane_WCS: Plane, idx: Int32
# ---------- inverse: Python ----------
import Rhino.Geometry as rg
from compas_fabrication.fabrication.geometry import Frame, Transformation
from compas_fabrication.fabrication.grasshopper import xdraw_frame

tcp_WCS = Frame(plane_WCS.Origin, plane_WCS.XAxis, plane_WCS.YAxis)

# transform frame to robot coordinate system
tcp_RCS = robot.get_frame_in_RCS(tcp_WCS)

# get the frame of tool0
tool0_RCS = robot.get_tool0_frame_from_tcp_frame(tcp_RCS)

# calculate solutions to frame
solutions = robot.inverse_kinematics(tool0_RCS)

if not len(solutions):
    q = [0,0,0,0,0,0]
else:
    idx = min(len(solutions) - 1, idx)
    q = solutions[idx]
    
print q

configuration = q
# ---------- end inverse ----------

# ---- group: Calculate joint positions for path / Shows joint positions along path
flip = BooleanToggle(True)
l2t = PythonScript(L=py_4, flip=flip)  # -> T; inputs L: list, flip: Boolean
# ---------- l2t: Python ----------
from compas_fabrication.fabrication.grasshopper import list_to_tree

if flip:
    L = zip(*L)
T = list_to_tree(L)
# ---------- end l2t ----------
graph = QuickGraph(l2t)

# ---- group: Define joint positions
elbow = Slider(158.393, range=-360..360)
wrist2 = Slider(89, range=-360..360)
base_2 = Slider(-214.102, range=-360..360)
shoulder = Slider(-57.05, range=-360..360)
wrist1 = Slider(-108.821, range=-360..360)
wrist3 = Slider(-33.607, range=-360..360)
ur1_q1_q6 = Data([base_2, wrist3, shoulder, wrist2, elbow, wrist1])
rad = Radians(Degrees=ur1_q1_q6)

# ---- group: Send joint position directly to robot
idx = Slider(0, range=0..100)
commands_2 = Data(python)
list_4 = ValueList({"send all cmds": 0, "send only one cmd": 1}, selected="send only one cmd")
item = ListItem(List=commands_2, Index=idx, Wrap=True)
filter = StreamFilter(Gate=list_4, Stream0=commands_2, Stream1=item)
movel = PythonScript(commands=filter, velocity=Slider(50, range=0..100))  # -> script; inputs commands: list
# ---------- movel: Python ----------
script_lines = []

for cmd in commands:
    #q, a=1.4, v=1.05, t=0, r=0)
    x, y, z, ax, ay, az, speed, radius = cmd
    script_lines.append("movel(p%s, v=%f, r=%f)" % (str([x/1000., y/1000., z/1000, ax, ay, az]), speed/1000., radius/1000.))



script = "def prog():\n"
script += "\ttextmsg(\">> program start\")\n"
script += "".join(["\t%s\n" % line for line in script_lines])
script += "\ttextmsg(\"<< program end\")\n"
script += "end\n"
script += "prog()\n\n"


print script

#script = ""
# ---------- end movel ----------
send_5 = Button()
list_5 = ValueList({"30001", "30002", "30003"}, selected="30002")
send_6 = PythonScript(script=movel, robot_ip="192.168.10.10", robot_port=list_5, send=send_5)  # -> out
# ---------- send_6: Python ----------
import socket

if send:
    s = socket.create_connection((robot_ip, robot_port), timeout=0.5) 
    s.send(script)
    s.close()
# ---------- end send_6 ----------
panel_17 = Panel(send_6)

idx_2 = Slider(0, range=0..100)
joint_positions = Data(py_4)
item_2 = ListItem(List=joint_positions, Index=idx_2, Wrap=True)
list_6 = ValueList({"send all positions": 0, "send only one position": 1}, selected="send all positions")
filter_2 = StreamFilter(Gate=list_6, Stream0=joint_positions, Stream1=item_2)
movel_2 = PythonScript(joint_positions=filter_2, velocity=Slider(50, range=0..100))  # -> script; inputs joint_positions: list
# ---------- movel_2: Python ----------
script_lines = []

for position in joint_positions:
    script_lines.append("movel(%s, v=%f)" % (str(position), velocity/1000.))


script = "def prog():\n"
script += "\ttextmsg(\">> program start\")\n"
script += "".join(["\t%s\n" % line for line in script_lines])
script += "\ttextmsg(\"<< program end\")\n"
script += "end\n"
script += "prog()\n\n"


print script

#script = ""
# ---------- end movel_2 ----------
send_7 = Button()
list_7 = ValueList({"30001", "30002", "30003"}, selected="30002")
send_8 = PythonScript(script=movel_2, robot_ip="192.168.10.10", robot_port=list_7, send=send_7)  # -> out; same code as send_6
panel_18 = Panel(send_8)

# ---- group: Visualise / robot model brep
show_brep = BooleanToggle(False)
py_5 = PythonScript(model=list_2)  # -> n
# ---------- py_5: Python ----------
if model == "UR5":
    n = 0
if model == "UR10":
    n = 1

print n
# ---------- end py_5 ----------
ur5_brep = UR5Brep([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])
ur10_brep = UR10Brep([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])
filter_3 = StreamFilter(Gate=py_5, Stream0=ur5_brep, Stream1=ur10_brep)

# ---- group: Visualise
list_8 = ValueList({"0 forward, from angles": 0, "1 inverse, from one plane": 1, "2 inverse, from multiple planes": 2, "3 forward, from robot": 3}, selected="2 inverse, from multiple planes")
filter_4 = StreamFilter(Gate=list_8, Stream0=rad, Stream1=inverse, Stream2=counter, Stream3=pose_joints)
configuration = Panel(filter_4)
mesh = Mesh(filter_3)
draw = PythonScript(robot=robot_2, configuration=filter_4, mesh=mesh, brep=filter_3, show_brep=show_brep)  # -> meshes, tool0_plane, tcp_plane, robot_brep; inputs configuration: list, mesh: list, brep: list
# ---------- draw: Python ----------
from compas_fabrication.fabrication.grasshopper import xdraw_frame
from compas_fabrication.fabrication.grasshopper import draw_mesh 
from compas_fabrication.fabrication.grasshopper import xform_from_transformation
from compas_fabrication.fabrication.geometry import Frame, Transformation
from compas_fabrication.fabrication.geometry.helpers import mesh_update_vertices

import Rhino.Geometry as rg
import Rhino

q = configuration

R0, R1, R2, R3, R4, R5 = robot.get_forward_transformations(q)
tool0_frame, tcp_frame = robot.get_transformed_tool_frames(R5)

m0, m1, m2, m3, m4, m5 = mesh
for i in range(6):
    exec("R%drg = xform_from_transformation(R%d)" % (i, i))
    exec("m%d.Transform(R%drg)" % (i, i))
meshes = [m0, m1, m2, m3, m4, m5]

mt = robot.get_transformed_tool_model(tcp_frame)
meshes.append(draw_mesh(mt))

"""
m0, m1, m2, m3, m4, m5, tool0_frame, tcp_frame = robot.get_transformed_model(q)
mt = robot.get_transformed_tool_model(tcp_frame)

meshes = []
meshes.append(draw_mesh(m0))
meshes.append(draw_mesh(m1))
meshes.append(draw_mesh(m2))
meshes.append(draw_mesh(m3))
meshes.append(draw_mesh(m4))
meshes.append(draw_mesh(m5))
if mt:
    meshes.append(draw_mesh(mt))

"""

tool0_plane = xdraw_frame(tool0_frame)
tcp_plane = xdraw_frame(tcp_frame)

if show_brep:
    
    b0, b1, b2, b3, b4, b5 = brep
    
    b0.Transform(R0rg)
    b1.Transform(R1rg)
    b2.Transform(R2rg)
    b3.Transform(R3rg)
    b4.Transform(R4rg)
    b5.Transform(R5rg)
    
    robot_brep = [b0, b1, b2, b3, b4, b5]
# ---------- end draw ----------
robot_brep = Brep(draw.robot_brep)
tcp_plane = Plane(draw.tcp_plane)
tool0_plane = Plane(draw.tool0_plane)
draw_2 = RepresentPlaneAsLines(plane=tcp_plane, size=100)  # -> G, C
# ---------- draw_2: Python ----------
import Rhino.Geometry as rg
from System.Drawing import Color

if plane:

    G = []
    G.append(rg.Line(plane.Origin, size * plane.XAxis))
    G.append(rg.Line(plane.Origin, size * plane.YAxis))
    G.append(rg.Line(plane.Origin, size * plane.ZAxis))
    
    C = []
    C.append(Color.FromArgb(255, 0, 0))
    C.append(Color.FromArgb(0, 255, 0))
    C.append(Color.FromArgb(0, 0, 255))
# ---------- end draw_2 ----------
preview = CustomPreview(Geometry=draw.meshes, Shader=ColourSwatch(SwatchColor=RGBA(99, 94, 94, 96)))
preview_2 = CustomPreview(Geometry=draw_2.G, Shader=draw_2.C)

# ----
# Trash
init = Button()

disconnect_2 = Button()
panel_19 = Panel("initiate connection")
connect_2 = Button()

# ----
# Communication
comm = PythonScript(init=init)  # -> comm
# ---------- comm: Python ----------
from scriptcontext import sticky as st
from mas_lib.robots.communication.ur_communication import URCommunication

ur_ip = st["ur_ip"]
server_ip = st["server_ip"]
server_port = st["server_port"]

if "ur_model" in st:
    ur5 = st["ur_model"]
    if ur5.communication:
        ur5.communication.disconnect()
        comm = URCommunication(ur5, ur_ip, server_ip, server_port, ghenv)
    else:
        comm = URCommunication(ur5, ur_ip, server_ip, server_port, ghenv)
else:
    comm = URCommunication(None, ur_ip, server_ip, server_port, ghenv)
# ---------- end comm ----------
comm_2 = PythonScript(comm=comm)  # -> ur5
# ---------- comm_2: Python ----------
from scriptcontext import sticky as st
from mas_lib.robots.communication.ur_communication import URCommunication

comm.set_robot(ur5)

ur5.set_communication(comm)

st["ur_model"] = ur5
# ---------- end comm_2 ----------

# ----
# UR TCP/IP communication
ur_communication = PythonScript(ur5=comm_2, connect=connect_2, disconnect=disconnect_2)  # -> comm, ur5
# ---------- ur_communication: Python ----------
from scriptcontext import sticky as st
from mas_lib.communication.states import *
from mas_lib.communication.msg_identifiers import *

comm = ur5.communication

# define some storage keys
guid = str(ghenv.Component.InstanceGuid)
comm.current_pose_cartesian_key =  "current_pose_cartesian_" + guid
comm.current_pose_joints_key = "current_pose_joints_" + guid
comm.current_digital_in_key = "current_digital_in_" + guid

if comm.current_pose_cartesian_key not in st:
    st[comm.current_pose_cartesian_key] = None
    st[comm.current_pose_joints_key] = None
    st[comm.current_digital_in_key] = None

    
if not comm.is_connected() and connect:
    comm.connect()

if disconnect:
    comm.disconnect()

connected = comm.is_connected()
# ---------- end ur_communication ----------

# ----
# Calculate shape
calculate = Button()
stop_timer = BooleanToggle(False)
simulation = PythonScript(calculate=calculate, stop_timer=stop_timer)  # -> out, all_xyz, all_force_vectors, all_speeds, tangentsA, tangentsB; inputs msgs: list, num: Int32
# ---------- simulation: Python ----------
from scriptcontext import sticky as st
from Rhino.RhinoApp import WriteLine
import Grasshopper as gh
from server.gh_client import Client
import Rhino.Geometry as rg
import time

def ghComponentTimer(run, interval):
    if interval <= 0: interval = 1
    ghComp = ghenv.Component
    ghDoc = ghComp.OnPingDocument()
    def callBack(ghDoc):
        ghComp.ExpireSolution(False)
    if run:
        ghDoc.ScheduleSolution(interval, gh.Kernel.GH_Document.GH_ScheduleDelegate(callBack))
        
def graft_to_point_list(flattened_points):
    points = []
    for i in range(0, len(flattened_points), 3):
        x, y, z = flattened_points[i:i+3]
        points.append(rg.Point3d(x,y,z))
    return points

def graft_to_vector_list(flattened_vectors):
    vectors = []
    for i in range(0, len(flattened_vectors), 3):
        x, y, z = flattened_vectors[i:i+3]
        vectors.append(rg.Vector3d(x,y,z))
    return vectors

guid = str(ghenv.Component.InstanceGuid)
address = st["simulation_server"]
port = st["simulation_server_port"]

simulation_client_key = "simulation_client_" + guid
timer_key = "timer_" + guid
calculated_key = "calculated_" + guid
num_current_packets_key = "num_current_packets_" + guid

all_xyz_key = "all_xyz_" + guid
all_force_vectors_key =  "all_force_vectors_" + guid
all_speeds_key = "all_speeds_" + guid
calculation_duration_key = "calculation_duration_" + guid
tangentsA_key = "tangentsA_" + guid
tangentsB_key = "tangentsB_" + guid

num_total_packets = num * 5

if calculate:
    st[simulation_client_key] = Client("GH", address, port)
    st[simulation_client_key].connect_to_server()
    if st[simulation_client_key].running:
        for msg_id, msg in msgs:
            st[simulation_client_key].send(int(msg_id), msg)
    st[calculated_key] = False
    st[num_current_packets_key] = 0
    st[all_xyz_key] = []
    st[all_force_vectors_key] = []
    st[all_speeds_key] = []
    st[calculation_duration_key] = time.time()
    st[tangentsA_key] = []
    st[tangentsB_key] = []
else:
    if simulation_client_key not in st or calculated_key not in st:
        pass
    else:
        # we need a timer to ask if we have something on the rcv queue
        client = st[simulation_client_key]
        if client.running:
            if st[num_current_packets_key] == 0 and client.rcvQ.qsize() >= num:
                for i in range(num):
                    array2d_flat = client.rcvQ.get(block = False)
                    array_rg = graft_to_point_list(array2d_flat)
                    st[all_xyz_key].append(array_rg)
                st[num_current_packets_key] += num
            if st[num_current_packets_key] == num and client.rcvQ.qsize() >= num:
                for i in range(num):
                    array2d_flat = client.rcvQ.get(block = False)
                    array_rg = graft_to_vector_list(array2d_flat)
                    st[all_force_vectors_key].append(array_rg)
                st[num_current_packets_key] += num
            if st[num_current_packets_key] == 2 * num and client.rcvQ.qsize() >= num:
                for i in range(num):
                    array = client.rcvQ.get(block = False)
                    st[all_speeds_key].append(array)
                st[num_current_packets_key] += num
            if st[num_current_packets_key] == 3 * num and client.rcvQ.qsize() == 2:
                print "almost done!"
                array = client.rcvQ.get(block = False)
                st[tangentsA_key] = graft_to_vector_list(array)
                array = client.rcvQ.get(block = False)
                st[tangentsB_key] = graft_to_vector_list(array)
               
                WriteLine("Time spent on calculation and sending: %f seconds." % (time.time() - st[calculation_duration_key]))
                WriteLine("Now terminating calculation.")
                client.close()
                st[calculated_key] = True
            if st[num_current_packets_key] != num_total_packets:
                ghComponentTimer(True, 100)
                
            else: # client.rcvQ.qsize() == 0:
                if not st[calculated_key] and stop_timer == False:
                    ghComponentTimer(True, 100)
                    
if simulation_client_key in st:
    print st[simulation_client_key].rcvQ.qsize()

if all_xyz_key in st:
    all_xyz = st[all_xyz_key]
    all_force_vectors = st[all_force_vectors_key]
    all_speeds = st[all_speeds_key]
    tangentsA = st[tangentsA_key]
    tangentsB = st[tangentsB_key]
# ---------- end simulation ----------
entwine = Entwine(
    Branch00=simulation.all_xyz,
    Branch01=simulation.all_force_vectors,
    Branch02=simulation.all_speeds,
    Branch03=simulation.tangentsA,
    Branch04=simulation.tangentsB,
    FlattenInputs=True)
panel_20 = Panel(simulation.out)

flatten = PythonScript()  # -> msgs; inputs T: tree
# ---------- flatten: Python ----------
from generic import flatten_list
from scriptcontext import sticky as st

from globals.message_identifiers import *


ur1_poses = T.Branch(0)
ur2_poses = T.Branch(1)
ur1_radii = T.Branch(2)
ur2_radii = T.Branch(3)
ur1_relative_speeds = T.Branch(4)
ur2_relative_speeds = T.Branch(5)
ur1_speeds = T.Branch(6) # the real speeds

print ur1_relative_speeds
print ur2_relative_speeds
print ur1_speeds

print len(ur1_speeds)
print len(ur1_relative_speeds)

ur1_poses_list = []
ur2_poses_list = []

for i, (l, s, r) in enumerate(zip(ur1_poses, ur1_relative_speeds, ur1_radii)):
    ur1_poses_list.append(l + [s, r])
    
for i, (l, s, r) in enumerate(zip(ur2_poses, ur2_relative_speeds, ur2_radii)):
    ur2_poses_list.append(l + [s, r])

ur1_cmds = flatten_list(ur1_poses_list)
ur2_cmds = flatten_list(ur2_poses_list)

fab = [voltage, speed]
print fab

ur1_plane = st["ur1_plane"]
ur2_plane = st["ur2_plane"]

ur1_plane_list = [ur1_plane.Origin.X, ur1_plane.Origin.Y, ur1_plane.Origin.Z, ur1_plane.XAxis.X, ur1_plane.XAxis.Y, ur1_plane.XAxis.Z, ur1_plane.YAxis.X, ur1_plane.YAxis.Y, ur1_plane.YAxis.Z]
ur2_plane_list = [ur2_plane.Origin.X, ur2_plane.Origin.Y, ur2_plane.Origin.Z, ur2_plane.XAxis.X, ur2_plane.XAxis.Y, ur2_plane.XAxis.Z, ur2_plane.YAxis.X, ur2_plane.YAxis.Y, ur2_plane.YAxis.Z]

ur1_speeds = list(ur1_speeds)

msgs = []

msgs.append([MSG_FLOAT_LIST, fab])
msgs.append([MSG_FLOAT_LIST, ur1_cmds])
msgs.append([MSG_FLOAT_LIST, ur2_cmds])
msgs.append([MSG_FLOAT_LIST, ur1_speeds])
msgs.append([MSG_FLOAT_LIST, ur1_plane_list])
msgs.append([MSG_FLOAT_LIST, ur2_plane_list])
# ---------- end flatten ----------
send_9 = PythonScript(msgs=flatten)  # inputs msgs: list
# ---------- send_9: Python ----------
from scriptcontext import sticky as st


if send and st["gh_client"].running:
    for msg_id, msg in msgs:
        print int(msg_id), msg
        st["gh_client"].send(int(msg_id), msg)

connected = st["gh_client"].running
# ---------- end send_9 ----------

# ==== cluster Tools
measurement_tool_geo = Geometry([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])
tool_name = ClusterInput()
py = PythonScript(rhino_geometry=measurement_tool_geo)  # -> measurement_tool; inputs rhino_geometry: list
# ---------- py: Python ----------
from compas_fabrication.fabrication.robots.ur.tools import MeasurementTool

measurement_tool = MeasurementTool()
measurement_tool.rhino_geometry = rhino_geometry
# ---------- end py ----------
tools = PythonScript(tool_name=tool_name, measurement_tool=py)  # -> tool
# ---------- tools: Python ----------
if tool_name == "measurement_tool":
    tool = measurement_tool
    print tool.tcp_frame
# ---------- end tools ----------
tool = ClusterOutput(tools)
